# Grasshopper definition E.2_ModelExamples.gh (Grasshopper 1.0.7)

# ----
# Mesh Components
meshpointssweep = CSharpScript(TooltipDescriptionOverride="Divisions longitudinally")  # -> Mesh, Srf, SourceSrf, TargetSrf, Orientation; inputs PointsSource: list of Point3d, PointsTarget: list of Point3d, Divisions: Int32, U: Int32, V: Int32
# ---------- meshpointssweep: C# usings ----------
using System.IO;
using System.Linq;
using System.Data;
using System.Drawing;
using System.Reflection;
using System.Windows.Forms;
using System.Xml;
using System.Xml.Linq;
using System.Runtime.InteropServices;

using Rhino.DocObjects;
using Rhino.Collections;
using GH_IO;
using GH_IO.Serialization;
# ---------- meshpointssweep: C# ----------
    //riktig oppdatert0306
    List<double> length = new List<double>();
    List <Curve> edgecrv = new List<Curve>();
    DataTree<Curve> edgecrvtree = new DataTree<Curve>();
    DataTree <Point3d> vrttree = new DataTree<Point3d>();
    DataTree <Point3d> vrtsectiontree = new DataTree<Point3d>();
    List <NurbsSurface> s = new List<NurbsSurface>();
    DataTree <System.Object> meshtree = new DataTree<System.Object>();


    //Default values if not specified, added 27.04
    if(Divisions == 0){Divisions = 1;};
    if(U == 0){U = 1;};
    if(V == 0){V = 1;};

    //Make edgecurves, get their length and make new corner points
    for ( int i = 0; i < 4; i++)
    {
      edgecrv.Add(new Line(PointsSource[i], PointsTarget[i]).ToNurbsCurve()); //Add for only one item
      length.Add(edgecrv[i].GetLength());
      edgecrvtree.Add(new Line(PointsSource[i], PointsTarget[i]).ToNurbsCurve(), new GH_Path(i));
      vrttree.AddRange(edgecrvtree.Branch(i)[0].DivideEquidistant(length[i] / Divisions), new GH_Path(i));

      int listitem = 0;
      for (int j = 0; j < (Divisions + 1); j++)
      {
        vrtsectiontree.Add(vrttree.Branch(i)[listitem], new GH_Path(j));
        listitem++;
      }
    }
    //make surfaces
    //get beginning and end surface if needed for tie/boundary conditions or etc.
    Brep ss = Brep.CreateFromCornerPoints(PointsSource[0], PointsSource[1], PointsSource[2], PointsSource[3], 0);
    Brep ts = Brep.CreateFromCornerPoints(PointsTarget[0], PointsTarget[1], PointsTarget[2], PointsTarget[3], 0);

    //get cross-sectional surfaces
    for (int j = 0; j < (Divisions + 1); j++)
    {
      s.Add(NurbsSurface.CreateFromCorners(vrtsectiontree.Branch(j)[0], vrtsectiontree.Branch(j)[1], vrtsectiontree.Branch(j)[2], vrtsectiontree.Branch(j)[3], 0));
    } // (branch number) [list number]


    DataTree<Brep> btree = new DataTree<Brep>();
    DataTree <Curve> loftcrv = new DataTree<Curve>(); //loft to get solid
    DataTree <Point3d> nodetree = new DataTree<Point3d>();


    for (int a = 0; a < (Divisions + 1); a++)
    {
      for (int i = 0; i < (V + 1); i++)
      {
        for (int j = 0; j < (U + 1); j++)
        {
          Point3d p = new Point3d(s[a].PointAt(s[a].Domain(0).Length / V * i, s[a].Domain(1).Length / U * j)); // v-value first, then u value, because domain(0) is v
          meshtree.Add(p, new GH_Path(0, 0)); //added 1704
          //meshtree.Add(p, new GH_Path(1, a)); //added1704 to get nodetree2 in same list
          nodetree.Add(p, new GH_Path(a, i));
        }
      }
    }

    for (int a = 0; a < (Divisions + 1); a++)
    {
      for (int i = 0; i < V; i++)
      {
        for (int j = 0; j < U; j++)
        {
          Brep b = Brep.CreateFromCornerPoints(nodetree.Branch(a, i)[j], nodetree.Branch(a, i + 1)[j], nodetree.Branch(a, i + 1)[j + 1], nodetree.Branch(a, i)[j + 1], 0);
          btree.Add(b, new GH_Path(a, i));
          //meshtree.Add(b, new GH_Path(2, a));
          meshtree.Add(b, new GH_Path(1, 0));
          loftcrv.AddRange(btree.Branch(a, i)[j].DuplicateEdgeCurves(), new GH_Path(a));
        }
      }
    }


    DataTree <Brep> srf = new DataTree<Brep>();
    for ( int i = 0; i < loftcrv.Branch(0).Count; i++)
    {
      for (int j = 0; j < Divisions; j++)
      {
        srf.AddRange(Brep.CreateFromLoft(new List<Curve>{loftcrv.Branch(0 + j)[i], loftcrv.Branch(1 + j)[i]}, Point3d.Unset, Point3d.Unset, LoftType.Normal, false), new GH_Path(i));
      }
    } // Surfaces in the middle are doubled


    //orientation

    Point3d p1 = new Point3d((PointsSource[0].X + PointsSource[1].X + PointsSource[2].X + PointsSource[3].X) / 4, (PointsSource[0].Y + PointsSource[1].Y + PointsSource[2].Y + PointsSource[3].Y) / 4, (PointsSource[0].Z + PointsSource[1].Z + PointsSource[2].Z + PointsSource[3].Z) / 4);
    Point3d p2 = new Point3d((PointsTarget[0].X + PointsTarget[1].X + PointsTarget[2].X + PointsTarget[3].X) / 4, (PointsTarget[0].Y + PointsTarget[1].Y + PointsTarget[2].Y + PointsTarget[3].Y) / 4, (PointsTarget[0].Z + PointsTarget[1].Z + PointsTarget[2].Z + PointsTarget[3].Z) / 4);

    //orientation

    List <string> orilist = new List<string>();

    Vector3d vec1 = p2 - p1; //longitudinal direction of timber cross-section central points = Direction 1 (x-axis). Created between the average points (center points p1 and p2) of the source and target points.
    vec1.Unitize();
    Plane nplan = new Plane(p1, vec1); //normal plane
    Vector3d vec2 = nplan.XAxis; // Second axis (unitized)

    double cx = p1.X; double cy = p1.Y; double cz = p1.Z; //center point x,y,z

    //coordinates of the first principal axis(x-axis)
    double x1 = vec1.X + cx; double y1 = vec1.Y + cy; double z1 = vec1.Z + cz;

    //coordinates of the second principal axis(z-axis in Rhino, y-axis in Abaqus)
    double x2 = vec2.X + cx; double y2 = vec2.Y + cy; double z2 = vec2.Z + cz;

    //Add orientation (for orthotropic material)
    orilist.Add("Ori-1");
    orilist.Add("*Orientation, name=Ori-1");
    orilist.Add(string.Format("{0}, {1}, {2}, {3}, {4}, {5}, {6}, {7}, {8}", x1, z1, y1, x2, z2, y2, cx, cz, cy)); //changed y z due to abaqus/rhino different axis systems
    orilist.Add("1, 0"); // 1,0. 1 means primary axis (x), 0 means no rotation


    //add divisions, u and v to be used further to end of mesh tree
    GH_Path pth = new GH_Path(2, 0);
    meshtree.Add(Divisions, pth); //number of divisions
    //meshtree.Add((U + 1) * (V + 1), pth); // number of nodes per branch
    meshtree.Add(U * V, pth); //number of surfaces per branch


    Srf = srf;
    Mesh = meshtree;
    SourceSrf = ss;
    TargetSrf = ts;
    Orientation = orilist;
# ---------- end meshpointssweep ----------
meshpointsnurbssweep = CSharpScript(TooltipDescriptionOverride="Divisions longitudinally")  # -> Mesh, Srf, SourceSrf, TargetSrf, Orientation; inputs Points: list of Point3d, Degree: Int32, Divisions: Int32, U: Int32, V: Int32
# ---------- meshpointsnurbssweep: C# ----------
    //riktig oppdatert 03.06
    List<double> length = new List<double>();
    List <NurbsCurve> edgecrv = new List<NurbsCurve>();
    DataTree<NurbsCurve> edgecrvtree = new DataTree<NurbsCurve>();
    DataTree <Point3d> vrttree = new DataTree<Point3d>();
    DataTree <Point3d> vrtsectiontree = new DataTree<Point3d>();
    List <NurbsSurface> s = new List<NurbsSurface>();
    DataTree <System.Object> meshtree = new DataTree<System.Object>();


    //Default values if not specified, added 27.04
    if(Divisions == 0){Divisions = 1;};
    if(U == 0){U = 1;};
    if(V == 0){V = 1;};
    if(Degree == 0){Degree = 1;}

    // NurbsCurve crv = NurbsCurve.Create(false, Degree, PointsSource[1] PointsMid[1] PointsTarget[1]);
    DataTree<Point3d> clst = new DataTree<Point3d>(); //make ordered list to make curve
    //List <NurbsCurve> nrbs = new List<NurbsCurve>();
    Point3d ps;
    for (int i = 0;i < 4;i++)
    {
      GH_Path pthnr = new GH_Path(i);
      for (int j = i;j < Points.Count();j += 4) //if more midpoints
      {
        ps = Points[j];
        clst.Add(ps, pthnr);
      }
      edgecrv.Add(NurbsCurve.Create(false, Degree, clst.Branch(i)));
      length.Add(edgecrv[i].GetLength());
      //edgecrvtree.Add(NurbsCurve.Create(false, Degree, clst.Branch(i)), new GH_Path(i));
      vrttree.AddRange(edgecrv[i].DivideEquidistant(length[i] / Divisions), new GH_Path(i));
      vrttree.Add(Points[Points.Count() - 4 + i], new GH_Path(i));
      int listitem = 0;

      for (int j = 0; j < (Divisions + 1); j++)
      {
        vrtsectiontree.Add(vrttree.Branch(i)[listitem], new GH_Path(j));
        listitem++;
      }

    }
    //make surfaces
    //get beginning and end surface if needed for tie/boundary conditions or etc.
    int pnum = Points.Count();
    Brep ss = Brep.CreateFromCornerPoints(Points[0], Points[1], Points[2], Points[3], 0);
    Brep ts = Brep.CreateFromCornerPoints(Points[pnum - 4], Points[pnum - 3], Points[pnum - 2], Points[pnum - 1], 0);

    //get cross-sectional surfaces
    for (int j = 0; j < (Divisions + 1); j++)
    {
      s.Add(NurbsSurface.CreateFromCorners(vrtsectiontree.Branch(j)[0], vrtsectiontree.Branch(j)[1], vrtsectiontree.Branch(j)[2], vrtsectiontree.Branch(j)[3], 0));
    } // (branch number) [list number]


    DataTree<Brep> btree = new DataTree<Brep>();
    DataTree <Curve> loftcrv = new DataTree<Curve>(); //loft to get solid
    DataTree <Point3d> nodetree = new DataTree<Point3d>();


    for (int a = 0; a < (Divisions + 1); a++)
    {
      for (int i = 0; i < (V + 1); i++)
      {
        for (int j = 0; j < (U + 1); j++)
        {
          Point3d p = new Point3d(s[a].PointAt(s[a].Domain(0).Length / V * i, s[a].Domain(1).Length / U * j)); // v-value first, then u value, because domain(0) is v
          meshtree.Add(p, new GH_Path(0, 0)); //added 1704
          //meshtree.Add(p, new GH_Path(1, a)); //added1704 to get nodetree2 in same list
          nodetree.Add(p, new GH_Path(a, i));
        }
      }
    }

    for (int a = 0; a < (Divisions + 1); a++)
    {
      for (int i = 0; i < V; i++)
      {
        for (int j = 0; j < U; j++)
        {
          Brep b = Brep.CreateFromCornerPoints(nodetree.Branch(a, i)[j], nodetree.Branch(a, i + 1)[j], nodetree.Branch(a, i + 1)[j + 1], nodetree.Branch(a, i)[j + 1], 0);
          btree.Add(b, new GH_Path(a, i));
          //meshtree.Add(b, new GH_Path(2, a));
          meshtree.Add(b, new GH_Path(1, 0));
          loftcrv.AddRange(btree.Branch(a, i)[j].DuplicateEdgeCurves(), new GH_Path(a));
        }
      }
    }


    DataTree <Brep> srf = new DataTree<Brep>();
    for ( int i = 0; i < loftcrv.Branch(0).Count; i++)
    {
      for (int j = 0; j < Divisions; j++)
      {
        srf.AddRange(Brep.CreateFromLoft(new List<Curve>{loftcrv.Branch(0 + j)[i], loftcrv.Branch(1 + j)[i]}, Point3d.Unset, Point3d.Unset, LoftType.Normal, false), new GH_Path(i));
      }
    } // Surfaces in the middle are doubled


    //orientation


    Point3d p1 = new Point3d((Points[0].X + Points[1].X + Points[2].X + Points[3].X) / 4, (Points[0].Y + Points[1].Y + Points[2].Y + Points[3].Y) / 4, (Points[0].Z + Points[1].Z + Points[2].Z + Points[3].Z) / 4);
    Point3d p2 = new Point3d((Points[pnum - 4].X + Points[pnum - 3].X + Points[pnum - 2].X + Points[pnum - 1].X) / 4, (Points[pnum - 4].Y + Points[pnum - 3].Y + Points[pnum - 2].Y + Points[pnum - 3].Y) / 4, (Points[pnum - 4].Z + Points[pnum - 3].Z + Points[pnum - 2].Z + Points[pnum - 1].Z) / 4);

    List <string> orilist = new List<string>();

    Vector3d vec1 = p2 - p1; //longitudinal direction of timber cross-section central points = Direction 1 (x-axis). Created between the average points (center points p1 and p2) of the source and target points.
    vec1.Unitize();
    Plane nplan = new Plane(p1, vec1); //normal plane
    Vector3d vec2 = nplan.XAxis; // Second axis (unitized)

    double cx = p1.X; double cy = p1.Y; double cz = p1.Z; //center point x,y,z

    //coordinates of the first principal axis(x-axis)
    double x1 = vec1.X + cx; double y1 = vec1.Y + cy; double z1 = vec1.Z + cz;

    //coordinates of the second principal axis(z-axis in Rhino, y-axis in Abaqus)
    double x2 = vec2.X + cx; double y2 = vec2.Y + cy; double z2 = vec2.Z + cz;

    //Add orientation (for orthotropic material)
    orilist.Add("Ori-1");
    orilist.Add("*Orientation, name=Ori-1");
    orilist.Add(string.Format("{0}, {1}, {2}, {3}, {4}, {5}, {6}, {7}, {8}", x1, z1, y1, x2, z2, y2, cx, cz, cy)); //changed y z due to abaqus/rhino different axis systems
    orilist.Add("1, 0"); // 1,0. 1 means primary axis (x), 0 means no rotation

    //add divisions, u and v to be used further to end of mesh tree
    GH_Path pth = new GH_Path(2, 0);
    meshtree.Add(Divisions, pth); //number of divisions
    //meshtree.Add((U + 1) * (V + 1), pth); // number of nodes per division
    meshtree.Add(U * V, pth); //number of surfaces per division


    //    Srf = srf;
    Mesh = meshtree;
    Srf = srf;
    SourceSrf = ss;
    TargetSrf = ts;
    Orientation = orilist;
# ---------- end meshpointsnurbssweep ----------

# ----
# Load
load_type = ValueList({"Uniform Pressure": "Pressure,P", "Surface Traction Shear": "Surface traction,TRSHR", "Surface Traction General": "Surface traction,TRVEC"}, selected="Uniform Pressure")
load_type_2 = ValueList({"Uniform Pressure": "Pressure,P", "Surface Traction Shear": "Surface traction,TRSHR", "Surface Traction General": "Surface traction,TRVEC"}, selected="Uniform Pressure")
load_type_3 = ValueList({"Uniform Pressure": "Pressure,P", "Surface Traction Shear": "Surface traction,TRSHR", "Surface Traction General": "Surface traction,TRVEC"}, selected="Surface Traction Shear")
load_type_4 = ValueList({"Uniform Pressure": "Pressure,P", "Surface Traction Shear": "Surface traction,TRSHR", "Surface Traction General": "Surface traction,TRVEC"}, selected="Surface Traction General")
panel = Panel([load_type_2, load_type_3, load_type_4])
load = CSharpScript(LoadType=load_type)  # -> Load; inputs ID: String, LoadType: String, Tol: Double, Face: Brep, DirVector: Vector3d, kNMagnitude: Double, MPaMagnitude: Double
# ---------- load: C# ----------
    //Create output tree
    DataTree <System.Object> tree = new DataTree<System.Object>();
    ///////////////////////////////////////////////////////////////////////////////////////
    ///////////////////////////////////////////////////////////////////////////////////////
    if (string.IsNullOrEmpty(ID)) //if ID is not assigned
    {
      ID = "Load1"; //Make default ID
    }
    //Add surface and ID to be used in Part component
    tree.Add(Face, new GH_Path(0));
    tree.Add(ID, new GH_Path(2));
    ///////////////////////////////////////////////////////////////////////////////////////
    //Makes string LoadType into list of two values with LoadType and abbreviation (P,TRSHR,TRVEC)
    string[] loadtypelist;
    loadtypelist = LoadType.Split(new char[] {','}, StringSplitOptions.None);
    ///////////////////////////////////////////////////////////////////////////////////////
    //Get info from the Direction vector, assign Default value
    if (DirVector.IsZero) //it the vector is the default value {0,0,0}
    {
      DirVector = new Vector3d(0, 0, -1); //default value downwards in z-direction, otherwise DirVec=DirVec
    }
    DirVector.Unitize(); //make the direction vector have unit length
    //Calculate the magnitude Stress [MPa] that works over the Face Area, so that the magnitude adds itself up to assigned kNMagnitude
    double Magnitude;
    if (kNMagnitude == 0)//if kNMagnitude is empty (==0)
    {
      Magnitude = MPaMagnitude; //then Magnitude is given in MPa
    }
    else
    {
      Magnitude = kNMagnitude * 1000 / Face.GetArea(); //Convert kN to a stress working over the face area
    }

    //Add conditions to be exported in INP
    tree.Add("**", new GH_Path(1));
    tree.Add(string.Format("** STEP: {0}", ID), new GH_Path(1));
    tree.Add("**", new GH_Path(1));
    tree.Add(string.Format("*Step, name={0}, nlgeom=NO", ID), new GH_Path(1));
    tree.Add("Uniform Load", new GH_Path(1));
    tree.Add("*Static", new GH_Path(1));
    tree.Add("0.1, 1., 1e-05, 1.", new GH_Path(1));
    tree.Add("**", new GH_Path(1));
    tree.Add("** LOADS", new GH_Path(1));
    tree.Add("**", new GH_Path(1));
    tree.Add(string.Format("** Name: {0}-Load   Type: {1}", ID, loadtypelist[0]), new GH_Path(1));
    tree.Add("*Dsload", new GH_Path(1));
    tree.Add(string.Format("{0},{1}, {2}, {3}, {4},{5}", ID, loadtypelist[1], Magnitude, DirVector.X, DirVector.Z, DirVector.Y), new GH_Path(1));
    tree.Add("**", new GH_Path(1));
    tree.Add("** OUTPUT REQUESTS", new GH_Path(1));
    tree.Add("**", new GH_Path(1));
    tree.Add("*Restart, write, frequency=0", new GH_Path(1));
    tree.Add("**", new GH_Path(1));
    tree.Add("** FIELD OUTPUT: F-Output-1", new GH_Path(1));
    tree.Add("**", new GH_Path(1));
    tree.Add("*Output, field, variable=PRESELECT", new GH_Path(1));
    tree.Add("**", new GH_Path(1));
    tree.Add("** HISTORY OUTPUT: H-Output-1", new GH_Path(1));
    tree.Add("**", new GH_Path(1));
    tree.Add("*Output, history, variable=PRESELECT", new GH_Path(1));
    tree.Add("*End Step", new GH_Path(1));
    ///////////////////////////////////////////////////////////////////////////////////////
    ///////////////////////////////////////////////////////////////////////////////////////
    //Add tolerance for pointcompare
    if(Tol == 0)
    {
      tree.Add(0.001, new GH_Path(3));
    }
    else
    {
      tree.Add(Tol, new GH_Path(3));
    }
    ///////////////////////////////////////////////////////////////////////////////////////
    ///////////////////////////////////////////////////////////////////////////////////////
    Load = tree;
# ---------- end load ----------

# ----
# Materials
isotropicmaterial = CSharpScript(
    TooltipDescriptionOverride="Default material: Steel, E=210000, PR=0.3",
    TooltipTextOverride="Isotropic Material. Steel default")  # -> Properties; inputs Material: String, E: Int32, PR: Double
# ---------- isotropicmaterial: C# ----------
    //Create Lists
    List<string> B = new List<string>();
    ///////////////////////////////////////////////////////////////////////////////////////
    ///////////////////////////////////////////////////////////////////////////////////////
    if (string.IsNullOrEmpty(Material)){Material = "Steel";}
    B.Add(Material);
    B.Add("Elastic");
    if(E == 0){E = 210000;}
    if(PR == 0){PR = 0.3;}
    B.Add(string.Format("{0}, {1}", E, PR));
    B.Add("**");

    Properties = B;
# ---------- end isotropicmaterial ----------
orthotropicmaterial = CSharpScript(TooltipDescriptionOverride="Norwegian Spruce default material. E1=10000, E2 = 800, E3 = 400. Nu12=0.5, Nu13=0.6, Nu23=0.6. G12=600, G13=600, G23=30.")  # -> Properties; inputs Material: String, E1: Int32, E2: Int32, E3: Int32, Nu12: Double, Nu13: Double, Nu23: Double, G12: Int32, G13: Int32, G23: Int32
# ---------- orthotropicmaterial: C# ----------
    List< System.Object > B = new List<System.Object>();
    ///////////////////////////////////////////////////////////////////////////////////////
    ///////////////////////////////////////////////////////////////////////////////////////
    if (string.IsNullOrEmpty(Material)){Material = "Timber";}
    B.Add(Material);
    B.Add("Elastic, type=ENGINEERING CONSTANTS");
    //Elastic moduli
    if(E1 == 0){E1 = 10000;}
    if(E2 == 0){E2 = 800;}
    if(E3 == 0){E3 = 400;}

    //Poisson's ratios
    if(Nu12 == 0){Nu12 = 0.5;}
    if(Nu13 == 0){Nu13 = 0.6;}
    if(Nu23 == 0){Nu23 = 0.6;}

    //Shear moduli
    if(G12 == 0){G12 = 600;}
    if(G13 == 0){G13 = 600;}
    if(G23 == 0){G23 = 30;}


    B.Add(string.Format("{0}, {1}, {2}, {3}, {4}, {5}, {6}, {7}", E1, E2, E3, Nu12, Nu13, Nu23, G12, G13));
    B.Add(string.Format("{0}", G23)); //Apparently the ABAQUS demands that G23 is on the second line.

    Properties = B;
# ---------- end orthotropicmaterial ----------
panel_2 = Panel(isotropicmaterial)
panel_3 = Panel(orthotropicmaterial)

# ----
# Assembling the model
# Tie
hexahedron = ValueList({"Full integration": "C3D8", "Reduced Integration": "C3D8R", "Incompatible Modes": "C3D8I"}, selected="Full integration")
hexahedron_2 = ValueList({"Full integration": "C3D8", "Reduced Integration": "C3D8R", "Incompatible Modes": "C3D8I"}, selected="Full integration")
hexahedron_3 = ValueList({"Full integration": "C3D8", "Reduced Integration": "C3D8R", "Incompatible Modes": "C3D8I"}, selected="Reduced Integration")
hexahedron_4 = ValueList({"Full integration": "C3D8", "Reduced Integration": "C3D8R", "Incompatible Modes": "C3D8I"}, selected="Incompatible Modes")
tie = CSharpScript()  # -> Part, INP; inputs ID: String, Master: String, Slave: String, Tol: Double, Face: Brep
# ---------- tie: C# ----------
    //Create output tree
    DataTree <System.Object> tree = new DataTree<System.Object>();
    List< string > INPLst = new List<string>();
    if (string.IsNullOrEmpty(ID)) //if ID is not assigned
    {
      ID = "TIE1"; //Make default ID
    }
    //Add surface and ID to be used in Part component
    tree.Add(Face, new GH_Path(0));
    tree.Add(ID, new GH_Path(1));
    //Add tolerance for pointcompare
    if(Tol == 0)
    {
      tree.Add(0.001, new GH_Path(2));
    }
    else
    {
      tree.Add(Tol, new GH_Path(2));
    }
    //Add conditions to be exported in INP
    INPLst.Add(string.Format("** Constraint: {0}", ID));
    INPLst.Add(string.Format("*Tie, name={0}, adjust=yes, type=SURFACE TO SURFACE", ID));
    INPLst.Add(string.Format("{0}-{1}-TieSrf, {0}-{2}-TieSrf", ID, Slave, Master));
    ///////////////////////////////////////////////////////////////////////////////////////
    ///////////////////////////////////////////////////////////////////////////////////////
    Part = tree;
    INP = INPLst;
# ---------- end tie ----------
abaquspart = CSharpScript(ElmntType=hexahedron)  # -> Geometry, Part, Instance, Sets, BC, Steps; inputs ID: String, Mesh: tree, ElmntType: list of String, Material: list, Orientation: list of String, Support: tree, Load: tree, Tie: tree, Run: Boolean
# ---------- abaquspart: C# ----------
    //oppdatert 0306
    //Declare variables;
    Point3d Crd;
    string Nr, X, Y, Z;

    if (string.IsNullOrEmpty(ID)) //if ID is not assigned
    {
      ID = "Part1"; //Make default ID
    }

    //Create output tree;
    DataTree <Curve> Crvs = new DataTree<Curve>();
    DataTree <Point3d> Elements = new DataTree<Point3d>();
    DataTree <System.Object> GeoTree = new DataTree<System.Object>();
    DataTree <string> Inf = new DataTree<string>();
    DataTree <int> Tick = new DataTree<int>();
    DataTree <int> Tock = new DataTree<int>();

    //Create Lists;
    List< Point3d > Vertices = new List<Point3d>();
    List< Point3d > Nds = new List<Point3d>();
    List< Brep > Srf = new List<Brep>();
    List< Brep > ObjList = new List<Brep>();
    List< string > PrtLst = new List<string>();
    List< string > SetLst = new List<string>();
    List< string > InsLst = new List<string>();
    List< string > BCLst = new List<string>();
    List< string > StpLst = new List<string>();
    List< string > ElNr = new List<string>();
    List<Brep> SupLst = new List<Brep>();
    List<double> TolSupLst = new List<double>();
    List<Brep> DisLst = new List<Brep>();
    List<double> TolDisLst = new List<double>();
    List<Brep> LdLst = new List<Brep>();
    List<double> TolLdLst = new List<double>();
    List<Brep> TieLst = new List<Brep>();
    List<double> TolTieLst = new List<double>();

    ////////////////////////////////////////////////////////////////////////////////////
    //Sorts number of meshes into correct lists so that it is possible to assign different values of v,u and div to each mesh and merge meshes into same part
    List<Point3d> nodelist = new List<Point3d>();
    DataTree<Point3d> nodetree = new DataTree<Point3d>();
    DataTree<Brep> breps = new DataTree<Brep>();

    for (int i = 0; i < Mesh.Branch(0, 0).Count(); i++)
    {
      Point3d n = (Point3d) Mesh.Branch(0, 0)[i];
      nodelist.Add(n);
    }

    int div, numbr;
    int startlocb = 0; //startindex of brep
    int count = 0; //count to get correct assignment of div,numnb,numbr;
    for (int j = 0; j < (Mesh.Branch(2, 0).Count() / 2) ; j++) //number of meshes
    {
      div = (int) Mesh.Branch(2, 0)[count]; //divisions j mesh
      numbr = (int) Mesh.Branch(2, 0)[count + 1]; //number of surfaces in each division
      for (int k = 0; k < (div + 1); k++)
      {
        for (int p = startlocb; p < (startlocb + numbr); p++)
        {
          Brep bb = (Brep) Mesh.Branch(1, 0)[p];
          breps.Add(bb, new GH_Path(j, k));
        }
        for (int q = 0; q < numbr; q++)
        {
          Elements.AddRange(breps.Branch(j, k)[q].DuplicateVertices(), new GH_Path(j, k, q));
        }
        startlocb = startlocb + numbr; //make next location
      }
      count = count + 2; //to get next mesh's division and number of surfaces.
    }



    ///////////////////////////////////////////////////////////////////////////////////////
    ///////////////////////////////////////////////////////////////////////////////////////

    if (Run)
    {
      //Discretize the data of the Part;
      PrtLst.Add(string.Format("*Part, name={0}", ID));
      //Nodes of the Part;
      PrtLst.Add("*Node");

      Nds.AddRange(Point3d.CullDuplicates(nodelist, doc.ModelAbsoluteTolerance)); //remove duplicate node points
      for ( int i = 0; i < Nds.Count; i++)
      {
        Nr = (i + 1).ToString();
        Crd = Nds[i];
        X = Crd.X.ToString();
        Y = Crd.Y.ToString();
        Z = Crd.Z.ToString();
        PrtLst.Add(Nr + ", " + X + ", " + Z + ", " + Y);
      }
      //Sort element Nodes and identify faces which is supported or loaded;
      PrtLst.Add(string.Format("*Element, type={0}", ElmntType[0]));

      //If Load, import input for load;
      if ( Load.PathExists(0) )
      {
        double TolLd;
        Brep LdSrf = new Brep();
        for (int i = 0; i < Load.Branch(0).Count(); i++)
        {
          GH_Convert.ToBrep(Load.Branch(0)[i], ref LdSrf, Grasshopper.Kernel.GH_Conversion.Both);
          GH_Convert.ToDouble(Load.Branch(3)[i], out TolLd, GH_Conversion.Both);
          TolLdLst.Add(TolLd);
          LdLst.Add(LdSrf);
        }
      }
      //If Tie, import input for tie;
      if ( Tie.PathExists(0) )
      {
        double TolTie;
        Brep TieSrf = new Brep();
        for (int i = 0; i < Tie.Branch(0).Count(); i++)
        {
          GH_Convert.ToBrep(Tie.Branch(0)[i], ref TieSrf, Grasshopper.Kernel.GH_Conversion.Both);
          GH_Convert.ToDouble(Tie.Branch(2)[i], out TolTie, GH_Conversion.Both);
          TolTieLst.Add(TolTie);
          TieLst.Add(TieSrf);
        }
      }

      //Make list of elements, identify load and tie
      int count2 = 0; //To get the correct assignment of divisions, number of breps for each mesh
      int count3 = 1; //Begin at element 1 in Abaqus

      for (int f = 0; f < (Mesh.Branch(2, 0).Count() / 2) ; f++) //number of meshes
      {
        int div2 = (int) Mesh.Branch(2, 0)[count2]; //divisions of f mesh
        int numbr2 = (int) Mesh.Branch(2, 0)[count2 + 1]; //numbers of breps in each division

        for (int g = 0; g < div2; g++)
        {
          for (int h = 0; h < numbr2; h++)
          {
            ElNr.Add(count3.ToString());
            for ( int k = 0; k < Elements.Branch(f, g, h).Count; k++)
            {
              for ( int l = 0; l < Nds.Count; l++)
              {
                if ( PtCmp(Elements.Branch(f, g, h)[k], Nds[l]))
                {
                  ElNr.Add((l + 1).ToString());
                }
              } //4 first corners
            }
            for ( int k = 0; k < Elements.Branch(f, g, h).Count; k++)
            {
              for ( int l = 0; l < Nds.Count; l++)
              {
                if ( PtCmp(Elements.Branch(f, g + 1, h)[k], Nds[l]))
                {
                  ElNr.Add((l + 1).ToString());
                }
              } //4 second corners

              //identify if srf is loaded
              if ( Load.PathExists(0) )
              {
                for (int m = 0; m < Load.Branch(0).Count; m++)
                {
                  Tick.EnsurePath(m);
                  if ( IdenSet(LdLst[m], Elements.Branch(f, g, h)[k], TolLdLst[m]))
                  {
                    Tick.Add(k + 1, new GH_Path(m));
                    if (Tick.Branch(m).Count == 4)
                    {
                      Inf.Add((count3).ToString() + ",", new GH_Path(1, m, 2));
                      Inf.Add(SrfInd(Tick.Branch(m)).ToString(), new GH_Path(1, m, 3));
                    }
                  }
                  if ( IdenSet(LdLst[m], Elements.Branch(f, g + 1, h)[k], TolLdLst[m]))
                  {
                    Tick.Add(k + 5, new GH_Path(m));
                    if (Tick.Branch(m).Count == 4)
                    {
                      Inf.Add((count3).ToString() + ",", new GH_Path(1, m, 2));
                      Inf.Add(SrfInd(Tick.Branch(m)).ToString(), new GH_Path(1, m, 3));
                    }
                  }
                }
              } //end load Path

              //identify if nodes are tied
              if ( Tie.PathExists(0) )
              {
                for (int m = 0; m < Tie.Branch(0).Count; m++)
                {
                  Tock.EnsurePath(m);
                  if ( IdenSet(TieLst[m], Elements.Branch(f, g, h)[k], TolTieLst[m]))
                  {
                    Tock.Add(k + 1, new GH_Path(m));
                    if (Tock.Branch(m).Count == 4)
                    {
                      Inf.Add((count3).ToString() + ",", new GH_Path(1, m, 4));
                      Inf.Add(SrfInd(Tock.Branch(m)).ToString(), new GH_Path(1, m, 5));
                    }
                  }
                  if ( IdenSet(TieLst[m], Elements.Branch(f, g + 1, h)[k], TolTieLst[m]))
                  {
                    Tock.Add(k + 5, new GH_Path(m));
                    if (Tock.Branch(m).Count == 4)
                    {
                      Inf.Add((count3).ToString() + ",", new GH_Path(1, m, 4));
                      Inf.Add(SrfInd(Tock.Branch(m)).ToString(), new GH_Path(1, m, 5));
                    }
                  }
                }
              } //end tie
            }

            PrtLst.Add(String.Join(",  ", ElNr.ToArray()));
            count3 = count3 + 1;
            ElNr.Clear();
            Tick.ClearData();
            Tock.ClearData();
          }
        }
        count2 = count2 + 2;
      }


      //Identify nodes on supported face;
      if ( Support.PathExists(0) )
      {
        double TolSup;
        Brep SupSrf = new Brep();
        for (int i = 0; i < Support.Branch(0).Count(); i++)
        {
          GH_Convert.ToBrep(Support.Branch(0)[i], ref SupSrf, Grasshopper.Kernel.GH_Conversion.Both);
          GH_Convert.ToDouble(Support.Branch(3)[i], out TolSup, GH_Conversion.Both);
          TolSupLst.Add(TolSup);
          SupLst.Add(SupSrf);
        }
        for (int i = 0; i < Nds.Count; i++)
        {
          for (int j = 0; j < Support.Branch(0).Count; j++)
          {
            if ( IdenSet(SupLst[j], Nds[i], TolSupLst[j]) )
            {
              Inf.Add((i + 1).ToString() + ",", new GH_Path(0, j, 1));
              GeoTree.Add(Nds[i].X.ToString(), new GH_Path(2, j, 0));
              GeoTree.Add(Nds[i].Y.ToString(), new GH_Path(2, j, 1));
              GeoTree.Add(Nds[i].Z.ToString(), new GH_Path(2, j, 2));
            }
          }
        }
      }

      ///////////////////////////////////////////////////////////////////////////////////////
      ///////////////////////////////////////////////////////////////////////////////////////
      //Create sets of nodes;
      PrtLst.Add("*Nset, nset=Set-1, generate");
      PrtLst.Add(string.Format("   1,    {0},    1", Nds.Count));
      //Create sets of elements;
      PrtLst.Add("*Elset, elset=Set-1, generate");
      PrtLst.Add(string.Format("   1,    {0},    1", count3 - 1));

      //Add orientation (for orthotropic material) 30.04

      if ( (Orientation != null) && (!Orientation.Any()) ) //if the list is empty
      {
        PrtLst.Add(string.Format("**Section: {0}_section", ID));
        PrtLst.Add(string.Format("*Solid Section, elset=Set-1, material={0}", Material[0]));
      }
      else
      {
        PrtLst.Add(Orientation[1]);
        PrtLst.Add(Orientation[2]);
        PrtLst.Add(Orientation[3]);
        PrtLst.Add(string.Format("**Section: {0}_section", ID));
        PrtLst.Add(string.Format("*Solid Section, elset=Set-1, orientation=Ori-1, material={0}", Material[0]));
      }

      PrtLst.Add(",");
      //Finish defining Part;
      PrtLst.Add("*End Part");
      PrtLst.Add("**");
      //Create instance of the part;
      InsLst.Add(string.Format("*Instance, name={0}, part={0}", ID));
      InsLst.Add("*End Instance");
      InsLst.Add("**");
      //BC; Add nodes on supported Face;
      if ( Inf.PathExists(0, 0, 1) )
      {
        for (int i = 0; i < Support.Branch(0).Count; i++)
        {
          SetLst.Add(string.Format("*Nset, nset={0}, instance={1}", Support.Branch(2)[i], ID));
          for (int j = 0; j < Inf.Branch(0, i, 1).Count; j++)
          {
            SetLst.Add(Inf.Branch(0, i, 1)[j]);
          }
        }
      }
      //Add elements on tied face;
      if ( Inf.PathExists(1, 0, 4) )
      {
        for (int i = 0; i < Tie.Branch(0).Count; i++)
        {
          SetLst.Add(string.Format("*Elset, elset={0}-{1}-TieSrf, internal, instance={1}", Tie.Branch(1)[i], ID));
          for (int j = 0; j < Inf.Branch(1, i, 4).Count; j++)
          {
            SetLst.Add(Inf.Branch(1, i, 4)[j]);
          }
        }
      }
      //Define tie surface;
      if ( Inf.PathExists(1, 0, 5) )
      {
        for (int i = 0; i < Tie.Branch(0).Count; i++)
        {
          SetLst.Add(string.Format("*Surface, type=ELEMENT, name={0}-{1}-TieSrf", Tie.Branch(1)[i], ID));
          SetLst.Add(string.Format("{0}-{1}-TieSrf, S{2}", Tie.Branch(1)[i], ID, Inf.Branch(1, i, 5)[0]));
        }
      }
      //Add elements on loaded face;
      if ( Inf.PathExists(1, 0, 2) )
      {
        for (int i = 0; i < Load.Branch(0).Count; i++)
        {
          SetLst.Add(string.Format("*Elset, elset={0}-Surf, internal, instance={1}", Load.Branch(2)[i], ID));
          for (int j = 0; j < Inf.Branch(1, i, 2).Count; j++)
          {
            SetLst.Add(Inf.Branch(1, i, 2)[j]);
          }
        }
      }
      //Define load surface;
      if ( Inf.PathExists(1, 0, 2) )
      {
        for (int i = 0; i < Load.Branch(0).Count; i++)
        {
          SetLst.Add(string.Format("*Surface, type=ELEMENT, name={0}", Load.Branch(2)[i]));
          SetLst.Add(string.Format("{0}-Surf, S{1}", Load.Branch(2)[i], Inf.Branch(1, i, 3)[0]));
        }
      }
      //Boundary conditions;
      if ( Support.PathExists(0) )
      {
        for (int i = 0; i < Support.Branch(1).Count; i++)
        {
          BCLst.Add(string.Format("{0}", Support.Branch(1)[i]));
        }
      }
      //Steps;
      if ( Load.PathExists(0) )
      {
        for (int i = 0; i < Load.Branch(1).Count; i++)
        {
          StpLst.Add(string.Format("{0}", Load.Branch(1)[i]));;
        }
      }

    }
    Geometry = GeoTree;
    Part = PrtLst;
    Instance = InsLst;
    Sets = SetLst;
    BC = BCLst;
    Steps = StpLst;
# ---------- abaquspart: C# additional code ----------
  public int SrfInd(List < int > N)
  {
    int Indx;

    if (!N.Except(new List<int>{ 1, 2, 3, 4 }).Any() && N.Count == 4)
    {
      Indx = 1;
    }
    else if(!N.Except(new List<int>{ 5, 6, 7, 8 }).Any() && N.Count == 4)
    {
      Indx = 2;
    }
    else if(!N.Except(new List<int>{ 1, 2, 5, 6 }).Any() && N.Count == 4)
    {
      Indx = 3;
    }
    else if(!N.Except(new List<int>{ 2, 3, 6, 7 }).Any() && N.Count == 4)
    {
      Indx = 4;
    }
    else if(!N.Except(new List<int>{ 3, 4, 7, 8 }).Any() && N.Count == 4)
    {
      Indx = 5;
    }
    else
    {
      Indx = 6;
    }
    return Indx;
  }

  public bool IdenSet(Brep Srf, Point3d Nd, double Tol)
  {
    bool Truth;
    Point3d Pt = Srf.ClosestPoint(Nd);
    Vector3d Vct = Pt - Nd;

    if (Vct.Length < Tol)
    {
      Truth = true;
    }
    else
    {
      Truth = false;
    }
    return Truth;
  }

  public bool PtCmp(Point3d ElNd, Point3d Nd)
  {
    bool Truth;
    Vector3d Vct = ElNd - Nd;

    if (Vct.Length < doc.ModelAbsoluteTolerance)
    {
      Truth = true;
    }
    else
    {
      Truth = false;
    }
    return Truth;
  }
# ---------- end abaquspart ----------
panel_4 = Panel([hexahedron_2, hexahedron_3, hexahedron_4])
inpassembly = CSharpScript()  # -> INP; inputs ID: list of String, Job: list of String, Model: list of String, Part: list of String, Instance: list of String, Sets: list of String, BC: list of String, Material: list of String, Tie: list of String, Steps: list of String
# ---------- inpassembly: C# ----------
    //Create output;
    List < string > INPLst = new List<string>{ "*Heading" };
    //Create variables;
    string job, model;
    //Include the header, job- and model name;Model
    if (ID.Count == 0)
    {
      INPLst.Add("GH_File");
    }
    else
    {
      INPLst.Add(ID[0]);
    }
    if (Job.Count == 0)
    {
      job = "GH_Job";
    }
    else
    {
      job = Job[0];
    }
    if (Model.Count == 0)
    {
      model = "GH_Model";
    }
    else
    {
      model = Model[0];
    }
    INPLst.Add(string.Format("** Job name: {0} Model name: {1}", job, model));
    ///////////////////////////////////////////////////////////////////////////////////////
    ///////////////////////////////////////////////////////////////////////////////////////
    //Setting the data file printing options;
    INPLst.Add("*Preprint, echo=NO, model=NO, history=NO, contact=NO");
    //Parts;
    INPLst.Add("**");
    INPLst.Add("** PARTS");
    INPLst.Add("**");
    INPLst.AddRange(Part);
    //Start assemble the model;
    INPLst.Add("**");
    INPLst.Add("** ASSEMBLY");
    INPLst.Add("**");
    INPLst.Add("*Assembly, name=Assembly");
    INPLst.Add("**");
    //Instances;
    INPLst.AddRange(Instance);
    //Sets;
    INPLst.AddRange(Sets);
    //Tie;
    INPLst.AddRange(Tie);
    //End assembly;
    INPLst.Add("*End Assembly");
    //Defining the material properties;
    INPLst.Add("**");
    INPLst.Add("** MATERIALS");
    INPLst.Add("**");

    /*if ( Material.Count > 3)
    {
      INPLst.Add(string.Format("*Material, name={0}", Material[0]));
      INPLst.Add(string.Format("* {0}", Material[1]));
      INPLst.Add(string.Format("{0}, {1}", Material[2], Material[3]));
    }
 */

    for (int i = 0; i < Material.Count; i += 4) //fixed 2904
    {
      INPLst.Add(string.Format("*Material, name={0}", Material[i]));
      INPLst.Add(string.Format("*{0}", Material[i + 1]));
      INPLst.Add(string.Format("{0}", Material[i + 2]));
      INPLst.Add(string.Format("{0}", Material[i + 3]));
    }


    //Defining the boundary conditions;
    INPLst.Add("**");
    INPLst.Add("** BOUNDARY CONDITIONS");
    INPLst.Add("**");
    INPLst.Add("** Name: BC-1 Type: Displacement/Rotation");
    INPLst.Add("*Boundary");
    INPLst.AddRange(BC);
    //End defining BC;
    INPLst.Add("** ----------------------------------------------------------------");
    //Add the steps;
    INPLst.AddRange(Steps);
    ///////////////////////////////////////////////////////////////////////////////////////
    ///////////////////////////////////////////////////////////////////////////////////////
    INP = INPLst;
# ---------- end inpassembly ----------

# ----
# Boundary Conditions
# Support
bcs = ValueList({"U1": 1, "U2": 2, "U3": 3, "UR1": 4, "UR2": 5, "UR3": 6}, selected=["U1", "U2", "U3", "UR1", "UR2", "UR3"])
support = CSharpScript(Conditions=bcs)  # -> Support; inputs ID: String, Tol: Double, Face: Brep, Conditions: list of String
# ---------- support: C# ----------
    //Create output tree
    DataTree <System.Object> tree = new DataTree<System.Object>();
    ///////////////////////////////////////////////////////////////////////////////////////
    if (string.IsNullOrEmpty(ID)) //if ID is not assigned
    {
      ID = "BC1"; //Make default ID
    }
    ///////////////////////////////////////////////////////////////////////////////////////
    //Add surface and ID to be used in Part component
    tree.Add(Face, new GH_Path(0));
    tree.Add(ID, new GH_Path(2));
    ///////////////////////////////////////////////////////////////////////////////////////
    ///////////////////////////////////////////////////////////////////////////////////////
    //Add conditions to be exported in INP
    for( int i = 0; i < Conditions.Count(); i++)
    {
      if(Conditions[i] == "U1" || Conditions[i] == "1")
      {
        tree.Add(string.Format("{0}, 1, 1", ID), new GH_Path(1));
      }
      if(Conditions[i] == "U2" || Conditions[i] == "2")
      {
        tree.Add(string.Format("{0}, 2, 2", ID), new GH_Path(1));
      }
      if(Conditions[i] == "U3" || Conditions[i] == "3")
      {
        tree.Add(string.Format("{0}, 3, 3", ID), new GH_Path(1));
      }
      if(Conditions[i] == "UR1" || Conditions[i] == "4")
      {
        tree.Add(string.Format("{0}, 4, 4", ID), new GH_Path(1));
      }
      if(Conditions[i] == "UR2" || Conditions[i] == "5")
      {
        tree.Add(string.Format("{0}, 5, 5", ID), new GH_Path(1));
      }
      if(Conditions[i] == "UR3" || Conditions[i] == "6")
      {
        tree.Add(string.Format("{0}, 6, 6", ID), new GH_Path(1));
      }

    }
    ///////////////////////////////////////////////////////////////////////////////////////
    ///////////////////////////////////////////////////////////////////////////////////////
    //Add tolerance for pointcompare
    if(Tol == 0)
    {
      tree.Add(0.001, new GH_Path(3));
    }
    else
    {
      tree.Add(Tol, new GH_Path(3));
    }

    Support = tree;
# ---------- end support ----------

# ----
# Geometrical Components
rectangleyzrev = CSharpScript()  # -> Rcntr, Pts; inputs Cntr: Point3d, W: Double, H: Double
# ---------- rectangleyzrev: C# ----------
    Point3d firstp = new Point3d(Cntr.X, Cntr.Y + W / 2, Cntr.Z - H / 2);
    Point3d secondp = new Point3d(Cntr.X, Cntr.Y + W / 2, Cntr.Z + H / 2);
    Point3d thirdp = new Point3d(Cntr.X, Cntr.Y - W / 2, Cntr.Z + H / 2);
    Point3d fourthp = new Point3d(Cntr.X, Cntr.Y - W / 2, Cntr.Z - H / 2);
    List<Point3d> ptslist = new List<Point3d>();
    ptslist.Add(fourthp); //reverse points to avoid negative volume
    ptslist.Add(thirdp);
    ptslist.Add(secondp);
    ptslist.Add(firstp);
    Pts = ptslist;
    Rcntr = Cntr;
# ---------- end rectangleyzrev ----------
sortptsxz = CSharpScript(TooltipDescriptionOverride="Sort 4 points counter clockwise ", TooltipTextOverride="Sort")  # -> SPts; inputs Pts: list of Point3d
# ---------- sortptsxz: C# ----------
    Point3d[] pointarray = Pts.ToArray();
    double x = 0;
    double y = 0;
    double z = 0;
    for (int i = 0; i < Pts.Count;i++)
    {
      x = x + Pts[i].X;
      y = y + Pts[i].Y;
      z = z + Pts[i].Z;
    }
    double cntx = x / Pts.Count;
    double cnty = y / Pts.Count;
    double cntz = z / Pts.Count;

    Point3d cnt = new Point3d(cntx, cnty, cntz);

    double[] angles = new double[pointarray.Length];

    for (int i = 0; i < pointarray.Length; i++)
    {
      angles[i] = Math.Atan2((pointarray[i].Z - cnt.Z), (pointarray[i].X - cnt.X));
    }
    Array.Sort(angles, pointarray);

    List < Point3d > sorted = new List <Point3d>();
    for (int j = 1; j < Pts.Count; j++)
    {
      sorted.Add(pointarray[j]); //to get correct listing
    }
    sorted.Add(pointarray[0]);


    SPts = sorted;
# ---------- end sortptsxz ----------
# Components
rectanglexzrev = CSharpScript()  # -> Rcntr, Pts; inputs Cntr: Point3d, W: Double, H: Double
# ---------- rectanglexzrev: C# ----------
    Point3d firstp = new Point3d(Cntr.X - W / 2, Cntr.Y, Cntr.Z - H / 2);
    Point3d secondp = new Point3d(Cntr.X - W / 2, Cntr.Y, Cntr.Z + H / 2);
    Point3d thirdp = new Point3d(Cntr.X + W / 2, Cntr.Y, Cntr.Z + H / 2);
    Point3d fourthp = new Point3d(Cntr.X + W / 2, Cntr.Y, Cntr.Z - H / 2);
    List<Point3d> pointlist = new List<Point3d>();
    pointlist.Add(fourthp); //reverse points to avoid negative volume
    pointlist.Add(thirdp);
    pointlist.Add(secondp);
    pointlist.Add(firstp);
    Pts = pointlist;
    Rcntr = Cntr;
# ---------- end rectanglexzrev ----------
getvertices = CSharpScript()  # -> Vrt; inputs Breps: list of Brep, Closed: Boolean
# ---------- getvertices: C# ----------
    List<Point3d> vertices = new List<Point3d>();

    for (int i = 0; i < Breps.Count; i++)
    {
      List<Point3d> vrev = new List<Point3d>();
      vrev.AddRange(Breps[i].DuplicateVertices());
      vrev.Reverse();
      vertices.AddRange(vrev);
    }
    if (Closed)
    {
      List<Point3d> vend = new List<Point3d>();
      vend.AddRange(Breps[0].DuplicateVertices()); //to make closed shape
      vend.Reverse();
      vertices.AddRange(vend);
    }

    Vrt = vertices;
# ---------- end getvertices ----------
sortptsyz = CSharpScript(TooltipDescriptionOverride="Sort 4 points counter clockwise ", TooltipTextOverride="Sort")  # -> SPts; inputs Pts: list of Point3d
# ---------- sortptsyz: C# ----------
    Point3d[] pointarray = Pts.ToArray();
    double x = 0;
    double y = 0;
    double z = 0;
    for (int i = 0; i < Pts.Count;i++)
    {
      x = x + Pts[i].X;
      y = y + Pts[i].Y;
      z = z + Pts[i].Z;
    }
    double cntx = x / Pts.Count;
    double cnty = y / Pts.Count;
    double cntz = z / Pts.Count;

    Point3d cnt = new Point3d(cntx, cnty, cntz);


    double[] angles = new double[pointarray.Length];

    for (int i = 0; i < pointarray.Length; i++)
    {
      angles[i] = Math.Atan2((pointarray[i].Z - cnt.Z), (pointarray[i].Y - cnt.Y));
    }
    Array.Sort(angles, pointarray);

    List < Point3d > sorted = new List <Point3d>();
    for (int j = 1; j < Pts.Count; j++)
    {
      sorted.Add(pointarray[j]); //to get correct listing
    }
    sorted.Add(pointarray[0]);
    sorted.Reverse();



    SPts = sorted;
# ---------- end sortptsyz ----------
ptstosrf = CSharpScript(
    TooltipDescriptionOverride="Points must be sorted correctly",
    TooltipTextOverride="From 4 corner points to surface. Or list of corner points to list of surfaces")  # -> Srf; inputs Pts: list of Point3d
# ---------- ptstosrf: C# ----------
    List<Brep> breps = new List<Brep>();
    for (int i = 0; i < Pts.Count(); i += 4)
    {
      Brep b = Brep.CreateFromCornerPoints(Pts[i], Pts[i + 1], Pts[i + 2], Pts[i + 3], 0);
      breps.Add(b);
    }
    Srf = breps;
# ---------- end ptstosrf ----------
cnt = CSharpScript(TooltipDescriptionOverride="Center point Point list", TooltipTextOverride="Center Point")  # -> Cnt; inputs Pts: list of Point3d
# ---------- cnt: C# ----------
    double x = 0;
    double y = 0;
    double z = 0;
    for (int i = 0; i < Pts.Count;i++)
    {
      x = x + Pts[i].X;
      y = y + Pts[i].Y;
      z = z + Pts[i].Z;
    }
    double cntx = x / Pts.Count;
    double cnty = y / Pts.Count;
    double cntz = z / Pts.Count;

    Point3d cnt = new Point3d(cntx, cnty, cntz);
    Cnt = cnt;
# ---------- end cnt ----------

number_slider = Slider(660, range=0..1000)
number_slider_2 = Slider(-1000, range=-1000..0)
X = UnitX(Factor=number_slider)
X_2 = UnitX(Factor=Slider(200, range=0..1000))
X_3 = UnitX(Factor=Slider(200, range=0..1000))
pt = ConstructPoint(XCoordinate=number_slider_2, YCoordinate=Slider(-1000, range=-1000..0), ZCoordinate=0)
move = Move(Geometry=pt, Motion=X)  # -> Geometry, Transform
# Model Examples
xy = XYPlane(Origin=move.Geometry)

number_slider_3 = Slider(2, range=0..10)
divisions_timber = Slider(4, range=0..10)
length_alu = Slider(600, range=500..2000)
division_alu = Slider(2, range=0..10)
length_timber = Slider(850, range=500..2000)

U = Slider(1, range=0..10)
V = Slider(1, range=0..10)
rectangle_dim = Slider(69, range=0..100)

longitudinal_divisions = Slider(5, range=0..50)
length = Slider(1000, range=0..1000)

v_flange = Slider(1, range=0..10)
height_flange = Slider(10, range=0..50)
u_flange = Slider(2, range=0..20)
width_flange = Slider(200, range=0..500)

u_web = Slider(1, range=0..10)
width_web = Slider(10, range=0..50)
height_web = Slider(300, range=0..1000)
v_web = Slider(3, range=0..30)

divisions_timber2 = Slider(4, range=0..10)
length_timber1 = Slider(700, range=500..2000)
division_timber1 = Slider(4, range=0..10)
length_timber2 = Slider(700, range=500..2000)
number_slider_4 = Slider(1, range=0..10)
number_slider_5 = Slider(2, range=0..10)
height = Slider(506, range=0..1000)

addition = Addition(A=number_slider_2, B=number_slider)
pt_2 = ConstructPoint(XCoordinate=addition, YCoordinate=0, ZCoordinate=0)

end_width_height = Slider(300, range=10..500)
uandv = Slider(1, range=0..10)
degrees_of_total_twist = Slider(360, range=0..1000)
start_width_height = Slider(10, range=10..100)
number_slider_6 = Slider(10, range=0..10)
L = Slider(1000, range=0..1000)
number_slider_7 = Slider(1000, range=0..1000)

number_slider_8 = Slider(10, range=0..10)
number_slider_9 = Slider(27, range=0..100)
number_slider_10 = Slider(1, range=0..1)

# ----
# Simple Tie
# Alu + Timber
panel_5 = Panel("{-2000,0,0}")
rectangleyzrev_2 = CSharpScript(Cntr=panel_5, W=Slider(100, range=0..100), H=Slider(200, range=0..1000))  # -> Rcntr, Pts; inputs Cntr: Point3d, W: Double, H: Double; same code as rectangleyzrev
xy_2 = XYPlane(Origin=pt_2)
X_4 = UnitX(Factor=length_timber)
panel_6 = Panel("""Simple Tie
Alu + Timber""")
X_5 = UnitX(Factor=length_alu)
move_2 = Move(Geometry=rectangleyzrev_2.Pts, Motion=X_5)  # -> Geometry, Transform
rgb = ColourRGB(Alpha=Slider(200, range=0..255), Red="102", Green="197", Blue="200")
move_3 = Move(Geometry=move_2.Geometry, Motion=X_4)  # -> Geometry, Transform
tag = TextTag3D(Location=xy_2, Text=panel_6, Size=Slider(100, range=0..100), Justification=7)
meshpointssweep_2 = CSharpScript(
    PointsSource=move_2.Geometry,
    PointsTarget=move_3.Geometry,
    Divisions=divisions_timber,
    U=number_slider_3,
    V=number_slider_3,
    TooltipDescriptionOverride="Divisions longitudinally")  # -> Mesh, Srf, SourceSrf, TargetSrf, Orientation; inputs PointsSource: list of Point3d, PointsTarget: list of Point3d, Divisions: Int32, U: Int32, V: Int32; same code as meshpointssweep
meshpointssweep_3 = CSharpScript(
    PointsSource=rectangleyzrev_2.Pts,
    PointsTarget=move_2.Geometry,
    Divisions=division_alu,
    U=number_slider_3,
    V=number_slider_3,
    TooltipDescriptionOverride="Divisions longitudinally")  # -> Mesh, Srf, SourceSrf, TargetSrf, Orientation; inputs PointsSource: list of Point3d, PointsTarget: list of Point3d, Divisions: Int32, U: Int32, V: Int32
# ---------- meshpointssweep_3: C# ----------
    //riktig oppdatert0306
    List<double> length = new List<double>();
    List <Curve> edgecrv = new List<Curve>();
    DataTree<Curve> edgecrvtree = new DataTree<Curve>();
    DataTree <Point3d> vrttree = new DataTree<Point3d>();
    DataTree <Point3d> vrtsectiontree = new DataTree<Point3d>();
    List <NurbsSurface> s = new List<NurbsSurface>();
    DataTree <System.Object> meshtree = new DataTree<System.Object>();


    //Default values if not specified, added 27.04
    if(Divisions == 0){Divisions = 1;};
    if(U == 0){U = 1;};
    if(V == 0){V = 1;};

    //Make edgecurves, get their length and make new corner points
    for ( int i = 0; i < 4; i++)
    {
      edgecrv.Add(new Line(PointsSource[i], PointsTarget[i]).ToNurbsCurve()); //Add for only one item
      length.Add(edgecrv[i].GetLength());
      edgecrvtree.Add(new Line(PointsSource[i], PointsTarget[i]).ToNurbsCurve(), new GH_Path(i));
      vrttree.AddRange(edgecrvtree.Branch(i)[0].DivideEquidistant(length[i] / Divisions), new GH_Path(i));

      int listitem = 0;
      for (int j = 0; j < (Divisions + 1); j++)
      {
        vrtsectiontree.Add(vrttree.Branch(i)[listitem], new GH_Path(j));
        listitem++;
      }
    }
    //make surfaces
    //get beginning and end surface if needed for tie/boundary conditions or etc.
    Brep ss = Brep.CreateFromCornerPoints(PointsSource[0], PointsSource[1], PointsSource[2], PointsSource[3], 0);
    Brep ts = Brep.CreateFromCornerPoints(PointsTarget[0], PointsTarget[1], PointsTarget[2], PointsTarget[3], 0);

    //get cross-sectional surfaces
    for (int j = 0; j < (Divisions + 1); j++)
    {
      s.Add(NurbsSurface.CreateFromCorners(vrtsectiontree.Branch(j)[0], vrtsectiontree.Branch(j)[1], vrtsectiontree.Branch(j)[2], vrtsectiontree.Branch(j)[3], 0));
    } // (branch number) [list number]


    DataTree<Brep> btree = new DataTree<Brep>();
    DataTree <Curve> loftcrv = new DataTree<Curve>(); //loft to get solid
    DataTree <Point3d> nodetree = new DataTree<Point3d>();


    for (int a = 0; a < (Divisions + 1); a++)
    {
      for (int i = 0; i < (V + 1); i++)
      {
        for (int j = 0; j < (U + 1); j++)
        {
          Point3d p = new Point3d(s[a].PointAt(s[a].Domain(0).Length / V * i, s[a].Domain(1).Length / U * j)); // v-value first, then u value, because domain(0) is v
          meshtree.Add(p, new GH_Path(0, 0)); //added 1704
          //meshtree.Add(p, new GH_Path(1, a)); //added1704 to get nodetree2 in same list
          nodetree.Add(p, new GH_Path(a, i));
        }
      }
    }

    for (int a = 0; a < (Divisions + 1); a++)
    {
      for (int i = 0; i < V; i++)
      {
        for (int j = 0; j < U; j++)
        {
          Brep b = Brep.CreateFromCornerPoints(nodetree.Branch(a, i)[j], nodetree.Branch(a, i + 1)[j], nodetree.Branch(a, i + 1)[j + 1], nodetree.Branch(a, i)[j + 1], 0);
          btree.Add(b, new GH_Path(a, i));
          //meshtree.Add(b, new GH_Path(2, a));
          meshtree.Add(b, new GH_Path(1, 0));
          loftcrv.AddRange(btree.Branch(a, i)[j].DuplicateEdgeCurves(), new GH_Path(a));
        }
      }
    }


    DataTree <Brep> srf = new DataTree<Brep>();
    for ( int i = 0; i < loftcrv.Branch(0).Count; i++)
    {
      for (int j = 0; j < Divisions; j++)
      {
        srf.AddRange(Brep.CreateFromLoft(new List<Curve>{loftcrv.Branch(0 + j)[i], loftcrv.Branch(1 + j)[i]}, Point3d.Unset, Point3d.Unset, LoftType.Normal, false), new GH_Path(i));
      }
    } // Surfaces in the middle are doubled


    //orientation

    Point3d p1 = new Point3d((PointsSource[0].X + PointsSource[1].X + PointsSource[2].X + PointsSource[3].X) / 4, (PointsSource[0].Y + PointsSource[1].Y + PointsSource[2].Y + PointsSource[3].Y) / 4, (PointsSource[0].Z + PointsSource[1].Z + PointsSource[2].Z + PointsSource[3].Z) / 4);
    Point3d p2 = new Point3d((PointsTarget[0].X + PointsTarget[1].X + PointsTarget[2].X + PointsTarget[3].X) / 4, (PointsTarget[0].Y + PointsTarget[1].Y + PointsTarget[2].Y + PointsTarget[3].Y) / 4, (PointsTarget[0].Z + PointsTarget[1].Z + PointsTarget[2].Z + PointsTarget[3].Z) / 4);

    List <string> orilist = new List<string>();

    Vector3d vec1 = p2 - p1; //longitudinal direction of timber cross-section central points = Direction 1
    vec1.Unitize();
    Plane nplan = new Plane(p1, vec1); //normal plane
    Vector3d vec2 = nplan.XAxis; // Second axis (unitized)

    double x1 = vec1.X;
    double y1 = vec1.Y;
    double z1 = vec1.Z;

    double x2 = vec2.X;
    double y2 = vec2.Y;
    double z2 = vec2.Z;

    double cx = p1.X;
    double cy = p1.Y;
    double cz = p1.Z;

    //Add orientation (for orthotropic material)
    orilist.Add("Ori-1");
    orilist.Add("*Orientation, name=Ori-1");
    orilist.Add(string.Format("{0}, {1}, {2}, {3}, {4}, {5}, {6}, {7}, {8}", x1, z1, y1, x2, z2, y2, cx, cz, cy)); //changed y z due to abaqus/rhino different axis systems
    orilist.Add("1, 0"); // 1,0. 1 means primary axis (x), 0 means no rotation


    //add divisions, u and v to be used further to end of mesh tree
    GH_Path pth = new GH_Path(2, 0);
    meshtree.Add(Divisions, pth); //number of divisions
    //meshtree.Add((U + 1) * (V + 1), pth); // number of nodes per branch
    meshtree.Add(U * V, pth); //number of surfaces per branch


    Srf = srf;
    Mesh = meshtree;
    SourceSrf = ss;
    TargetSrf = ts;
    Orientation = orilist;
# ---------- end meshpointssweep_3 ----------
load_type_5 = ValueList({"Uniform Pressure": "Pressure,P", "Surface Traction Shear": "Surface traction,TRSHR", "Surface Traction General": "Surface traction,TRVEC"}, selected="Uniform Pressure")  # disabled
number_slider_11 = Slider(-10, range=-10..0)  # disabled
hexahedron_5 = ValueList({"Full integration": "C3D8", "Reduced Integration": "C3D8R", "Incompatible Modes": "C3D8I"}, selected="Reduced Integration")  # disabled
bcs_2 = ValueList({"U1": 1, "U2": 2, "U3": 3, "UR1": 4, "UR2": 5, "UR3": 6}, selected=["U1", "U2", "U3", "UR1", "UR2", "UR3"])  # disabled
panel_7 = Panel("70000")  # disabled
panel_8 = Panel("Alu")  # disabled
support_2 = CSharpScript(Face=meshpointssweep_3.SourceSrf, Conditions=bcs_2)  # -> Support; inputs ID: String, Tol: Double, Face: Brep, Conditions: list of String; disabled; same code as support
isotropicmaterial_2 = CSharpScript(
    Material=panel_8,
    E=panel_7,
    TooltipDescriptionOverride="Default material: Steel, E=210000, PR=0.3",
    TooltipTextOverride="Isotropic Material. Steel default")  # -> Properties; inputs Material: String, E: Int32, PR: Double; disabled; same code as isotropicmaterial
load_2 = CSharpScript(LoadType=load_type_5, Face=meshpointssweep_2.TargetSrf, kNMagnitude=number_slider_11)  # -> Load; inputs ID: String, LoadType: String, Tol: Double, Face: Brep, DirVector: Vector3d, kNMagnitude: Double, MPaMagnitude: Double; disabled; same code as load
orthotropicmaterial_2 = CSharpScript(TooltipDescriptionOverride="Norwegian Spruce default material. E1=10000, E2 = 800, E3 = 400. Nu12=0.5, Nu13=0.6, Nu23=0.6. G12=600, G13=600, G23=30.")  # -> Properties; inputs Material: String, E1: Int32, E2: Int32, E3: Int32, Nu12: Double, Nu13: Double, Nu23: Double, G12: Int32, G13: Int32, G23: Int32; disabled; same code as orthotropicmaterial
panel_9 = Panel("Alu")  # disabled
panel_10 = Panel("Timber")  # disabled
tie_2 = CSharpScript(Master=panel_9, Slave=panel_10, Face=meshpointssweep_3.TargetSrf)  # -> Part, INP; inputs ID: String, Master: String, Slave: String, Tol: Double, Face: Brep; disabled; same code as tie
toggle = BooleanToggle(True)  # disabled
abaquspart_2 = CSharpScript(
    ID=panel_9,
    Mesh=meshpointssweep_3.Mesh,
    ElmntType=hexahedron_5,
    Material=isotropicmaterial_2,
    Support=support_2,
    Tie=tie_2.Part,
    Run=toggle)  # -> Geometry, Part, Instance, Sets, BC, Steps; inputs ID: String, Mesh: tree, ElmntType: list of String, Material: list, Orientation: list of String, Support: tree, Load: tree, Tie: tree, Run: Boolean; disabled
# ---------- abaquspart_2: C# ----------
    //oppdatert 0306
    //Declare variables;
    Point3d Crd;
    string Nr, X, Y, Z;
    
    if (string.IsNullOrEmpty(ID)) //if ID is not assigned
    {
      ID = "Part1"; //Make default ID
    }

    //Create output tree;
    DataTree <Curve> Crvs = new DataTree<Curve>();
    DataTree <Point3d> Elements = new DataTree<Point3d>();
    DataTree <System.Object> GeoTree = new DataTree<System.Object>();
    DataTree <string> Inf = new DataTree<string>();
    DataTree <int> Tick = new DataTree<int>();
    DataTree <int> Tock = new DataTree<int>();

    //Create Lists;
    List< Point3d > Vertices = new List<Point3d>();
    List< Point3d > Nds = new List<Point3d>();
    List< Brep > Srf = new List<Brep>();
    List< Brep > ObjList = new List<Brep>();
    List< string > PrtLst = new List<string>();
    List< string > SetLst = new List<string>();
    List< string > InsLst = new List<string>();
    List< string > BCLst = new List<string>();
    List< string > StpLst = new List<string>();
    List< string > ElNr = new List<string>();
    List<Brep> SupLst = new List<Brep>();
    List<double> TolSupLst = new List<double>();
    List<Brep> DisLst = new List<Brep>();
    List<double> TolDisLst = new List<double>();
    List<Brep> LdLst = new List<Brep>();
    List<double> TolLdLst = new List<double>();
    List<Brep> TieLst = new List<Brep>();
    List<double> TolTieLst = new List<double>();

    ////////////////////////////////////////////////////////////////////////////////////
    //Sorts number of meshes into correct lists so that it is possible to assign different values of v,u and div to each mesh and merge meshes into same part
    List<Point3d> nodelist = new List<Point3d>();
    DataTree<Point3d> nodetree = new DataTree<Point3d>();
    DataTree<Brep> breps = new DataTree<Brep>();

    for (int i = 0; i < Mesh.Branch(0, 0).Count(); i++)
    {
      Point3d n = (Point3d) Mesh.Branch(0, 0)[i];
      nodelist.Add(n);
    }

    int div, numbr;
    int startlocb = 0; //startindex of brep
    int count = 0; //count to get correct assignment of div,numnb,numbr;
    for (int j = 0; j < (Mesh.Branch(2, 0).Count() / 2) ; j++) //number of meshes
    {
      div = (int) Mesh.Branch(2, 0)[count]; //divisions j mesh
      numbr = (int) Mesh.Branch(2, 0)[count + 1]; //number of surfaces in each division
      for (int k = 0; k < (div + 1); k++)
      {
        for (int p = startlocb; p < (startlocb + numbr); p++)
        {
          Brep bb = (Brep) Mesh.Branch(1, 0)[p];
          breps.Add(bb, new GH_Path(j, k));
        }
        for (int q = 0; q < numbr; q++)
        {
          Elements.AddRange(breps.Branch(j, k)[q].DuplicateVertices(), new GH_Path(j, k, q));
        }
        startlocb = startlocb + numbr; //make next location
      }
      count = count + 2; //to get next mesh's division and number of surfaces.
    }



    ///////////////////////////////////////////////////////////////////////////////////////
    ///////////////////////////////////////////////////////////////////////////////////////

    if (Run)
    {
      //Discretize the data of the Part;
      PrtLst.Add(string.Format("*Part, name={0}", ID));
      //Nodes of the Part;
      PrtLst.Add("*Node");

      Nds.AddRange(Point3d.CullDuplicates(nodelist, doc.ModelAbsoluteTolerance)); //remove duplicate node points
      for ( int i = 0; i < Nds.Count; i++)
      {
        Nr = (i + 1).ToString();
        Crd = Nds[i];
        X = Crd.X.ToString();
        Y = Crd.Y.ToString();
        Z = Crd.Z.ToString();
        PrtLst.Add(Nr + ", " + X + ", " + Z + ", " + Y);
      }
      //Sort element Nodes and identify faces which is supported or loaded;
      PrtLst.Add(string.Format("*Element, type={0}", ElmntType[0]));

      //If Load, import input for load;
      if ( Load.PathExists(0) )
      {
        double TolLd;
        Brep LdSrf = new Brep();
        for (int i = 0; i < Load.Branch(0).Count(); i++)
        {
          GH_Convert.ToBrep(Load.Branch(0)[i], ref LdSrf, Grasshopper.Kernel.GH_Conversion.Both);
          GH_Convert.ToDouble(Load.Branch(3)[i], out TolLd, GH_Conversion.Both);
          TolLdLst.Add(TolLd);
          LdLst.Add(LdSrf);
        }
      }
      //If Tie, import input for tie;
      if ( Tie.PathExists(0) )
      {
        double TolTie;
        Brep TieSrf = new Brep();
        for (int i = 0; i < Tie.Branch(0).Count(); i++)
        {
          GH_Convert.ToBrep(Tie.Branch(0)[i], ref TieSrf, Grasshopper.Kernel.GH_Conversion.Both);
          GH_Convert.ToDouble(Tie.Branch(2)[i], out TolTie, GH_Conversion.Both);
          TolTieLst.Add(TolTie);
          TieLst.Add(TieSrf);
        }
      }

      //Make list of elements, identify load and tie
      int count2 = 0; //To get the correct assignment of divisions, number of breps for each mesh
      int count3 = 1; //Begin at element 1 in Abaqus

      for (int f = 0; f < (Mesh.Branch(2, 0).Count() / 2) ; f++) //number of meshes
      {
        int div2 = (int) Mesh.Branch(2, 0)[count2]; //divisions of f mesh
        int numbr2 = (int) Mesh.Branch(2, 0)[count2 + 1]; //numbers of breps in each division

        for (int g = 0; g < div2; g++)
        {
          for (int h = 0; h < numbr2; h++)
          {
            ElNr.Add(count3.ToString());
            for ( int k = 0; k < Elements.Branch(f, g, h).Count; k++)
            {
              for ( int l = 0; l < Nds.Count; l++)
              {
                if ( PtCmp(Elements.Branch(f, g, h)[k], Nds[l]))
                {
                  ElNr.Add((l + 1).ToString());
                }
              } //4 first corners
            }
            for ( int k = 0; k < Elements.Branch(f, g, h).Count; k++)
            {
              for ( int l = 0; l < Nds.Count; l++)
              {
                if ( PtCmp(Elements.Branch(f, g + 1, h)[k], Nds[l]))
                {
                  ElNr.Add((l + 1).ToString());
                }
              } //4 second corners

              //identify if srf is loaded
              if ( Load.PathExists(0) )
              {
                for (int m = 0; m < Load.Branch(0).Count; m++)
                {
                  Tick.EnsurePath(m);
                  if ( IdenSet(LdLst[m], Elements.Branch(f, g, h)[k], TolLdLst[m]))
                  {
                    Tick.Add(k + 1, new GH_Path(m));
                    if (Tick.Branch(m).Count == 4)
                    {
                      Inf.Add((count3).ToString() + ",", new GH_Path(1, m, 2));
                      Inf.Add(SrfInd(Tick.Branch(m)).ToString(), new GH_Path(1, m, 3));
                    }
                  }
                  if ( IdenSet(LdLst[m], Elements.Branch(f, g + 1, h)[k], TolLdLst[m]))
                  {
                    Tick.Add(k + 5, new GH_Path(m));
                    if (Tick.Branch(m).Count == 4)
                    {
                      Inf.Add((count3).ToString() + ",", new GH_Path(1, m, 2));
                      Inf.Add(SrfInd(Tick.Branch(m)).ToString(), new GH_Path(1, m, 3));
                    }
                  }
                }
              } //end load Path

              //identify if nodes are tied
              if ( Tie.PathExists(0) )
              {
                for (int m = 0; m < Tie.Branch(0).Count; m++)
                {
                  Tock.EnsurePath(m);
                  if ( IdenSet(TieLst[m], Elements.Branch(f, g, h)[k], TolTieLst[m]))
                  {
                    Tock.Add(k + 1, new GH_Path(m));
                    if (Tock.Branch(m).Count == 4)
                    {
                      Inf.Add((count3).ToString() + ",", new GH_Path(1, m, 4));
                      Inf.Add(SrfInd(Tock.Branch(m)).ToString(), new GH_Path(1, m, 5));
                    }
                  }
                  if ( IdenSet(TieLst[m], Elements.Branch(f, g + 1, h)[k], TolTieLst[m]))
                  {
                    Tock.Add(k + 5, new GH_Path(m));
                    if (Tock.Branch(m).Count == 4)
                    {
                      Inf.Add((count3).ToString() + ",", new GH_Path(1, m, 4));
                      Inf.Add(SrfInd(Tock.Branch(m)).ToString(), new GH_Path(1, m, 5));
                    }
                  }
                }
              } //end tie
            }

            PrtLst.Add(String.Join(",  ", ElNr.ToArray()));
            count3 = count3 + 1;
            ElNr.Clear();
            Tick.ClearData();
            Tock.ClearData();
          }
        }
        count2 = count2 + 2;
      }


      //Identify nodes on supported face;
      if ( Support.PathExists(0) )
      {
        double TolSup;
        Brep SupSrf = new Brep();
        for (int i = 0; i < Support.Branch(0).Count(); i++)
        {
          GH_Convert.ToBrep(Support.Branch(0)[i], ref SupSrf, Grasshopper.Kernel.GH_Conversion.Both);
          GH_Convert.ToDouble(Support.Branch(3)[i], out TolSup, GH_Conversion.Both);
          TolSupLst.Add(TolSup);
          SupLst.Add(SupSrf);
        }
        for (int i = 0; i < Nds.Count; i++)
        {
          for (int j = 0; j < Support.Branch(0).Count; j++)
          {
            if ( IdenSet(SupLst[j], Nds[i], TolSupLst[j]) )
            {
              Inf.Add((i + 1).ToString() + ",", new GH_Path(0, j, 1));
              GeoTree.Add(Nds[i].X.ToString(), new GH_Path(2, j, 0));
              GeoTree.Add(Nds[i].Y.ToString(), new GH_Path(2, j, 1));
              GeoTree.Add(Nds[i].Z.ToString(), new GH_Path(2, j, 2));
            }
          }
        }
      }

      ///////////////////////////////////////////////////////////////////////////////////////
      ///////////////////////////////////////////////////////////////////////////////////////
      //Create sets of nodes;
      PrtLst.Add("*Nset, nset=Set-1, generate");
      PrtLst.Add(string.Format("   1,    {0},    1", Nds.Count));
      //Create sets of elements;
      PrtLst.Add("*Elset, elset=Set-1, generate");
      PrtLst.Add(string.Format("   1,    {0},    1", count3 - 1));

      //Add orientation (for orthotropic material) 30.04

      if ( (Orientation != null) && (!Orientation.Any()) ) //if the list is empty
      {
        PrtLst.Add(string.Format("**Section: {0}_section", ID));
        PrtLst.Add(string.Format("*Solid Section, elset=Set-1, material={0}", Material[0]));
      }
      else
      {
        PrtLst.Add(Orientation[1]);
        PrtLst.Add(Orientation[2]);
        PrtLst.Add(Orientation[3]);
        PrtLst.Add(string.Format("**Section: {0}_section", ID));
        PrtLst.Add(string.Format("*Solid Section, elset=Set-1, orientation=Ori-1, material={0}", Material[0]));
      }

      PrtLst.Add(",");
      //Finish defining Part;
      PrtLst.Add("*End Part");
      PrtLst.Add("**");
      //Create instance of the part;
      InsLst.Add(string.Format("*Instance, name={0}, part={0}", ID));
      InsLst.Add("*End Instance");
      InsLst.Add("**");
      //BC; Add nodes on supported Face;
      if ( Inf.PathExists(0, 0, 1) )
      {
        for (int i = 0; i < Support.Branch(0).Count; i++)
        {
          SetLst.Add(string.Format("*Nset, nset={0}, instance={1}", Support.Branch(2)[i], ID));
          for (int j = 0; j < Inf.Branch(0, i, 1).Count; j++)
          {
            SetLst.Add(Inf.Branch(0, i, 1)[j]);
          }
        }
      }
      //Add elements on tied face;
      if ( Inf.PathExists(1, 0, 4) )
      {
        for (int i = 0; i < Tie.Branch(0).Count; i++)
        {
          SetLst.Add(string.Format("*Elset, elset={0}-{1}-TieSrf, internal, instance={1}", Tie.Branch(1)[i], ID));
          for (int j = 0; j < Inf.Branch(1, i, 4).Count; j++)
          {
            SetLst.Add(Inf.Branch(1, i, 4)[j]);
          }
        }
      }
      //Define tie surface;
      if ( Inf.PathExists(1, 0, 5) )
      {
        for (int i = 0; i < Tie.Branch(0).Count; i++)
        {
          SetLst.Add(string.Format("*Surface, type=ELEMENT, name={0}-{1}-TieSrf", Tie.Branch(1)[i], ID));
          SetLst.Add(string.Format("{0}-{1}-TieSrf, S{2}", Tie.Branch(1)[i], ID, Inf.Branch(1, i, 5)[0]));
        }
      }
      //Add elements on loaded face;
      if ( Inf.PathExists(1, 0, 2) )
      {
        for (int i = 0; i < Load.Branch(0).Count; i++)
        {
          SetLst.Add(string.Format("*Elset, elset={0}-Surf, internal, instance={1}", Load.Branch(2)[i], ID));
          for (int j = 0; j < Inf.Branch(1, i, 2).Count; j++)
          {
            SetLst.Add(Inf.Branch(1, i, 2)[j]);
          }
        }
      }
      //Define load surface;
      if ( Inf.PathExists(1, 0, 2) )
      {
        for (int i = 0; i < Load.Branch(0).Count; i++)
        {
          SetLst.Add(string.Format("*Surface, type=ELEMENT, name={0}", Load.Branch(2)[i]));
          SetLst.Add(string.Format("{0}-Surf, S{1}", Load.Branch(2)[i], Inf.Branch(1, i, 3)[0]));
        }
      }
      //Boundary conditions;
      if ( Support.PathExists(0) )
      {
        for (int i = 0; i < Support.Branch(1).Count; i++)
        {
          BCLst.Add(string.Format("{0}", Support.Branch(1)[i]));
        }
      }
      //Steps;
      if ( Load.PathExists(0) )
      {
        for (int i = 0; i < Load.Branch(1).Count; i++)
        {
          StpLst.Add(string.Format("{0}", Load.Branch(1)[i]));;
        }
      }

    }
    Geometry = GeoTree;
    Part = PrtLst;
    Instance = InsLst;
    Sets = SetLst;
    BC = BCLst;
    Steps = StpLst;
# ---------- abaquspart_2: C# additional code ----------
  public int SrfInd(List < int > N)
  {
    int Indx;

    if (!N.Except(new List<int>{ 1, 2, 3, 4 }).Any() && N.Count == 4)
    {
      Indx = 1;
    }
    else if(!N.Except(new List<int>{ 5, 6, 7, 8 }).Any() && N.Count == 4)
    {
      Indx = 2;
    }
    else if(!N.Except(new List<int>{ 1, 2, 5, 6 }).Any() && N.Count == 4)
    {
      Indx = 3;
    }
    else if(!N.Except(new List<int>{ 2, 3, 6, 7 }).Any() && N.Count == 4)
    {
      Indx = 4;
    }
    else if(!N.Except(new List<int>{ 3, 4, 7, 8 }).Any() && N.Count == 4)
    {
      Indx = 5;
    }
    else
    {
      Indx = 6;
    }
    return Indx;
  }

  public bool IdenSet(Brep Srf, Point3d Nd, double Tol)
  {
    bool Truth;
    Point3d Pt = Srf.ClosestPoint(Nd);
    Vector3d Vct = Pt - Nd;

    if (Vct.Length < Tol)
    {
      Truth = true;
    }
    else
    {
      Truth = false;
    }
    return Truth;
  }

  public bool PtCmp(Point3d ElNd, Point3d Nd)
  {
    bool Truth;
    Vector3d Vct = ElNd - Nd;

    if (Vct.Length < doc.ModelAbsoluteTolerance)
    {
      Truth = true;
    }
    else
    {
      Truth = false;
    }
    return Truth;
  }
# ---------- end abaquspart_2 ----------
abaquspart_3 = CSharpScript(
    ID=panel_10,
    Mesh=meshpointssweep_2.Mesh,
    ElmntType=hexahedron_5,
    Material=orthotropicmaterial_2,
    Orientation=meshpointssweep_2.Orientation,
    Load=load_2,
    Tie=tie_2.Part,
    Run=toggle)  # -> Geometry, Part, Instance, Sets, BC, Steps; inputs ID: String, Mesh: tree, ElmntType: list of String, Material: list, Orientation: list of String, Support: tree, Load: tree, Tie: tree, Run: Boolean; disabled; same code as abaquspart_2
inpassembly_2 = CSharpScript(
    Part=flatten([abaquspart_2.Part, abaquspart_3.Part]),
    Instance=flatten([abaquspart_2.Instance, abaquspart_3.Instance]),
    Sets=flatten([abaquspart_2.Sets, abaquspart_3.Sets]),
    BC=flatten([abaquspart_2.BC, abaquspart_3.BC]),
    Material=[isotropicmaterial_2, orthotropicmaterial_2],
    Tie=flatten(tie_2.INP),
    Steps=flatten([abaquspart_2.Steps, abaquspart_3.Steps]))  # -> INP; inputs ID: list of String, Job: list of String, Model: list of String, Part: list of String, Instance: list of String, Sets: list of String, BC: list of String, Material: list of String, Tie: list of String, Steps: list of String; disabled; same code as inpassembly
panel_11 = Panel(inpassembly_2)  # disabled

# ----
# Randomly Generated Curve
panel_12 = Panel("1000 TO 2000")
range = Range(Domain=panel_12, Steps=number_slider_8)
panel_13 = Panel("""Randomly 
Generated 
Curve""")
random = Random(Range="0 TO 300", Number=number_slider_8, Seed=Slider(4, range=0..10))
number_slider_12 = Slider(3, range=0..10)
pt_3 = ConstructPoint(XCoordinate=range, YCoordinate="-1000", ZCoordinate=random)
item = ListItem(List=pt_3, Index=number_slider_8, Wrap=True)
move_4 = Move(Geometry=item, Motion=X_2)  # -> Geometry, Transform
xy_3 = XYPlane(Origin=move_4.Geometry)
tag_2 = TextTag3D(Location=xy_3, Text=panel_13, Size=Slider(100, range=0..300), Justification=7)
nurbs = NurbsCurve(Vertices=pt_3, Degree=number_slider_12, Periodic=False)  # -> Curve, Length, Domain
pframes = PerpFrames(Curve=nurbs.Curve, Count=number_slider_9, Align=True)  # -> Frames, Parameters
rectangle = Rectangle(Plane=pframes.Frames, XSize=Slider(30, range=0..100), YSize=Slider(49, range=0..100), Radius=0)  # -> Rectangle, Length
brep = Brep(rectangle.Rectangle)
getvertices_2 = CSharpScript(Breps=brep)  # -> Vrt; inputs Breps: list of Brep, Closed: Boolean; same code as getvertices
load_type_6 = ValueList({"Uniform Pressure": "Pressure,P", "Surface Traction Shear": "Surface traction,TRSHR", "Surface Traction General": "Surface traction,TRVEC"}, selected="Surface Traction General")  # disabled
meshpointsnurbssweep_2 = CSharpScript(
    Points=flatten(getvertices_2),
    Degree=number_slider_12,
    Divisions=number_slider_9,
    U=number_slider_10,
    V=number_slider_10,
    TooltipDescriptionOverride="Divisions longitudinally")  # -> Mesh, Srf, SourceSrf, TargetSrf, Orientation; inputs Points: list of Point3d, Degree: Int32, Divisions: Int32, U: Int32, V: Int32
# ---------- meshpointsnurbssweep_2: C# ----------
    //riktig oppdatert 03.06
    List<double> length = new List<double>();
    List <NurbsCurve> edgecrv = new List<NurbsCurve>();
    DataTree<NurbsCurve> edgecrvtree = new DataTree<NurbsCurve>();
    DataTree <Point3d> vrttree = new DataTree<Point3d>();
    DataTree <Point3d> vrtsectiontree = new DataTree<Point3d>();
    List <NurbsSurface> s = new List<NurbsSurface>();
    DataTree <System.Object> meshtree = new DataTree<System.Object>();


    //Default values if not specified, added 27.04
    if(Divisions == 0){Divisions = 1;};
    if(U == 0){U = 1;};
    if(V == 0){V = 1;};
    if(Degree == 0){Degree = 1;}

    // NurbsCurve crv = NurbsCurve.Create(false, Degree, PointsSource[1] PointsMid[1] PointsTarget[1]);
    DataTree<Point3d> clst = new DataTree<Point3d>(); //make ordered list to make curve
    //List <NurbsCurve> nrbs = new List<NurbsCurve>();
    Point3d ps;
    for (int i = 0;i < 4;i++)
    {
      GH_Path pthnr = new GH_Path(i);
      for (int j = i;j < Points.Count();j += 4) //if more midpoints
      {
        ps = Points[j];
        clst.Add(ps, pthnr);
      }
      edgecrv.Add(NurbsCurve.Create(false, Degree, clst.Branch(i)));
      length.Add(edgecrv[i].GetLength());
      //edgecrvtree.Add(NurbsCurve.Create(false, Degree, clst.Branch(i)), new GH_Path(i));
      vrttree.AddRange(edgecrv[i].DivideEquidistant(length[i] / Divisions), new GH_Path(i));
      vrttree.Add(Points[Points.Count() - 4 + i], new GH_Path(i));
      int listitem = 0;

      for (int j = 0; j < (Divisions + 1); j++)
      {
        vrtsectiontree.Add(vrttree.Branch(i)[listitem], new GH_Path(j));
        listitem++;
      }

    }
    //make surfaces
    //get beginning and end surface if needed for tie/boundary conditions or etc.
    int pnum = Points.Count();
    Brep ss = Brep.CreateFromCornerPoints(Points[0], Points[1], Points[2], Points[3], 0);
    Brep ts = Brep.CreateFromCornerPoints(Points[pnum - 4], Points[pnum - 3], Points[pnum - 2], Points[pnum - 1], 0);

    //get cross-sectional surfaces
    for (int j = 0; j < (Divisions + 1); j++)
    {
      s.Add(NurbsSurface.CreateFromCorners(vrtsectiontree.Branch(j)[0], vrtsectiontree.Branch(j)[1], vrtsectiontree.Branch(j)[2], vrtsectiontree.Branch(j)[3], 0));
    } // (branch number) [list number]


    DataTree<Brep> btree = new DataTree<Brep>();
    DataTree <Curve> loftcrv = new DataTree<Curve>(); //loft to get solid
    DataTree <Point3d> nodetree = new DataTree<Point3d>();


    for (int a = 0; a < (Divisions + 1); a++)
    {
      for (int i = 0; i < (V + 1); i++)
      {
        for (int j = 0; j < (U + 1); j++)
        {
          Point3d p = new Point3d(s[a].PointAt(s[a].Domain(0).Length / V * i, s[a].Domain(1).Length / U * j)); // v-value first, then u value, because domain(0) is v
          meshtree.Add(p, new GH_Path(0, 0)); //added 1704
          //meshtree.Add(p, new GH_Path(1, a)); //added1704 to get nodetree2 in same list
          nodetree.Add(p, new GH_Path(a, i));
        }
      }
    }

    for (int a = 0; a < (Divisions + 1); a++)
    {
      for (int i = 0; i < V; i++)
      {
        for (int j = 0; j < U; j++)
        {
          Brep b = Brep.CreateFromCornerPoints(nodetree.Branch(a, i)[j], nodetree.Branch(a, i + 1)[j], nodetree.Branch(a, i + 1)[j + 1], nodetree.Branch(a, i)[j + 1], 0);
          btree.Add(b, new GH_Path(a, i));
          //meshtree.Add(b, new GH_Path(2, a));
          meshtree.Add(b, new GH_Path(1, 0));
          loftcrv.AddRange(btree.Branch(a, i)[j].DuplicateEdgeCurves(), new GH_Path(a));
        }
      }
    }


    DataTree <Brep> srf = new DataTree<Brep>();
    for ( int i = 0; i < loftcrv.Branch(0).Count; i++)
    {
      for (int j = 0; j < Divisions; j++)
      {
        srf.AddRange(Brep.CreateFromLoft(new List<Curve>{loftcrv.Branch(0 + j)[i], loftcrv.Branch(1 + j)[i]}, Point3d.Unset, Point3d.Unset, LoftType.Normal, false), new GH_Path(i));
      }
    } // Surfaces in the middle are doubled


    //orientation


    Point3d p1 = new Point3d((Points[0].X + Points[1].X + Points[2].X + Points[3].X) / 4, (Points[0].Y + Points[1].Y + Points[2].Y + Points[3].Y) / 4, (Points[0].Z + Points[1].Z + Points[2].Z + Points[3].Z) / 4);
    Point3d p2 = new Point3d((Points[pnum - 4].X + Points[pnum - 3].X + Points[pnum - 2].X + Points[pnum - 1].X) / 4, (Points[pnum - 4].Y + Points[pnum - 3].Y + Points[pnum - 2].Y + Points[pnum - 3].Y) / 4, (Points[pnum - 4].Z + Points[pnum - 3].Z + Points[pnum - 2].Z + Points[pnum - 1].Z) / 4);

    List <string> orilist = new List<string>();

    Vector3d vec1 = p2 - p1; //longitudinal direction of timber cross-section central points = Direction 1
    vec1.Unitize();
    Plane nplan = new Plane(p1, vec1); //normal plane
    Vector3d vec2 = nplan.XAxis; // Second axis (unitized)

    double x1 = vec1.X;
    double y1 = vec1.Y;
    double z1 = vec1.Z;

    double x2 = vec2.X;
    double y2 = vec2.Y;
    double z2 = vec2.Z;

    double cx = p1.X;
    double cy = p1.Y;
    double cz = p1.Z;

    //Add orientation (for orthotropic material)
    orilist.Add("Ori-1");
    orilist.Add("*Orientation, name=Ori-1");
    orilist.Add(string.Format("{0}, {1}, {2}, {3}, {4}, {5}, {6}, {7}, {8}", x1, z1, y1, x2, z2, y2, cx, cz, cy)); //changed y z due to abaqus/rhino different axis systems
    orilist.Add("1, 0"); // 1,0. 1 means primary axis (x), 0 means no rotation

    //add divisions, u and v to be used further to end of mesh tree
    GH_Path pth = new GH_Path(2, 0);
    meshtree.Add(Divisions, pth); //number of divisions
    //meshtree.Add((U + 1) * (V + 1), pth); // number of nodes per division
    meshtree.Add(U * V, pth); //number of surfaces per division


    //    Srf = srf;
    Mesh = meshtree;
    Srf = srf;
    SourceSrf = ss;
    TargetSrf = ts;
    Orientation = orilist;
# ---------- end meshpointsnurbssweep_2 ----------
number_slider_13 = Slider(1, range=0..1)  # disabled
hexahedron_6 = ValueList({"Full integration": "C3D8", "Reduced Integration": "C3D8R", "Incompatible Modes": "C3D8I"}, selected="Reduced Integration")
number_slider_14 = Slider(10, range=0..10)  # disabled
bcs_3 = ValueList({"U1": 1, "U2": 2, "U3": 3, "UR1": 4, "UR2": 5, "UR3": 6}, selected=["U1", "U2", "U3", "UR1", "UR2", "UR3"])  # disabled
vec = VectorXYZ(XComponent=number_slider_13, YComponent=number_slider_13, ZComponent=number_slider_13)  # -> Vector, Length; disabled
isotropicmaterial_3 = CSharpScript(
    TooltipDescriptionOverride="Default material: Steel, E=210000, PR=0.3",
    TooltipTextOverride="Isotropic Material. Steel default")  # -> Properties; inputs Material: String, E: Int32, PR: Double; disabled; same code as isotropicmaterial
support_3 = CSharpScript(Face=meshpointsnurbssweep_2.SourceSrf, Conditions=bcs_3)  # -> Support; inputs ID: String, Tol: Double, Face: Brep, Conditions: list of String; disabled; same code as support
load_3 = CSharpScript(LoadType=load_type_6, Face=meshpointsnurbssweep_2.TargetSrf, DirVector=vec.Vector, MPaMagnitude=number_slider_14)  # -> Load; inputs ID: String, LoadType: String, Tol: Double, Face: Brep, DirVector: Vector3d, kNMagnitude: Double, MPaMagnitude: Double; disabled; same code as load
abaquspart_4 = CSharpScript(
    Mesh=meshpointsnurbssweep_2.Mesh,
    ElmntType=hexahedron_6,
    Material=isotropicmaterial_3,
    Support=support_3,
    Load=load_3,
    Run=Toggle(False))  # -> Geometry, Part, Instance, Sets, BC, Steps; inputs ID: String, Mesh: tree, ElmntType: list of String, Material: list, Orientation: list of String, Support: tree, Load: tree, Tie: tree, Run: Boolean; disabled; same code as abaquspart
inpassembly_3 = CSharpScript(
    Part=flatten(abaquspart_4.Part),
    Instance=flatten(abaquspart_4.Instance),
    Sets=flatten(abaquspart_4.Sets),
    BC=flatten(abaquspart_4.BC),
    Material=isotropicmaterial_3,
    Steps=flatten(abaquspart_4.Steps))  # -> INP; inputs ID: list of String, Job: list of String, Model: list of String, Part: list of String, Instance: list of String, Sets: list of String, BC: list of String, Material: list of String, Tie: list of String, Steps: list of String; disabled; same code as inpassembly
panel_14 = Panel(inpassembly_3)

# ----
# Twist
number_slider_15 = Slider(100, range=0..300)
addition_2 = Addition(A=number_slider_7, B=L)
startpoint = ConstructPoint(XCoordinate=number_slider_7, YCoordinate=0, ZCoordinate=0)
pt_4 = ConstructPoint(XCoordinate=addition_2, YCoordinate=0, ZCoordinate=0)
move_5 = Move(Geometry=pt_4, Motion=X_2)  # -> Geometry, Transform
xy_4 = XYPlane(Origin=move_5.Geometry)
tag_3 = TextTag3D(Location=xy_4, Text="Twist", Size=number_slider_15, Justification=7)
dom = ConstructDomain(DomainStart=start_width_height, DomainEnd=end_width_height)
dom_2 = ConstructDomain(DomainStart="0", DomainEnd=degrees_of_total_twist)
ln = Line(StartPoint=startpoint, EndPoint=pt_4)
range_2 = Range(Domain=dom, Steps=number_slider_6)
range_3 = Range(Domain=dom_2, Steps=number_slider_6)
pframes_2 = PerpFrames(Curve=ln, Count=number_slider_6, Align=True)  # -> Frames, Parameters
rotax = RotateAxis(Geometry=pframes_2.Frames, Angle=degrees(range_3), Axis=Line((0, 0, 0), (10, 0, 0)))  # -> Geometry, Transform
rectangle_2 = Rectangle(Plane=rotax.Geometry, XSize=range_2, YSize=range_2, Radius=0)  # -> Rectangle, Length
load_type_7 = ValueList({"Uniform Pressure": "Pressure,P", "Surface Traction Shear": "Surface traction,TRSHR", "Surface Traction General": "Surface traction,TRVEC"}, selected="Surface Traction Shear")
brep_2 = Brep(rectangle_2.Rectangle)
getvertices_3 = CSharpScript(Breps=brep_2)  # -> Vrt; inputs Breps: list of Brep, Closed: Boolean; same code as getvertices
bcs_4 = ValueList({"U1": 1, "U2": 2, "U3": 3, "UR1": 4, "UR2": 5, "UR3": 6}, selected=["U1", "U2", "U3", "UR1", "UR2", "UR3"])
meshpointsnurbssweep_3 = CSharpScript(
    Points=flatten(getvertices_3),
    Degree=Slider(3, range=1..19),
    Divisions=Slider(22, range=1..50),
    U=uandv,
    V=uandv,
    TooltipDescriptionOverride="Divisions longitudinally")  # -> Mesh, Srf, SourceSrf, TargetSrf, Orientation; inputs Points: list of Point3d, Degree: Int32, Divisions: Int32, U: Int32, V: Int32; same code as meshpointsnurbssweep_2
hexahedron_7 = ValueList({"Full integration": "C3D8", "Reduced Integration": "C3D8R", "Incompatible Modes": "C3D8I"}, selected="Incompatible Modes")  # disabled
isotropicalumaterial = CSharpScript(
    TooltipDescriptionOverride="Default material: Aluminium, E=70000, PR=0.3",
    TooltipTextOverride="Isotropic Material. Alu default")  # -> Properties; inputs Material: String, E: Int32, PR: Double; disabled
# ---------- isotropicalumaterial: C# ----------
    //Create Lists
    List< System.Object > B = new List<System.Object>();
    ///////////////////////////////////////////////////////////////////////////////////////
    ///////////////////////////////////////////////////////////////////////////////////////
    if (string.IsNullOrEmpty(Material)){Material = "Aluminium";}
    B.Add(Material);
    B.Add("Elastic");
    if(E == 0){E = 70000;}
    if(PR == 0){PR = 0.3;}
    B.Add(string.Format("{0}, {1}", E, PR));
    B.Add("**");

    Properties = B;
# ---------- end isotropicalumaterial ----------
support_4 = CSharpScript(Face=meshpointsnurbssweep_3.TargetSrf, Conditions=bcs_4)  # -> Support; inputs ID: String, Tol: Double, Face: Brep, Conditions: list of String; disabled; same code as support
panel_15 = Panel("1")  # disabled
vec_2 = VectorXYZ(XComponent=0, YComponent=0, ZComponent=panel_15)  # -> Vector, Length
load_4 = CSharpScript(
    LoadType=load_type_7,
    Face=meshpointsnurbssweep_3.SourceSrf,
    DirVector=vec_2.Vector,
    kNMagnitude=Slider(10, range=0..100))  # -> Load; inputs ID: String, LoadType: String, Tol: Double, Face: Brep, DirVector: Vector3d, kNMagnitude: Double, MPaMagnitude: Double; disabled; same code as load
toggle_2 = BooleanToggle(False)  # disabled
abaquspart_5 = CSharpScript(
    Mesh=meshpointsnurbssweep_3.Mesh,
    ElmntType=hexahedron_7,
    Material=isotropicalumaterial,
    Support=support_4,
    Load=load_4,
    Run=toggle_2)  # -> Geometry, Part, Instance, Sets, BC, Steps; inputs ID: String, Mesh: tree, ElmntType: list of String, Material: list, Orientation: list of String, Support: tree, Load: tree, Tie: tree, Run: Boolean; disabled; same code as abaquspart_2
inpassembly_4 = CSharpScript(
    Part=flatten(abaquspart_5.Part),
    Instance=flatten(abaquspart_5.Instance),
    Sets=flatten(abaquspart_5.Sets),
    BC=flatten(abaquspart_5.BC),
    Material=isotropicalumaterial,
    Steps=flatten(abaquspart_5.Steps))  # -> INP; inputs ID: list of String, Job: list of String, Model: list of String, Part: list of String, Instance: list of String, Sets: list of String, BC: list of String, Material: list of String, Tie: list of String, Steps: list of String; disabled; same code as inpassembly
panel_16 = Panel(inpassembly_4)  # disabled

preview = CustomPreview(Geometry=[meshpointssweep_2.Srf, meshpointssweep_2.SourceSrf, meshpointssweep_2.TargetSrf], Material=rgb)

# ----
# Ring/Polygon
number_slider_16 = Slider(100, range=0..100)
xy_5 = XYPlane(Origin=pt)
tag_4 = TextTag3D(Location=xy, Text="Ring/Polygon", Size=number_slider_16, Justification=7)
cir = Circle(Plane=xy_5, Radius=Slider(500, range=0..500))
crv = Curve(cir)
pframes_3 = PerpFrames(Curve=crv, Count=Slider(7, range=0..100), Align=True)  # -> Frames, Parameters
rectangle_3 = Rectangle(Plane=pframes_3.Frames, XSize=rectangle_dim, YSize=rectangle_dim, Radius=0)  # -> flatten(Rectangle), Length
getvertices_4 = CSharpScript(Breps=rectangle_3.Rectangle, Closed=Toggle(True))  # -> Vrt; inputs Breps: list of Brep, Closed: Boolean; same code as getvertices
load_type_8 = ValueList({"Uniform Pressure": "Pressure,P", "Surface Traction Shear": "Surface traction,TRSHR", "Surface Traction General": "Surface traction,TRVEC"}, selected="Uniform Pressure")  # disabled
meshpointsnurbssweep_4 = CSharpScript(
    Points=flatten(getvertices_4),
    Degree=Slider(1, range=1..19),
    Divisions=Slider(21, range=1..50),
    U=U,
    V=V,
    TooltipDescriptionOverride="Divisions longitudinally")  # -> Mesh, Srf, SourceSrf, TargetSrf, Orientation; inputs Points: list of Point3d, Degree: Int32, Divisions: Int32, U: Int32, V: Int32; same code as meshpointsnurbssweep_2
number_slider_17 = Slider(1, range=1..10)  # disabled
bcs_5 = ValueList({"U1": 1, "U2": 2, "U3": 3, "UR1": 4, "UR2": 5, "UR3": 6}, selected=["U1", "U2", "U3", "UR1", "UR2", "UR3"])  # disabled
isotropicalumaterial_2 = CSharpScript(
    TooltipDescriptionOverride="Default material: Aluminium, E=70000, PR=0.3",
    TooltipTextOverride="Isotropic Material. Alu default")  # -> Properties; inputs Material: String, E: Int32, PR: Double; disabled; same code as isotropicalumaterial
panel_17 = Panel("C3D8R")  # disabled
toggle_3 = BooleanToggle(False)  # disabled

# ----
# Creating different load
# /boundary condition sets
c_script = CSharpScript(U=U)  # -> A; inputs U: Int32; disabled
# ---------- c_script: C# ----------
    List < int> numbers = new List<int>();
    int start = 3;
    while (start <= ((U * 4) - 1))
    {
      numbers.Add(start);
      start = start + 4;
    }
    A = numbers;
# ---------- end c_script ----------
c_script_2 = CSharpScript(U=U, V=V)  # -> A; inputs U: Int32, V: Int32; disabled
# ---------- c_script_2: C# ----------
    List < int> numbers = new List<int>();
    int start = U * V * 4 - 3;
    int i = 0;
    while (i < U)
    {
      numbers.Add(start);
      start = start - 4;
      i++;
    }
    A = numbers;
# ---------- end c_script_2 ----------
branch = TreeBranch(Tree=meshpointsnurbssweep_4.Srf, Path=c_script, MaintainPaths=True)  # -> flatten(Branch); disabled
branch_2 = TreeBranch(Tree=meshpointsnurbssweep_4.Srf, Path=c_script_2, MaintainPaths=True)  # -> flatten(Branch); disabled
outside = BrepJoin(Breps=branch)  # -> Breps, Closed; disabled
inside = BrepJoin(Breps=branch_2)  # -> Breps, Closed; disabled

support_5 = CSharpScript(Face=inside.Breps, Conditions=bcs_5)  # -> Support; inputs ID: String, Tol: Double, Face: Brep, Conditions: list of String; disabled; same code as support
load_5 = CSharpScript(LoadType=load_type_8, Face=outside.Breps, MPaMagnitude=number_slider_17)  # -> Load; inputs ID: String, LoadType: String, Tol: Double, Face: Brep, DirVector: Vector3d, kNMagnitude: Double, MPaMagnitude: Double; disabled; same code as load
abaquspart_6 = CSharpScript(
    Mesh=meshpointsnurbssweep_4.Mesh,
    ElmntType=panel_17,
    Material=isotropicalumaterial_2,
    Support=support_5,
    Load=load_5,
    Run=toggle_3)  # -> Geometry, Part, Instance, Sets, BC, Steps; inputs ID: String, Mesh: tree, ElmntType: list of String, Material: list, Orientation: list of String, Support: tree, Load: tree, Tie: tree, Run: Boolean; disabled; same code as abaquspart_2
inpassembly_5 = CSharpScript(
    Part=flatten(abaquspart_6.Part),
    Instance=flatten(abaquspart_6.Instance),
    Sets=flatten(abaquspart_6.Sets),
    BC=flatten(abaquspart_6.BC),
    Material=isotropicalumaterial_2,
    Steps=flatten(abaquspart_6.Steps))  # -> INP; inputs ID: list of String, Job: list of String, Model: list of String, Part: list of String, Instance: list of String, Sets: list of String, BC: list of String, Material: list of String, Tie: list of String, Steps: list of String; disabled; same code as inpassembly
panel_18 = Panel(inpassembly_5)  # disabled

# ----
# Shell
divisions_longitudinally = Slider(5, range=0..100)
arch_divisions = Slider(10, range=0..60)
length_2 = Slider(4000, range=0..10000)
addition_3 = Addition(A=length_2, B="2000")
thickness_divisions = Slider(1, range=0..100)
perp_frame_count = Slider(10, range=0..100)
thickness = Slider(100, range=0..1000)
pt_5 = ConstructPoint(XCoordinate=0, YCoordinate=addition_3, ZCoordinate=0)
xz = XZPlane(Origin=pt_5)
arc = Arc(Plane=xz, Radius=Slider(2000, range=0..5000), Angle=Domain(0, 3.141592654))  # -> Arc, Length
pframes_4 = PerpFrames(Curve=arc.Arc, Count=perp_frame_count, Align=True)  # -> Frames, Parameters
rectangle_4 = Rectangle(Plane=pframes_4.Frames, XSize=thickness, YSize=length_2, Radius=0)  # -> Rectangle, Length
getvertices_5 = CSharpScript(Breps=rectangle_4.Rectangle)  # -> Vrt; inputs Breps: list of Brep, Closed: Boolean; same code as getvertices
item_2 = ListItem(List=getvertices_5, Index=0, Wrap=True)
meshpointsnurbssweep_5 = CSharpScript(
    Points=flatten(getvertices_5),
    Divisions=arch_divisions,
    U=divisions_longitudinally,
    V=thickness_divisions,
    TooltipDescriptionOverride="Divisions longitudinally")  # -> Mesh, Srf, SourceSrf, TargetSrf, Orientation; inputs Points: list of Point3d, Degree: Int32, Divisions: Int32, U: Int32, V: Int32
# ---------- meshpointsnurbssweep_5: C# ----------
    List<double> length = new List<double>();
    List <NurbsCurve> edgecrv = new List<NurbsCurve>();
    DataTree<NurbsCurve> edgecrvtree = new DataTree<NurbsCurve>();
    DataTree <Point3d> vrttree = new DataTree<Point3d>();
    DataTree <Point3d> vrtsectiontree = new DataTree<Point3d>();
    List <NurbsSurface> s = new List<NurbsSurface>();
    DataTree <System.Object> meshtree = new DataTree<System.Object>();


    //Default values if not specified, added 27.04
    if(Divisions == 0){Divisions = 1;};
    if(U == 0){U = 1;};
    if(V == 0){V = 1;};
    if(Degree == 0){Degree = 1;}

    // NurbsCurve crv = NurbsCurve.Create(false, Degree, PointsSource[1] PointsMid[1] PointsTarget[1]);
    DataTree<Point3d> clst = new DataTree<Point3d>(); //make ordered list to make curve
    //List <NurbsCurve> nrbs = new List<NurbsCurve>();
    Point3d ps;
    for (int i = 0;i < 4;i++)
    {
      GH_Path pthnr = new GH_Path(i);
      for (int j = i;j < Points.Count();j += 4) //if more midpoints
      {
        ps = Points[j];
        clst.Add(ps, pthnr);
      }
      edgecrv.Add(NurbsCurve.Create(false, Degree, clst.Branch(i)));
      length.Add(edgecrv[i].GetLength());
      //edgecrvtree.Add(NurbsCurve.Create(false, Degree, clst.Branch(i)), new GH_Path(i));
      vrttree.AddRange(edgecrv[i].DivideEquidistant(length[i] / Divisions), new GH_Path(i));
      vrttree.Add(Points[Points.Count() - 4 + i], new GH_Path(i));
      int listitem = 0;

      for (int j = 0; j < (Divisions + 1); j++)
      {
        vrtsectiontree.Add(vrttree.Branch(i)[listitem], new GH_Path(j));
        listitem++;
      }

    }
    //make surfaces
    //get beginning and end surface if needed for tie/boundary conditions or etc.
    int pnum = Points.Count();
    Brep ss = Brep.CreateFromCornerPoints(Points[0], Points[1], Points[2], Points[3], 0);
    Brep ts = Brep.CreateFromCornerPoints(Points[pnum - 4], Points[pnum - 3], Points[pnum - 2], Points[pnum - 1], 0);

    //get cross-sectional surfaces
    for (int j = 0; j < (Divisions + 1); j++)
    {
      s.Add(NurbsSurface.CreateFromCorners(vrtsectiontree.Branch(j)[0], vrtsectiontree.Branch(j)[1], vrtsectiontree.Branch(j)[2], vrtsectiontree.Branch(j)[3], 0));
    } // (branch number) [list number]


    DataTree<Brep> btree = new DataTree<Brep>();
    DataTree <Curve> loftcrv = new DataTree<Curve>(); //loft to get solid
    DataTree <Point3d> nodetree = new DataTree<Point3d>();


    for (int a = 0; a < (Divisions + 1); a++)
    {
      for (int i = 0; i < (V + 1); i++)
      {
        for (int j = 0; j < (U + 1); j++)
        {
          Point3d p = new Point3d(s[a].PointAt(s[a].Domain(0).Length / V * i, s[a].Domain(1).Length / U * j)); // v-value first, then u value, because domain(0) is v
          meshtree.Add(p, new GH_Path(0, 0)); //added 1704
          //meshtree.Add(p, new GH_Path(1, a)); //added1704 to get nodetree2 in same list
          nodetree.Add(p, new GH_Path(a, i));
        }
      }
    }

    for (int a = 0; a < (Divisions + 1); a++)
    {
      for (int i = 0; i < V; i++)
      {
        for (int j = 0; j < U; j++)
        {
          Brep b = Brep.CreateFromCornerPoints(nodetree.Branch(a, i)[j], nodetree.Branch(a, i + 1)[j], nodetree.Branch(a, i + 1)[j + 1], nodetree.Branch(a, i)[j + 1], 0);
          btree.Add(b, new GH_Path(a, i));
          //meshtree.Add(b, new GH_Path(2, a));
          meshtree.Add(b, new GH_Path(1, 0));
          loftcrv.AddRange(btree.Branch(a, i)[j].DuplicateEdgeCurves(), new GH_Path(a));
        }
      }
    }


    DataTree <Brep> srf = new DataTree<Brep>();
    for ( int i = 0; i < loftcrv.Branch(0).Count; i++)
    {
      for (int j = 0; j < Divisions; j++)
      {
        srf.AddRange(Brep.CreateFromLoft(new List<Curve>{loftcrv.Branch(0 + j)[i], loftcrv.Branch(1 + j)[i]}, Point3d.Unset, Point3d.Unset, LoftType.Normal, false), new GH_Path(i));
      }
    } // Surfaces in the middle are doubled


    //orientation


    Point3d p1 = new Point3d((Points[0].X + Points[1].X + Points[2].X + Points[3].X) / 4, (Points[0].Y + Points[1].Y + Points[2].Y + Points[3].Y) / 4, (Points[0].Z + Points[1].Z + Points[2].Z + Points[3].Z) / 4);
    Point3d p2 = new Point3d((Points[pnum - 4].X + Points[pnum - 3].X + Points[pnum - 2].X + Points[pnum - 1].X) / 4, (Points[pnum - 4].Y + Points[pnum - 3].Y + Points[pnum - 2].Y + Points[pnum - 3].Y) / 4, (Points[pnum - 4].Z + Points[pnum - 3].Z + Points[pnum - 2].Z + Points[pnum - 1].Z) / 4);

    List <string> orilist = new List<string>();

    Vector3d vec1 = p2 - p1; //longitudinal direction of timber cross-section central points = Direction 1
    vec1.Unitize();
    Plane nplan = new Plane(p1, vec1); //normal plane
    Vector3d vec2 = nplan.XAxis; // Second axis (unitized)

    double x1 = vec1.X;
    double y1 = vec1.Y;
    double z1 = vec1.Z;

    double x2 = vec2.X;
    double y2 = vec2.Y;
    double z2 = vec2.Z;

    double cx = p1.X;
    double cy = p1.Y;
    double cz = p1.Z;

    //Add orientation (for orthotropic material)
    orilist.Add("Ori-1");
    orilist.Add("*Orientation, name=Ori-1");
    orilist.Add(string.Format("{0}, {1}, {2}, {3}, {4}, {5}, {6}, {7}, {8}", x1, z1, y1, x2, z2, y2, cx, cz, cy)); //changed y z due to abaqus/rhino different axis systems
    orilist.Add("1, 0"); // 1,0. 1 means primary axis (x), 0 means no rotation

    //add divisions, u and v to be used further to end of mesh tree
    GH_Path pth = new GH_Path(2, 0);
    meshtree.Add(Divisions, pth); //number of divisions
   // meshtree.Add((U + 1) * (V + 1), pth); // number of nodes per branch
    meshtree.Add(U * V, pth); //number of surfaces per branch


    //    Srf = srf;
    Mesh = meshtree;
    Srf = srf;
    SourceSrf = ss;
    TargetSrf = ts;
    Orientation = orilist;
# ---------- end meshpointsnurbssweep_5 ----------
load_type_9 = ValueList({"Uniform Pressure": "Pressure,P", "Surface Traction Shear": "Surface traction,TRSHR", "Surface Traction General": "Surface traction,TRVEC"}, selected="Uniform Pressure")  # disabled
bcs_6 = ValueList({"U1": 1, "U2": 2, "U3": 3, "UR1": 4, "UR2": 5, "UR3": 6}, selected=["U1", "U2", "U3", "UR1", "UR2", "UR3"])  # disabled
number_slider_18 = Slider(1, range=0..1)  # disabled
panel_19 = Panel("""support1
support2""")  # disabled
isotropicmaterial_4 = CSharpScript(
    TooltipDescriptionOverride="Default material: Steel, E=210000, PR=0.3",
    TooltipTextOverride="Isotropic Material. Steel default")  # -> Properties; inputs Material: String, E: Int32, PR: Double; disabled; same code as isotropicmaterial
support_6 = CSharpScript(ID=panel_19, Face=[meshpointsnurbssweep_5.SourceSrf, meshpointsnurbssweep_5.TargetSrf], Conditions=bcs_6)  # -> Support; inputs ID: String, Tol: Double, Face: Brep, Conditions: list of String; disabled
# ---------- support_6: C# ----------
    //Create output tree
    DataTree <System.Object> tree = new DataTree<System.Object>();
    ///////////////////////////////////////////////////////////////////////////////////////
    ///////////////////////////////////////////////////////////////////////////////////////
    //Add surface and ID to be used in Part component
    tree.Add(Face, new GH_Path(0));
    tree.Add(ID, new GH_Path(2));
    ///////////////////////////////////////////////////////////////////////////////////////
    ///////////////////////////////////////////////////////////////////////////////////////
    //Add conditions to be exported in INP
    for( int i = 0; i < Conditions.Count(); i++)
    {
      if(Conditions[i] == "U1" || Conditions[i] == "1")
      {
        tree.Add(string.Format("{0}, 1, 1", ID), new GH_Path(1));
      }
      if(Conditions[i] == "U2" || Conditions[i] == "2")
      {
        tree.Add(string.Format("{0}, 2, 2", ID), new GH_Path(1));
      }
      if(Conditions[i] == "U3" || Conditions[i] == "3")
      {
        tree.Add(string.Format("{0}, 3, 3", ID), new GH_Path(1));
      }
      if(Conditions[i] == "UR1" || Conditions[i] == "4")
      {
        tree.Add(string.Format("{0}, 4, 4", ID), new GH_Path(1));
      }
      if(Conditions[i] == "UR2" || Conditions[i] == "5")
      {
        tree.Add(string.Format("{0}, 5, 5", ID), new GH_Path(1));
      }
      if(Conditions[i] == "UR3" || Conditions[i] == "6")
      {
        tree.Add(string.Format("{0}, 6, 6", ID), new GH_Path(1));
      }

    }
    ///////////////////////////////////////////////////////////////////////////////////////
    ///////////////////////////////////////////////////////////////////////////////////////
    //Add tolerance for pointcompare
    if(Tol == 0)
    {
      tree.Add(0.001, new GH_Path(3));
    }
    else
    {
      tree.Add(Tol, new GH_Path(3));
    }

    Support = tree;
# ---------- end support_6 ----------
load_6 = CSharpScript(LoadType=load_type_9, MPaMagnitude=number_slider_18)  # -> Load; inputs ID: String, LoadType: String, Tol: Double, Face: Brep, DirVector: Vector3d, kNMagnitude: Double, MPaMagnitude: Double; disabled; same code as load
panel_20 = Panel("C3D8R")  # disabled
panel_21 = Panel("Arch")  # disabled
toggle_4 = BooleanToggle(False)  # disabled
abaquspart_7 = CSharpScript(
    ID=panel_21,
    Mesh=meshpointsnurbssweep_5.Mesh,
    ElmntType=panel_20,
    Material=isotropicmaterial_4,
    Support=support_6,
    Load=load_6,
    Run=toggle_4)  # -> Geometry, Part, Instance, Sets, BC, Steps; inputs ID: String, Mesh: tree, ElmntType: list of String, Material: list, Orientation: list of String, Support: tree, Load: tree, Tie: tree, Run: Boolean; disabled
# ---------- abaquspart_7: C# ----------
    //oppdatert 0306
    //Declare variables;
    Point3d Crd;
    string Nr, X, Y, Z;

    //Create output tree;
    DataTree <Curve> Crvs = new DataTree<Curve>();
    DataTree <Point3d> Elements = new DataTree<Point3d>();
    DataTree <System.Object> GeoTree = new DataTree<System.Object>();
    DataTree <string> Inf = new DataTree<string>();
    DataTree <int> Tick = new DataTree<int>();
    DataTree <int> Tock = new DataTree<int>();

    //Create Lists;
    List< Point3d > Vertices = new List<Point3d>();
    List< Point3d > Nds = new List<Point3d>();
    List< Brep > Srf = new List<Brep>();
    List< Brep > ObjList = new List<Brep>();
    List< string > PrtLst = new List<string>();
    List< string > SetLst = new List<string>();
    List< string > InsLst = new List<string>();
    List< string > BCLst = new List<string>();
    List< string > StpLst = new List<string>();
    List< string > ElNr = new List<string>();
    List<Brep> SupLst = new List<Brep>();
    List<double> TolSupLst = new List<double>();
    List<Brep> DisLst = new List<Brep>();
    List<double> TolDisLst = new List<double>();
    List<Brep> LdLst = new List<Brep>();
    List<double> TolLdLst = new List<double>();
    List<Brep> TieLst = new List<Brep>();
    List<double> TolTieLst = new List<double>();

    ////////////////////////////////////////////////////////////////////////////////////
    //Sorts number of meshes into correct lists so that it is possible to assign different values of v,u and div to each mesh and merge meshes into same part
    List<Point3d> nodelist = new List<Point3d>();
    DataTree<Point3d> nodetree = new DataTree<Point3d>();
    DataTree<Brep> breps = new DataTree<Brep>();

    for (int i = 0; i < Mesh.Branch(0, 0).Count(); i++)
    {
      Point3d n = (Point3d) Mesh.Branch(0, 0)[i];
      nodelist.Add(n);
    }

    int div, numbr;
    int startlocb = 0; //startindex of brep
    int count = 0; //count to get correct assignment of div,numnb,numbr;
    for (int j = 0; j < (Mesh.Branch(2, 0).Count() / 2) ; j++) //number of meshes
    {
      div = (int) Mesh.Branch(2, 0)[count]; //divisions j mesh
      numbr = (int) Mesh.Branch(2, 0)[count + 1]; //number of surfaces in each division
      for (int k = 0; k < (div + 1); k++)
      {
        for (int p = startlocb; p < (startlocb + numbr); p++)
        {
          Brep bb = (Brep) Mesh.Branch(1, 0)[p];
          breps.Add(bb, new GH_Path(j, k));
        }
        for (int q = 0; q < numbr; q++)
        {
          Elements.AddRange(breps.Branch(j, k)[q].DuplicateVertices(), new GH_Path(j, k, q));
        }
        startlocb = startlocb + numbr; //make next location
      }
      count = count + 2; //to get next mesh's division and number of surfaces.
    }



    ///////////////////////////////////////////////////////////////////////////////////////
    ///////////////////////////////////////////////////////////////////////////////////////

    if (Run)
    {
      //Discretize the data of the Part;
      PrtLst.Add(string.Format("*Part, name={0}", ID));
      //Nodes of the Part;
      PrtLst.Add("*Node");

      Nds.AddRange(Point3d.CullDuplicates(nodelist, doc.ModelAbsoluteTolerance)); //remove duplicate node points
      for ( int i = 0; i < Nds.Count; i++)
      {
        Nr = (i + 1).ToString();
        Crd = Nds[i];
        X = Crd.X.ToString();
        Y = Crd.Y.ToString();
        Z = Crd.Z.ToString();
        PrtLst.Add(Nr + ", " + X + ", " + Z + ", " + Y);
      }
      //Sort element Nodes and identify faces which is supported or loaded;
      PrtLst.Add(string.Format("*Element, type={0}", ElmntType[0]));

      //If Load, import input for load;
      if ( Load.PathExists(0) )
      {
        double TolLd;
        Brep LdSrf = new Brep();
        for (int i = 0; i < Load.Branch(0).Count(); i++)
        {
          GH_Convert.ToBrep(Load.Branch(0)[i], ref LdSrf, Grasshopper.Kernel.GH_Conversion.Both);
          GH_Convert.ToDouble(Load.Branch(3)[i], out TolLd, GH_Conversion.Both);
          TolLdLst.Add(TolLd);
          LdLst.Add(LdSrf);
        }
      }
      //If Tie, import input for tie;
      if ( Tie.PathExists(0) )
      {
        double TolTie;
        Brep TieSrf = new Brep();
        for (int i = 0; i < Tie.Branch(0).Count(); i++)
        {
          GH_Convert.ToBrep(Tie.Branch(0)[i], ref TieSrf, Grasshopper.Kernel.GH_Conversion.Both);
          GH_Convert.ToDouble(Tie.Branch(2)[i], out TolTie, GH_Conversion.Both);
          TolTieLst.Add(TolTie);
          TieLst.Add(TieSrf);
        }
      }

      //Make list of elements, identify load and tie
      int count2 = 0; //To get the correct assignment of divisions, number of breps for each mesh
      int count3 = 1; //Begin at element 1 in Abaqus

      for (int f = 0; f < (Mesh.Branch(2, 0).Count() / 2) ; f++) //number of meshes
      {
        int div2 = (int) Mesh.Branch(2, 0)[count2]; //divisions of f mesh
        int numbr2 = (int) Mesh.Branch(2, 0)[count2 + 1]; //numbers of breps in each division

        for (int g = 0; g < div2; g++)
        {
          for (int h = 0; h < numbr2; h++)
          {
            ElNr.Add(count3.ToString());
            for ( int k = 0; k < Elements.Branch(f, g, h).Count; k++)
            {
              for ( int l = 0; l < Nds.Count; l++)
              {
                if ( PtCmp(Elements.Branch(f, g, h)[k], Nds[l]))
                {
                  ElNr.Add((l + 1).ToString());
                }
              } //4 first corners
            }
            for ( int k = 0; k < Elements.Branch(f, g, h).Count; k++)
            {
              for ( int l = 0; l < Nds.Count; l++)
              {
                if ( PtCmp(Elements.Branch(f, g + 1, h)[k], Nds[l]))
                {
                  ElNr.Add((l + 1).ToString());
                }
              } //4 second corners

              //identify if srf is loaded
              if ( Load.PathExists(0) )
              {
                for (int m = 0; m < Load.Branch(0).Count; m++)
                {
                  Tick.EnsurePath(m);
                  if ( IdenSet(LdLst[m], Elements.Branch(f, g, h)[k], TolLdLst[m]))
                  {
                    Tick.Add(k + 1, new GH_Path(m));
                    if (Tick.Branch(m).Count == 4)
                    {
                      Inf.Add((count3).ToString() + ",", new GH_Path(1, m, 2));
                      Inf.Add(SrfInd(Tick.Branch(m)).ToString(), new GH_Path(1, m, 3));
                    }
                  }
                  if ( IdenSet(LdLst[m], Elements.Branch(f, g + 1, h)[k], TolLdLst[m]))
                  {
                    Tick.Add(k + 5, new GH_Path(m));
                    if (Tick.Branch(m).Count == 4)
                    {
                      Inf.Add((count3).ToString() + ",", new GH_Path(1, m, 2));
                      Inf.Add(SrfInd(Tick.Branch(m)).ToString(), new GH_Path(1, m, 3));
                    }
                  }
                }
              } //end load Path

              //identify if nodes are tied
              if ( Tie.PathExists(0) )
              {
                for (int m = 0; m < Tie.Branch(0).Count; m++)
                {
                  Tock.EnsurePath(m);
                  if ( IdenSet(TieLst[m], Elements.Branch(f, g, h)[k], TolTieLst[m]))
                  {
                    Tock.Add(k + 1, new GH_Path(m));
                    if (Tock.Branch(m).Count == 4)
                    {
                      Inf.Add((count3).ToString() + ",", new GH_Path(1, m, 4));
                      Inf.Add(SrfInd(Tock.Branch(m)).ToString(), new GH_Path(1, m, 5));
                    }
                  }
                  if ( IdenSet(TieLst[m], Elements.Branch(f, g + 1, h)[k], TolTieLst[m]))
                  {
                    Tock.Add(k + 5, new GH_Path(m));
                    if (Tock.Branch(m).Count == 4)
                    {
                      Inf.Add((count3).ToString() + ",", new GH_Path(1, m, 4));
                      Inf.Add(SrfInd(Tock.Branch(m)).ToString(), new GH_Path(1, m, 5));
                    }
                  }
                }
              } //end tie
            }

            PrtLst.Add(String.Join(",  ", ElNr.ToArray()));
            count3 = count3 + 1;
            ElNr.Clear();
            Tick.ClearData();
            Tock.ClearData();
          }
        }
        count2 = count2 + 2;
      }


      //Identify nodes on supported face;
      if ( Support.PathExists(0) )
      {
        double TolSup;
        Brep SupSrf = new Brep();
        for (int i = 0; i < Support.Branch(0).Count(); i++)
        {
          GH_Convert.ToBrep(Support.Branch(0)[i], ref SupSrf, Grasshopper.Kernel.GH_Conversion.Both);
          GH_Convert.ToDouble(Support.Branch(3)[i], out TolSup, GH_Conversion.Both);
          TolSupLst.Add(TolSup);
          SupLst.Add(SupSrf);
        }
        for (int i = 0; i < Nds.Count; i++)
        {
          for (int j = 0; j < Support.Branch(0).Count; j++)
          {
            if ( IdenSet(SupLst[j], Nds[i], TolSupLst[j]) )
            {
              Inf.Add((i + 1).ToString() + ",", new GH_Path(0, j, 1));
              GeoTree.Add(Nds[i].X.ToString(), new GH_Path(2, j, 0));
              GeoTree.Add(Nds[i].Y.ToString(), new GH_Path(2, j, 1));
              GeoTree.Add(Nds[i].Z.ToString(), new GH_Path(2, j, 2));
            }
          }
        }
      }

      ///////////////////////////////////////////////////////////////////////////////////////
      ///////////////////////////////////////////////////////////////////////////////////////
      //Create sets of nodes;
      PrtLst.Add("*Nset, nset=Set-1, generate");
      PrtLst.Add(string.Format("   1,    {0},    1", Nds.Count));
      //Create sets of elements;
      PrtLst.Add("*Elset, elset=Set-1, generate");
      PrtLst.Add(string.Format("   1,    {0},    1", count3 - 1));

      //Add orientation (for orthotropic material) 30.04

      if ( (Orientation != null) && (!Orientation.Any()) ) //if the list is empty
      {
        PrtLst.Add(string.Format("**Section: {0}_section", ID));
        PrtLst.Add(string.Format("*Solid Section, elset=Set-1, material={0}", Material[0]));
      }
      else
      {
        PrtLst.Add(Orientation[1]);
        PrtLst.Add(Orientation[2]);
        PrtLst.Add(Orientation[3]);
        PrtLst.Add(string.Format("**Section: {0}_section", ID));
        PrtLst.Add(string.Format("*Solid Section, elset=Set-1, orientation=Ori-1, material={0}", Material[0]));
      }

      PrtLst.Add(",");
      //Finish defining Part;
      PrtLst.Add("*End Part");
      PrtLst.Add("**");
      //Create instance of the part;
      InsLst.Add(string.Format("*Instance, name={0}, part={0}", ID));
      InsLst.Add("*End Instance");
      InsLst.Add("**");
      //BC; Add nodes on supported Face;
      if ( Inf.PathExists(0, 0, 1) )
      {
        for (int i = 0; i < Support.Branch(0).Count; i++)
        {
          SetLst.Add(string.Format("*Nset, nset={0}, instance={1}", Support.Branch(2)[i], ID));
          for (int j = 0; j < Inf.Branch(0, i, 1).Count; j++)
          {
            SetLst.Add(Inf.Branch(0, i, 1)[j]);
          }
        }
      }
      //Add elements on tied face;
      if ( Inf.PathExists(1, 0, 4) )
      {
        for (int i = 0; i < Tie.Branch(0).Count; i++)
        {
          SetLst.Add(string.Format("*Elset, elset={0}-{1}-TieSrf, internal, instance={1}", Tie.Branch(1)[i], ID));
          for (int j = 0; j < Inf.Branch(1, i, 4).Count; j++)
          {
            SetLst.Add(Inf.Branch(1, i, 4)[j]);
          }
        }
      }
      //Define tie surface;
      if ( Inf.PathExists(1, 0, 5) )
      {
        for (int i = 0; i < Tie.Branch(0).Count; i++)
        {
          SetLst.Add(string.Format("*Surface, type=ELEMENT, name={0}-{1}-TieSrf", Tie.Branch(1)[i], ID));
          SetLst.Add(string.Format("{0}-{1}-TieSrf, S{2}", Tie.Branch(1)[i], ID, Inf.Branch(1, i, 5)[0]));
        }
      }
      //Add elements on loaded face;
      if ( Inf.PathExists(1, 0, 2) )
      {
        for (int i = 0; i < Load.Branch(0).Count; i++)
        {
          SetLst.Add(string.Format("*Elset, elset={0}-Surf, internal, instance={1}", Load.Branch(2)[i], ID));
          for (int j = 0; j < Inf.Branch(1, i, 2).Count; j++)
          {
            SetLst.Add(Inf.Branch(1, i, 2)[j]);
          }
        }
      }
      //Define load surface;
      if ( Inf.PathExists(1, 0, 2) )
      {
        for (int i = 0; i < Load.Branch(0).Count; i++)
        {
          SetLst.Add(string.Format("*Surface, type=ELEMENT, name={0}", Load.Branch(2)[i]));
          SetLst.Add(string.Format("{0}-Surf, S{1}", Load.Branch(2)[i], Inf.Branch(1, i, 3)[0]));
        }
      }
      //Boundary conditions;
      if ( Support.PathExists(0) )
      {
        for (int i = 0; i < Support.Branch(1).Count; i++)
        {
          BCLst.Add(string.Format("{0}", Support.Branch(1)[i]));
        }
      }
      //Steps;
      if ( Load.PathExists(0) )
      {
        for (int i = 0; i < Load.Branch(1).Count; i++)
        {
          StpLst.Add(string.Format("{0}", Load.Branch(1)[i]));;
        }
      }

    }
    Geometry = GeoTree;
    Part = PrtLst;
    Instance = InsLst;
    Sets = SetLst;
    BC = BCLst;
    Steps = StpLst;
# ---------- abaquspart_7: C# additional code ----------
  public int SrfInd(List < int > N)
  {
    int Indx;

    if (!N.Except(new List<int>{ 1, 2, 3, 4 }).Any() && N.Count == 4)
    {
      Indx = 1;
    }
    else if(!N.Except(new List<int>{ 5, 6, 7, 8 }).Any() && N.Count == 4)
    {
      Indx = 2;
    }
    else if(!N.Except(new List<int>{ 1, 2, 5, 6 }).Any() && N.Count == 4)
    {
      Indx = 3;
    }
    else if(!N.Except(new List<int>{ 2, 3, 6, 7 }).Any() && N.Count == 4)
    {
      Indx = 4;
    }
    else if(!N.Except(new List<int>{ 3, 4, 7, 8 }).Any() && N.Count == 4)
    {
      Indx = 5;
    }
    else
    {
      Indx = 6;
    }
    return Indx;
  }

  public bool IdenSet(Brep Srf, Point3d Nd, double Tol)
  {
    bool Truth;
    Point3d Pt = Srf.ClosestPoint(Nd);
    Vector3d Vct = Pt - Nd;

    if (Vct.Length < Tol)
    {
      Truth = true;
    }
    else
    {
      Truth = false;
    }
    return Truth;
  }

  public bool PtCmp(Point3d ElNd, Point3d Nd)
  {
    bool Truth;
    Vector3d Vct = ElNd - Nd;

    if (Vct.Length < doc.ModelAbsoluteTolerance)
    {
      Truth = true;
    }
    else
    {
      Truth = false;
    }
    return Truth;
  }
# ---------- end abaquspart_7 ----------
inpassembly_6 = CSharpScript(
    Part=flatten(abaquspart_7.Part),
    Instance=flatten(abaquspart_7.Instance),
    Sets=flatten(abaquspart_7.Sets),
    BC=flatten(abaquspart_7.BC),
    Material=isotropicmaterial_4,
    Steps=flatten(abaquspart_7.Steps))  # -> INP; inputs ID: list of String, Job: list of String, Model: list of String, Part: list of String, Instance: list of String, Sets: list of String, BC: list of String, Material: list of String, Tie: list of String, Steps: list of String; disabled; same code as inpassembly
panel_22 = Panel(inpassembly_6)  # disabled

move_6 = Move(Geometry=item_2, Motion=X_2)  # -> Geometry, Transform

xy_6 = XYPlane(Origin=move_6.Geometry)
tag_5 = TextTag3D(Location=xy_6, Text="Shell", Size=Slider(100, range=0..300), Justification=7)

# ----
# Creating different load surface sets
_4_sides_of_surfaces = Panel("4")  # disabled
panel_23 = Panel("2")  # disabled
division = Division(A=arch_divisions, B=panel_23)  # disabled
multiplication = Multiplication(A=divisions_longitudinally, C=_4_sides_of_surfaces)  # disabled
c_script_3 = CSharpScript(srf=multiplication)  # -> A; inputs srf: Int32; disabled
# ---------- c_script_3: C# ----------
    List < int> numbers = new List<int>();
    int start = 3;
    while (start <= (srf - 1))
    {
      numbers.Add(start);
      start = start + 4;
    }
    A = numbers;
# ---------- end c_script_3 ----------
series = Series(Start=0, Step=panel_23, Count=divisions_longitudinally)  # disabled
branch_3 = TreeBranch(Tree=meshpointsnurbssweep_5.Srf, Path=c_script_3, MaintainPaths=True)  # -> flatten(Branch); disabled
partition = PartitionList(List=branch_3, Size=division)  # -> simplify(Chunks); disabled
halfroof = TreeBranch(Tree=partition, Path=series, MaintainPaths=True)  # -> flatten(Branch); disabled
halfsurface = BrepJoin(Breps=halfroof)  # -> Breps, Closed; disabled
wholesurface = BrepJoin(Breps=branch_3)  # -> Breps, Closed; disabled

# ----
# I-Beam
number_slider_19 = Slider(100, range=0..100)
panel_24 = Panel("""0
3""")
panel_25 = Panel("""1
2""")
X_6 = UnitX(Factor=length)
rectangleyzrev_3 = CSharpScript(Cntr="{1000,1000,0}", W=width_web, H=height_web)  # -> Rcntr, Pts; inputs Cntr: Point3d, W: Double, H: Double; same code as rectangleyzrev
item_3 = ListItem(List=rectangleyzrev_3.Pts, Index=panel_24, Wrap=True)
multiplication_2 = Multiplication(A=height_flange, B="-1")
item_4 = ListItem(List=rectangleyzrev_3.Pts, Index=panel_25, Wrap=True)
Z = UnitZ(Factor=height_flange)
subtraction = Subtraction(A=width_flange, B=width_web)
Z_2 = UnitZ(Factor=multiplication_2)
move_7 = Move(Geometry=item_4, Motion=Z)  # -> Geometry, Transform
move_8 = Move(Geometry=item_3, Motion=Z_2)  # -> Geometry, Transform
move_9 = Move(Geometry=rectangleyzrev_3.Pts, Motion=X_6)  # -> Geometry, Transform
cnt_2 = CSharpScript(Pts=move_9.Geometry, TooltipDescriptionOverride="Center point from 4 points", TooltipTextOverride="Center Point")  # -> Cnt; inputs Pts: list of Point3d
# ---------- cnt_2: C# ----------
    Point3d cnt = new Point3d((Pts[0].X + Pts[1].X + Pts[2].X + Pts[3].X) / 4, (Pts[0].Y + Pts[1].Y + Pts[2].Y + Pts[3].Y) / 4, (Pts[0].Z + Pts[1].Z + Pts[2].Z + Pts[3].Z) / 4); //central point
    Cnt = cnt;
# ---------- end cnt_2 ----------
division_2 = Division(A=subtraction, B="-2")
division_3 = Division(A=subtraction, B="2")
sortptsyz_2 = CSharpScript(
    UPts=[item_4, move_7.Geometry],
    TooltipDescriptionOverride="Sort 4 points counter clockwise ",
    TooltipTextOverride="Sort")  # -> SPts; inputs UPts: list of Point3d
# ---------- sortptsyz_2: C# ----------
    Point3d[] pointarray = UPts.ToArray();
    Point3d cnt = new Point3d((UPts[0].X + UPts[1].X + UPts[2].X + UPts[3].X) / 4, (UPts[0].Y + UPts[1].Y + UPts[2].Y + UPts[3].Y) / 4, (UPts[0].Z + UPts[1].Z + UPts[2].Z + UPts[3].Z) / 4); //central point

    double[] angles = new double[pointarray.Length];

    for (int i = 0; i < pointarray.Length; i++)
    {
      angles[i] = Math.Atan2((pointarray[i].Z - cnt.Z), (pointarray[i].Y - cnt.Y));
    }
    Array.Sort(angles, pointarray);

    List < Point3d > sorted = new List <Point3d>();
    sorted.Add(pointarray[1]); //to get correct listing
    sorted.Add(pointarray[2]);
    sorted.Add(pointarray[3]);
    sorted.Add(pointarray[0]);
    sorted.Reverse();



    SPts = sorted;
# ---------- end sortptsyz_2 ----------
sortptsyz_3 = CSharpScript(
    UPts=[item_3, move_8.Geometry],
    TooltipDescriptionOverride="Sort 4 points counter clockwise ",
    TooltipTextOverride="Sort")  # -> SPts; inputs UPts: list of Point3d; same code as sortptsyz_2
panel_26 = Panel("""2
3""")
move_10 = Move(Geometry=sortptsyz_3, Motion=X_6)  # -> Geometry, Transform
move_11 = Move(Geometry=sortptsyz_2, Motion=X_6)  # -> Geometry, Transform
panel_27 = Panel("""0
1""")
item_5 = ListItem(List=sortptsyz_2, Index=panel_26, Wrap=True)
item_6 = ListItem(List=sortptsyz_2, Index=panel_27, Wrap=True)
panel_28 = Panel("""2
3""")
panel_29 = Panel("""0
1""")
item_7 = ListItem(List=sortptsyz_3, Index=panel_28, Wrap=True)
item_8 = ListItem(List=sortptsyz_3, Index=panel_29, Wrap=True)
Y = UnitY(Factor=division_2)
Y_2 = UnitY(Factor=division_3)
move_12 = Move(Geometry=item_6, Motion=Y)  # -> Geometry, Transform
Y_3 = UnitY(Factor=division_2)
move_13 = Move(Geometry=item_5, Motion=Y_2)  # -> Geometry, Transform
Y_4 = UnitY(Factor=division_3)
sortptsyz_4 = CSharpScript(
    UPts=[move_13.Geometry, item_5],
    TooltipDescriptionOverride="Sort 4 points counter clockwise ",
    TooltipTextOverride="Sort")  # -> SPts; inputs UPts: list of Point3d; same code as sortptsyz_2
sortptsyz_5 = CSharpScript(
    UPts=[item_6, move_12.Geometry],
    TooltipDescriptionOverride="Sort 4 points counter clockwise ",
    TooltipTextOverride="Sort")  # -> SPts; inputs UPts: list of Point3d; same code as sortptsyz_2
move_14 = Move(Geometry=item_8, Motion=Y_3)  # -> Geometry, Transform
move_15 = Move(Geometry=item_7, Motion=Y_4)  # -> Geometry, Transform
item_9 = ListItem(List=sortptsyz_4, Index="2", Wrap=True)
move_16 = Move(Geometry=sortptsyz_5, Motion=X_6)  # -> Geometry, Transform
item_10 = ListItem(List=sortptsyz_5, Index="1", Wrap=True)
sortptsyz_6 = CSharpScript(
    UPts=[move_15.Geometry, item_7],
    TooltipDescriptionOverride="Sort 4 points counter clockwise ",
    TooltipTextOverride="Sort")  # -> SPts; inputs UPts: list of Point3d; same code as sortptsyz_2
sortptsyz_7 = CSharpScript(
    UPts=[item_8, move_14.Geometry],
    TooltipDescriptionOverride="Sort 4 points counter clockwise ",
    TooltipTextOverride="Sort")  # -> SPts; inputs UPts: list of Point3d; same code as sortptsyz_2
move_17 = Move(Geometry=sortptsyz_4, Motion=X_6)  # -> Geometry, Transform
item_11 = ListItem(List=move_17.Geometry, Index="2", Wrap=True)
item_12 = ListItem(List=move_16.Geometry, Index="1", Wrap=True)
move_18 = Move(Geometry=sortptsyz_6, Motion=X_6)  # -> Geometry, Transform
move_19 = Move(Geometry=sortptsyz_7, Motion=X_6)  # -> Geometry, Transform
item_13 = ListItem(List=sortptsyz_6, Index="3", Wrap=True)
item_14 = ListItem(List=sortptsyz_7, Index="0", Wrap=True)
loadsrf = CSharpScript(
    Pts=[item_9, item_10, item_12, item_11],
    TooltipDescriptionOverride="Points must be sorted correctly",
    TooltipTextOverride="From 4 corner points to surface. Or list of corner points to list of surfaces")  # -> Srf; inputs Pts: list of Point3d; same code as ptstosrf
bottomflangemid = CSharpScript(
    PointsSource=sortptsyz_3,
    PointsTarget=move_10.Geometry,
    Divisions=longitudinal_divisions,
    U=u_web,
    V=v_flange,
    TooltipDescriptionOverride="Divisions longitudinally")  # -> Mesh, Srf, SourceSrf, TargetSrf, Orientation; inputs PointsSource: list of Point3d, PointsTarget: list of Point3d, Divisions: Int32, U: Int32, V: Int32; same code as meshpointssweep_3
topflangemid = CSharpScript(
    PointsSource=sortptsyz_2,
    PointsTarget=move_11.Geometry,
    Divisions=longitudinal_divisions,
    U=u_web,
    V=v_flange,
    TooltipDescriptionOverride="Divisions longitudinally")  # -> Mesh, Srf, SourceSrf, TargetSrf, Orientation; inputs PointsSource: list of Point3d, PointsTarget: list of Point3d, Divisions: Int32, U: Int32, V: Int32; same code as meshpointssweep_3
topflange2 = CSharpScript(
    PointsSource=sortptsyz_5,
    PointsTarget=move_16.Geometry,
    Divisions=longitudinal_divisions,
    U=u_flange,
    V=v_flange,
    TooltipDescriptionOverride="Divisions longitudinally")  # -> Mesh, Srf, SourceSrf, TargetSrf, Orientation; inputs PointsSource: list of Point3d, PointsTarget: list of Point3d, Divisions: Int32, U: Int32, V: Int32; same code as meshpointssweep_3
web = CSharpScript(
    PointsSource=rectangleyzrev_3.Pts,
    PointsTarget=move_9.Geometry,
    Divisions=longitudinal_divisions,
    U=u_web,
    V=v_web,
    TooltipDescriptionOverride="Divisions longitudinally")  # -> Mesh, Srf, SourceSrf, TargetSrf, Orientation; inputs PointsSource: list of Point3d, PointsTarget: list of Point3d, Divisions: Int32, U: Int32, V: Int32; same code as meshpointssweep_3
bottomflange2 = CSharpScript(
    PointsSource=sortptsyz_7,
    PointsTarget=move_19.Geometry,
    Divisions=longitudinal_divisions,
    U=u_flange,
    V=v_flange,
    TooltipDescriptionOverride="Divisions longitudinally")  # -> Mesh, Srf, SourceSrf, TargetSrf, Orientation; inputs PointsSource: list of Point3d, PointsTarget: list of Point3d, Divisions: Int32, U: Int32, V: Int32; same code as meshpointssweep_3
bottomflange1 = CSharpScript(
    PointsSource=sortptsyz_6,
    PointsTarget=move_18.Geometry,
    Divisions=longitudinal_divisions,
    U=u_flange,
    V=v_flange,
    TooltipDescriptionOverride="Divisions longitudinally")  # -> Mesh, Srf, SourceSrf, TargetSrf, Orientation; inputs PointsSource: list of Point3d, PointsTarget: list of Point3d, Divisions: Int32, U: Int32, V: Int32; same code as meshpointssweep_3
topflange1 = CSharpScript(
    PointsSource=sortptsyz_4,
    PointsTarget=move_17.Geometry,
    Divisions=longitudinal_divisions,
    U=u_flange,
    V=v_flange,
    TooltipDescriptionOverride="Divisions longitudinally")  # -> Mesh, Srf, SourceSrf, TargetSrf, Orientation; inputs PointsSource: list of Point3d, PointsTarget: list of Point3d, Divisions: Int32, U: Int32, V: Int32; same code as meshpointssweep_3
pt_6 = Point([item_10, item_9, item_13, item_14])  # disabled
support_7 = CSharpScript(
    Pts=pt_6,
    TooltipDescriptionOverride="Points must be sorted correctly",
    TooltipTextOverride="From 4 corner points to surface. Or list of corner points to list of surfaces")  # -> Srf; inputs Pts: list of Point3d; disabled; same code as ptstosrf
load_type_10 = ValueList({"Uniform Pressure": "Pressure,P", "Surface Traction Shear": "Surface traction,TRSHR", "Surface Traction General": "Surface traction,TRVEC"}, selected="Uniform Pressure")
hexahedron_8 = ValueList({"Full integration": "C3D8", "Reduced Integration": "C3D8R", "Incompatible Modes": "C3D8I"}, selected="Reduced Integration")  # disabled
bcs_7 = ValueList({"U1": 1, "U2": 2, "U3": 3, "UR1": 4, "UR2": 5, "UR3": 6}, selected=["U1", "U2", "U3", "UR1", "UR2", "UR3"])  # disabled
number_slider_20 = Slider(10, range=0..500)  # disabled
isotropicmaterial_5 = CSharpScript(
    TooltipDescriptionOverride="Default material: Steel, E=210000, PR=0.3",
    TooltipTextOverride="Isotropic Material. Steel default")  # -> Properties; inputs Material: String, E: Int32, PR: Double; disabled; same code as isotropicmaterial
panel_30 = Panel("Ibeam")  # disabled
support_8 = CSharpScript(Face=support_7, Conditions=bcs_7)  # -> Support; inputs ID: String, Tol: Double, Face: Brep, Conditions: list of String; disabled; same code as support
toggle_5 = BooleanToggle(False)  # disabled
load_7 = CSharpScript(LoadType=load_type_10, Face=loadsrf, kNMagnitude=number_slider_20)  # -> Load; inputs ID: String, LoadType: String, Tol: Double, Face: Brep, DirVector: Vector3d, kNMagnitude: Double, MPaMagnitude: Double; disabled; same code as load
abaquspart_8 = CSharpScript(
    ID=panel_30,
    Mesh=[web.Mesh, topflangemid.Mesh, bottomflangemid.Mesh, topflange1.Mesh, topflange2.Mesh, bottomflange1.Mesh, bottomflange2.Mesh],
    ElmntType=hexahedron_8,
    Material=isotropicmaterial_5,
    Support=support_8,
    Load=load_7,
    Run=toggle_5)  # -> Geometry, Part, Instance, Sets, BC, Steps; inputs ID: String, Mesh: tree, ElmntType: list of String, Material: list, Orientation: list of String, Support: tree, Load: tree, Tie: tree, Run: Boolean; disabled; same code as abaquspart_2
inpassembly_7 = CSharpScript(
    Part=flatten(abaquspart_8.Part),
    Instance=flatten(abaquspart_8.Instance),
    Sets=flatten(abaquspart_8.Sets),
    BC=flatten(abaquspart_8.BC),
    Material=isotropicmaterial_5,
    Steps=flatten(abaquspart_8.Steps))  # -> INP; inputs ID: list of String, Job: list of String, Model: list of String, Part: list of String, Instance: list of String, Sets: list of String, BC: list of String, Material: list of String, Tie: list of String, Steps: list of String; disabled; same code as inpassembly
panel_31 = Panel(inpassembly_7)  # disabled

move_20 = Move(Geometry=cnt_2, Motion=X_3)  # -> Geometry, Transform

xy_7 = XYPlane(Origin=move_20.Geometry)
tag_6 = TextTag3D(Location=xy_7, Text="I-beam", Size=number_slider_19, Justification=7)

# ----
# Orientations
# Two Timber Parts
panel_32 = Panel("{-2000,1000,0}")
rectangleyzrev_4 = CSharpScript(Cntr=panel_32, W=Slider(100, range=0..100), H=Slider(200, range=0..1000))  # -> Rcntr, Pts; inputs Cntr: Point3d, W: Double, H: Double; same code as rectangleyzrev
addition_4 = Addition(A=length_timber1, B=length_timber2)
vec_3 = VectorXYZ(XComponent=length_timber1, YComponent=0, ZComponent=height)  # -> Vector, Length
panel_33 = Panel("""Orientations
Two Timber Parts""")
X_7 = UnitX(Factor=addition_4)
move_21 = Move(Geometry=rectangleyzrev_4.Pts, Motion=vec_3.Vector)  # -> Geometry, Transform
move_22 = Move(Geometry=rectangleyzrev_4.Pts, Motion=X_7)  # -> Geometry, Transform
rgb_2 = ColourRGB(Alpha=Slider(200, range=0..255), Red="102", Green="197", Blue="200")
meshpointssweep_4 = CSharpScript(
    PointsSource=rectangleyzrev_4.Pts,
    PointsTarget=move_21.Geometry,
    Divisions=division_timber1,
    U=number_slider_4,
    V=number_slider_5,
    TooltipDescriptionOverride="Divisions longitudinally")  # -> Mesh, Srf, SourceSrf, TargetSrf, Orientation; inputs PointsSource: list of Point3d, PointsTarget: list of Point3d, Divisions: Int32, U: Int32, V: Int32; same code as meshpointssweep
meshpointssweep_5 = CSharpScript(
    PointsSource=move_21.Geometry,
    PointsTarget=move_22.Geometry,
    Divisions=divisions_timber2,
    U=number_slider_4,
    V=number_slider_5,
    TooltipDescriptionOverride="Divisions longitudinally")  # -> Mesh, Srf, SourceSrf, TargetSrf, Orientation; inputs PointsSource: list of Point3d, PointsTarget: list of Point3d, Divisions: Int32, U: Int32, V: Int32
# ---------- meshpointssweep_5: C# ----------
    //riktig oppdatert0306
    List<double> length = new List<double>();
    List <Curve> edgecrv = new List<Curve>();
    DataTree<Curve> edgecrvtree = new DataTree<Curve>();
    DataTree <Point3d> vrttree = new DataTree<Point3d>();
    DataTree <Point3d> vrtsectiontree = new DataTree<Point3d>();
    List <NurbsSurface> s = new List<NurbsSurface>();
    DataTree <System.Object> meshtree = new DataTree<System.Object>();


    //Default values if not specified, added 27.04
    if(Divisions == 0){Divisions = 1;};
    if(U == 0){U = 1;};
    if(V == 0){V = 1;};

    //Make edgecurves, get their length and make new corner points
    for ( int i = 0; i < 4; i++)
    {
      edgecrv.Add(new Line(PointsSource[i], PointsTarget[i]).ToNurbsCurve()); //Add for only one item
      length.Add(edgecrv[i].GetLength());
      edgecrvtree.Add(new Line(PointsSource[i], PointsTarget[i]).ToNurbsCurve(), new GH_Path(i));
      vrttree.AddRange(edgecrvtree.Branch(i)[0].DivideEquidistant(length[i] / Divisions), new GH_Path(i));

      int listitem = 0;
      for (int j = 0; j < (Divisions + 1); j++)
      {
        vrtsectiontree.Add(vrttree.Branch(i)[listitem], new GH_Path(j));
        listitem++;
      }
    }
    //make surfaces
    //get beginning and end surface if needed for tie/boundary conditions or etc.
    Brep ss = Brep.CreateFromCornerPoints(PointsSource[0], PointsSource[1], PointsSource[2], PointsSource[3], 0);
    Brep ts = Brep.CreateFromCornerPoints(PointsTarget[0], PointsTarget[1], PointsTarget[2], PointsTarget[3], 0);

    //get cross-sectional surfaces
    for (int j = 0; j < (Divisions + 1); j++)
    {
      s.Add(NurbsSurface.CreateFromCorners(vrtsectiontree.Branch(j)[0], vrtsectiontree.Branch(j)[1], vrtsectiontree.Branch(j)[2], vrtsectiontree.Branch(j)[3], 0));
    } // (branch number) [list number]


    DataTree<Brep> btree = new DataTree<Brep>();
    DataTree <Curve> loftcrv = new DataTree<Curve>(); //loft to get solid
    DataTree <Point3d> nodetree = new DataTree<Point3d>();


    for (int a = 0; a < (Divisions + 1); a++)
    {
      for (int i = 0; i < (V + 1); i++)
      {
        for (int j = 0; j < (U + 1); j++)
        {
          Point3d p = new Point3d(s[a].PointAt(s[a].Domain(0).Length / V * i, s[a].Domain(1).Length / U * j)); // v-value first, then u value, because domain(0) is v
          meshtree.Add(p, new GH_Path(0, 0)); //added 1704
          //meshtree.Add(p, new GH_Path(1, a)); //added1704 to get nodetree2 in same list
          nodetree.Add(p, new GH_Path(a, i));
        }
      }
    }

    for (int a = 0; a < (Divisions + 1); a++)
    {
      for (int i = 0; i < V; i++)
      {
        for (int j = 0; j < U; j++)
        {
          Brep b = Brep.CreateFromCornerPoints(nodetree.Branch(a, i)[j], nodetree.Branch(a, i + 1)[j], nodetree.Branch(a, i + 1)[j + 1], nodetree.Branch(a, i)[j + 1], 0);
          btree.Add(b, new GH_Path(a, i));
          //meshtree.Add(b, new GH_Path(2, a));
          meshtree.Add(b, new GH_Path(1, 0));
          loftcrv.AddRange(btree.Branch(a, i)[j].DuplicateEdgeCurves(), new GH_Path(a));
        }
      }
    }


    DataTree <Brep> srf = new DataTree<Brep>();
    for ( int i = 0; i < loftcrv.Branch(0).Count; i++)
    {
      for (int j = 0; j < Divisions; j++)
      {
        srf.AddRange(Brep.CreateFromLoft(new List<Curve>{loftcrv.Branch(0 + j)[i], loftcrv.Branch(1 + j)[i]}, Point3d.Unset, Point3d.Unset, LoftType.Normal, false), new GH_Path(i));
      }
    } // Surfaces in the middle are doubled


    //orientation

    Point3d p1 = new Point3d((PointsSource[0].X + PointsSource[1].X + PointsSource[2].X + PointsSource[3].X) / 4, (PointsSource[0].Y + PointsSource[1].Y + PointsSource[2].Y + PointsSource[3].Y) / 4, (PointsSource[0].Z + PointsSource[1].Z + PointsSource[2].Z + PointsSource[3].Z) / 4);
    Point3d p2 = new Point3d((PointsTarget[0].X + PointsTarget[1].X + PointsTarget[2].X + PointsTarget[3].X) / 4, (PointsTarget[0].Y + PointsTarget[1].Y + PointsTarget[2].Y + PointsTarget[3].Y) / 4, (PointsTarget[0].Z + PointsTarget[1].Z + PointsTarget[2].Z + PointsTarget[3].Z) / 4);

    List <string> orilist = new List<string>();

    Vector3d vec1 = p2 - p1; //longitudinal direction of timber cross-section central points = Direction 1 (x-axis). Created between the average points (center points p1 and p2) of the source and target points.
    vec1.Unitize();
    Plane nplan = new Plane(p1, vec1); //normal plane
    Vector3d vec2 = nplan.XAxis; // Second axis (unitized)

    double cx = p1.X; double cy = p1.Y; double cz = p1.Z; //center point x,y,z

    //coordinates of the first principal axis(x-axis)
    double x1 = vec1.X + cx; double y1 = vec1.Y + cy; double z1 = vec1.Z + cz;

    //coordinates of the second principal axis(z-axis in Rhino, y-axis in Abaqus)
    double x2 = vec2.X + cx; double y2 = vec2.Y + cy; double z2 = vec2.Z + cz;

    //Add orientation (for orthotropic material)
    orilist.Add("Ori-1");
    orilist.Add("*Orientation, name=Ori-1");
    orilist.Add(string.Format("{0}, {1}, {2}, {3}, {4}, {5}, {6}, {7}, {8}", x1, z1, y1, x2, z2, y2, cx, cz, cy)); //changed y z due to abaqus/rhino different axis systems
    orilist.Add("1, 0"); // 1,0. 1 means primary axis (x), 0 means no rotation

    //add divisions, u and v to be used further to end of mesh tree
    GH_Path pth = new GH_Path(2, 0);
    meshtree.Add(Divisions, pth); //number of divisions
    //meshtree.Add((U + 1) * (V + 1), pth); // number of nodes per branch
    meshtree.Add(U * V, pth); //number of surfaces per branch


    Srf = srf;
    Mesh = meshtree;
    SourceSrf = ss;
    TargetSrf = ts;
    Orientation = orilist;
# ---------- end meshpointssweep_5 ----------
load_type_11 = ValueList({"Uniform Pressure": "Pressure,P", "Surface Traction Shear": "Surface traction,TRSHR", "Surface Traction General": "Surface traction,TRVEC"}, selected="Surface Traction General")  # disabled
colour = CustomPreview(Geometry=[meshpointssweep_5.Srf, meshpointssweep_5.SourceSrf, meshpointssweep_5.TargetSrf], Material=rgb_2)
number_slider_21 = Slider(1, range=0..10)  # disabled
bcs_8 = ValueList({"U1": 1, "U2": 2, "U3": 3, "UR1": 4, "UR2": 5, "UR3": 6}, selected=["U1", "U2", "U3", "UR1", "UR2", "UR3"])  # disabled
hexahedron_9 = ValueList({"Full integration": "C3D8", "Reduced Integration": "C3D8R", "Incompatible Modes": "C3D8I"}, selected="Reduced Integration")  # disabled
bcs_9 = ValueList({"U1": 1, "U2": 2, "U3": 3, "UR1": 4, "UR2": 5, "UR3": 6}, selected=["U1", "U2", "U3", "UR1", "UR2", "UR3"])  # disabled
panel_34 = Panel("Load2")  # disabled
panel_35 = Panel("Load1")  # disabled
orthotropicmaterial_3 = CSharpScript(TooltipDescriptionOverride="Norwegian Spruce default material. E1=10000, E2 = 800, E3 = 400. Nu12=0.5, Nu13=0.6, Nu23=0.6. G12=600, G13=600, G23=30.")  # -> Properties; inputs Material: String, E1: Int32, E2: Int32, E3: Int32, Nu12: Double, Nu13: Double, Nu23: Double, G12: Int32, G13: Int32, G23: Int32; disabled; same code as orthotropicmaterial
support_9 = CSharpScript(Face=meshpointssweep_5.TargetSrf, Conditions=bcs_8)  # -> Support; inputs ID: String, Tol: Double, Face: Brep, Conditions: list of String; disabled; same code as support
support_10 = CSharpScript(Face=meshpointssweep_4.SourceSrf, Conditions=bcs_9)  # -> Support; inputs ID: String, Tol: Double, Face: Brep, Conditions: list of String; disabled; same code as support
panel_36 = Panel("Timber1")  # disabled
panel_37 = Panel("Timber2")  # disabled
tie_3 = CSharpScript(Master=panel_36, Slave=panel_37, Face=meshpointssweep_4.TargetSrf)  # -> Part, INP; inputs ID: String, Master: String, Slave: String, Tol: Double, Face: Brep; disabled; same code as tie
toggle_6 = BooleanToggle(False)  # disabled

addition_5 = Addition(A=number_slider_2, B=number_slider)
pt_7 = ConstructPoint(XCoordinate=addition_5, YCoordinate="1000", ZCoordinate=0)

# ----
# Creating different load surface sets
# Timber 1
c_script_4 = CSharpScript(U=number_slider_4, V=number_slider_5)  # -> A; inputs U: Int32, V: Int32; same code as c_script_2
branch_4 = TreeBranch(Tree=meshpointssweep_4.Srf, Path=c_script_4, MaintainPaths=True)  # -> flatten(Branch)
top = BrepJoin(Breps=branch_4)  # -> Breps, Closed

# ----
# Creating different load surface sets
# Timber 2
c_script_5 = CSharpScript(U=number_slider_4, V=number_slider_5)  # -> A; inputs U: Int32, V: Int32; same code as c_script_2
branch_5 = TreeBranch(Tree=meshpointssweep_5.Srf, Path=c_script_5, MaintainPaths=True)  # -> flatten(Branch)
top_2 = BrepJoin(Breps=branch_5)  # -> Breps, Closed

xy_8 = XYPlane(Origin=pt_7)
tag_7 = TextTag3D(Location=xy_8, Text=panel_33, Size=Slider(100, range=0..100), Justification=7)
load_8 = CSharpScript(ID=panel_34, LoadType=load_type_11, Face=top_2.Breps, kNMagnitude=number_slider_21)  # -> Load; inputs ID: String, LoadType: String, Tol: Double, Face: Brep, DirVector: Vector3d, kNMagnitude: Double, MPaMagnitude: Double; disabled; same code as load
load_9 = CSharpScript(ID=panel_35, LoadType=load_type_11, Face=top.Breps, kNMagnitude=number_slider_21)  # -> Load; inputs ID: String, LoadType: String, Tol: Double, Face: Brep, DirVector: Vector3d, kNMagnitude: Double, MPaMagnitude: Double; disabled; same code as load
abaquspart_9 = CSharpScript(
    ID=panel_36,
    Mesh=meshpointssweep_4.Mesh,
    ElmntType=hexahedron_9,
    Material=orthotropicmaterial_3,
    Orientation=meshpointssweep_4.Orientation,
    Support=support_10,
    Load=load_9,
    Tie=tie_3.Part,
    Run=toggle_6)  # -> Geometry, Part, Instance, Sets, BC, Steps; inputs ID: String, Mesh: tree, ElmntType: list of String, Material: list, Orientation: list of String, Support: tree, Load: tree, Tie: tree, Run: Boolean; disabled; same code as abaquspart_2
abaquspart_10 = CSharpScript(
    ID=panel_37,
    Mesh=meshpointssweep_5.Mesh,
    ElmntType=hexahedron_9,
    Material=orthotropicmaterial_3,
    Orientation=meshpointssweep_5.Orientation,
    Support=support_9,
    Load=load_8,
    Tie=tie_3.Part,
    Run=toggle_6)  # -> Geometry, Part, Instance, Sets, BC, Steps; inputs ID: String, Mesh: tree, ElmntType: list of String, Material: list, Orientation: list of String, Support: tree, Load: tree, Tie: tree, Run: Boolean; disabled; same code as abaquspart_2
inpassembly_8 = CSharpScript(
    Part=flatten([abaquspart_9.Part, abaquspart_10.Part]),
    Instance=flatten([abaquspart_9.Instance, abaquspart_10.Instance]),
    Sets=flatten([abaquspart_9.Sets, abaquspart_10.Sets]),
    BC=flatten([abaquspart_9.BC, abaquspart_10.BC]),
    Material=orthotropicmaterial_3,
    Tie=flatten(tie_3.INP),
    Steps=flatten([abaquspart_9.Steps, abaquspart_10.Steps]))  # -> INP; inputs ID: list of String, Job: list of String, Model: list of String, Part: list of String, Instance: list of String, Sets: list of String, BC: list of String, Material: list of String, Tie: list of String, Steps: list of String; disabled; same code as inpassembly
panel_38 = Panel(inpassembly_8)  # disabled
