# Grasshopper definition E.3_GFConnector.gh (Grasshopper 1.0.7)

# ----
# Hide/Shows Faint Wires
toggle = BooleanToggle(False)
wdt = CSharpScript(showFaintWires=toggle)  # inputs showFaintWires: Boolean
# ---------- wdt: C# ----------
    foreach(IGH_ActiveObject ao in GrasshopperDocument.ActiveObjects()){
      if(ao is IGH_Param){
        IGH_Param param = ao as IGH_Param;
        fixWires(param, showFaintWires);
      } else if(ao is IGH_Component){
        IGH_Component comp = ao as IGH_Component;
        foreach(IGH_Param param in comp.Params){
          fixWires(param, showFaintWires);
        }
      }
    }
# ---------- wdt: C# additional code ----------
  void fixWires(IGH_Param param, bool showFaint){
    if(showFaint && param.WireDisplay == GH_ParamWireDisplay.hidden){
      param.WireDisplay = GH_ParamWireDisplay.faint;
    } else if((!showFaint) && param.WireDisplay == GH_ParamWireDisplay.faint){
      param.WireDisplay = GH_ParamWireDisplay.hidden;
    }
  }
# ---------- end wdt ----------

# ----
# Height and Width of Timber
# All elements should be divided with same number in V direction
image = ImageSampler(Filter="Colour", Interpolate=False, Umax=1, Umin=0, Vmax=1, Vmin=0, Wrap=1)
u_e1_e2 = Slider(2, range=0..10)
# length and width of splices
fl = Slider(200, range=0..1000)

# ----
# length (hypotenus) and angle
angle = Slider(20, range=0..100)
ehyp = Slider(100, range=0..200)

fw = Slider(10, range=0..100)
# can be used if making more grippers
midpartdivided_into_4 = Slider(4, range=0..10)
div_f_t1 = Slider(4, range=0..50)
divt2 = Slider(2, range=0..50)

timberheightcrosssection = Slider(200, range=0..1000)
timberwidthcrosssection = Slider(200, range=0..1000)
timberlength = Slider(300, range=0..1000)

global_v = Slider(1, range=0..20)

div_a_b = Slider(2, range=0..10)
u_a_b_c_d1 = Slider(1, range=0..10)

bl = Slider(30, range=0..100)
cl = Slider(100, range=0..300)
widthhexagon = Slider(60, range=0..500)
u_d2_d21_d4_d41_timber = Slider(1, range=0..10)
u_d4_d41_td4_td41 = Slider(2, range=0..10)
div_d_e = Slider(2, range=0..10)
cw = Slider(25, range=0..100)
dl = Slider(30, range=0..100)
div_c = Slider(5, range=0..25)
u_splice_f3_f31_d3_d31 = Slider(1, range=0..10)
rad = Radians(Degrees=angle)
cos = Cosine(Value=rad)

# ----
# Hexagon
panel = Panel("-1")
c_sqrt_3_2_w_2 = CSharpScript(w=widthhexagon)  # -> A; inputs w: Double
# ---------- c_sqrt_3_2_w_2: C# ----------
    A = (w / 4) * Math.Sqrt(3);
# ---------- end c_sqrt_3_2_w_2 ----------
rectanglexzplanerev = CSharpScript(w=widthhexagon, h=timberheightcrosssection)  # -> Rcntr, pointlist; inputs cntr: Point3d, w: Double, h: Double; same code as rectanglexzplanerev
Y = UnitY(Factor=c_sqrt_3_2_w_2)
multiplication = Multiplication(A=Y, B=panel)
move = Move(Geometry=rectanglexzplanerev.Rcntr, Motion=multiplication)  # -> Geometry, Transform
division = Division(A=widthhexagon, B="2")
move_2 = Move(Geometry=rectanglexzplanerev.Rcntr, Motion=Y)  # -> Geometry, Transform
abelow = CSharpScript(cntr=move.Geometry, w=division, h=timberheightcrosssection)  # -> Rcntr, pointlist; inputs cntr: Point3d, w: Double, h: Double; same code as rectanglexzplanerev

sin = Sine(Value=rad)

el = Multiplication(A=cos, B=ehyp)
ew = Multiplication(A=sin, B=ehyp)

Y_2 = UnitY(Factor=dl)
swatch = ColourSwatch(SwatchColor=RGB(184, 139, 35))
swatch_2 = ColourSwatch(SwatchColor=RGB(122, 122, 122))
panel_2 = Panel("""Ori-1
*Orientation, name=Ori-1
0.866025403784438, 0, -0.5, 0.5, 0, 0.866025403784438, 161.06406460551, 0, -92.9903810567667
1, 90""")
panel_3 = Panel("""Ori-1
*Orientation, name=Ori-1
-0.866025403784439, 0, -0.5, 0.5, 0, -0.866025403784439, -161.06406460551, 0, -92.9903810567666
1, 90""")
panel_4 = Panel("""Ori-1
*Orientation, name=Ori-1
0.866025403784438, 0, 0.5, -0.5, 0, 0.866025403784438, 161.06406460551, 0, 92.9903810567666
1, 90""")
panel_5 = Panel("""Ori-1
*Orientation, name=Ori-1
-0.866025403784438, 0, 0.5, -0.5, 0, -0.866025403784438, -161.06406460551, 0, 92.9903810567666
1, 90""")
panel_6 = Panel("""Ori-1
*Orientation, name=Ori-1
0, 0, -1, 0, -1, 0, 0, 0, -185.980762113533
1, 180""")

# ----
# Toggle to RUN
toggle_2 = BooleanToggle(False)

abelow_2 = CSharpScript(
    PointsSource=abelow.pointlist,
    PointsTarget=rectanglexzplanerev.pointlist,
    Divisions=u_a_b_c_d1,
    U=u_a_b_c_d1,
    V=global_v,
    TooltipDescriptionOverride="Divisions longitudinally")  # -> Mesh, Srf, SourceSrf, TargetSrf, Orientation; inputs PointsSource: list of Point3d, PointsTarget: list of Point3d, Divisions: Int32, U: Int32, V: Int32; same code as B

# ----
# Part 2
panel_7 = Panel("60")

# ----
# Part 3
panel_8 = Panel("120")

# ----
# Part 4
panel_9 = Panel("180")

# ----
# Part 6
panel_10 = Panel("300")

# ----
# Part 1
Y_3 = UnitY(Factor=cl)
Y_4 = UnitY(Factor=bl)
bs = CSharpScript(cntr=move_2.Geometry, w=division, h=timberheightcrosssection)  # -> Rcntr, pointlist; inputs cntr: Point3d, w: Double, h: Double; same code as rectanglexzplanerev
# Left: Aluminium
move_3 = Move(Geometry=bs.Rcntr, Motion=Y_4)  # -> Geometry, Transform
bt_cs = CSharpScript(cntr=move_3.Geometry, w=cw, h=timberheightcrosssection)  # -> Rcntr, pointlist; inputs cntr: Point3d, w: Double, h: Double; same code as rectanglexzplanerev
ct_d1s = Move(Geometry=bt_cs.pointlist, Motion=Y_3)  # -> Geometry, Transform
d1t_td1s = Move(Geometry=ct_d1s.Geometry, Motion=Y_2)  # -> Geometry, Transform
Y_5 = UnitY(Factor=fl)
# Right: Timber
t2length = Subtraction(A=timberlength, B=fl)
td1t_t2d1s = Move(Geometry=d1t_td1s.Geometry, Motion=Y_5)  # -> Geometry, Transform
Y_6 = UnitY(Factor=t2length)
t2d1t = Move(Geometry=td1t_t2d1s.Geometry, Motion=Y_6)  # -> Geometry, Transform

cluster = Cluster(
    x=midpartdivided_into_4,
    T=Y_2,
    A_2=timberwidthcrosssection,
    A=ew,
    N=midpartdivided_into_4,
    w=fw,
    pts=ct_d1s.Geometry,
    h=timberheightcrosssection,
    A_3=timberheightcrosssection,
    h_2=timberheightcrosssection)  # -> G, pointlist, pointlist_2

# ----
# Hexagon
A = CSharpScript(
    PointsSource=rectanglexzplanerev.pointlist,
    PointsTarget=bs.pointlist,
    Divisions=u_a_b_c_d1,
    U=u_a_b_c_d1,
    V=global_v,
    TooltipDescriptionOverride="Divisions longitudinally")  # -> Mesh, Srf, SourceSrf, TargetSrf, Orientation; inputs PointsSource: list of Point3d, PointsTarget: list of Point3d, Divisions: Int32, U: Int32, V: Int32; same code as B

d3s = TreeBranch(Tree=cluster.pointlist_2, Path="1", MaintainPaths=True)

d31s = TreeBranch(Tree=cluster.pointlist_2, Path="0", MaintainPaths=True)

# ----
# Part 5
panel_11 = Panel("240")
bs_2 = Rotate3D(Geometry=bs.pointlist, Angle=degrees(panel_11), Center=Point(0, 0, 0), Axis=Vector(0, 0, 1))  # -> Geometry, Transform
bt_cs_2 = Rotate3D(Geometry=bt_cs.pointlist, Angle=degrees(panel_11), Center=Point(0, 0, 0), Axis=Vector(0, 0, 1))  # -> Geometry, Transform
ct_d1s_2 = Rotate3D(Geometry=ct_d1s.Geometry, Angle=degrees(panel_11), Center=Point(0, 0, 0), Axis=Vector(0, 0, 1))  # -> Geometry, Transform
d3s_2 = Rotate3D(Geometry=d3s, Angle=degrees(panel_11), Center=Point(0, 0, 0), Axis=Vector(0, 0, 1))  # -> Geometry, Transform
d31s_2 = Rotate3D(Geometry=d31s, Angle=degrees(panel_11), Center=Point(0, 0, 0), Axis=Vector(0, 0, 1))  # -> Geometry, Transform
d1t_td1s_2 = Rotate3D(Geometry=d1t_td1s.Geometry, Angle=degrees(panel_11), Center=Point(0, 0, 0), Axis=Vector(0, 0, 1))  # -> Geometry, Transform
td1t_t2d1s_2 = Rotate3D(Geometry=td1t_t2d1s.Geometry, Angle=degrees(panel_11), Center=Point(0, 0, 0), Axis=Vector(0, 0, 1))  # -> Geometry, Transform
t2d1t_2 = Rotate3D(Geometry=t2d1t.Geometry, Angle=degrees(panel_11), Center=Point(0, 0, 0), Axis=Vector(0, 0, 1))  # -> Geometry, Transform

bs_3 = Rotate3D(Geometry=bs.pointlist, Angle=degrees(panel_7), Center=Point(0, 0, 0), Axis=Vector(0, 0, 1))  # -> Geometry, Transform
bt_cs_3 = Rotate3D(Geometry=bt_cs.pointlist, Angle=degrees(panel_7), Center=Point(0, 0, 0), Axis=Vector(0, 0, 1))  # -> Geometry, Transform
ct_d1s_3 = Rotate3D(Geometry=ct_d1s.Geometry, Angle=degrees(panel_7), Center=Point(0, 0, 0), Axis=Vector(0, 0, 1))  # -> Geometry, Transform
d3s_3 = Rotate3D(Geometry=d3s, Angle=degrees(panel_7), Center=Point(0, 0, 0), Axis=Vector(0, 0, 1))  # -> Geometry, Transform
d31s_3 = Rotate3D(Geometry=d31s, Angle=degrees(panel_7), Center=Point(0, 0, 0), Axis=Vector(0, 0, 1))  # -> Geometry, Transform
d1t_td1s_3 = Rotate3D(Geometry=d1t_td1s.Geometry, Angle=degrees(panel_7), Center=Point(0, 0, 0), Axis=Vector(0, 0, 1))  # -> Geometry, Transform
td1t_t2d1s_3 = Rotate3D(Geometry=td1t_t2d1s.Geometry, Angle=degrees(panel_7), Center=Point(0, 0, 0), Axis=Vector(0, 0, 1))  # -> Geometry, Transform
t2d1t_3 = Rotate3D(Geometry=t2d1t.Geometry, Angle=degrees(panel_7), Center=Point(0, 0, 0), Axis=Vector(0, 0, 1))  # -> Geometry, Transform

d3t_f3s = Move(Geometry=d3s, Motion=Y_2)  # -> Geometry, Transform
d31t_f31s = Move(Geometry=d31s, Motion=Y_2)  # -> Geometry, Transform
f3t_t2f3s = Move(Geometry=d3t_f3s.Geometry, Motion=Y_5)  # -> Geometry, Transform
f31t_t2f31 = Move(Geometry=d31t_f31s.Geometry, Motion=Y_5)  # -> Geometry, Transform
t2f3t = Move(Geometry=f3t_t2f3s.Geometry, Motion=Y_6)  # -> Geometry, Transform
t2f31t = Move(Geometry=f31t_t2f31.Geometry, Motion=Y_6)  # -> Geometry, Transform

cluster_2 = Cluster_2(
    L=cluster.pointlist,
    L_3=d31s,
    L_4=d3s,
    L_5=d1t_td1s.Geometry,
    L_2=ct_d1s.Geometry,
    L_6=d31t_f31s.Geometry,
    L_7=d3t_f3s.Geometry,
    L_8=cluster.G)  # -> d2sp_2, d2tp_2, d21sp_2, d21tp_2, A, B, A_2, B_2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
cluster_3 = Cluster_3(d4end=cluster_2.A, X=ew, Y_2=el, e1tp=cluster_2.A_2, T_2=Y_2, d41end=cluster_2.B, e2tp=cluster_2.B_2, Y=el, A=ew, T=Y_2)  # -> e1sp_2, e1tp_3, e2sp_2, e2tp_3

d21s = CSharpScript(Pts=cluster_2.d21sp_2, TooltipDescriptionOverride="Sort 4 points counter clockwise ", TooltipTextOverride="Sort")  # -> SPts; inputs Pts: list of Point3d; same code as sortxz
d21t_td21s = CSharpScript(Pts=cluster_2.d21tp_2, TooltipDescriptionOverride="Sort 4 points counter clockwise ", TooltipTextOverride="Sort")  # -> SPts; inputs Pts: list of Point3d; same code as sortxz

d2s = CSharpScript(Pts=cluster_2.d2sp_2, TooltipDescriptionOverride="Sort 4 points counter clockwise ", TooltipTextOverride="Sort")  # -> SPts; inputs Pts: list of Point3d; same code as sortxz
d2t_td2s = CSharpScript(Pts=cluster_2.d2tp_2, TooltipDescriptionOverride="Sort 4 points counter clockwise ", TooltipTextOverride="Sort")  # -> SPts; inputs Pts: list of Point3d; same code as sortxz

e2t_te2s = CSharpScript(Pts=cluster_3.e2tp_3, TooltipDescriptionOverride="Sort 4 points counter clockwise ", TooltipTextOverride="Sort")  # -> SPts; inputs Pts: list of Point3d; same code as sortxz
e2s = CSharpScript(Pts=cluster_3.e2sp_2, TooltipDescriptionOverride="Sort 4 points counter clockwise ", TooltipTextOverride="Sort")  # -> SPts; inputs Pts: list of Point3d; same code as sortxz

cluster_4 = Cluster_4(T=Y_5, L=e2t_te2s, A=fl, B=el)  # -> te2tp_2, G

e1s = CSharpScript(Pts=cluster_3.e1sp_2, TooltipDescriptionOverride="Sort 4 points counter clockwise ", TooltipTextOverride="Sort")  # -> SPts; inputs Pts: list of Point3d; same code as sortxz
e1t_te1s = CSharpScript(Pts=cluster_3.e1tp_3, TooltipDescriptionOverride="Sort 4 points counter clockwise ", TooltipTextOverride="Sort")  # -> SPts; inputs Pts: list of Point3d; same code as sortxz

cluster_5 = Cluster_5(pt=cluster_4.G, T_2=Y_6, L=e1t_te1s, A=fl, B=el, T=Y_5)  # -> G_3, G_2, G

d41s = CSharpScript(Pts=cluster_2.d41sp_2, TooltipDescriptionOverride="Sort 4 points counter clockwise ", TooltipTextOverride="Sort")  # -> SPts; inputs Pts: list of Point3d; same code as sortxz
d41t_td41s = CSharpScript(Pts=cluster_2.d41tp_2, TooltipDescriptionOverride="Sort 4 points counter clockwise ", TooltipTextOverride="Sort")  # -> SPts; inputs Pts: list of Point3d; same code as sortxz
d4s = CSharpScript(Pts=cluster_2.d4sp_2, TooltipDescriptionOverride="Sort 4 points counter clockwise ", TooltipTextOverride="Sort")  # -> SPts; inputs Pts: list of Point3d; same code as sortxz
d4t_td4s = CSharpScript(Pts=cluster_2.d4tp_2, TooltipDescriptionOverride="Sort 4 points counter clockwise ", TooltipTextOverride="Sort")  # -> SPts; inputs Pts: list of Point3d; same code as sortxz
alupart1 = AluPart1(
    pointssource=bs.pointlist,
    pointstarget=bt_cs.pointlist,
    divisions=div_a_b,
    U=u_a_b_c_d1,
    V=global_v,
    pointssource_2=bt_cs.pointlist,
    pointstarget_2=ct_d1s.Geometry,
    divisions_2=div_c,
    U_2=u_a_b_c_d1,
    V_2=global_v,
    pointssource_3=e1s,
    pointstarget_3=e1t_te1s,
    divisions_3=div_d_e,
    U_3=u_e1_e2,
    V_3=global_v,
    pointssource_6=d4s,
    pointstarget_6=d4t_td4s,
    divisions_6=div_d_e,
    U_6=u_d4_d41_td4_td41,
    V_6=global_v,
    pointssource_4=d31s,
    pointstarget_4=d31t_f31s.Geometry,
    divisions_4=div_d_e,
    U_4=u_splice_f3_f31_d3_d31,
    V_4=global_v,
    pointssource_5=d2s,
    pointstarget_5=d2t_td2s,
    divisions_5=div_d_e,
    U_5=u_d2_d21_d4_d41_timber,
    V_5=global_v,
    pointssource_7=ct_d1s.Geometry,
    pointstarget_7=d1t_td1s.Geometry,
    divisions_7=div_d_e,
    U_7=u_a_b_c_d1,
    V_7=global_v,
    pointssource_8=d21s,
    pointstarget_8=d21t_td21s,
    divisions_8=div_d_e,
    U_8=u_d2_d21_d4_d41_timber,
    V_8=global_v,
    pointssource_9=d3s,
    pointstarget_9=d3t_f3s.Geometry,
    divisions_9=div_d_e,
    U_9=u_splice_f3_f31_d3_d31,
    V_9=global_v,
    pointssource_10=d41s,
    pointstarget_10=d41t_td41s,
    divisions_10=div_d_e,
    U_10=u_d4_d41_td4_td41,
    V_10=global_v,
    pointssource_11=e2s,
    pointstarget_11=e2t_te2s,
    divisions_11=div_d_e,
    U_11=u_e1_e2,
    V_11=global_v,
    pointssource_13=d3t_f3s.Geometry,
    pointstarget_13=f3t_t2f3s.Geometry,
    divisions_13=div_f_t1,
    U_13=u_splice_f3_f31_d3_d31,
    V_13=global_v,
    pointssource_12=d31t_f31s.Geometry,
    pointstarget_12=f31t_t2f31.Geometry,
    divisions_12=div_f_t1,
    U_12=u_splice_f3_f31_d3_d31,
    V_12=global_v)  # -> mesh, srf, sourcesrf, targetsrf, mesh_2, srf_2, sourcesrf_2, targetsrf_2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
td4t_t2d4s = Move(Geometry=d4t_td4s, Motion=Y_5)  # -> Geometry, Transform
te1t_t2e1s = Point([cluster_5.G_2, cluster_5.G])
td2t_t2d2s = Move(Geometry=d2t_td2s, Motion=Y_5)  # -> Geometry, Transform
td21t_t2d21s = Move(Geometry=d21t_td21s, Motion=Y_5)  # -> Geometry, Transform
t2d21t = Move(Geometry=td21t_t2d21s.Geometry, Motion=Y_6)  # -> Geometry, Transform
te2t_t2e2s = CSharpScript(Pts=cluster_4.te2tp_2, TooltipDescriptionOverride="Sort 4 points counter clockwise ", TooltipTextOverride="Sort")  # -> SPts; inputs Pts: list of Point3d; same code as sortxz
t2e2t = Move(Geometry=te2t_t2e2s, Motion=Y_6)  # -> Geometry, Transform
td41t_t2d41s = Move(Geometry=d41t_td41s, Motion=Y_5)  # -> Geometry, Transform
t2e1t = Move(Geometry=te1t_t2e1s, Motion=Y_6)  # -> Geometry, Transform
t2d41t = Move(Geometry=td41t_t2d41s.Geometry, Motion=Y_6)  # -> Geometry, Transform
t2d4t = Move(Geometry=td4t_t2d4s.Geometry, Motion=Y_6)  # -> Geometry, Transform
t2d2t = Move(Geometry=td2t_t2d2s.Geometry, Motion=Y_6)  # -> Geometry, Transform
timberpart1 = TimberPart2(
    pointssource_15=e1t_te1s,
    pointstarget_15=te1t_t2e1s,
    divisions_15=div_f_t1,
    U_15=u_e1_e2,
    V_15=global_v,
    pointssource_14=d4t_td4s,
    pointstarget_14=td4t_t2d4s.Geometry,
    divisions_14=div_f_t1,
    U_14=u_d4_d41_td4_td41,
    V_14=global_v,
    pointssource_9=d2t_td2s,
    pointstarget_9=td2t_t2d2s.Geometry,
    divisions_9=div_f_t1,
    U_9=u_d2_d21_d4_d41_timber,
    V_9=global_v,
    pointssource_7=d1t_td1s.Geometry,
    pointstarget_7=td1t_t2d1s.Geometry,
    divisions_7=div_f_t1,
    U_7=u_a_b_c_d1,
    V_7=global_v,
    pointssource_5=d21t_td21s,
    pointstarget_5=td21t_t2d21s.Geometry,
    divisions_5=div_f_t1,
    U_5=u_d2_d21_d4_d41_timber,
    V_5=global_v,
    pointssource=d41t_td41s,
    pointstarget=td41t_t2d41s.Geometry,
    divisions=div_f_t1,
    U=u_d4_d41_td4_td41,
    V=global_v,
    pointssource_10=e2t_te2s,
    pointstarget_10=te2t_t2e2s,
    divisions_10=div_f_t1,
    U_10=u_e1_e2,
    V_10=global_v,
    pointssource_11=te1t_t2e1s,
    pointstarget_11=t2e1t.Geometry,
    divisions_11=divt2,
    U_11=u_e1_e2,
    V_11=global_v,
    pointssource_8=td4t_t2d4s.Geometry,
    pointstarget_8=t2d4t.Geometry,
    divisions_8=divt2,
    U_8=u_d4_d41_td4_td41,
    V_8=global_v,
    pointssource_12=f3t_t2f3s.Geometry,
    pointstarget_12=t2f3t.Geometry,
    divisions_12=divt2,
    U_12=u_splice_f3_f31_d3_d31,
    V_12=global_v,
    pointssource_16=td2t_t2d2s.Geometry,
    pointstarget_16=t2d2t.Geometry,
    divisions_16=divt2,
    U_16=u_d2_d21_d4_d41_timber,
    V_16=global_v,
    pointssource_13=td1t_t2d1s.Geometry,
    pointstarget_13=t2d1t.Geometry,
    divisions_13=divt2,
    U_13=u_a_b_c_d1,
    V_13=global_v,
    pointssource_6=f31t_t2f31.Geometry,
    pointstarget_6=t2f31t.Geometry,
    divisions_6=divt2,
    U_6=u_splice_f3_f31_d3_d31,
    V_6=global_v,
    pointssource_3=td41t_t2d41s.Geometry,
    pointstarget_3=t2d41t.Geometry,
    divisions_3=divt2,
    U_3=u_d4_d41_td4_td41,
    V_3=global_v,
    pointssource_4=te2t_t2e2s,
    pointstarget_4=t2e2t.Geometry,
    divisions_4=divt2,
    U_4=u_e1_e2,
    V_4=global_v,
    pointssource_2=td21t_t2d21s.Geometry,
    pointstarget_2=t2d21t.Geometry,
    divisions_2=divt2,
    U_2=u_d2_d21_d4_d41_timber,
    V_2=global_v)  # -> mesh_15, srf_15, mesh_14, srf_14, sourcesrf_4, mesh_9, srf_9, mesh_7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

e1t_te1s_2 = Rotate3D(Geometry=e1t_te1s, Angle=degrees(panel_7), Center=Point(0, 0, 0), Axis=Vector(0, 0, 1))  # -> Geometry, Transform
e1s_2 = Rotate3D(Geometry=e1s, Angle=degrees(panel_7), Center=Point(0, 0, 0), Axis=Vector(0, 0, 1))  # -> Geometry, Transform
d3t_f3s_2 = Rotate3D(Geometry=d3t_f3s.Geometry, Angle=degrees(panel_7), Center=Point(0, 0, 0), Axis=Vector(0, 0, 1))  # -> Geometry, Transform
f3t_t2f3s_2 = Rotate3D(Geometry=f3t_t2f3s.Geometry, Angle=degrees(panel_7), Center=Point(0, 0, 0), Axis=Vector(0, 0, 1))  # -> Geometry, Transform
d4t_td4s_2 = Rotate3D(Geometry=d4t_td4s, Angle=degrees(panel_7), Center=Point(0, 0, 0), Axis=Vector(0, 0, 1))  # -> Geometry, Transform
f31t_t2f31_2 = Rotate3D(Geometry=f31t_t2f31.Geometry, Angle=degrees(panel_7), Center=Point(0, 0, 0), Axis=Vector(0, 0, 1))  # -> Geometry, Transform
d4s_2 = Rotate3D(Geometry=d4s, Angle=degrees(panel_7), Center=Point(0, 0, 0), Axis=Vector(0, 0, 1))  # -> Geometry, Transform
d2s_2 = Rotate3D(Geometry=d2s, Angle=degrees(panel_7), Center=Point(0, 0, 0), Axis=Vector(0, 0, 1))  # -> Geometry, Transform
e2s_2 = Rotate3D(Geometry=e2s, Angle=degrees(panel_7), Center=Point(0, 0, 0), Axis=Vector(0, 0, 1))  # -> Geometry, Transform
d2t_td2s_2 = Rotate3D(Geometry=d2t_td2s, Angle=degrees(panel_7), Center=Point(0, 0, 0), Axis=Vector(0, 0, 1))  # -> Geometry, Transform
d21t_td21s_2 = Rotate3D(Geometry=d21t_td21s, Angle=degrees(panel_7), Center=Point(0, 0, 0), Axis=Vector(0, 0, 1))  # -> Geometry, Transform
e2t_te2s_2 = Rotate3D(Geometry=e2t_te2s, Angle=degrees(panel_7), Center=Point(0, 0, 0), Axis=Vector(0, 0, 1))  # -> Geometry, Transform
d21s_2 = Rotate3D(Geometry=d21s, Angle=degrees(panel_7), Center=Point(0, 0, 0), Axis=Vector(0, 0, 1))  # -> Geometry, Transform
d41t_td41s_2 = Rotate3D(Geometry=d41t_td41s, Angle=degrees(panel_7), Center=Point(0, 0, 0), Axis=Vector(0, 0, 1))  # -> Geometry, Transform
d31t_f31s_2 = Rotate3D(Geometry=d31t_f31s.Geometry, Angle=degrees(panel_7), Center=Point(0, 0, 0), Axis=Vector(0, 0, 1))  # -> Geometry, Transform
d41s_2 = Rotate3D(Geometry=d41s, Angle=degrees(panel_7), Center=Point(0, 0, 0), Axis=Vector(0, 0, 1))  # -> Geometry, Transform
alupart2 = AluPart1(
    pointssource=bs_3.Geometry,
    pointstarget=bt_cs_3.Geometry,
    divisions=div_a_b,
    U=u_a_b_c_d1,
    V=global_v,
    pointssource_2=bt_cs_3.Geometry,
    pointstarget_2=ct_d1s_3.Geometry,
    divisions_2=div_c,
    U_2=u_a_b_c_d1,
    V_2=global_v,
    pointssource_3=e1s_2.Geometry,
    pointstarget_3=e1t_te1s_2.Geometry,
    divisions_3=div_d_e,
    U_3=u_e1_e2,
    V_3=global_v,
    pointssource_6=d4s_2.Geometry,
    pointstarget_6=d4t_td4s_2.Geometry,
    divisions_6=div_d_e,
    U_6=u_d4_d41_td4_td41,
    V_6=global_v,
    pointssource_4=d31s_3.Geometry,
    pointstarget_4=d31t_f31s_2.Geometry,
    divisions_4=div_d_e,
    U_4=u_splice_f3_f31_d3_d31,
    V_4=global_v,
    pointssource_5=d2s_2.Geometry,
    pointstarget_5=d2t_td2s_2.Geometry,
    divisions_5=div_d_e,
    U_5=u_d2_d21_d4_d41_timber,
    V_5=global_v,
    pointssource_7=ct_d1s_3.Geometry,
    pointstarget_7=d1t_td1s_3.Geometry,
    divisions_7=div_d_e,
    U_7=u_a_b_c_d1,
    V_7=global_v,
    pointssource_8=d21s_2.Geometry,
    pointstarget_8=d21t_td21s_2.Geometry,
    divisions_8=div_d_e,
    U_8=u_d2_d21_d4_d41_timber,
    V_8=global_v,
    pointssource_9=d3s_3.Geometry,
    pointstarget_9=d3t_f3s_2.Geometry,
    divisions_9=div_d_e,
    U_9=u_splice_f3_f31_d3_d31,
    V_9=global_v,
    pointssource_10=d41s_2.Geometry,
    pointstarget_10=d41t_td41s_2.Geometry,
    divisions_10=div_d_e,
    U_10=u_d4_d41_td4_td41,
    V_10=global_v,
    pointssource_11=e2s_2.Geometry,
    pointstarget_11=e2t_te2s_2.Geometry,
    divisions_11=div_d_e,
    U_11=u_e1_e2,
    V_11=global_v,
    pointssource_13=d3t_f3s_2.Geometry,
    pointstarget_13=f3t_t2f3s_2.Geometry,
    divisions_13=div_f_t1,
    U_13=u_splice_f3_f31_d3_d31,
    V_13=global_v,
    pointssource_12=d31t_f31s_2.Geometry,
    pointstarget_12=f31t_t2f31_2.Geometry,
    divisions_12=div_f_t1,
    U_12=u_splice_f3_f31_d3_d31,
    V_12=global_v)  # -> mesh, srf, sourcesrf, targetsrf, mesh_2, srf_2, sourcesrf_2, targetsrf_2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
te1t_t2e1s_2 = Rotate3D(Geometry=te1t_t2e1s, Angle=degrees(panel_7), Center=Point(0, 0, 0), Axis=Vector(0, 0, 1))  # -> Geometry, Transform
td4t_t2d4s_2 = Rotate3D(Geometry=td4t_t2d4s.Geometry, Angle=degrees(panel_7), Center=Point(0, 0, 0), Axis=Vector(0, 0, 1))  # -> Geometry, Transform
td2t_t2d2s_2 = Rotate3D(Geometry=td2t_t2d2s.Geometry, Angle=degrees(panel_7), Center=Point(0, 0, 0), Axis=Vector(0, 0, 1))  # -> Geometry, Transform
te2t_t2e2s_2 = Rotate3D(Geometry=te2t_t2e2s, Angle=degrees(panel_7), Center=Point(0, 0, 0), Axis=Vector(0, 0, 1))  # -> Geometry, Transform
td21t_t2d21s_2 = Rotate3D(Geometry=td21t_t2d21s.Geometry, Angle=degrees(panel_7), Center=Point(0, 0, 0), Axis=Vector(0, 0, 1))  # -> Geometry, Transform
td41t_t2d41s_2 = Rotate3D(Geometry=td41t_t2d41s.Geometry, Angle=degrees(panel_7), Center=Point(0, 0, 0), Axis=Vector(0, 0, 1))  # -> Geometry, Transform
t2e1t_2 = Rotate3D(Geometry=t2e1t.Geometry, Angle=degrees(panel_7), Center=Point(0, 0, 0), Axis=Vector(0, 0, 1))  # -> Geometry, Transform
t2d4t_2 = Rotate3D(Geometry=t2d4t.Geometry, Angle=degrees(panel_7), Center=Point(0, 0, 0), Axis=Vector(0, 0, 1))  # -> Geometry, Transform
t2f3t_2 = Rotate3D(Geometry=t2f3t.Geometry, Angle=degrees(panel_7), Center=Point(0, 0, 0), Axis=Vector(0, 0, 1))  # -> Geometry, Transform
t2d2t_2 = Rotate3D(Geometry=t2d2t.Geometry, Angle=degrees(panel_7), Center=Point(0, 0, 0), Axis=Vector(0, 0, 1))  # -> Geometry, Transform
t2f31t_2 = Rotate3D(Geometry=t2f31t.Geometry, Angle=degrees(panel_7), Center=Point(0, 0, 0), Axis=Vector(0, 0, 1))  # -> Geometry, Transform
t2d21t_2 = Rotate3D(Geometry=t2d21t.Geometry, Angle=degrees(panel_7), Center=Point(0, 0, 0), Axis=Vector(0, 0, 1))  # -> Geometry, Transform
t2d41t_2 = Rotate3D(Geometry=t2d41t.Geometry, Angle=degrees(panel_7), Center=Point(0, 0, 0), Axis=Vector(0, 0, 1))  # -> Geometry, Transform
t2e2t_2 = Rotate3D(Geometry=t2e2t.Geometry, Angle=degrees(panel_7), Center=Point(0, 0, 0), Axis=Vector(0, 0, 1))  # -> Geometry, Transform
timberpart2 = TimberPart2(
    pointssource_15=e1t_te1s_2.Geometry,
    pointstarget_15=te1t_t2e1s_2.Geometry,
    divisions_15=div_f_t1,
    U_15=u_e1_e2,
    V_15=global_v,
    pointssource_14=d4t_td4s_2.Geometry,
    pointstarget_14=td4t_t2d4s_2.Geometry,
    divisions_14=div_f_t1,
    U_14=u_d4_d41_td4_td41,
    V_14=global_v,
    pointssource_9=d2t_td2s_2.Geometry,
    pointstarget_9=td2t_t2d2s_2.Geometry,
    divisions_9=div_f_t1,
    U_9=u_d2_d21_d4_d41_timber,
    V_9=global_v,
    pointssource_7=d1t_td1s_3.Geometry,
    pointstarget_7=td1t_t2d1s_3.Geometry,
    divisions_7=div_f_t1,
    U_7=u_a_b_c_d1,
    V_7=global_v,
    pointssource_5=d21t_td21s_2.Geometry,
    pointstarget_5=td21t_t2d21s_2.Geometry,
    divisions_5=div_f_t1,
    U_5=u_d2_d21_d4_d41_timber,
    V_5=global_v,
    pointssource=d41t_td41s_2.Geometry,
    pointstarget=td41t_t2d41s_2.Geometry,
    divisions=div_f_t1,
    U=u_d4_d41_td4_td41,
    V=global_v,
    pointssource_10=e2t_te2s_2.Geometry,
    pointstarget_10=te2t_t2e2s_2.Geometry,
    divisions_10=div_f_t1,
    U_10=u_e1_e2,
    V_10=global_v,
    pointssource_11=te1t_t2e1s_2.Geometry,
    pointstarget_11=t2e1t_2.Geometry,
    divisions_11=divt2,
    U_11=u_e1_e2,
    V_11=global_v,
    pointssource_8=td4t_t2d4s_2.Geometry,
    pointstarget_8=t2d4t_2.Geometry,
    divisions_8=divt2,
    U_8=u_d4_d41_td4_td41,
    V_8=global_v,
    pointssource_12=f3t_t2f3s_2.Geometry,
    pointstarget_12=t2f3t_2.Geometry,
    divisions_12=divt2,
    U_12=u_splice_f3_f31_d3_d31,
    V_12=global_v,
    pointssource_16=td2t_t2d2s_2.Geometry,
    pointstarget_16=t2d2t_2.Geometry,
    divisions_16=divt2,
    U_16=u_d2_d21_d4_d41_timber,
    V_16=global_v,
    pointssource_13=td1t_t2d1s_3.Geometry,
    pointstarget_13=t2d1t_3.Geometry,
    divisions_13=divt2,
    U_13=u_a_b_c_d1,
    V_13=global_v,
    pointssource_6=f31t_t2f31_2.Geometry,
    pointstarget_6=t2f31t_2.Geometry,
    divisions_6=divt2,
    U_6=u_splice_f3_f31_d3_d31,
    V_6=global_v,
    pointssource_3=td41t_t2d41s_2.Geometry,
    pointstarget_3=t2d41t_2.Geometry,
    divisions_3=divt2,
    U_3=u_d4_d41_td4_td41,
    V_3=global_v,
    pointssource_4=te2t_t2e2s_2.Geometry,
    pointstarget_4=t2e2t_2.Geometry,
    divisions_4=divt2,
    U_4=u_e1_e2,
    V_4=global_v,
    pointssource_2=td21t_t2d21s_2.Geometry,
    pointstarget_2=t2d21t_2.Geometry,
    divisions_2=divt2,
    U_2=u_d2_d21_d4_d41_timber,
    V_2=global_v)  # -> mesh_15, srf_15, mesh_14, srf_14, sourcesrf_4, mesh_9, srf_9, mesh_7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

bs_4 = Rotate3D(Geometry=bs.pointlist, Angle=degrees(panel_8), Center=Point(0, 0, 0), Axis=Vector(0, 0, 1))  # -> Geometry, Transform
e1t_te1s_3 = Rotate3D(Geometry=e1t_te1s, Angle=degrees(panel_8), Center=Point(0, 0, 0), Axis=Vector(0, 0, 1))  # -> Geometry, Transform
bt_cs_4 = Rotate3D(Geometry=bt_cs.pointlist, Angle=degrees(panel_8), Center=Point(0, 0, 0), Axis=Vector(0, 0, 1))  # -> Geometry, Transform
ct_d1s_4 = Rotate3D(Geometry=ct_d1s.Geometry, Angle=degrees(panel_8), Center=Point(0, 0, 0), Axis=Vector(0, 0, 1))  # -> Geometry, Transform
e1s_3 = Rotate3D(Geometry=e1s, Angle=degrees(panel_8), Center=Point(0, 0, 0), Axis=Vector(0, 0, 1))  # -> Geometry, Transform
d3t_f3s_3 = Rotate3D(Geometry=d3t_f3s.Geometry, Angle=degrees(panel_8), Center=Point(0, 0, 0), Axis=Vector(0, 0, 1))  # -> Geometry, Transform
f3t_t2f3s_3 = Rotate3D(Geometry=f3t_t2f3s.Geometry, Angle=degrees(panel_8), Center=Point(0, 0, 0), Axis=Vector(0, 0, 1))  # -> Geometry, Transform
d4t_td4s_3 = Rotate3D(Geometry=d4t_td4s, Angle=degrees(panel_8), Center=Point(0, 0, 0), Axis=Vector(0, 0, 1))  # -> Geometry, Transform
f31t_t2f31_3 = Rotate3D(Geometry=f31t_t2f31.Geometry, Angle=degrees(panel_8), Center=Point(0, 0, 0), Axis=Vector(0, 0, 1))  # -> Geometry, Transform
d3s_4 = Rotate3D(Geometry=d3s, Angle=degrees(panel_8), Center=Point(0, 0, 0), Axis=Vector(0, 0, 1))  # -> Geometry, Transform
d4s_3 = Rotate3D(Geometry=d4s, Angle=degrees(panel_8), Center=Point(0, 0, 0), Axis=Vector(0, 0, 1))  # -> Geometry, Transform
d31s_4 = Rotate3D(Geometry=d31s, Angle=degrees(panel_8), Center=Point(0, 0, 0), Axis=Vector(0, 0, 1))  # -> Geometry, Transform
d2s_3 = Rotate3D(Geometry=d2s, Angle=degrees(panel_8), Center=Point(0, 0, 0), Axis=Vector(0, 0, 1))  # -> Geometry, Transform
e2s_3 = Rotate3D(Geometry=e2s, Angle=degrees(panel_8), Center=Point(0, 0, 0), Axis=Vector(0, 0, 1))  # -> Geometry, Transform
d2t_td2s_3 = Rotate3D(Geometry=d2t_td2s, Angle=degrees(panel_8), Center=Point(0, 0, 0), Axis=Vector(0, 0, 1))  # -> Geometry, Transform
d21t_td21s_3 = Rotate3D(Geometry=d21t_td21s, Angle=degrees(panel_8), Center=Point(0, 0, 0), Axis=Vector(0, 0, 1))  # -> Geometry, Transform
e2t_te2s_3 = Rotate3D(Geometry=e2t_te2s, Angle=degrees(panel_8), Center=Point(0, 0, 0), Axis=Vector(0, 0, 1))  # -> Geometry, Transform
d1t_td1s_4 = Rotate3D(Geometry=d1t_td1s.Geometry, Angle=degrees(panel_8), Center=Point(0, 0, 0), Axis=Vector(0, 0, 1))  # -> Geometry, Transform
d21s_3 = Rotate3D(Geometry=d21s, Angle=degrees(panel_8), Center=Point(0, 0, 0), Axis=Vector(0, 0, 1))  # -> Geometry, Transform
d41t_td41s_3 = Rotate3D(Geometry=d41t_td41s, Angle=degrees(panel_8), Center=Point(0, 0, 0), Axis=Vector(0, 0, 1))  # -> Geometry, Transform
d31t_f31s_3 = Rotate3D(Geometry=d31t_f31s.Geometry, Angle=degrees(panel_8), Center=Point(0, 0, 0), Axis=Vector(0, 0, 1))  # -> Geometry, Transform
d41s_3 = Rotate3D(Geometry=d41s, Angle=degrees(panel_8), Center=Point(0, 0, 0), Axis=Vector(0, 0, 1))  # -> Geometry, Transform
alupart3 = AluPart1(
    pointssource=bs_4.Geometry,
    pointstarget=bt_cs_4.Geometry,
    divisions=div_a_b,
    U=u_a_b_c_d1,
    V=global_v,
    pointssource_2=bt_cs_4.Geometry,
    pointstarget_2=ct_d1s_4.Geometry,
    divisions_2=div_c,
    U_2=u_a_b_c_d1,
    V_2=global_v,
    pointssource_3=e1s_3.Geometry,
    pointstarget_3=e1t_te1s_3.Geometry,
    divisions_3=div_d_e,
    U_3=u_e1_e2,
    V_3=global_v,
    pointssource_6=d4s_3.Geometry,
    pointstarget_6=d4t_td4s_3.Geometry,
    divisions_6=div_d_e,
    U_6=u_d4_d41_td4_td41,
    V_6=global_v,
    pointssource_4=d31s_4.Geometry,
    pointstarget_4=d31t_f31s_3.Geometry,
    divisions_4=div_d_e,
    U_4=u_splice_f3_f31_d3_d31,
    V_4=global_v,
    pointssource_5=d2s_3.Geometry,
    pointstarget_5=d2t_td2s_3.Geometry,
    divisions_5=div_d_e,
    U_5=u_d2_d21_d4_d41_timber,
    V_5=global_v,
    pointssource_7=ct_d1s_4.Geometry,
    pointstarget_7=d1t_td1s_4.Geometry,
    divisions_7=div_d_e,
    U_7=u_a_b_c_d1,
    V_7=global_v,
    pointssource_8=d21s_3.Geometry,
    pointstarget_8=d21t_td21s_3.Geometry,
    divisions_8=div_d_e,
    U_8=u_d2_d21_d4_d41_timber,
    V_8=global_v,
    pointssource_9=d3s_4.Geometry,
    pointstarget_9=d3t_f3s_3.Geometry,
    divisions_9=div_d_e,
    U_9=u_splice_f3_f31_d3_d31,
    V_9=global_v,
    pointssource_10=d41s_3.Geometry,
    pointstarget_10=d41t_td41s_3.Geometry,
    divisions_10=div_d_e,
    U_10=u_d4_d41_td4_td41,
    V_10=global_v,
    pointssource_11=e2s_3.Geometry,
    pointstarget_11=e2t_te2s_3.Geometry,
    divisions_11=div_d_e,
    U_11=u_e1_e2,
    V_11=global_v,
    pointssource_13=d3t_f3s_3.Geometry,
    pointstarget_13=f3t_t2f3s_3.Geometry,
    divisions_13=div_f_t1,
    U_13=u_splice_f3_f31_d3_d31,
    V_13=global_v,
    pointssource_12=d31t_f31s_3.Geometry,
    pointstarget_12=f31t_t2f31_3.Geometry,
    divisions_12=div_f_t1,
    U_12=u_splice_f3_f31_d3_d31,
    V_12=global_v)  # -> mesh, srf, sourcesrf, targetsrf, mesh_2, srf_2, sourcesrf_2, targetsrf_2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
alumesh3 = Relay([alupart3.mesh, alupart3.mesh_2, alupart3.mesh_3, alupart3.mesh_6, alupart3.mesh_4, alupart3.mesh_5, alupart3.mesh_7, alupart3.mesh_8, alupart3.mesh_9, alupart3.mesh_10, alupart3.mesh_11, alupart3.mesh_13, alupart3.mesh_12])
te1t_t2e1s_3 = Rotate3D(Geometry=te1t_t2e1s, Angle=degrees(panel_8), Center=Point(0, 0, 0), Axis=Vector(0, 0, 1))  # -> Geometry, Transform
td4t_t2d4s_3 = Rotate3D(Geometry=td4t_t2d4s.Geometry, Angle=degrees(panel_8), Center=Point(0, 0, 0), Axis=Vector(0, 0, 1))  # -> Geometry, Transform
td2t_t2d2s_3 = Rotate3D(Geometry=td2t_t2d2s.Geometry, Angle=degrees(panel_8), Center=Point(0, 0, 0), Axis=Vector(0, 0, 1))  # -> Geometry, Transform
te2t_t2e2s_3 = Rotate3D(Geometry=te2t_t2e2s, Angle=degrees(panel_8), Center=Point(0, 0, 0), Axis=Vector(0, 0, 1))  # -> Geometry, Transform
td21t_t2d21s_3 = Rotate3D(Geometry=td21t_t2d21s.Geometry, Angle=degrees(panel_8), Center=Point(0, 0, 0), Axis=Vector(0, 0, 1))  # -> Geometry, Transform
td1t_t2d1s_4 = Rotate3D(Geometry=td1t_t2d1s.Geometry, Angle=degrees(panel_8), Center=Point(0, 0, 0), Axis=Vector(0, 0, 1))  # -> Geometry, Transform
td41t_t2d41s_3 = Rotate3D(Geometry=td41t_t2d41s.Geometry, Angle=degrees(panel_8), Center=Point(0, 0, 0), Axis=Vector(0, 0, 1))  # -> Geometry, Transform
t2e1t_3 = Rotate3D(Geometry=t2e1t.Geometry, Angle=degrees(panel_8), Center=Point(0, 0, 0), Axis=Vector(0, 0, 1))  # -> Geometry, Transform
t2d4t_3 = Rotate3D(Geometry=t2d4t.Geometry, Angle=degrees(panel_8), Center=Point(0, 0, 0), Axis=Vector(0, 0, 1))  # -> Geometry, Transform
t2d1t_4 = Rotate3D(Geometry=t2d1t.Geometry, Angle=degrees(panel_8), Center=Point(0, 0, 0), Axis=Vector(0, 0, 1))  # -> Geometry, Transform
t2f3t_3 = Rotate3D(Geometry=t2f3t.Geometry, Angle=degrees(panel_8), Center=Point(0, 0, 0), Axis=Vector(0, 0, 1))  # -> Geometry, Transform
t2d2t_3 = Rotate3D(Geometry=t2d2t.Geometry, Angle=degrees(panel_8), Center=Point(0, 0, 0), Axis=Vector(0, 0, 1))  # -> Geometry, Transform
t2f31t_3 = Rotate3D(Geometry=t2f31t.Geometry, Angle=degrees(panel_8), Center=Point(0, 0, 0), Axis=Vector(0, 0, 1))  # -> Geometry, Transform
t2d21t_3 = Rotate3D(Geometry=t2d21t.Geometry, Angle=degrees(panel_8), Center=Point(0, 0, 0), Axis=Vector(0, 0, 1))  # -> Geometry, Transform
t2d41t_3 = Rotate3D(Geometry=t2d41t.Geometry, Angle=degrees(panel_8), Center=Point(0, 0, 0), Axis=Vector(0, 0, 1))  # -> Geometry, Transform
t2e2t_3 = Rotate3D(Geometry=t2e2t.Geometry, Angle=degrees(panel_8), Center=Point(0, 0, 0), Axis=Vector(0, 0, 1))  # -> Geometry, Transform
timberpart3 = TimberPart2(
    pointssource_15=e1t_te1s_3.Geometry,
    pointstarget_15=te1t_t2e1s_3.Geometry,
    divisions_15=div_f_t1,
    U_15=u_e1_e2,
    V_15=global_v,
    pointssource_14=d4t_td4s_3.Geometry,
    pointstarget_14=td4t_t2d4s_3.Geometry,
    divisions_14=div_f_t1,
    U_14=u_d4_d41_td4_td41,
    V_14=global_v,
    pointssource_9=d2t_td2s_3.Geometry,
    pointstarget_9=td2t_t2d2s_3.Geometry,
    divisions_9=div_f_t1,
    U_9=u_d2_d21_d4_d41_timber,
    V_9=global_v,
    pointssource_7=d1t_td1s_4.Geometry,
    pointstarget_7=td1t_t2d1s_4.Geometry,
    divisions_7=div_f_t1,
    U_7=u_a_b_c_d1,
    V_7=global_v,
    pointssource_5=d21t_td21s_3.Geometry,
    pointstarget_5=td21t_t2d21s_3.Geometry,
    divisions_5=div_f_t1,
    U_5=u_d2_d21_d4_d41_timber,
    V_5=global_v,
    pointssource=d41t_td41s_3.Geometry,
    pointstarget=td41t_t2d41s_3.Geometry,
    divisions=div_f_t1,
    U=u_d4_d41_td4_td41,
    V=global_v,
    pointssource_10=e2t_te2s_3.Geometry,
    pointstarget_10=te2t_t2e2s_3.Geometry,
    divisions_10=div_f_t1,
    U_10=u_e1_e2,
    V_10=global_v,
    pointssource_11=te1t_t2e1s_3.Geometry,
    pointstarget_11=t2e1t_3.Geometry,
    divisions_11=divt2,
    U_11=u_e1_e2,
    V_11=global_v,
    pointssource_8=td4t_t2d4s_3.Geometry,
    pointstarget_8=t2d4t_3.Geometry,
    divisions_8=divt2,
    U_8=u_d4_d41_td4_td41,
    V_8=global_v,
    pointssource_12=f3t_t2f3s_3.Geometry,
    pointstarget_12=t2f3t_3.Geometry,
    divisions_12=divt2,
    U_12=u_splice_f3_f31_d3_d31,
    V_12=global_v,
    pointssource_16=td2t_t2d2s_3.Geometry,
    pointstarget_16=t2d2t_3.Geometry,
    divisions_16=divt2,
    U_16=u_d2_d21_d4_d41_timber,
    V_16=global_v,
    pointssource_13=td1t_t2d1s_4.Geometry,
    pointstarget_13=t2d1t_4.Geometry,
    divisions_13=divt2,
    U_13=u_a_b_c_d1,
    V_13=global_v,
    pointssource_6=f31t_t2f31_3.Geometry,
    pointstarget_6=t2f31t_3.Geometry,
    divisions_6=divt2,
    U_6=u_splice_f3_f31_d3_d31,
    V_6=global_v,
    pointssource_3=td41t_t2d41s_3.Geometry,
    pointstarget_3=t2d41t_3.Geometry,
    divisions_3=divt2,
    U_3=u_d4_d41_td4_td41,
    V_3=global_v,
    pointssource_4=te2t_t2e2s_3.Geometry,
    pointstarget_4=t2e2t_3.Geometry,
    divisions_4=divt2,
    U_4=u_e1_e2,
    V_4=global_v,
    pointssource_2=td21t_t2d21s_3.Geometry,
    pointstarget_2=t2d21t_3.Geometry,
    divisions_2=divt2,
    U_2=u_d2_d21_d4_d41_timber,
    V_2=global_v)  # -> mesh_15, srf_15, mesh_14, srf_14, sourcesrf_4, mesh_9, srf_9, mesh_7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

bs_5 = Rotate3D(Geometry=bs.pointlist, Angle=degrees(panel_9), Center=Point(0, 0, 0), Axis=Vector(0, 0, 1))  # -> Geometry, Transform
e1t_te1s_4 = Rotate3D(Geometry=e1t_te1s, Angle=degrees(panel_9), Center=Point(0, 0, 0), Axis=Vector(0, 0, 1))  # -> Geometry, Transform
bt_cs_5 = Rotate3D(Geometry=bt_cs.pointlist, Angle=degrees(panel_9), Center=Point(0, 0, 0), Axis=Vector(0, 0, 1))  # -> Geometry, Transform
ct_d1s_5 = Rotate3D(Geometry=ct_d1s.Geometry, Angle=degrees(panel_9), Center=Point(0, 0, 0), Axis=Vector(0, 0, 1))  # -> Geometry, Transform
e1s_4 = Rotate3D(Geometry=e1s, Angle=degrees(panel_9), Center=Point(0, 0, 0), Axis=Vector(0, 0, 1))  # -> Geometry, Transform
d3t_f3s_4 = Rotate3D(Geometry=d3t_f3s.Geometry, Angle=degrees(panel_9), Center=Point(0, 0, 0), Axis=Vector(0, 0, 1))  # -> Geometry, Transform
f3t_t2f3s_4 = Rotate3D(Geometry=f3t_t2f3s.Geometry, Angle=degrees(panel_9), Center=Point(0, 0, 0), Axis=Vector(0, 0, 1))  # -> Geometry, Transform
d4t_td4s_4 = Rotate3D(Geometry=d4t_td4s, Angle=degrees(panel_9), Center=Point(0, 0, 0), Axis=Vector(0, 0, 1))  # -> Geometry, Transform
f31t_t2f31_4 = Rotate3D(Geometry=f31t_t2f31.Geometry, Angle=degrees(panel_9), Center=Point(0, 0, 0), Axis=Vector(0, 0, 1))  # -> Geometry, Transform
d3s_5 = Rotate3D(Geometry=d3s, Angle=degrees(panel_9), Center=Point(0, 0, 0), Axis=Vector(0, 0, 1))  # -> Geometry, Transform
d4s_4 = Rotate3D(Geometry=d4s, Angle=degrees(panel_9), Center=Point(0, 0, 0), Axis=Vector(0, 0, 1))  # -> Geometry, Transform
d31s_5 = Rotate3D(Geometry=d31s, Angle=degrees(panel_9), Center=Point(0, 0, 0), Axis=Vector(0, 0, 1))  # -> Geometry, Transform
d2s_4 = Rotate3D(Geometry=d2s, Angle=degrees(panel_9), Center=Point(0, 0, 0), Axis=Vector(0, 0, 1))  # -> Geometry, Transform
e2s_4 = Rotate3D(Geometry=e2s, Angle=degrees(panel_9), Center=Point(0, 0, 0), Axis=Vector(0, 0, 1))  # -> Geometry, Transform
d2t_td2s_4 = Rotate3D(Geometry=d2t_td2s, Angle=degrees(panel_9), Center=Point(0, 0, 0), Axis=Vector(0, 0, 1))  # -> Geometry, Transform
d21t_td21s_4 = Rotate3D(Geometry=d21t_td21s, Angle=degrees(panel_9), Center=Point(0, 0, 0), Axis=Vector(0, 0, 1))  # -> Geometry, Transform
e2t_te2s_4 = Rotate3D(Geometry=e2t_te2s, Angle=degrees(panel_9), Center=Point(0, 0, 0), Axis=Vector(0, 0, 1))  # -> Geometry, Transform
d1t_td1s_5 = Rotate3D(Geometry=d1t_td1s.Geometry, Angle=degrees(panel_9), Center=Point(0, 0, 0), Axis=Vector(0, 0, 1))  # -> Geometry, Transform
d21s_4 = Rotate3D(Geometry=d21s, Angle=degrees(panel_9), Center=Point(0, 0, 0), Axis=Vector(0, 0, 1))  # -> Geometry, Transform
d41t_td41s_4 = Rotate3D(Geometry=d41t_td41s, Angle=degrees(panel_9), Center=Point(0, 0, 0), Axis=Vector(0, 0, 1))  # -> Geometry, Transform
d31t_f31s_4 = Rotate3D(Geometry=d31t_f31s.Geometry, Angle=degrees(panel_9), Center=Point(0, 0, 0), Axis=Vector(0, 0, 1))  # -> Geometry, Transform
d41s_4 = Rotate3D(Geometry=d41s, Angle=degrees(panel_9), Center=Point(0, 0, 0), Axis=Vector(0, 0, 1))  # -> Geometry, Transform
alupart4 = AluPart1(
    pointssource=bs_5.Geometry,
    pointstarget=bt_cs_5.Geometry,
    divisions=div_a_b,
    U=u_a_b_c_d1,
    V=global_v,
    pointssource_2=bt_cs_5.Geometry,
    pointstarget_2=ct_d1s_5.Geometry,
    divisions_2=div_c,
    U_2=u_a_b_c_d1,
    V_2=global_v,
    pointssource_3=e1s_4.Geometry,
    pointstarget_3=e1t_te1s_4.Geometry,
    divisions_3=div_d_e,
    U_3=u_e1_e2,
    V_3=global_v,
    pointssource_6=d4s_4.Geometry,
    pointstarget_6=d4t_td4s_4.Geometry,
    divisions_6=div_d_e,
    U_6=u_d4_d41_td4_td41,
    V_6=global_v,
    pointssource_4=d31s_5.Geometry,
    pointstarget_4=d31t_f31s_4.Geometry,
    divisions_4=div_d_e,
    U_4=u_splice_f3_f31_d3_d31,
    V_4=global_v,
    pointssource_5=d2s_4.Geometry,
    pointstarget_5=d2t_td2s_4.Geometry,
    divisions_5=div_d_e,
    U_5=u_d2_d21_d4_d41_timber,
    V_5=global_v,
    pointssource_7=ct_d1s_5.Geometry,
    pointstarget_7=d1t_td1s_5.Geometry,
    divisions_7=div_d_e,
    U_7=u_a_b_c_d1,
    V_7=global_v,
    pointssource_8=d21s_4.Geometry,
    pointstarget_8=d21t_td21s_4.Geometry,
    divisions_8=div_d_e,
    U_8=u_d2_d21_d4_d41_timber,
    V_8=global_v,
    pointssource_9=d3s_5.Geometry,
    pointstarget_9=d3t_f3s_4.Geometry,
    divisions_9=div_d_e,
    U_9=u_splice_f3_f31_d3_d31,
    V_9=global_v,
    pointssource_10=d41s_4.Geometry,
    pointstarget_10=d41t_td41s_4.Geometry,
    divisions_10=div_d_e,
    U_10=u_d4_d41_td4_td41,
    V_10=global_v,
    pointssource_11=e2s_4.Geometry,
    pointstarget_11=e2t_te2s_4.Geometry,
    divisions_11=div_d_e,
    U_11=u_e1_e2,
    V_11=global_v,
    pointssource_13=d3t_f3s_4.Geometry,
    pointstarget_13=f3t_t2f3s_4.Geometry,
    divisions_13=div_f_t1,
    U_13=u_splice_f3_f31_d3_d31,
    V_13=global_v,
    pointssource_12=d31t_f31s_4.Geometry,
    pointstarget_12=f31t_t2f31_4.Geometry,
    divisions_12=div_f_t1,
    U_12=u_splice_f3_f31_d3_d31,
    V_12=global_v)  # -> mesh, srf, sourcesrf, targetsrf, mesh_2, srf_2, sourcesrf_2, targetsrf_2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
alumesh4 = Relay([alupart4.mesh, alupart4.mesh_2, alupart4.mesh_3, alupart4.mesh_6, alupart4.mesh_4, alupart4.mesh_5, alupart4.mesh_7, alupart4.mesh_8, alupart4.mesh_9, alupart4.mesh_10, alupart4.mesh_11, alupart4.mesh_13, alupart4.mesh_12])
te1t_t2e1s_4 = Rotate3D(Geometry=te1t_t2e1s, Angle=degrees(panel_9), Center=Point(0, 0, 0), Axis=Vector(0, 0, 1))  # -> Geometry, Transform
td4t_t2d4s_4 = Rotate3D(Geometry=td4t_t2d4s.Geometry, Angle=degrees(panel_9), Center=Point(0, 0, 0), Axis=Vector(0, 0, 1))  # -> Geometry, Transform
td2t_t2d2s_4 = Rotate3D(Geometry=td2t_t2d2s.Geometry, Angle=degrees(panel_9), Center=Point(0, 0, 0), Axis=Vector(0, 0, 1))  # -> Geometry, Transform
te2t_t2e2s_4 = Rotate3D(Geometry=te2t_t2e2s, Angle=degrees(panel_9), Center=Point(0, 0, 0), Axis=Vector(0, 0, 1))  # -> Geometry, Transform
td21t_t2d21s_4 = Rotate3D(Geometry=td21t_t2d21s.Geometry, Angle=degrees(panel_9), Center=Point(0, 0, 0), Axis=Vector(0, 0, 1))  # -> Geometry, Transform
td1t_t2d1s_5 = Rotate3D(Geometry=td1t_t2d1s.Geometry, Angle=degrees(panel_9), Center=Point(0, 0, 0), Axis=Vector(0, 0, 1))  # -> Geometry, Transform
td41t_t2d41s_4 = Rotate3D(Geometry=td41t_t2d41s.Geometry, Angle=degrees(panel_9), Center=Point(0, 0, 0), Axis=Vector(0, 0, 1))  # -> Geometry, Transform
t2e1t_4 = Rotate3D(Geometry=t2e1t.Geometry, Angle=degrees(panel_9), Center=Point(0, 0, 0), Axis=Vector(0, 0, 1))  # -> Geometry, Transform
t2d4t_4 = Rotate3D(Geometry=t2d4t.Geometry, Angle=degrees(panel_9), Center=Point(0, 0, 0), Axis=Vector(0, 0, 1))  # -> Geometry, Transform
t2d1t_5 = Rotate3D(Geometry=t2d1t.Geometry, Angle=degrees(panel_9), Center=Point(0, 0, 0), Axis=Vector(0, 0, 1))  # -> Geometry, Transform
t2f3t_4 = Rotate3D(Geometry=t2f3t.Geometry, Angle=degrees(panel_9), Center=Point(0, 0, 0), Axis=Vector(0, 0, 1))  # -> Geometry, Transform
t2d2t_4 = Rotate3D(Geometry=t2d2t.Geometry, Angle=degrees(panel_9), Center=Point(0, 0, 0), Axis=Vector(0, 0, 1))  # -> Geometry, Transform
t2f31t_4 = Rotate3D(Geometry=t2f31t.Geometry, Angle=degrees(panel_9), Center=Point(0, 0, 0), Axis=Vector(0, 0, 1))  # -> Geometry, Transform
t2d21t_4 = Rotate3D(Geometry=t2d21t.Geometry, Angle=degrees(panel_9), Center=Point(0, 0, 0), Axis=Vector(0, 0, 1))  # -> Geometry, Transform
t2d41t_4 = Rotate3D(Geometry=t2d41t.Geometry, Angle=degrees(panel_9), Center=Point(0, 0, 0), Axis=Vector(0, 0, 1))  # -> Geometry, Transform
t2e2t_4 = Rotate3D(Geometry=t2e2t.Geometry, Angle=degrees(panel_9), Center=Point(0, 0, 0), Axis=Vector(0, 0, 1))  # -> Geometry, Transform
timberpart4 = TimberPart2(
    pointssource_15=e1t_te1s_4.Geometry,
    pointstarget_15=te1t_t2e1s_4.Geometry,
    divisions_15=div_f_t1,
    U_15=u_e1_e2,
    V_15=global_v,
    pointssource_14=d4t_td4s_4.Geometry,
    pointstarget_14=td4t_t2d4s_4.Geometry,
    divisions_14=div_f_t1,
    U_14=u_d4_d41_td4_td41,
    V_14=global_v,
    pointssource_9=d2t_td2s_4.Geometry,
    pointstarget_9=td2t_t2d2s_4.Geometry,
    divisions_9=div_f_t1,
    U_9=u_d2_d21_d4_d41_timber,
    V_9=global_v,
    pointssource_7=d1t_td1s_5.Geometry,
    pointstarget_7=td1t_t2d1s_5.Geometry,
    divisions_7=div_f_t1,
    U_7=u_a_b_c_d1,
    V_7=global_v,
    pointssource_5=d21t_td21s_4.Geometry,
    pointstarget_5=td21t_t2d21s_4.Geometry,
    divisions_5=div_f_t1,
    U_5=u_d2_d21_d4_d41_timber,
    V_5=global_v,
    pointssource=d41t_td41s_4.Geometry,
    pointstarget=td41t_t2d41s_4.Geometry,
    divisions=div_f_t1,
    U=u_d4_d41_td4_td41,
    V=global_v,
    pointssource_10=e2t_te2s_4.Geometry,
    pointstarget_10=te2t_t2e2s_4.Geometry,
    divisions_10=div_f_t1,
    U_10=u_e1_e2,
    V_10=global_v,
    pointssource_11=te1t_t2e1s_4.Geometry,
    pointstarget_11=t2e1t_4.Geometry,
    divisions_11=divt2,
    U_11=u_e1_e2,
    V_11=global_v,
    pointssource_8=td4t_t2d4s_4.Geometry,
    pointstarget_8=t2d4t_4.Geometry,
    divisions_8=divt2,
    U_8=u_d4_d41_td4_td41,
    V_8=global_v,
    pointssource_12=f3t_t2f3s_4.Geometry,
    pointstarget_12=t2f3t_4.Geometry,
    divisions_12=divt2,
    U_12=u_splice_f3_f31_d3_d31,
    V_12=global_v,
    pointssource_16=td2t_t2d2s_4.Geometry,
    pointstarget_16=t2d2t_4.Geometry,
    divisions_16=divt2,
    U_16=u_d2_d21_d4_d41_timber,
    V_16=global_v,
    pointssource_13=td1t_t2d1s_5.Geometry,
    pointstarget_13=t2d1t_5.Geometry,
    divisions_13=divt2,
    U_13=u_a_b_c_d1,
    V_13=global_v,
    pointssource_6=f31t_t2f31_4.Geometry,
    pointstarget_6=t2f31t_4.Geometry,
    divisions_6=divt2,
    U_6=u_splice_f3_f31_d3_d31,
    V_6=global_v,
    pointssource_3=td41t_t2d41s_4.Geometry,
    pointstarget_3=t2d41t_4.Geometry,
    divisions_3=divt2,
    U_3=u_d4_d41_td4_td41,
    V_3=global_v,
    pointssource_4=te2t_t2e2s_4.Geometry,
    pointstarget_4=t2e2t_4.Geometry,
    divisions_4=divt2,
    U_4=u_e1_e2,
    V_4=global_v,
    pointssource_2=td21t_t2d21s_4.Geometry,
    pointstarget_2=t2d21t_4.Geometry,
    divisions_2=divt2,
    U_2=u_d2_d21_d4_d41_timber,
    V_2=global_v)  # -> mesh_15, srf_15, mesh_14, srf_14, sourcesrf_4, mesh_9, srf_9, mesh_7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

bs_6 = Rotate3D(Geometry=bs.pointlist, Angle=degrees(panel_10), Center=Point(0, 0, 0), Axis=Vector(0, 0, 1))  # -> Geometry, Transform
e1t_te1s_5 = Rotate3D(Geometry=e1t_te1s, Angle=degrees(panel_10), Center=Point(0, 0, 0), Axis=Vector(0, 0, 1))  # -> Geometry, Transform
bt_cs_6 = Rotate3D(Geometry=bt_cs.pointlist, Angle=degrees(panel_10), Center=Point(0, 0, 0), Axis=Vector(0, 0, 1))  # -> Geometry, Transform
ct_d1s_6 = Rotate3D(Geometry=ct_d1s.Geometry, Angle=degrees(panel_10), Center=Point(0, 0, 0), Axis=Vector(0, 0, 1))  # -> Geometry, Transform
e1s_5 = Rotate3D(Geometry=e1s, Angle=degrees(panel_10), Center=Point(0, 0, 0), Axis=Vector(0, 0, 1))  # -> Geometry, Transform
d3t_f3s_5 = Rotate3D(Geometry=d3t_f3s.Geometry, Angle=degrees(panel_10), Center=Point(0, 0, 0), Axis=Vector(0, 0, 1))  # -> Geometry, Transform
f3t_t2f3s_5 = Rotate3D(Geometry=f3t_t2f3s.Geometry, Angle=degrees(panel_10), Center=Point(0, 0, 0), Axis=Vector(0, 0, 1))  # -> Geometry, Transform
d4t_td4s_5 = Rotate3D(Geometry=d4t_td4s, Angle=degrees(panel_10), Center=Point(0, 0, 0), Axis=Vector(0, 0, 1))  # -> Geometry, Transform
f31t_t2f31_5 = Rotate3D(Geometry=f31t_t2f31.Geometry, Angle=degrees(panel_10), Center=Point(0, 0, 0), Axis=Vector(0, 0, 1))  # -> Geometry, Transform
d3s_6 = Rotate3D(Geometry=d3s, Angle=degrees(panel_10), Center=Point(0, 0, 0), Axis=Vector(0, 0, 1))  # -> Geometry, Transform
d4s_5 = Rotate3D(Geometry=d4s, Angle=degrees(panel_10), Center=Point(0, 0, 0), Axis=Vector(0, 0, 1))  # -> Geometry, Transform
d31s_6 = Rotate3D(Geometry=d31s, Angle=degrees(panel_10), Center=Point(0, 0, 0), Axis=Vector(0, 0, 1))  # -> Geometry, Transform
d2s_5 = Rotate3D(Geometry=d2s, Angle=degrees(panel_10), Center=Point(0, 0, 0), Axis=Vector(0, 0, 1))  # -> Geometry, Transform
e2s_5 = Rotate3D(Geometry=e2s, Angle=degrees(panel_10), Center=Point(0, 0, 0), Axis=Vector(0, 0, 1))  # -> Geometry, Transform
d2t_td2s_5 = Rotate3D(Geometry=d2t_td2s, Angle=degrees(panel_10), Center=Point(0, 0, 0), Axis=Vector(0, 0, 1))  # -> Geometry, Transform
d21t_td21s_5 = Rotate3D(Geometry=d21t_td21s, Angle=degrees(panel_10), Center=Point(0, 0, 0), Axis=Vector(0, 0, 1))  # -> Geometry, Transform
e2t_te2s_5 = Rotate3D(Geometry=e2t_te2s, Angle=degrees(panel_10), Center=Point(0, 0, 0), Axis=Vector(0, 0, 1))  # -> Geometry, Transform
d1t_td1s_6 = Rotate3D(Geometry=d1t_td1s.Geometry, Angle=degrees(panel_10), Center=Point(0, 0, 0), Axis=Vector(0, 0, 1))  # -> Geometry, Transform
d21s_5 = Rotate3D(Geometry=d21s, Angle=degrees(panel_10), Center=Point(0, 0, 0), Axis=Vector(0, 0, 1))  # -> Geometry, Transform
d41t_td41s_5 = Rotate3D(Geometry=d41t_td41s, Angle=degrees(panel_10), Center=Point(0, 0, 0), Axis=Vector(0, 0, 1))  # -> Geometry, Transform
d31t_f31s_5 = Rotate3D(Geometry=d31t_f31s.Geometry, Angle=degrees(panel_10), Center=Point(0, 0, 0), Axis=Vector(0, 0, 1))  # -> Geometry, Transform
d41s_5 = Rotate3D(Geometry=d41s, Angle=degrees(panel_10), Center=Point(0, 0, 0), Axis=Vector(0, 0, 1))  # -> Geometry, Transform
alupart6 = AluPart1(
    pointssource=bs_6.Geometry,
    pointstarget=bt_cs_6.Geometry,
    divisions=div_a_b,
    U=u_a_b_c_d1,
    V=global_v,
    pointssource_2=bt_cs_6.Geometry,
    pointstarget_2=ct_d1s_6.Geometry,
    divisions_2=div_c,
    U_2=u_a_b_c_d1,
    V_2=global_v,
    pointssource_3=e1s_5.Geometry,
    pointstarget_3=e1t_te1s_5.Geometry,
    divisions_3=div_d_e,
    U_3=u_e1_e2,
    V_3=global_v,
    pointssource_6=d4s_5.Geometry,
    pointstarget_6=d4t_td4s_5.Geometry,
    divisions_6=div_d_e,
    U_6=u_d4_d41_td4_td41,
    V_6=global_v,
    pointssource_4=d31s_6.Geometry,
    pointstarget_4=d31t_f31s_5.Geometry,
    divisions_4=div_d_e,
    U_4=u_splice_f3_f31_d3_d31,
    V_4=global_v,
    pointssource_5=d2s_5.Geometry,
    pointstarget_5=d2t_td2s_5.Geometry,
    divisions_5=div_d_e,
    U_5=u_d2_d21_d4_d41_timber,
    V_5=global_v,
    pointssource_7=ct_d1s_6.Geometry,
    pointstarget_7=d1t_td1s_6.Geometry,
    divisions_7=div_d_e,
    U_7=u_a_b_c_d1,
    V_7=global_v,
    pointssource_8=d21s_5.Geometry,
    pointstarget_8=d21t_td21s_5.Geometry,
    divisions_8=div_d_e,
    U_8=u_d2_d21_d4_d41_timber,
    V_8=global_v,
    pointssource_9=d3s_6.Geometry,
    pointstarget_9=d3t_f3s_5.Geometry,
    divisions_9=div_d_e,
    U_9=u_splice_f3_f31_d3_d31,
    V_9=global_v,
    pointssource_10=d41s_5.Geometry,
    pointstarget_10=d41t_td41s_5.Geometry,
    divisions_10=div_d_e,
    U_10=u_d4_d41_td4_td41,
    V_10=global_v,
    pointssource_11=e2s_5.Geometry,
    pointstarget_11=e2t_te2s_5.Geometry,
    divisions_11=div_d_e,
    U_11=u_e1_e2,
    V_11=global_v,
    pointssource_13=d3t_f3s_5.Geometry,
    pointstarget_13=f3t_t2f3s_5.Geometry,
    divisions_13=div_f_t1,
    U_13=u_splice_f3_f31_d3_d31,
    V_13=global_v,
    pointssource_12=d31t_f31s_5.Geometry,
    pointstarget_12=f31t_t2f31_5.Geometry,
    divisions_12=div_f_t1,
    U_12=u_splice_f3_f31_d3_d31,
    V_12=global_v)  # -> mesh, srf, sourcesrf, targetsrf, mesh_2, srf_2, sourcesrf_2, targetsrf_2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
alumesh6 = Relay([alupart6.mesh, alupart6.mesh_2, alupart6.mesh_3, alupart6.mesh_6, alupart6.mesh_4, alupart6.mesh_5, alupart6.mesh_7, alupart6.mesh_8, alupart6.mesh_9, alupart6.mesh_10, alupart6.mesh_11, alupart6.mesh_13, alupart6.mesh_12])
te1t_t2e1s_5 = Rotate3D(Geometry=te1t_t2e1s, Angle=degrees(panel_10), Center=Point(0, 0, 0), Axis=Vector(0, 0, 1))  # -> Geometry, Transform
td4t_t2d4s_5 = Rotate3D(Geometry=td4t_t2d4s.Geometry, Angle=degrees(panel_10), Center=Point(0, 0, 0), Axis=Vector(0, 0, 1))  # -> Geometry, Transform
td2t_t2d2s_5 = Rotate3D(Geometry=td2t_t2d2s.Geometry, Angle=degrees(panel_10), Center=Point(0, 0, 0), Axis=Vector(0, 0, 1))  # -> Geometry, Transform
te2t_t2e2s_5 = Rotate3D(Geometry=te2t_t2e2s, Angle=degrees(panel_10), Center=Point(0, 0, 0), Axis=Vector(0, 0, 1))  # -> Geometry, Transform
td21t_t2d21s_5 = Rotate3D(Geometry=td21t_t2d21s.Geometry, Angle=degrees(panel_10), Center=Point(0, 0, 0), Axis=Vector(0, 0, 1))  # -> Geometry, Transform
td1t_t2d1s_6 = Rotate3D(Geometry=td1t_t2d1s.Geometry, Angle=degrees(panel_10), Center=Point(0, 0, 0), Axis=Vector(0, 0, 1))  # -> Geometry, Transform
td41t_t2d41s_5 = Rotate3D(Geometry=td41t_t2d41s.Geometry, Angle=degrees(panel_10), Center=Point(0, 0, 0), Axis=Vector(0, 0, 1))  # -> Geometry, Transform
t2e1t_5 = Rotate3D(Geometry=t2e1t.Geometry, Angle=degrees(panel_10), Center=Point(0, 0, 0), Axis=Vector(0, 0, 1))  # -> Geometry, Transform
t2d4t_5 = Rotate3D(Geometry=t2d4t.Geometry, Angle=degrees(panel_10), Center=Point(0, 0, 0), Axis=Vector(0, 0, 1))  # -> Geometry, Transform
t2d1t_6 = Rotate3D(Geometry=t2d1t.Geometry, Angle=degrees(panel_10), Center=Point(0, 0, 0), Axis=Vector(0, 0, 1))  # -> Geometry, Transform
t2f3t_5 = Rotate3D(Geometry=t2f3t.Geometry, Angle=degrees(panel_10), Center=Point(0, 0, 0), Axis=Vector(0, 0, 1))  # -> Geometry, Transform
t2d2t_5 = Rotate3D(Geometry=t2d2t.Geometry, Angle=degrees(panel_10), Center=Point(0, 0, 0), Axis=Vector(0, 0, 1))  # -> Geometry, Transform
t2f31t_5 = Rotate3D(Geometry=t2f31t.Geometry, Angle=degrees(panel_10), Center=Point(0, 0, 0), Axis=Vector(0, 0, 1))  # -> Geometry, Transform
t2d21t_5 = Rotate3D(Geometry=t2d21t.Geometry, Angle=degrees(panel_10), Center=Point(0, 0, 0), Axis=Vector(0, 0, 1))  # -> Geometry, Transform
t2d41t_5 = Rotate3D(Geometry=t2d41t.Geometry, Angle=degrees(panel_10), Center=Point(0, 0, 0), Axis=Vector(0, 0, 1))  # -> Geometry, Transform
t2e2t_5 = Rotate3D(Geometry=t2e2t.Geometry, Angle=degrees(panel_10), Center=Point(0, 0, 0), Axis=Vector(0, 0, 1))  # -> Geometry, Transform
timberpart6 = TimberPart2(
    pointssource_15=e1t_te1s_5.Geometry,
    pointstarget_15=te1t_t2e1s_5.Geometry,
    divisions_15=div_f_t1,
    U_15=u_e1_e2,
    V_15=global_v,
    pointssource_14=d4t_td4s_5.Geometry,
    pointstarget_14=td4t_t2d4s_5.Geometry,
    divisions_14=div_f_t1,
    U_14=u_d4_d41_td4_td41,
    V_14=global_v,
    pointssource_9=d2t_td2s_5.Geometry,
    pointstarget_9=td2t_t2d2s_5.Geometry,
    divisions_9=div_f_t1,
    U_9=u_d2_d21_d4_d41_timber,
    V_9=global_v,
    pointssource_7=d1t_td1s_6.Geometry,
    pointstarget_7=td1t_t2d1s_6.Geometry,
    divisions_7=div_f_t1,
    U_7=u_a_b_c_d1,
    V_7=global_v,
    pointssource_5=d21t_td21s_5.Geometry,
    pointstarget_5=td21t_t2d21s_5.Geometry,
    divisions_5=div_f_t1,
    U_5=u_d2_d21_d4_d41_timber,
    V_5=global_v,
    pointssource=d41t_td41s_5.Geometry,
    pointstarget=td41t_t2d41s_5.Geometry,
    divisions=div_f_t1,
    U=u_d4_d41_td4_td41,
    V=global_v,
    pointssource_10=e2t_te2s_5.Geometry,
    pointstarget_10=te2t_t2e2s_5.Geometry,
    divisions_10=div_f_t1,
    U_10=u_e1_e2,
    V_10=global_v,
    pointssource_11=te1t_t2e1s_5.Geometry,
    pointstarget_11=t2e1t_5.Geometry,
    divisions_11=divt2,
    U_11=u_e1_e2,
    V_11=global_v,
    pointssource_8=td4t_t2d4s_5.Geometry,
    pointstarget_8=t2d4t_5.Geometry,
    divisions_8=divt2,
    U_8=u_d4_d41_td4_td41,
    V_8=global_v,
    pointssource_12=f3t_t2f3s_5.Geometry,
    pointstarget_12=t2f3t_5.Geometry,
    divisions_12=divt2,
    U_12=u_splice_f3_f31_d3_d31,
    V_12=global_v,
    pointssource_16=td2t_t2d2s_5.Geometry,
    pointstarget_16=t2d2t_5.Geometry,
    divisions_16=divt2,
    U_16=u_d2_d21_d4_d41_timber,
    V_16=global_v,
    pointssource_13=td1t_t2d1s_6.Geometry,
    pointstarget_13=t2d1t_6.Geometry,
    divisions_13=divt2,
    U_13=u_a_b_c_d1,
    V_13=global_v,
    pointssource_6=f31t_t2f31_5.Geometry,
    pointstarget_6=t2f31t_5.Geometry,
    divisions_6=divt2,
    U_6=u_splice_f3_f31_d3_d31,
    V_6=global_v,
    pointssource_3=td41t_t2d41s_5.Geometry,
    pointstarget_3=t2d41t_5.Geometry,
    divisions_3=divt2,
    U_3=u_d4_d41_td4_td41,
    V_3=global_v,
    pointssource_4=te2t_t2e2s_5.Geometry,
    pointstarget_4=t2e2t_5.Geometry,
    divisions_4=divt2,
    U_4=u_e1_e2,
    V_4=global_v,
    pointssource_2=td21t_t2d21s_5.Geometry,
    pointstarget_2=t2d21t_5.Geometry,
    divisions_2=divt2,
    U_2=u_d2_d21_d4_d41_timber,
    V_2=global_v)  # -> mesh_15, srf_15, mesh_14, srf_14, sourcesrf_4, mesh_9, srf_9, mesh_7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

e1t_te1s_6 = Rotate3D(Geometry=e1t_te1s, Angle=degrees(panel_11), Center=Point(0, 0, 0), Axis=Vector(0, 0, 1))  # -> Geometry, Transform
e1s_6 = Rotate3D(Geometry=e1s, Angle=degrees(panel_11), Center=Point(0, 0, 0), Axis=Vector(0, 0, 1))  # -> Geometry, Transform
d3t_f3s_6 = Rotate3D(Geometry=d3t_f3s.Geometry, Angle=degrees(panel_11), Center=Point(0, 0, 0), Axis=Vector(0, 0, 1))  # -> Geometry, Transform
f3t_t2f3s_6 = Rotate3D(Geometry=f3t_t2f3s.Geometry, Angle=degrees(panel_11), Center=Point(0, 0, 0), Axis=Vector(0, 0, 1))  # -> Geometry, Transform
d4t_td4s_6 = Rotate3D(Geometry=d4t_td4s, Angle=degrees(panel_11), Center=Point(0, 0, 0), Axis=Vector(0, 0, 1))  # -> Geometry, Transform
f31t_t2f31_6 = Rotate3D(Geometry=f31t_t2f31.Geometry, Angle=degrees(panel_11), Center=Point(0, 0, 0), Axis=Vector(0, 0, 1))  # -> Geometry, Transform
d4s_6 = Rotate3D(Geometry=d4s, Angle=degrees(panel_11), Center=Point(0, 0, 0), Axis=Vector(0, 0, 1))  # -> Geometry, Transform
d2s_6 = Rotate3D(Geometry=d2s, Angle=degrees(panel_11), Center=Point(0, 0, 0), Axis=Vector(0, 0, 1))  # -> Geometry, Transform
e2s_6 = Rotate3D(Geometry=e2s, Angle=degrees(panel_11), Center=Point(0, 0, 0), Axis=Vector(0, 0, 1))  # -> Geometry, Transform
d2t_td2s_6 = Rotate3D(Geometry=d2t_td2s, Angle=degrees(panel_11), Center=Point(0, 0, 0), Axis=Vector(0, 0, 1))  # -> Geometry, Transform
d21t_td21s_6 = Rotate3D(Geometry=d21t_td21s, Angle=degrees(panel_11), Center=Point(0, 0, 0), Axis=Vector(0, 0, 1))  # -> Geometry, Transform
e2t_te2s_6 = Rotate3D(Geometry=e2t_te2s, Angle=degrees(panel_11), Center=Point(0, 0, 0), Axis=Vector(0, 0, 1))  # -> Geometry, Transform
d21s_6 = Rotate3D(Geometry=d21s, Angle=degrees(panel_11), Center=Point(0, 0, 0), Axis=Vector(0, 0, 1))  # -> Geometry, Transform
d41t_td41s_6 = Rotate3D(Geometry=d41t_td41s, Angle=degrees(panel_11), Center=Point(0, 0, 0), Axis=Vector(0, 0, 1))  # -> Geometry, Transform
d31t_f31s_6 = Rotate3D(Geometry=d31t_f31s.Geometry, Angle=degrees(panel_11), Center=Point(0, 0, 0), Axis=Vector(0, 0, 1))  # -> Geometry, Transform
d41s_6 = Rotate3D(Geometry=d41s, Angle=degrees(panel_11), Center=Point(0, 0, 0), Axis=Vector(0, 0, 1))  # -> Geometry, Transform
alupart5 = AluPart1(
    pointssource=bs_2.Geometry,
    pointstarget=bt_cs_2.Geometry,
    divisions=div_a_b,
    U=u_a_b_c_d1,
    V=global_v,
    pointssource_2=bt_cs_2.Geometry,
    pointstarget_2=ct_d1s_2.Geometry,
    divisions_2=div_c,
    U_2=u_a_b_c_d1,
    V_2=global_v,
    pointssource_3=e1s_6.Geometry,
    pointstarget_3=e1t_te1s_6.Geometry,
    divisions_3=div_d_e,
    U_3=u_e1_e2,
    V_3=global_v,
    pointssource_6=d4s_6.Geometry,
    pointstarget_6=d4t_td4s_6.Geometry,
    divisions_6=div_d_e,
    U_6=u_d4_d41_td4_td41,
    V_6=global_v,
    pointssource_4=d31s_2.Geometry,
    pointstarget_4=d31t_f31s_6.Geometry,
    divisions_4=div_d_e,
    U_4=u_splice_f3_f31_d3_d31,
    V_4=global_v,
    pointssource_5=d2s_6.Geometry,
    pointstarget_5=d2t_td2s_6.Geometry,
    divisions_5=div_d_e,
    U_5=u_d2_d21_d4_d41_timber,
    V_5=global_v,
    pointssource_7=ct_d1s_2.Geometry,
    pointstarget_7=d1t_td1s_2.Geometry,
    divisions_7=div_d_e,
    U_7=u_a_b_c_d1,
    V_7=global_v,
    pointssource_8=d21s_6.Geometry,
    pointstarget_8=d21t_td21s_6.Geometry,
    divisions_8=div_d_e,
    U_8=u_d2_d21_d4_d41_timber,
    V_8=global_v,
    pointssource_9=d3s_2.Geometry,
    pointstarget_9=d3t_f3s_6.Geometry,
    divisions_9=div_d_e,
    U_9=u_splice_f3_f31_d3_d31,
    V_9=global_v,
    pointssource_10=d41s_6.Geometry,
    pointstarget_10=d41t_td41s_6.Geometry,
    divisions_10=div_d_e,
    U_10=u_d4_d41_td4_td41,
    V_10=global_v,
    pointssource_11=e2s_6.Geometry,
    pointstarget_11=e2t_te2s_6.Geometry,
    divisions_11=div_d_e,
    U_11=u_e1_e2,
    V_11=global_v,
    pointssource_13=d3t_f3s_6.Geometry,
    pointstarget_13=f3t_t2f3s_6.Geometry,
    divisions_13=div_f_t1,
    U_13=u_splice_f3_f31_d3_d31,
    V_13=global_v,
    pointssource_12=d31t_f31s_6.Geometry,
    pointstarget_12=f31t_t2f31_6.Geometry,
    divisions_12=div_f_t1,
    U_12=u_splice_f3_f31_d3_d31,
    V_12=global_v)  # -> mesh, srf, sourcesrf, targetsrf, mesh_2, srf_2, sourcesrf_2, targetsrf_2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
alumesh5 = Relay([alupart5.mesh, alupart5.mesh_2, alupart5.mesh_3, alupart5.mesh_6, alupart5.mesh_4, alupart5.mesh_5, alupart5.mesh_7, alupart5.mesh_8, alupart5.mesh_9, alupart5.mesh_10, alupart5.mesh_11, alupart5.mesh_13, alupart5.mesh_12])
te1t_t2e1s_6 = Rotate3D(Geometry=te1t_t2e1s, Angle=degrees(panel_11), Center=Point(0, 0, 0), Axis=Vector(0, 0, 1))  # -> Geometry, Transform
td4t_t2d4s_6 = Rotate3D(Geometry=td4t_t2d4s.Geometry, Angle=degrees(panel_11), Center=Point(0, 0, 0), Axis=Vector(0, 0, 1))  # -> Geometry, Transform
td2t_t2d2s_6 = Rotate3D(Geometry=td2t_t2d2s.Geometry, Angle=degrees(panel_11), Center=Point(0, 0, 0), Axis=Vector(0, 0, 1))  # -> Geometry, Transform
te2t_t2e2s_6 = Rotate3D(Geometry=te2t_t2e2s, Angle=degrees(panel_11), Center=Point(0, 0, 0), Axis=Vector(0, 0, 1))  # -> Geometry, Transform
td21t_t2d21s_6 = Rotate3D(Geometry=td21t_t2d21s.Geometry, Angle=degrees(panel_11), Center=Point(0, 0, 0), Axis=Vector(0, 0, 1))  # -> Geometry, Transform
td41t_t2d41s_6 = Rotate3D(Geometry=td41t_t2d41s.Geometry, Angle=degrees(panel_11), Center=Point(0, 0, 0), Axis=Vector(0, 0, 1))  # -> Geometry, Transform
t2e1t_6 = Rotate3D(Geometry=t2e1t.Geometry, Angle=degrees(panel_11), Center=Point(0, 0, 0), Axis=Vector(0, 0, 1))  # -> Geometry, Transform
t2d4t_6 = Rotate3D(Geometry=t2d4t.Geometry, Angle=degrees(panel_11), Center=Point(0, 0, 0), Axis=Vector(0, 0, 1))  # -> Geometry, Transform
t2f3t_6 = Rotate3D(Geometry=t2f3t.Geometry, Angle=degrees(panel_11), Center=Point(0, 0, 0), Axis=Vector(0, 0, 1))  # -> Geometry, Transform
t2d2t_6 = Rotate3D(Geometry=t2d2t.Geometry, Angle=degrees(panel_11), Center=Point(0, 0, 0), Axis=Vector(0, 0, 1))  # -> Geometry, Transform
t2f31t_6 = Rotate3D(Geometry=t2f31t.Geometry, Angle=degrees(panel_11), Center=Point(0, 0, 0), Axis=Vector(0, 0, 1))  # -> Geometry, Transform
t2d21t_6 = Rotate3D(Geometry=t2d21t.Geometry, Angle=degrees(panel_11), Center=Point(0, 0, 0), Axis=Vector(0, 0, 1))  # -> Geometry, Transform
t2d41t_6 = Rotate3D(Geometry=t2d41t.Geometry, Angle=degrees(panel_11), Center=Point(0, 0, 0), Axis=Vector(0, 0, 1))  # -> Geometry, Transform
t2e2t_6 = Rotate3D(Geometry=t2e2t.Geometry, Angle=degrees(panel_11), Center=Point(0, 0, 0), Axis=Vector(0, 0, 1))  # -> Geometry, Transform
timberpart5 = TimberPart2(
    pointssource_15=e1t_te1s_6.Geometry,
    pointstarget_15=te1t_t2e1s_6.Geometry,
    divisions_15=div_f_t1,
    U_15=u_e1_e2,
    V_15=global_v,
    pointssource_14=d4t_td4s_6.Geometry,
    pointstarget_14=td4t_t2d4s_6.Geometry,
    divisions_14=div_f_t1,
    U_14=u_d4_d41_td4_td41,
    V_14=global_v,
    pointssource_9=d2t_td2s_6.Geometry,
    pointstarget_9=td2t_t2d2s_6.Geometry,
    divisions_9=div_f_t1,
    U_9=u_d2_d21_d4_d41_timber,
    V_9=global_v,
    pointssource_7=d1t_td1s_2.Geometry,
    pointstarget_7=td1t_t2d1s_2.Geometry,
    divisions_7=div_f_t1,
    U_7=u_a_b_c_d1,
    V_7=global_v,
    pointssource_5=d21t_td21s_6.Geometry,
    pointstarget_5=td21t_t2d21s_6.Geometry,
    divisions_5=div_f_t1,
    U_5=u_d2_d21_d4_d41_timber,
    V_5=global_v,
    pointssource=d41t_td41s_6.Geometry,
    pointstarget=td41t_t2d41s_6.Geometry,
    divisions=div_f_t1,
    U=u_d4_d41_td4_td41,
    V=global_v,
    pointssource_10=e2t_te2s_6.Geometry,
    pointstarget_10=te2t_t2e2s_6.Geometry,
    divisions_10=div_f_t1,
    U_10=u_e1_e2,
    V_10=global_v,
    pointssource_11=te1t_t2e1s_6.Geometry,
    pointstarget_11=t2e1t_6.Geometry,
    divisions_11=divt2,
    U_11=u_e1_e2,
    V_11=global_v,
    pointssource_8=td4t_t2d4s_6.Geometry,
    pointstarget_8=t2d4t_6.Geometry,
    divisions_8=divt2,
    U_8=u_d4_d41_td4_td41,
    V_8=global_v,
    pointssource_12=f3t_t2f3s_6.Geometry,
    pointstarget_12=t2f3t_6.Geometry,
    divisions_12=divt2,
    U_12=u_splice_f3_f31_d3_d31,
    V_12=global_v,
    pointssource_16=td2t_t2d2s_6.Geometry,
    pointstarget_16=t2d2t_6.Geometry,
    divisions_16=divt2,
    U_16=u_d2_d21_d4_d41_timber,
    V_16=global_v,
    pointssource_13=td1t_t2d1s_2.Geometry,
    pointstarget_13=t2d1t_2.Geometry,
    divisions_13=divt2,
    U_13=u_a_b_c_d1,
    V_13=global_v,
    pointssource_6=f31t_t2f31_6.Geometry,
    pointstarget_6=t2f31t_6.Geometry,
    divisions_6=divt2,
    U_6=u_splice_f3_f31_d3_d31,
    V_6=global_v,
    pointssource_3=td41t_t2d41s_6.Geometry,
    pointstarget_3=t2d41t_6.Geometry,
    divisions_3=divt2,
    U_3=u_d4_d41_td4_td41,
    V_3=global_v,
    pointssource_4=te2t_t2e2s_6.Geometry,
    pointstarget_4=t2e2t_6.Geometry,
    divisions_4=divt2,
    U_4=u_e1_e2,
    V_4=global_v,
    pointssource_2=td21t_t2d21s_6.Geometry,
    pointstarget_2=t2d21t_6.Geometry,
    divisions_2=divt2,
    U_2=u_d2_d21_d4_d41_timber,
    V_2=global_v)  # -> mesh_15, srf_15, mesh_14, srf_14, sourcesrf_4, mesh_9, srf_9, mesh_7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

panel_12 = Panel(timberpart2.orientation)
panel_13 = Panel(timberpart3.orientation)
panel_14 = Panel(timberpart6.orientation)
panel_15 = Panel(timberpart4.orientation)
panel_16 = Panel(timberpart5.orientation)
cluster_6 = Cluster_6(
    cpts=e1t_te1s,
    L=f3t_t2f3s.Geometry,
    tie2=timberpart1.sourcesrf_4,
    L_2=f31t_t2f31.Geometry,
    pts=cluster_5.G_3,
    L_4=d31t_f31s.Geometry,
    tie4=timberpart1.sourcesrf_3,
    L_3=d3t_f3s.Geometry,
    tie8=timberpart1.sourcesrf_2,
    tie10=timberpart1.sourcesrf,
    tie11=alupart1.targetsrf_11)  # -> srf, tie2_3, spts, srf_2, tie4_3, tie8_3, tie10_3, tie11_3
preview = CustomPreview(
    Geometry=[timberpart2.srf_15, timberpart2.srf_14, timberpart2.srf_9, timberpart2.srf_7, timberpart2.srf_5, timberpart2.srf, timberpart2.srf_10, timberpart2.srf_11, timberpart2.srf_8, timberpart2.srf_12, timberpart2.srf_16, timberpart2.srf_13, timberpart2.srf_6, timberpart2.srf_3, timberpart2.srf_4, timberpart2.srf_2, timberpart1.srf_15, timberpart1.srf_14, timberpart1.srf_9, timberpart1.srf_7, timberpart1.srf_5, timberpart1.srf, timberpart1.srf_10, timberpart1.srf_11, timberpart1.srf_8, timberpart1.srf_12, timberpart1.srf_16, timberpart1.srf_13, timberpart1.srf_6, timberpart1.srf_3, timberpart1.srf_4, timberpart1.srf_2],
    Material=swatch)
preview_2 = CustomPreview(
    Geometry=flatten([A.Srf, A.SourceSrf, A.TargetSrf, alupart1.srf, alupart1.sourcesrf, alupart1.targetsrf, alupart1.srf_2, alupart1.sourcesrf_2, alupart1.targetsrf_2, alupart1.srf_3, alupart1.sourcesrf_3, alupart1.targetsrf_3, alupart1.srf_6, alupart1.sourcesrf_6, alupart1.targetsrf_6, alupart1.srf_4, alupart1.sourcesrf_4, alupart1.targetsrf_4, alupart1.srf_5, alupart1.sourcesrf_5, alupart1.targetsrf_5, alupart1.srf_7, alupart1.sourcesrf_7, alupart1.targetsrf_7, alupart1.srf_8, alupart1.sourcesrf_8, alupart1.targetsrf_8, alupart1.srf_9, alupart1.sourcesrf_9, alupart1.targetsrf_9, alupart1.srf_10, alupart1.sourcesrf_10, alupart1.targetsrf_10, alupart1.srf_11, alupart1.sourcesrf_11, alupart1.targetsrf_11, alupart1.srf_13, alupart1.sourcesrf_13, alupart1.targetsrf_13, alupart1.srf_12, alupart1.sourcesrf_12, alupart1.targetsrf_12, alupart2.srf, alupart2.sourcesrf, alupart2.targetsrf, alupart2.srf_2, alupart2.sourcesrf_2, alupart2.targetsrf_2, alupart2.srf_3, alupart2.sourcesrf_3, alupart2.targetsrf_3, alupart2.srf_6, alupart2.sourcesrf_6, alupart2.targetsrf_6, alupart2.srf_4, alupart2.sourcesrf_4, alupart2.targetsrf_4, alupart2.srf_5, alupart2.sourcesrf_5, alupart2.targetsrf_5, alupart2.srf_7, alupart2.sourcesrf_7, alupart2.targetsrf_7, alupart2.srf_8, alupart2.sourcesrf_8, alupart2.targetsrf_8, alupart2.srf_9, alupart2.sourcesrf_9, alupart2.targetsrf_9, alupart2.srf_10, alupart2.sourcesrf_10, alupart2.targetsrf_10, alupart2.srf_11, alupart2.sourcesrf_11, alupart2.targetsrf_11, alupart2.srf_13, alupart2.sourcesrf_13, alupart2.targetsrf_13, alupart2.srf_12, alupart2.sourcesrf_12, abelow_2.Srf]),
    Material=swatch_2)
preview_3 = CustomPreview(
    Geometry=[timberpart3.srf_15, timberpart3.srf_14, timberpart3.srf_9, timberpart3.srf_7, timberpart3.srf_5, timberpart3.srf, timberpart3.srf_10, timberpart3.srf_11, timberpart3.srf_8, timberpart3.srf_12, timberpart3.srf_16, timberpart3.srf_13, timberpart3.srf_6, timberpart3.srf_3, timberpart3.srf_4, timberpart3.srf_2, timberpart1.srf_15, timberpart1.srf_14, timberpart1.srf_9, timberpart1.srf_7, timberpart1.srf_5, timberpart1.srf, timberpart1.srf_10, timberpart1.srf_11, timberpart1.srf_8, timberpart1.srf_12, timberpart1.srf_16, timberpart1.srf_13, timberpart1.srf_6, timberpart1.srf_3, timberpart1.srf_4, timberpart1.srf_2],
    Material=swatch)
preview_4 = CustomPreview(
    Geometry=flatten([A.Srf, A.SourceSrf, A.TargetSrf, alupart1.srf, alupart1.sourcesrf, alupart1.targetsrf, alupart1.srf_2, alupart1.sourcesrf_2, alupart1.targetsrf_2, alupart1.srf_3, alupart1.sourcesrf_3, alupart1.targetsrf_3, alupart1.srf_6, alupart1.sourcesrf_6, alupart1.targetsrf_6, alupart1.srf_4, alupart1.sourcesrf_4, alupart1.targetsrf_4, alupart1.srf_5, alupart1.sourcesrf_5, alupart1.targetsrf_5, alupart1.srf_7, alupart1.sourcesrf_7, alupart1.targetsrf_7, alupart1.srf_8, alupart1.sourcesrf_8, alupart1.targetsrf_8, alupart1.srf_9, alupart1.sourcesrf_9, alupart1.targetsrf_9, alupart1.srf_10, alupart1.sourcesrf_10, alupart1.targetsrf_10, alupart1.srf_11, alupart1.sourcesrf_11, alupart1.targetsrf_11, alupart1.srf_13, alupart1.sourcesrf_13, alupart1.targetsrf_13, alupart1.srf_12, alupart1.sourcesrf_12, alupart1.targetsrf_12, alupart3.srf, alupart3.sourcesrf, alupart3.targetsrf, alupart3.srf_2, alupart3.sourcesrf_2, alupart3.targetsrf_2, alupart3.srf_3, alupart3.sourcesrf_3, alupart3.targetsrf_3, alupart3.srf_6, alupart3.sourcesrf_6, alupart3.targetsrf_6, alupart3.srf_4, alupart3.sourcesrf_4, alupart3.targetsrf_4, alupart3.srf_5, alupart3.sourcesrf_5, alupart3.targetsrf_5, alupart3.srf_7, alupart3.sourcesrf_7, alupart3.targetsrf_7, alupart3.srf_8, alupart3.sourcesrf_8, alupart3.targetsrf_8, alupart3.srf_9, alupart3.sourcesrf_9, alupart3.targetsrf_9, alupart3.srf_10, alupart3.sourcesrf_10, alupart3.targetsrf_10, alupart3.srf_11, alupart3.sourcesrf_11, alupart3.targetsrf_11, alupart3.srf_13, alupart3.sourcesrf_13, alupart3.targetsrf_13, alupart3.srf_12, alupart3.sourcesrf_12, abelow_2.Srf]),
    Material=swatch_2)
preview_5 = CustomPreview(
    Geometry=flatten([A.Srf, A.SourceSrf, A.TargetSrf, alupart1.srf, alupart1.sourcesrf, alupart1.targetsrf, alupart1.srf_2, alupart1.sourcesrf_2, alupart1.targetsrf_2, alupart1.srf_3, alupart1.sourcesrf_3, alupart1.targetsrf_3, alupart1.srf_6, alupart1.sourcesrf_6, alupart1.targetsrf_6, alupart1.srf_4, alupart1.sourcesrf_4, alupart1.targetsrf_4, alupart1.srf_5, alupart1.sourcesrf_5, alupart1.targetsrf_5, alupart1.srf_7, alupart1.sourcesrf_7, alupart1.targetsrf_7, alupart1.srf_8, alupart1.sourcesrf_8, alupart1.targetsrf_8, alupart1.srf_9, alupart1.sourcesrf_9, alupart1.targetsrf_9, alupart1.srf_10, alupart1.sourcesrf_10, alupart1.targetsrf_10, alupart1.srf_11, alupart1.sourcesrf_11, alupart1.targetsrf_11, alupart1.srf_13, alupart1.sourcesrf_13, alupart1.targetsrf_13, alupart1.srf_12, alupart1.sourcesrf_12, alupart1.targetsrf_12, alupart4.srf, alupart4.sourcesrf, alupart4.targetsrf, alupart4.srf_2, alupart4.sourcesrf_2, alupart4.targetsrf_2, alupart4.srf_3, alupart4.sourcesrf_3, alupart4.targetsrf_3, alupart4.srf_6, alupart4.sourcesrf_6, alupart4.targetsrf_6, alupart4.srf_4, alupart4.sourcesrf_4, alupart4.targetsrf_4, alupart4.srf_5, alupart4.sourcesrf_5, alupart4.targetsrf_5, alupart4.srf_7, alupart4.sourcesrf_7, alupart4.targetsrf_7, alupart4.srf_8, alupart4.sourcesrf_8, alupart4.targetsrf_8, alupart4.srf_9, alupart4.sourcesrf_9, alupart4.targetsrf_9, alupart4.srf_10, alupart4.sourcesrf_10, alupart4.targetsrf_10, alupart4.srf_11, alupart4.sourcesrf_11, alupart4.targetsrf_11, alupart4.srf_13, alupart4.sourcesrf_13, alupart4.targetsrf_13, alupart4.srf_12, alupart4.sourcesrf_12, abelow_2.Srf]),
    Material=swatch_2)
preview_6 = CustomPreview(
    Geometry=[timberpart5.srf_15, timberpart5.srf_14, timberpart5.srf_9, timberpart5.srf_7, timberpart5.srf_5, timberpart5.srf, timberpart5.srf_10, timberpart5.srf_11, timberpart5.srf_8, timberpart5.srf_12, timberpart5.srf_16, timberpart5.srf_13, timberpart5.srf_6, timberpart5.srf_3, timberpart5.srf_4, timberpart5.srf_2, timberpart1.srf_15, timberpart1.srf_14, timberpart1.srf_9, timberpart1.srf_7, timberpart1.srf_5, timberpart1.srf, timberpart1.srf_10, timberpart1.srf_11, timberpart1.srf_8, timberpart1.srf_12, timberpart1.srf_16, timberpart1.srf_13, timberpart1.srf_6, timberpart1.srf_3, timberpart1.srf_4, timberpart1.srf_2],
    Material=swatch)
preview_7 = CustomPreview(
    Geometry=flatten([A.Srf, A.SourceSrf, A.TargetSrf, alupart1.srf, alupart1.sourcesrf, alupart1.targetsrf, alupart1.srf_2, alupart1.sourcesrf_2, alupart1.targetsrf_2, alupart1.srf_3, alupart1.sourcesrf_3, alupart1.targetsrf_3, alupart1.srf_6, alupart1.sourcesrf_6, alupart1.targetsrf_6, alupart1.srf_4, alupart1.sourcesrf_4, alupart1.targetsrf_4, alupart1.srf_5, alupart1.sourcesrf_5, alupart1.targetsrf_5, alupart1.srf_7, alupart1.sourcesrf_7, alupart1.targetsrf_7, alupart1.srf_8, alupart1.sourcesrf_8, alupart1.targetsrf_8, alupart1.srf_9, alupart1.sourcesrf_9, alupart1.targetsrf_9, alupart1.srf_10, alupart1.sourcesrf_10, alupart1.targetsrf_10, alupart1.srf_11, alupart1.sourcesrf_11, alupart1.targetsrf_11, alupart1.srf_13, alupart1.sourcesrf_13, alupart1.targetsrf_13, alupart1.srf_12, alupart1.sourcesrf_12, alupart1.targetsrf_12, alupart5.srf, alupart5.sourcesrf, alupart5.targetsrf, alupart5.srf_2, alupart5.sourcesrf_2, alupart5.targetsrf_2, alupart5.srf_3, alupart5.sourcesrf_3, alupart5.targetsrf_3, alupart5.srf_6, alupart5.sourcesrf_6, alupart5.targetsrf_6, alupart5.srf_4, alupart5.sourcesrf_4, alupart5.targetsrf_4, alupart5.srf_5, alupart5.sourcesrf_5, alupart5.targetsrf_5, alupart5.srf_7, alupart5.sourcesrf_7, alupart5.targetsrf_7, alupart5.srf_8, alupart5.sourcesrf_8, alupart5.targetsrf_8, alupart5.srf_9, alupart5.sourcesrf_9, alupart5.targetsrf_9, alupart5.srf_10, alupart5.sourcesrf_10, alupart5.targetsrf_10, alupart5.srf_11, alupart5.sourcesrf_11, alupart5.targetsrf_11, alupart5.srf_13, alupart5.sourcesrf_13, alupart5.targetsrf_13, alupart5.srf_12, alupart5.sourcesrf_12, abelow_2.Srf]),
    Material=swatch_2)
preview_8 = CustomPreview(
    Geometry=[timberpart6.srf_15, timberpart6.srf_14, timberpart6.srf_9, timberpart6.srf_7, timberpart6.srf_5, timberpart6.srf, timberpart6.srf_10, timberpart6.srf_11, timberpart6.srf_8, timberpart6.srf_12, timberpart6.srf_16, timberpart6.srf_13, timberpart6.srf_6, timberpart6.srf_3, timberpart6.srf_4, timberpart6.srf_2, timberpart1.srf_15, timberpart1.srf_14, timberpart1.srf_9, timberpart1.srf_7, timberpart1.srf_5, timberpart1.srf, timberpart1.srf_10, timberpart1.srf_11, timberpart1.srf_8, timberpart1.srf_12, timberpart1.srf_16, timberpart1.srf_13, timberpart1.srf_6, timberpart1.srf_3, timberpart1.srf_4, timberpart1.srf_2],
    Material=swatch)
preview_9 = CustomPreview(
    Geometry=flatten([A.Srf, A.SourceSrf, A.TargetSrf, alupart1.srf, alupart1.sourcesrf, alupart1.targetsrf, alupart1.srf_2, alupart1.sourcesrf_2, alupart1.targetsrf_2, alupart1.srf_3, alupart1.sourcesrf_3, alupart1.targetsrf_3, alupart1.srf_6, alupart1.sourcesrf_6, alupart1.targetsrf_6, alupart1.srf_4, alupart1.sourcesrf_4, alupart1.targetsrf_4, alupart1.srf_5, alupart1.sourcesrf_5, alupart1.targetsrf_5, alupart1.srf_7, alupart1.sourcesrf_7, alupart1.targetsrf_7, alupart1.srf_8, alupart1.sourcesrf_8, alupart1.targetsrf_8, alupart1.srf_9, alupart1.sourcesrf_9, alupart1.targetsrf_9, alupart1.srf_10, alupart1.sourcesrf_10, alupart1.targetsrf_10, alupart1.srf_11, alupart1.sourcesrf_11, alupart1.targetsrf_11, alupart1.srf_13, alupart1.sourcesrf_13, alupart1.targetsrf_13, alupart1.srf_12, alupart1.sourcesrf_12, alupart1.targetsrf_12, alupart6.srf, alupart6.sourcesrf, alupart6.targetsrf, alupart6.srf_2, alupart6.sourcesrf_2, alupart6.targetsrf_2, alupart6.srf_3, alupart6.sourcesrf_3, alupart6.targetsrf_3, alupart6.srf_6, alupart6.sourcesrf_6, alupart6.targetsrf_6, alupart6.srf_4, alupart6.sourcesrf_4, alupart6.targetsrf_4, alupart6.srf_5, alupart6.sourcesrf_5, alupart6.targetsrf_5, alupart6.srf_7, alupart6.sourcesrf_7, alupart6.targetsrf_7, alupart6.srf_8, alupart6.sourcesrf_8, alupart6.targetsrf_8, alupart6.srf_9, alupart6.sourcesrf_9, alupart6.targetsrf_9, alupart6.srf_10, alupart6.sourcesrf_10, alupart6.targetsrf_10, alupart6.srf_11, alupart6.sourcesrf_11, alupart6.targetsrf_11, alupart6.srf_13, alupart6.sourcesrf_13, alupart6.targetsrf_13, alupart6.srf_12, alupart6.sourcesrf_12, abelow_2.Srf]),
    Material=swatch_2)

load_type = ValueList({"Uniform Pressure": "Pressure,P", "Surface Traction Shear": "Surface traction,TRSHR", "Surface Traction General": "Surface traction,TRVEC"}, selected="Uniform Pressure")

load_type_2 = ValueList({"Uniform Pressure": "Pressure,P", "Surface Traction Shear": "Surface traction,TRSHR", "Surface Traction General": "Surface traction,TRVEC"}, selected="Uniform Pressure")

load_type_3 = ValueList({"Uniform Pressure": "Pressure,P", "Surface Traction Shear": "Surface traction,TRSHR", "Surface Traction General": "Surface traction,TRVEC"}, selected="Uniform Pressure")

load_type_4 = ValueList({"Uniform Pressure": "Pressure,P", "Surface Traction Shear": "Surface traction,TRSHR", "Surface Traction General": "Surface traction,TRVEC"}, selected="Uniform Pressure")

load_type_5 = ValueList({"Uniform Pressure": "Pressure,P", "Surface Traction Shear": "Surface traction,TRSHR", "Surface Traction General": "Surface traction,TRVEC"}, selected="Uniform Pressure")

# ----
# AluPart
hexahedron = ValueList({"Full integration": "C3D8", "Reduced Integration": "C3D8R", "Incompatible Modes": "C3D8I"}, selected="Reduced Integration")
isotropicalumaterial = CSharpScript(
    TooltipDescriptionOverride="Default material: Aluminium, E=70000, PR=0.3",
    TooltipTextOverride="Isotropic Material. Alu default")  # -> Properties; inputs Material: String, E: Int32, PR: Double
# ---------- isotropicalumaterial: C# ----------
    //Create Lists
    List< System.Object > B = new List<System.Object>();
    ///////////////////////////////////////////////////////////////////////////////////////
    ///////////////////////////////////////////////////////////////////////////////////////
    if (string.IsNullOrEmpty(Material)){Material = "Aluminium";}
    B.Add(Material);
    B.Add("Elastic");
    if(E == 0){E = 70000;}
    if(PR == 0){PR = 0.3;}
    B.Add(string.Format("{0}, {1}", E, PR));
    B.Add("**");

    Properties = B;
# ---------- end isotropicalumaterial ----------

orthotropicmaterial = CSharpScript(TooltipDescriptionOverride="Norwegian Spruce default material. E1=10000, E2 = 800, E3 = 400. Nu12=0.5, Nu13=0.6, Nu23=0.6. G12=600, G13=600, G23=30.")  # -> Properties; inputs Material: String, E1: Int32, E2: Int32, E3: Int32, Nu12: Double, Nu13: Double, Nu23: Double, G12: Int32, G13: Int32, G23: Int32
# ---------- orthotropicmaterial: C# ----------
    List< System.Object > B = new List<System.Object>();
    ///////////////////////////////////////////////////////////////////////////////////////
    ///////////////////////////////////////////////////////////////////////////////////////
    if (string.IsNullOrEmpty(Material)){Material = "Timber";}
    B.Add(Material);
    B.Add("Elastic, type=ENGINEERING CONSTANTS");
    //Elastic moduli
    if(E1 == 0){E1 = 10000;}
    if(E2 == 0){E2 = 800;}
    if(E3 == 0){E3 = 400;}

    //Poisson's ratios
    if(Nu12 == 0){Nu12 = 0.5;}
    if(Nu13 == 0){Nu13 = 0.6;}
    if(Nu23 == 0){Nu23 = 0.6;}

    //Shear moduli
    if(G12 == 0){G12 = 600;}
    if(G13 == 0){G13 = 600;}
    if(G23 == 0){G23 = 30;}


    B.Add(string.Format("{0}, {1}, {2}, {3}, {4}, {5}, {6}, {7}", E1, E2, E3, Nu12, Nu13, Nu23, G12, G13));
    B.Add(string.Format("{0}", G23)); //Apparently the ABAQUS demands that G23 is on the second line.

    Properties = B;
# ---------- end orthotropicmaterial ----------
hexahedron_2 = ValueList({"Full integration": "C3D8", "Reduced Integration": "C3D8R", "Incompatible Modes": "C3D8I"}, selected="Reduced Integration")
brep = Brep(flatten([cluster_6.srf, cluster_6.tie2_3, cluster_6.srf_2, cluster_6.tie4_3, cluster_6.tie8_3, cluster_6.tie10_3, cluster_6.tie11_3]))
loadedsurface = CSharpScript(cpts=cluster_6.spts)  # -> srf; inputs cpts: list of Point3d; same code as tie1
bcs = ValueList({"U1": 1, "U2": 2, "U3": 3, "UR1": 4, "UR2": 5, "UR3": 6}, selected=["U1", "U2", "U3", "UR1", "UR2", "UR3"])
ids = CSharpScript(Breps=brep)  # -> IDList; inputs Breps: list of Brep
# ---------- ids: C# ----------
    List < string > idlist = new List < string >();
    for (int i = 0; i < Breps.Count; i++)
    {
      idlist.Add("tie" + i);
    }
    IDList = idlist;
# ---------- end ids ----------
support = CSharpScript(ID="fixed", Face=loadedsurface, Conditions=bcs)  # -> Support; inputs ID: String, Tol: Double, Face: Brep, Conditions: list of String
# ---------- support: C# ----------
    //Create output tree
    DataTree <System.Object> tree = new DataTree<System.Object>();
    ///////////////////////////////////////////////////////////////////////////////////////
    ///////////////////////////////////////////////////////////////////////////////////////
    //Add surface and ID to be used in Part component
    tree.Add(Face, new GH_Path(0));
    tree.Add(ID, new GH_Path(2));
    ///////////////////////////////////////////////////////////////////////////////////////
    ///////////////////////////////////////////////////////////////////////////////////////
    //Add conditions to be exported in INP
    for( int i = 0; i < Conditions.Count(); i++)
    {
      if(Conditions[i] == "U1" || Conditions[i] == "1")
      {
        tree.Add(string.Format("{0}, 1, 1", ID), new GH_Path(1));
      }
      if(Conditions[i] == "U2" || Conditions[i] == "2")
      {
        tree.Add(string.Format("{0}, 2, 2", ID), new GH_Path(1));
      }
      if(Conditions[i] == "U3" || Conditions[i] == "3")
      {
        tree.Add(string.Format("{0}, 3, 3", ID), new GH_Path(1));
      }
      if(Conditions[i] == "UR1" || Conditions[i] == "4")
      {
        tree.Add(string.Format("{0}, 4, 4", ID), new GH_Path(1));
      }
      if(Conditions[i] == "UR2" || Conditions[i] == "5")
      {
        tree.Add(string.Format("{0}, 5, 5", ID), new GH_Path(1));
      }
      if(Conditions[i] == "UR3" || Conditions[i] == "6")
      {
        tree.Add(string.Format("{0}, 6, 6", ID), new GH_Path(1));
      }

    }
    ///////////////////////////////////////////////////////////////////////////////////////
    ///////////////////////////////////////////////////////////////////////////////////////
    //Add tolerance for pointcompare
    if(Tol == 0)
    {
      tree.Add(0.001, new GH_Path(3));
    }
    else
    {
      tree.Add(Tol, new GH_Path(3));
    }

    Support = tree;
# ---------- end support ----------
tie1 = CSharpScript(ID=ids, Master="TimberPart1", Slave="AluPart", Face=brep)  # -> Part, INP; inputs ID: String, Master: String, Slave: String, Tol: Double, Face: Brep
# ---------- tie1: C# ----------
    //Create output tree
    DataTree <System.Object> tree = new DataTree<System.Object>();
    List< string > INPLst = new List<string>();
    //Add surface and ID to be used in Part component
    tree.Add(Face, new GH_Path(0));
    tree.Add(ID, new GH_Path(1));
    //Add tolerance for pointcompare
    if(Tol == 0)
    {
      tree.Add(0.001, new GH_Path(2));
    }
    else
    {
      tree.Add(Tol, new GH_Path(2));
    }
    //Add conditions to be exported in INP
    INPLst.Add(string.Format("** Constraint: {0}", ID));
    INPLst.Add(string.Format("*Tie, name={0}, adjust=yes, type=SURFACE TO SURFACE", ID));
    INPLst.Add(string.Format("{0}-{1}-TieSrf, {0}-{2}-TieSrf", ID, Slave, Master));
    ///////////////////////////////////////////////////////////////////////////////////////
    ///////////////////////////////////////////////////////////////////////////////////////
    Part = tree;
    INP = INPLst;
# ---------- end tie1 ----------
timberpart1_2 = CSharpScript(
    ID="TimberPart1",
    Mesh=[timberpart1.mesh_15, timberpart1.mesh_14, timberpart1.mesh_9, timberpart1.mesh_7, timberpart1.mesh_5, timberpart1.mesh, timberpart1.mesh_10, timberpart1.mesh_11, timberpart1.mesh_8, timberpart1.mesh_12, timberpart1.mesh_16, timberpart1.mesh_13, timberpart1.mesh_6, timberpart1.mesh_3, timberpart1.mesh_4, timberpart1.mesh_2],
    ElmntType=hexahedron_2,
    Material=orthotropicmaterial,
    Orientation=timberpart1.orientation,
    Support=support,
    Tie=tie1.Part,
    Run=toggle_2)  # -> Geometry, Part, Instance, Sets, BC, Steps; inputs ID: String, Mesh: tree, ElmntType: list of String, Material: list, Orientation: list of String, Support: tree, Load: tree, Displ: tree, Tie: tree, Run: Boolean
# ---------- timberpart1_2: C# ----------
    //Declare variables;
    Point3d Crd;
    string Nr, X, Y, Z;

    //Create output tree;
    DataTree <Curve> Crvs = new DataTree<Curve>();
    DataTree <Point3d> Elements = new DataTree<Point3d>();
    DataTree <System.Object> GeoTree = new DataTree<System.Object>();
    DataTree <string> Inf = new DataTree<string>();
    DataTree <int> Tick = new DataTree<int>();
    DataTree <int> Tock = new DataTree<int>();

    //Create Lists;
    List< Point3d > Vertices = new List<Point3d>();
    List< Point3d > Nds = new List<Point3d>();
    List< Brep > Srf = new List<Brep>();
    List< Brep > ObjList = new List<Brep>();
    List< string > PrtLst = new List<string>();
    List< string > SetLst = new List<string>();
    List< string > InsLst = new List<string>();
    List< string > BCLst = new List<string>();
    List< string > StpLst = new List<string>();
    List< string > ElNr = new List<string>();
    List<Brep> SupLst = new List<Brep>();
    List<double> TolSupLst = new List<double>();
    List<Brep> DisLst = new List<Brep>();
    List<double> TolDisLst = new List<double>();
    List<Brep> LdLst = new List<Brep>();
    List<double> TolLdLst = new List<double>();
    List<Brep> TieLst = new List<Brep>();
    List<double> TolTieLst = new List<double>();

    ////////////////////////////////////////////////////////////////////////////////////
    //Sorts number of meshes into correct lists so that it is possible to assign different values of v,u and div to each mesh and merge meshes into same part
    List<Point3d> nodelist = new List<Point3d>();
    DataTree<Point3d> nodetree = new DataTree<Point3d>();
    DataTree<Brep> breps = new DataTree<Brep>();

    for (int i = 0; i < Mesh.Branch(0, 0).Count(); i++)
    {
      Point3d n = (Point3d) Mesh.Branch(0, 0)[i];
      nodelist.Add(n);
    }

    int div, numnb, numbr;
    int startlocn = 0; //startindex of node
    int startlocb = 0; //startindex of brep
    int count = 0; //count to get correct assignment of div,numnb,numbr;
    for (int j = 0; j < (Mesh.Branch(2, 0).Count() / 3) ; j++) //number of meshes
    {
      div = (int) Mesh.Branch(2, 0)[count]; //divisions j mesh
      numnb = (int) Mesh.Branch(2, 0)[count + 1]; //number of nodes in each division
      numbr = (int) Mesh.Branch(2, 0)[count + 2]; //number of surfaces in each division
      for (int k = 0; k < (div + 1); k++)
      {
        for (int m = startlocn; m < (startlocn + numnb); m++)
        {
          Point3d nb = nodelist[m];
          nodetree.Add(nb, new GH_Path(j, k));
        }

        for (int p = startlocb; p < (startlocb + numbr); p++)
        {
          Brep bb = (Brep) Mesh.Branch(1, 0)[p];
          breps.Add(bb, new GH_Path(j, k));
        }
        for (int q = 0; q < numbr; q++)
        {
          Elements.AddRange(breps.Branch(j, k)[q].DuplicateVertices(), new GH_Path(j, k, q));
        }

        startlocn = startlocn + numnb; //make next location
        startlocb = startlocb + numbr; //make next location
      }
      count = count + 3;
    }



    ///////////////////////////////////////////////////////////////////////////////////////
    ///////////////////////////////////////////////////////////////////////////////////////

    if (Run)
    {
      //Discretize the data of the Part;
      PrtLst.Add(string.Format("*Part, name={0}", ID));
      //Nodes of the Part;
      PrtLst.Add("*Node");

      Nds.AddRange(Point3d.CullDuplicates(nodelist, doc.ModelAbsoluteTolerance)); //remove duplicate node points
      for ( int i = 0; i < Nds.Count; i++)
      {
        Nr = (i + 1).ToString();
        Crd = Nds[i];
        X = Crd.X.ToString();
        Y = Crd.Y.ToString();
        Z = Crd.Z.ToString();
        PrtLst.Add(Nr + ", " + X + ", " + Z + ", " + Y);
      }
      //Sort element Nodes and identify faces which is supported or loaded;
      PrtLst.Add(string.Format("*Element, type={0}", ElmntType[0]));

      //If Load, import input for load;
      if ( Load.PathExists(0) )
      {
        double TolLd;
        Brep LdSrf = new Brep();
        for (int i = 0; i < Load.Branch(0).Count(); i++)
        {
          GH_Convert.ToBrep(Load.Branch(0)[i], ref LdSrf, Grasshopper.Kernel.GH_Conversion.Both);
          GH_Convert.ToDouble(Load.Branch(3)[i], out TolLd, GH_Conversion.Both);
          TolLdLst.Add(TolLd);
          LdLst.Add(LdSrf);
        }
      }
      //If Tie, import input for tie;
      if ( Tie.PathExists(0) )
      {
        double TolTie;
        Brep TieSrf = new Brep();
        for (int i = 0; i < Tie.Branch(0).Count(); i++)
        {
          GH_Convert.ToBrep(Tie.Branch(0)[i], ref TieSrf, Grasshopper.Kernel.GH_Conversion.Both);
          GH_Convert.ToDouble(Tie.Branch(2)[i], out TolTie, GH_Conversion.Both);
          TolTieLst.Add(TolTie);
          TieLst.Add(TieSrf);
        }
      }

      //Make list of elements, identify load and tie
      int count2 = 0; //To get the correct assignment of divisions, number of breps for each mesh
      int count3 = 1; //Begin at element 1 in Abaqus

      for (int f = 0; f < (Mesh.Branch(2, 0).Count() / 3) ; f++) //number of meshes
      {
        int div2 = (int) Mesh.Branch(2, 0)[count2]; //divisions of f mesh
        int numbr2 = (int) Mesh.Branch(2, 0)[count2 + 2]; //numbers of breps in each division

        for (int g = 0; g < div2; g++)
        {
          for (int h = 0; h < numbr2; h++)
          {
            ElNr.Add(count3.ToString());
            for ( int k = 0; k < Elements.Branch(f, g, h).Count; k++)
            {
              for ( int l = 0; l < Nds.Count; l++)
              {
                if ( PtCmp(Elements.Branch(f, g, h)[k], Nds[l]))
                {
                  ElNr.Add((l + 1).ToString());
                }
              } //4 first corners
            }
            for ( int k = 0; k < Elements.Branch(f, g, h).Count; k++)
            {
              for ( int l = 0; l < Nds.Count; l++)
              {
                if ( PtCmp(Elements.Branch(f, g + 1, h)[k], Nds[l]))
                {
                  ElNr.Add((l + 1).ToString());
                }
              } //4 second corners

              //identify if srf is loaded
              if ( Load.PathExists(0) )
              {
                for (int m = 0; m < Load.Branch(0).Count; m++)
                {
                  Tick.EnsurePath(m);
                  if ( IdenSet(LdLst[m], Elements.Branch(f, g, h)[k], TolLdLst[m]))
                  {
                    Tick.Add(k + 1, new GH_Path(m));
                    if (Tick.Branch(m).Count == 4)
                    {
                      Inf.Add((count3).ToString() + ",", new GH_Path(1, m, 2));
                      Inf.Add(SrfInd(Tick.Branch(m)).ToString(), new GH_Path(1, m, 3));
                    }
                  }
                  if ( IdenSet(LdLst[m], Elements.Branch(f, g + 1, h)[k], TolLdLst[m]))
                  {
                    Tick.Add(k + 5, new GH_Path(m));
                    if (Tick.Branch(m).Count == 4)
                    {
                      Inf.Add((count3).ToString() + ",", new GH_Path(1, m, 2));
                      Inf.Add(SrfInd(Tick.Branch(m)).ToString(), new GH_Path(1, m, 3));
                    }
                  }
                }
              } //end load Path

              //identify if nodes are tied
              if ( Tie.PathExists(0) )
              {
                for (int m = 0; m < Tie.Branch(0).Count; m++)
                {
                  Tock.EnsurePath(m);
                  if ( IdenSet(TieLst[m], Elements.Branch(f, g, h)[k], TolTieLst[m]))
                  {
                    Tock.Add(k + 1, new GH_Path(m));
                    if (Tock.Branch(m).Count == 4)
                    {
                      Inf.Add((count3).ToString() + ",", new GH_Path(1, m, 4));
                      Inf.Add(SrfInd(Tock.Branch(m)).ToString(), new GH_Path(1, m, 5));
                    }
                  }
                  if ( IdenSet(TieLst[m], Elements.Branch(f, g + 1, h)[k], TolTieLst[m]))
                  {
                    Tock.Add(k + 5, new GH_Path(m));
                    if (Tock.Branch(m).Count == 4)
                    {
                      Inf.Add((count3).ToString() + ",", new GH_Path(1, m, 4));
                      Inf.Add(SrfInd(Tock.Branch(m)).ToString(), new GH_Path(1, m, 5));
                    }
                  }
                }
              } //end tie
            }

            PrtLst.Add(String.Join(",  ", ElNr.ToArray()));
            count3 = count3 + 1;
            ElNr.Clear();
            Tick.ClearData();
            Tock.ClearData();
          }
        }
        count2 = count2 + 3;
      }


      //Identify nodes on supported face;
      if ( Support.PathExists(0) )
      {
        double TolSup;
        Brep SupSrf = new Brep();
        for (int i = 0; i < Support.Branch(0).Count(); i++)
        {
          GH_Convert.ToBrep(Support.Branch(0)[i], ref SupSrf, Grasshopper.Kernel.GH_Conversion.Both);
          GH_Convert.ToDouble(Support.Branch(3)[i], out TolSup, GH_Conversion.Both);
          TolSupLst.Add(TolSup);
          SupLst.Add(SupSrf);
        }
        for (int i = 0; i < Nds.Count; i++)
        {
          for (int j = 0; j < Support.Branch(0).Count; j++)
          {
            if ( IdenSet(SupLst[j], Nds[i], TolSupLst[j]) )
            {
              Inf.Add((i + 1).ToString() + ",", new GH_Path(0, j, 1));
              GeoTree.Add(Nds[i].X.ToString(), new GH_Path(2, j, 0));
              GeoTree.Add(Nds[i].Y.ToString(), new GH_Path(2, j, 1));
              GeoTree.Add(Nds[i].Z.ToString(), new GH_Path(2, j, 2));
            }
          }
        }
      }
      //Identify displaced nodes;
      if ( Displ.PathExists(0) )
      {
        double TolDis;
        Brep DisSrf = new Brep();
        for (int i = 0; i < Displ.Branch(0).Count(); i++)
        {
          GH_Convert.ToBrep(Displ.Branch(0)[i], ref DisSrf, Grasshopper.Kernel.GH_Conversion.Both);
          GH_Convert.ToDouble(Displ.Branch(3)[i], out TolDis, GH_Conversion.Both);
          TolDisLst.Add(TolDis);
          DisLst.Add(DisSrf);
        }
        for (int i = 0; i < Nds.Count; i++)
        {
          for (int j = 0; j < Displ.Branch(0).Count; j++)
          {
            if ( IdenSet(DisLst[j], Nds[i], TolDisLst[j]) )
            {
              Inf.Add((i + 1).ToString() + ",", new GH_Path(0, j, 2));
              GeoTree.Add(Nds[i].X.ToString(), new GH_Path(3, j, 0));
              GeoTree.Add(Nds[i].Y.ToString(), new GH_Path(3, j, 1));
              GeoTree.Add(Nds[i].Z.ToString(), new GH_Path(3, j, 2));
            }
          }
        }
      }
      ///////////////////////////////////////////////////////////////////////////////////////
      ///////////////////////////////////////////////////////////////////////////////////////
      //Create sets of nodes;
      PrtLst.Add("*Nset, nset=Set-1, generate");
      PrtLst.Add(string.Format("   1,    {0},    1", Nds.Count));
      //Create sets of elements;
      PrtLst.Add("*Elset, elset=Set-1, generate");
      PrtLst.Add(string.Format("   1,    {0},    1", count3 - 1));

      //Add orientation (for orthotropic material) 30.04

      if ( (Orientation != null) && (!Orientation.Any()) ) //if the list is empty
      {
        PrtLst.Add(string.Format("**Section: {0}_section", ID));
        PrtLst.Add(string.Format("*Solid Section, elset=Set-1, material={0}", Material[0]));
      }
      else
      {
        PrtLst.Add(Orientation[1]);
        PrtLst.Add(Orientation[2]);
        PrtLst.Add(Orientation[3]);
        PrtLst.Add(string.Format("**Section: {0}_section", ID));
        PrtLst.Add(string.Format("*Solid Section, elset=Set-1, orientation=Ori-1, material={0}", Material[0]));
      }

      PrtLst.Add(",");
      //Finish defining Part;
      PrtLst.Add("*End Part");
      PrtLst.Add("**");
      //Create instance of the part;
      InsLst.Add(string.Format("*Instance, name={0}, part={0}", ID));
      InsLst.Add("*End Instance");
      InsLst.Add("**");
      //BC; Add nodes on supported Face;
      if ( Inf.PathExists(0, 0, 1) )
      {
        for (int i = 0; i < Support.Branch(0).Count; i++)
        {
          SetLst.Add(string.Format("*Nset, nset={0}, instance={1}", Support.Branch(2)[i], ID));
          for (int j = 0; j < Inf.Branch(0, i, 1).Count; j++)
          {
            SetLst.Add(Inf.Branch(0, i, 1)[j]);
          }
        }
      }
      //Displ/Rot; Add displaced nodes;
      if ( Inf.PathExists(0, 0, 2) )
      {
        for (int i = 0; i < Displ.Branch(0).Count; i++)
        {
          SetLst.Add(string.Format("*Nset, nset={0}, instance={1}", Displ.Branch(2)[i], ID));
          for (int j = 0; j < Inf.Branch(0, i, 2).Count; j++)
          {
            SetLst.Add(Inf.Branch(0, i, 2)[j]);
          }
        }
      }
      //Add elements on tied face;
      if ( Inf.PathExists(1, 0, 4) )
      {
        for (int i = 0; i < Tie.Branch(0).Count; i++)
        {
          SetLst.Add(string.Format("*Elset, elset={0}-{1}-TieSrf, internal, instance={1}", Tie.Branch(1)[i], ID));
          for (int j = 0; j < Inf.Branch(1, i, 4).Count; j++)
          {
            SetLst.Add(Inf.Branch(1, i, 4)[j]);
          }
        }
      }
      //Define tie surface;
      if ( Inf.PathExists(1, 0, 5) )
      {
        for (int i = 0; i < Tie.Branch(0).Count; i++)
        {
          SetLst.Add(string.Format("*Surface, type=ELEMENT, name={0}-{1}-TieSrf", Tie.Branch(1)[i], ID));
          SetLst.Add(string.Format("{0}-{1}-TieSrf, S{2}", Tie.Branch(1)[i], ID, Inf.Branch(1, i, 5)[0]));
        }
      }
      //Add elements on loaded face;
      if ( Inf.PathExists(1, 0, 2) )
      {
        for (int i = 0; i < Load.Branch(0).Count; i++)
        {
          SetLst.Add(string.Format("*Elset, elset={0}-Surf, internal, instance={1}", Load.Branch(2)[i], ID));
          for (int j = 0; j < Inf.Branch(1, i, 2).Count; j++)
          {
            SetLst.Add(Inf.Branch(1, i, 2)[j]);
          }
        }
      }
      //Define load surface;
      if ( Inf.PathExists(1, 0, 2) )
      {
        for (int i = 0; i < Load.Branch(0).Count; i++)
        {
          SetLst.Add(string.Format("*Surface, type=ELEMENT, name={0}", Load.Branch(2)[i]));
          SetLst.Add(string.Format("{0}-Surf, S{1}", Load.Branch(2)[i], Inf.Branch(1, i, 3)[0]));
        }
      }
      //Boundary conditions;
      if ( Support.PathExists(0) )
      {
        for (int i = 0; i < Support.Branch(1).Count; i++)
        {
          BCLst.Add(string.Format("{0}", Support.Branch(1)[i]));
        }
      }
      //Steps;
      if ( Load.PathExists(0) )
      {
        for (int i = 0; i < Load.Branch(1).Count; i++)
        {
          StpLst.Add(string.Format("{0}", Load.Branch(1)[i]));;
        }
      }
      if ( Displ.PathExists(0) )
      {
        for (int i = 0; i < Displ.Branch(1).Count; i++)
        {
          StpLst.Add(string.Format("{0}", Displ.Branch(1)[i]));
        }
      }

    }
    Geometry = GeoTree;
    Part = PrtLst;
    Instance = InsLst;
    Sets = SetLst;
    BC = BCLst;
    Steps = StpLst;
# ---------- timberpart1_2: C# additional code ----------
  public int SrfInd(List < int > N)
  {
    int Indx;

    if (!N.Except(new List<int>{ 1, 2, 3, 4 }).Any() && N.Count == 4)
    {
      Indx = 1;
    }
    else if(!N.Except(new List<int>{ 5, 6, 7, 8 }).Any() && N.Count == 4)
    {
      Indx = 2;
    }
    else if(!N.Except(new List<int>{ 1, 2, 5, 6 }).Any() && N.Count == 4)
    {
      Indx = 3;
    }
    else if(!N.Except(new List<int>{ 2, 3, 6, 7 }).Any() && N.Count == 4)
    {
      Indx = 4;
    }
    else if(!N.Except(new List<int>{ 3, 4, 7, 8 }).Any() && N.Count == 4)
    {
      Indx = 5;
    }
    else
    {
      Indx = 6;
    }
    return Indx;
  }

  public bool IdenSet(Brep Srf, Point3d Nd, double Tol)
  {
    bool Truth;
    Point3d Pt = Srf.ClosestPoint(Nd);
    Vector3d Vct = Pt - Nd;

    if (Vct.Length < Tol)
    {
      Truth = true;
    }
    else
    {
      Truth = false;
    }
    return Truth;
  }

  public bool PtCmp(Point3d ElNd, Point3d Nd)
  {
    bool Truth;
    Vector3d Vct = ElNd - Nd;

    if (Vct.Length < doc.ModelAbsoluteTolerance)
    {
      Truth = true;
    }
    else
    {
      Truth = false;
    }
    return Truth;
  }
# ---------- end timberpart1_2 ----------

loadsurface5 = Rotate3D(Geometry=loadedsurface, Angle=degrees("240"), Center=Point(0, 0, 0), Axis=Vector(0, 0, 1))  # -> Geometry, Transform
breps5 = Rotate3D(Geometry=brep, Angle=degrees("240"), Center=Point(0, 0, 0), Axis=Vector(0, 0, 1))  # -> Geometry, Transform
ids_2 = CSharpScript(Breps=breps5.Geometry)  # -> IDList; inputs Breps: list of Brep
# ---------- ids_2: C# ----------
    List < string > idlist = new List < string >();
    for (int i = 0; i < Breps.Count; i++)
    {
      idlist.Add("tie5" + i);
    }
    IDList = idlist;
# ---------- end ids_2 ----------
load = CSharpScript(ID="Load5", LoadType=load_type, Face=loadsurface5.Geometry, kNMagnitude=Slider(39.99, range=0..100))  # -> Load; inputs ID: String, LoadType: String, Tol: Double, Face: Brep, DirVector: Vector3d, kNMagnitude: Double, MPaMagnitude: Double
# ---------- load: C# ----------
    //Create output tree
    DataTree <System.Object> tree = new DataTree<System.Object>();
    ///////////////////////////////////////////////////////////////////////////////////////
    ///////////////////////////////////////////////////////////////////////////////////////
    if (string.IsNullOrEmpty(ID)) //if ID is not assigned
    {
      ID = "Load1"; //Make default ID
    }
    //Add surface and ID to be used in Part component
    tree.Add(Face, new GH_Path(0));
    tree.Add(ID, new GH_Path(2));
    ///////////////////////////////////////////////////////////////////////////////////////
    //Makes string LoadType into list of two values with LoadType and abbreviation (P,TRSHR,TRVEC)
    string[] loadtypelist;
    loadtypelist = LoadType.Split(new char[] {','}, StringSplitOptions.None);
    ///////////////////////////////////////////////////////////////////////////////////////
    //Get info from the Direction vector, assign Default value
    if (DirVector.IsZero) //it the vector is the default value {0,0,0}
    {
      DirVector = new Vector3d(0, 0, -1); //default value downwards in z-direction, otherwise DirVec=DirVec
    }
    DirVector.Unitize(); //make the direction vector have unit length
    //Calculate the magnitude Stress [MPa] that works over the Face Area, so that the magnitude adds itself up to assigned kNMagnitude
    double Magnitude;
    if (kNMagnitude == 0)//if kNMagnitude is empty (==0)
    {
      Magnitude = MPaMagnitude; //then Magnitude is given in MPa
    }
    else
    {
      Magnitude = kNMagnitude * 1000 / Face.GetArea(); //Convert kN to a stress working over the face area
    }

    //Add conditions to be exported in INP
    tree.Add("**", new GH_Path(1));
    tree.Add(string.Format("** STEP: {0}", ID), new GH_Path(1));
    tree.Add("**", new GH_Path(1));
    tree.Add(string.Format("*Step, name={0}, nlgeom=NO", ID), new GH_Path(1));
    tree.Add("Uniform Load", new GH_Path(1));
    tree.Add("*Static", new GH_Path(1));
    tree.Add("0.1, 1., 1e-05, 1.", new GH_Path(1));
    tree.Add("**", new GH_Path(1));
    tree.Add("** LOADS", new GH_Path(1));
    tree.Add("**", new GH_Path(1));
    tree.Add(string.Format("** Name: {0}-Load   Type: {1}", ID, loadtypelist[0]), new GH_Path(1));
    tree.Add("*Dsload", new GH_Path(1));
    tree.Add(string.Format("{0},{1}, {2}, {3}, {4},{5}", ID, loadtypelist[1], Magnitude, DirVector.X, DirVector.Z, DirVector.Y), new GH_Path(1));
    tree.Add("**", new GH_Path(1));
    tree.Add("** OUTPUT REQUESTS", new GH_Path(1));
    tree.Add("**", new GH_Path(1));
    tree.Add("*Restart, write, frequency=0", new GH_Path(1));
    tree.Add("**", new GH_Path(1));
    tree.Add("** FIELD OUTPUT: F-Output-1", new GH_Path(1));
    tree.Add("**", new GH_Path(1));
    tree.Add("*Output, field, variable=PRESELECT", new GH_Path(1));
    tree.Add("**", new GH_Path(1));
    tree.Add("** HISTORY OUTPUT: H-Output-1", new GH_Path(1));
    tree.Add("**", new GH_Path(1));
    tree.Add("*Output, history, variable=PRESELECT", new GH_Path(1));
    tree.Add("*End Step", new GH_Path(1));
    ///////////////////////////////////////////////////////////////////////////////////////
    ///////////////////////////////////////////////////////////////////////////////////////
    //Add tolerance for pointcompare
    if(Tol == 0)
    {
      tree.Add(0.001, new GH_Path(3));
    }
    else
    {
      tree.Add(Tol, new GH_Path(3));
    }
    ///////////////////////////////////////////////////////////////////////////////////////
    ///////////////////////////////////////////////////////////////////////////////////////
    Load = tree;
# ---------- end load ----------
tie5 = CSharpScript(ID=ids_2, Master="TimberPart5", Slave="AluPart", Face=breps5.Geometry)  # -> Part, INP; inputs ID: String, Master: String, Slave: String, Tol: Double, Face: Brep; same code as tie1
timberpart5_2 = CSharpScript(
    ID="TimberPart5",
    Mesh=[timberpart5.mesh_15, timberpart5.mesh_14, timberpart5.mesh_9, timberpart5.mesh_7, timberpart5.mesh_5, timberpart5.mesh, timberpart5.mesh_10, timberpart5.mesh_11, timberpart5.mesh_8, timberpart5.mesh_12, timberpart5.mesh_16, timberpart5.mesh_13, timberpart5.mesh_6, timberpart5.mesh_3, timberpart5.mesh_4, timberpart5.mesh_2],
    ElmntType=hexahedron_2,
    Material=orthotropicmaterial,
    Orientation=panel_2,
    Load=load,
    Tie=tie5.Part,
    Run=toggle_2)  # -> Geometry, Part, Instance, Sets, BC, Steps; inputs ID: String, Mesh: tree, ElmntType: list of String, Material: list, Orientation: list of String, Support: tree, Load: tree, Displ: tree, Tie: tree, Run: Boolean; same code as timberpart1_2

loadsurface2 = Rotate3D(Geometry=loadedsurface, Angle=degrees("60"), Center=Point(0, 0, 0), Axis=Vector(0, 0, 1))  # -> Geometry, Transform
breps2 = Rotate3D(Geometry=brep, Angle=degrees("60"), Center=Point(0, 0, 0), Axis=Vector(0, 0, 1))  # -> Geometry, Transform
ids_3 = CSharpScript(Breps=breps2.Geometry)  # -> IDList; inputs Breps: list of Brep
# ---------- ids_3: C# ----------
    List < string > idlist = new List < string >();
    for (int i = 0; i < Breps.Count; i++)
    {
      idlist.Add("tie2" + i);
    }
    IDList = idlist;
# ---------- end ids_3 ----------
load_2 = CSharpScript(ID="Load2", LoadType=load_type_2, Face=loadsurface2.Geometry, kNMagnitude=Slider(34.59, range=0..100))  # -> Load; inputs ID: String, LoadType: String, Tol: Double, Face: Brep, DirVector: Vector3d, kNMagnitude: Double, MPaMagnitude: Double; same code as load
tie2 = CSharpScript(ID=ids_3, Master="TimberPart2", Slave="AluPart", Face=breps2.Geometry)  # -> Part, INP; inputs ID: String, Master: String, Slave: String, Tol: Double, Face: Brep; same code as tie1
timberpart2_2 = CSharpScript(
    ID="TimberPart2",
    Mesh=[timberpart2.mesh_15, timberpart2.mesh_14, timberpart2.mesh_9, timberpart2.mesh_7, timberpart2.mesh_5, timberpart2.mesh, timberpart2.mesh_10, timberpart2.mesh_11, timberpart2.mesh_8, timberpart2.mesh_12, timberpart2.mesh_16, timberpart2.mesh_13, timberpart2.mesh_6, timberpart2.mesh_3, timberpart2.mesh_4, timberpart2.mesh_2],
    ElmntType=hexahedron_2,
    Material=orthotropicmaterial,
    Orientation=panel_5,
    Load=load_2,
    Tie=tie2.Part,
    Run=toggle_2)  # -> Geometry, Part, Instance, Sets, BC, Steps; inputs ID: String, Mesh: tree, ElmntType: list of String, Material: list, Orientation: list of String, Support: tree, Load: tree, Displ: tree, Tie: tree, Run: Boolean; same code as timberpart1_2

loadsurface4 = Rotate3D(Geometry=loadedsurface, Angle=degrees("180"), Center=Point(0, 0, 0), Axis=Vector(0, 0, 1))  # -> Geometry, Transform
breps4 = Rotate3D(Geometry=brep, Angle=degrees("180"), Center=Point(0, 0, 0), Axis=Vector(0, 0, 1))  # -> Geometry, Transform
ids_4 = CSharpScript(Breps=breps4.Geometry)  # -> IDList; inputs Breps: list of Brep
# ---------- ids_4: C# ----------
    List < string > idlist = new List < string >();
    for (int i = 0; i < Breps.Count; i++)
    {
      idlist.Add("tie4" + i);
    }
    IDList = idlist;
# ---------- end ids_4 ----------
load_3 = CSharpScript(ID="Load4", LoadType=load_type_3, Face=loadsurface4.Geometry, kNMagnitude=Slider(32.7, range=0..100))  # -> Load; inputs ID: String, LoadType: String, Tol: Double, Face: Brep, DirVector: Vector3d, kNMagnitude: Double, MPaMagnitude: Double; same code as load
tie4 = CSharpScript(ID=ids_4, Master="TimberPart4", Slave="AluPart", Face=breps4.Geometry)  # -> Part, INP; inputs ID: String, Master: String, Slave: String, Tol: Double, Face: Brep; same code as tie1
timberpart3_2 = CSharpScript(
    ID="TimberPart4",
    Mesh=[timberpart4.mesh_15, timberpart4.mesh_14, timberpart4.mesh_9, timberpart4.mesh_7, timberpart4.mesh_5, timberpart4.mesh, timberpart4.mesh_10, timberpart4.mesh_11, timberpart4.mesh_8, timberpart4.mesh_12, timberpart4.mesh_16, timberpart4.mesh_13, timberpart4.mesh_6, timberpart4.mesh_3, timberpart4.mesh_4, timberpart4.mesh_2],
    ElmntType=hexahedron_2,
    Material=orthotropicmaterial,
    Orientation=panel_6,
    Load=load_3,
    Tie=tie4.Part,
    Run=toggle_2)  # -> Geometry, Part, Instance, Sets, BC, Steps; inputs ID: String, Mesh: tree, ElmntType: list of String, Material: list, Orientation: list of String, Support: tree, Load: tree, Displ: tree, Tie: tree, Run: Boolean; same code as timberpart1_2

loadsurface3 = Rotate3D(Geometry=loadedsurface, Angle=degrees("120"), Center=Point(0, 0, 0), Axis=Vector(0, 0, 1))  # -> Geometry, Transform
breps3 = Rotate3D(Geometry=brep, Angle=degrees("120"), Center=Point(0, 0, 0), Axis=Vector(0, 0, 1))  # -> Geometry, Transform
ids_5 = CSharpScript(Breps=breps3.Geometry)  # -> IDList; inputs Breps: list of Brep
# ---------- ids_5: C# ----------
    List < string > idlist = new List < string >();
    for (int i = 0; i < Breps.Count; i++)
    {
      idlist.Add("tie3" + i);
    }
    IDList = idlist;
# ---------- end ids_5 ----------
load_4 = CSharpScript(ID="Load3", LoadType=load_type_4, Face=loadsurface3.Geometry, kNMagnitude=Slider(109.66, range=0..1000))  # -> Load; inputs ID: String, LoadType: String, Tol: Double, Face: Brep, DirVector: Vector3d, kNMagnitude: Double, MPaMagnitude: Double; same code as load
tie3 = CSharpScript(ID=ids_5, Master="TimberPart3", Slave="AluPart", Face=breps3.Geometry)  # -> Part, INP; inputs ID: String, Master: String, Slave: String, Tol: Double, Face: Brep; same code as tie1
timberpart3_3 = CSharpScript(
    ID="TimberPart3",
    Mesh=[timberpart3.mesh_15, timberpart3.mesh_14, timberpart3.mesh_9, timberpart3.mesh_7, timberpart3.mesh_5, timberpart3.mesh, timberpart3.mesh_10, timberpart3.mesh_11, timberpart3.mesh_8, timberpart3.mesh_12, timberpart3.mesh_16, timberpart3.mesh_13, timberpart3.mesh_6, timberpart3.mesh_3, timberpart3.mesh_4, timberpart3.mesh_2],
    ElmntType=hexahedron_2,
    Material=orthotropicmaterial,
    Orientation=panel_3,
    Load=load_4,
    Tie=tie3.Part,
    Run=toggle_2)  # -> Geometry, Part, Instance, Sets, BC, Steps; inputs ID: String, Mesh: tree, ElmntType: list of String, Material: list, Orientation: list of String, Support: tree, Load: tree, Displ: tree, Tie: tree, Run: Boolean; same code as timberpart1_2

loadsurface6 = Rotate3D(Geometry=loadedsurface, Angle=degrees("300"), Center=Point(0, 0, 0), Axis=Vector(0, 0, 1))  # -> Geometry, Transform
breps6 = Rotate3D(Geometry=brep, Angle=degrees("300"), Center=Point(0, 0, 0), Axis=Vector(0, 0, 1))  # -> Geometry, Transform
ids_6 = CSharpScript(Breps=breps6.Geometry)  # -> IDList; inputs Breps: list of Brep
# ---------- ids_6: C# ----------
    List < string > idlist = new List < string >();
    for (int i = 0; i < Breps.Count; i++)
    {
      idlist.Add("tie6" + i);
    }
    IDList = idlist;
# ---------- end ids_6 ----------
load_5 = CSharpScript(ID="Load6", LoadType=load_type_5, Face=loadsurface6.Geometry, kNMagnitude=Slider(108.82, range=0..1000))  # -> Load; inputs ID: String, LoadType: String, Tol: Double, Face: Brep, DirVector: Vector3d, kNMagnitude: Double, MPaMagnitude: Double; same code as load
tie6 = CSharpScript(ID=ids_6, Master="TimberPart6", Slave="AluPart", Face=breps6.Geometry)  # -> Part, INP; inputs ID: String, Master: String, Slave: String, Tol: Double, Face: Brep; same code as tie1
timberpart3_4 = CSharpScript(
    ID="TimberPart6",
    Mesh=[timberpart6.mesh_15, timberpart6.mesh_14, timberpart6.mesh_9, timberpart6.mesh_7, timberpart6.mesh_5, timberpart6.mesh, timberpart6.mesh_10, timberpart6.mesh_11, timberpart6.mesh_8, timberpart6.mesh_12, timberpart6.mesh_16, timberpart6.mesh_13, timberpart6.mesh_6, timberpart6.mesh_3, timberpart6.mesh_4, timberpart6.mesh_2],
    ElmntType=hexahedron_2,
    Material=orthotropicmaterial,
    Orientation=panel_4,
    Load=load_5,
    Tie=tie6.Part,
    Run=toggle_2)  # -> Geometry, Part, Instance, Sets, BC, Steps; inputs ID: String, Mesh: tree, ElmntType: list of String, Material: list, Orientation: list of String, Support: tree, Load: tree, Displ: tree, Tie: tree, Run: Boolean; same code as timberpart1_2

brep_2 = Brep([loadedsurface, loadsurface2.Geometry, loadsurface3.Geometry, loadsurface4.Geometry, loadsurface5.Geometry, loadsurface6.Geometry])
preview_10 = CustomPreview(
    Geometry=[timberpart4.srf_15, timberpart4.srf_14, timberpart4.srf_9, timberpart4.srf_7, timberpart4.srf_5, timberpart4.srf, timberpart4.srf_10, timberpart4.srf_11, timberpart4.srf_8, timberpart4.srf_12, timberpart4.srf_16, timberpart4.srf_13, timberpart4.srf_6, timberpart4.srf_3, timberpart4.srf_4, timberpart4.srf_2, timberpart1.srf_15, timberpart1.srf_14, timberpart1.srf_9, timberpart1.srf_7, timberpart1.srf_5, timberpart1.srf, timberpart1.srf_10, timberpart1.srf_11, timberpart1.srf_8, timberpart1.srf_12, timberpart1.srf_16, timberpart1.srf_13, timberpart1.srf_6, timberpart1.srf_3, timberpart1.srf_4, timberpart1.srf_2, brep_2],
    Material=swatch)

alupart = CSharpScript(
    ID="AluPart",
    Mesh=[A.Mesh, alupart1.mesh, alupart1.mesh_2, alupart1.mesh_3, alupart1.mesh_6, alupart1.mesh_4, alupart1.mesh_5, alupart1.mesh_7, alupart1.mesh_8, alupart1.mesh_9, alupart1.mesh_10, alupart1.mesh_11, alupart1.mesh_13, alupart1.mesh_12, alupart2.mesh, alupart2.mesh_2, alupart2.mesh_3, alupart2.mesh_6, alupart2.mesh_4, alupart2.mesh_5, alupart2.mesh_7, alupart2.mesh_8, alupart2.mesh_9, alupart2.mesh_10, alupart2.mesh_11, alupart2.mesh_13, alupart2.mesh_12, abelow_2.Mesh, alumesh3, alumesh4, alumesh5, alumesh6],
    ElmntType=hexahedron,
    Material=isotropicalumaterial,
    Tie=[tie1.Part, tie2.Part, tie3.Part, tie4.Part, tie5.Part, tie6.Part],
    Run=toggle_2)  # -> Geometry, Part, Instance, Sets, BC, Steps; inputs ID: String, Mesh: tree, ElmntType: list of String, Material: list, Orientation: list of String, Support: tree, Load: tree, Displ: tree, Tie: tree, Run: Boolean; same code as timberpart1_2

inpassembly2704 = CSharpScript(
    Part=flatten([alupart.Part, timberpart1_2.Part, timberpart2_2.Part, timberpart3_3.Part, timberpart3_2.Part, timberpart5_2.Part, timberpart3_4.Part]),
    Instance=flatten([alupart.Instance, timberpart1_2.Instance, timberpart2_2.Instance, timberpart3_3.Instance, timberpart3_2.Instance, timberpart5_2.Instance, timberpart3_4.Instance]),
    Sets=flatten([alupart.Sets, timberpart1_2.Sets, timberpart2_2.Sets, timberpart3_3.Sets, timberpart3_2.Sets, timberpart5_2.Sets, timberpart3_4.Sets]),
    BC=flatten([alupart.BC, timberpart1_2.BC, timberpart2_2.BC, timberpart3_3.BC, timberpart3_2.BC, timberpart5_2.BC, timberpart3_4.BC]),
    Material=[isotropicalumaterial, orthotropicmaterial],
    Tie=flatten([tie1.INP, tie2.INP, tie3.INP, tie4.INP, tie5.INP, tie6.INP]),
    Steps=flatten([alupart.Steps, timberpart1_2.Steps, timberpart2_2.Steps, timberpart3_3.Steps, timberpart3_2.Steps, timberpart5_2.Steps, timberpart3_4.Steps]))  # -> INP; inputs ID: list of String, Job: list of String, Model: list of String, Part: list of String, Instance: list of String, Sets: list of String, BC: list of String, Material: list of String, Tie: list of String, Steps: list of String
# ---------- inpassembly2704: C# ----------
    //Create output;
    List < string > INPLst = new List<string>{ "*Heading" };
    //Create variables;
    string job, model;
    //Include the header, job- and model name;Model
    if (ID.Count == 0)
    {
      INPLst.Add("GH_File");
    }
    else
    {
      INPLst.Add(ID[0]);
    }
    if (Job.Count == 0)
    {
      job = "GH_Job";
    }
    else
    {
      job = Job[0];
    }
    if (Model.Count == 0)
    {
      model = "GH_Model";
    }
    else
    {
      model = Model[0];
    }
    INPLst.Add(string.Format("** Job name: {0} Model name: {1}", job, model));
    ///////////////////////////////////////////////////////////////////////////////////////
    ///////////////////////////////////////////////////////////////////////////////////////
    //Setting the data file printing options;
    INPLst.Add("*Preprint, echo=NO, model=NO, history=NO, contact=NO");
    //Parts;
    INPLst.Add("**");
    INPLst.Add("** PARTS");
    INPLst.Add("**");
    INPLst.AddRange(Part);
    //Start assemble the model;
    INPLst.Add("**");
    INPLst.Add("** ASSEMBLY");
    INPLst.Add("**");
    INPLst.Add("*Assembly, name=Assembly");
    INPLst.Add("**");
    //Instances;
    INPLst.AddRange(Instance);
    //Sets;
    INPLst.AddRange(Sets);
    //Tie;
    INPLst.AddRange(Tie);
    //End assembly;
    INPLst.Add("*End Assembly");
    //Defining the material properties;
    INPLst.Add("**");
    INPLst.Add("** MATERIALS");
    INPLst.Add("**");

    /*if ( Material.Count > 3)
    {
      INPLst.Add(string.Format("*Material, name={0}", Material[0]));
      INPLst.Add(string.Format("* {0}", Material[1]));
      INPLst.Add(string.Format("{0}, {1}", Material[2], Material[3]));
    }
 */

    for (int i = 0; i < Material.Count; i += 4) //fixed 2904
    {
      INPLst.Add(string.Format("*Material, name={0}", Material[i]));
      INPLst.Add(string.Format("*{0}", Material[i + 1]));
      INPLst.Add(string.Format("{0}", Material[i + 2]));
      INPLst.Add(string.Format("{0}", Material[i + 3]));
    }


    //Defining the boundary conditions;
    INPLst.Add("**");
    INPLst.Add("** BOUNDARY CONDITIONS");
    INPLst.Add("**");
    INPLst.Add("** Name: BC-1 Type: Displacement/Rotation");
    INPLst.Add("*Boundary");
    INPLst.AddRange(BC);
    //End defining BC;
    INPLst.Add("** ----------------------------------------------------------------");
    //Add the steps;
    INPLst.AddRange(Steps);
    ///////////////////////////////////////////////////////////////////////////////////////
    ///////////////////////////////////////////////////////////////////////////////////////
    INP = INPLst;
# ---------- end inpassembly2704 ----------
panel_17 = Panel(inpassembly2704)

# ==== cluster Cluster
x = ClusterInput()
A = ClusterInput()
c_script = CSharpScript(x=x)  # -> A; inputs x: Int32
# ---------- c_script: C# ----------
    List<int> loc = new List<int>();
    loc.Add(1);
    loc.Add(x - 1);
    A = loc;
# ---------- end c_script ----------
pts = ClusterInput()
A_2 = ClusterInput()
multiplication = Multiplication(A=A, B="2")
cnt = CSharpScript(Pts=pts, TooltipDescriptionOverride="Center point from 4 points", TooltipTextOverride="Center Point")  # -> Cnt; inputs Pts: list of Point3d
# ---------- cnt: C# ----------
    Point3d cnt = new Point3d((Pts[0].X + Pts[1].X + Pts[2].X + Pts[3].X) / 4, (Pts[0].Y + Pts[1].Y + Pts[2].Y + Pts[3].Y) / 4, (Pts[0].Z + Pts[1].Z + Pts[2].Z + Pts[3].Z) / 4); //central point
    Cnt = cnt;
# ---------- end cnt ----------
subtraction = Subtraction(A=A_2, B=multiplication)
h = ClusterInput()
rectanglexzplanerev = CSharpScript(cntr=cnt, w=subtraction, h=h)  # -> Rcntr, pointlist; inputs cntr: Point3d, w: Double, h: Double
# ---------- rectanglexzplanerev: C# ----------
    Point3d firstp = new Point3d(cntr.X - w / 2, cntr.Y, cntr.Z - h / 2);
    Point3d secondp = new Point3d(cntr.X - w / 2, cntr.Y, cntr.Z + h / 2);
    Point3d thirdp = new Point3d(cntr.X + w / 2, cntr.Y, cntr.Z + h / 2);
    Point3d fourthp = new Point3d(cntr.X + w / 2, cntr.Y, cntr.Z - h / 2);
    List<Point3d> ptslist = new List<Point3d>();
    ptslist.Add(fourthp); //reverse points to avoid negative volume
    ptslist.Add(thirdp);
    ptslist.Add(secondp);
    ptslist.Add(firstp);
    pointlist = ptslist;
    Rcntr = cntr;
# ---------- end rectanglexzplanerev ----------
T = ClusterInput()
move = Move(Geometry=rectanglexzplanerev.pointlist, Motion=T)  # -> Geometry, Transform
pointlist = ClusterOutput(rectanglexzplanerev.pointlist)
item = ListItem(List=rectanglexzplanerev.pointlist, Index="2", Wrap=True)
item_2 = ListItem(List=rectanglexzplanerev.pointlist, Index="1", Wrap=True)
G = ClusterOutput(move.Geometry)
A_3 = ClusterInput()
ln = Line(StartPoint=item, EndPoint=item_2)
N = ClusterInput()
division = Division(A=A_3, B="-2")
divide = DivideCurve(Curve=ln, Count=N, Kinks=False)  # -> Points, Tangents, Parameters
Z = UnitZ(Factor=division)
move_2 = Move(Geometry=divide.Points, Motion=Z)  # -> Geometry, Transform
panel = Panel("""1
3""")
w = ClusterInput()
h_2 = ClusterInput()
item_3 = ListItem(List=move_2.Geometry, Index=c_script, Wrap=True)
rectanglexzplanerev_2 = CSharpScript(cntr=item_3, w=w, h=h_2)  # -> Rcntr, simplify(pointlist); inputs cntr: Point3d, w: Double, h: Double
# ---------- rectanglexzplanerev_2: C# usings ----------
using System.IO;
using System.Linq;
using System.Data;
using System.Drawing;
using System.Reflection;
using System.Windows.Forms;
using System.Xml;
using System.Xml.Linq;
using System.Runtime.InteropServices;

using Rhino.DocObjects;
using Rhino.Collections;
using GH_IO;
using GH_IO.Serialization;
# ---------- rectanglexzplanerev_2: C# ----------
    Point3d firstp = new Point3d(cntr.X - w / 2, cntr.Y, cntr.Z - h / 2);
    Point3d secondp = new Point3d(cntr.X - w / 2, cntr.Y, cntr.Z + h / 2);
    Point3d thirdp = new Point3d(cntr.X + w / 2, cntr.Y, cntr.Z + h / 2);
    Point3d fourthp = new Point3d(cntr.X + w / 2, cntr.Y, cntr.Z - h / 2);
    List<Point3d> ptslist = new List<Point3d>();
    ptslist.Add(fourthp); //reverse points to avoid negative volume
    ptslist.Add(thirdp);
    ptslist.Add(secondp);
    ptslist.Add(firstp);
    pointlist = ptslist;
    Rcntr = cntr;
# ---------- end rectanglexzplanerev_2 ----------
pointlist_2 = ClusterOutput(rectanglexzplanerev_2.pointlist)

# ==== cluster Cluster_2
L = ClusterInput()
L_2 = ClusterInput()
L_3 = ClusterInput()
L_4 = ClusterInput()
L_5 = ClusterInput()
L_6 = ClusterInput()
L_7 = ClusterInput()
L_8 = ClusterInput()
split = SplitList(List=L, Index="2")  # -> ListA, ListB
split_2 = SplitList(List=L_2, Index="2")  # -> ListA, ListB
split_3 = SplitList(List=L_3, Index="2")  # -> ListA, ListB
split_4 = SplitList(List=L_4, Index="2")  # -> ListA, ListB
split_5 = SplitList(List=L_5, Index="2")  # -> ListA, ListB
split_6 = SplitList(List=L_6, Index="2")  # -> ListA, ListB
split_7 = SplitList(List=L_7, Index="2")  # -> ListA, ListB
split_8 = SplitList(List=L_8, Index="2")  # -> ListA, ListB
A = ClusterOutput(split.ListA)
B = ClusterOutput(split.ListB)
d2sp = Point(flatten([split_4.ListB, split_2.ListA]))
d2tp = Point(flatten([split_5.ListA, split_7.ListB]))
d21sp = Point(flatten([split_3.ListA, split_2.ListB]))
A_2 = ClusterOutput(split_8.ListA)
B_2 = ClusterOutput(split_8.ListB)
d21tp = Point(flatten([split_5.ListB, split_6.ListA]))
d4sp = Point(flatten([split.ListA, split_4.ListA]))
d4tp = Point(flatten([split_8.ListA, split_7.ListA]))
d41sp = Point(flatten([split.ListB, split_3.ListB]))
d41tp = Point(flatten([split_8.ListB, split_6.ListB]))
d2sp_2 = ClusterOutput(d2sp)
d2tp_2 = ClusterOutput(d2tp)
d21sp_2 = ClusterOutput(d21sp)
d21tp_2 = ClusterOutput(d21tp)
d4sp_2 = ClusterOutput(d4sp)
d4tp_2 = ClusterOutput(d4tp)
d41sp_2 = ClusterOutput(d41sp)
d41tp_2 = ClusterOutput(d41tp)

# ==== cluster Cluster_3
A = ClusterInput()
d41end = ClusterInput()
multiplication = Multiplication(A=A, B="-1")
Y = ClusterInput()
d4end = ClusterInput()
X = ClusterInput()
Y_2 = ClusterInput()
d41end_2 = Point(d41end)
vec = VectorXYZ(XComponent=multiplication, YComponent=Y, ZComponent=0)  # -> Vector, Length
d4end_2 = Point(d4end)
T = ClusterInput()
vec_2 = VectorXYZ(XComponent=X, YComponent=Y_2, ZComponent=0)  # -> Vector, Length
move = Move(Geometry=d41end_2, Motion=vec.Vector)  # -> Geometry, Transform
T_2 = ClusterInput()
move_2 = Move(Geometry=move.Geometry, Motion=T)  # -> Geometry, Transform
e2tp = ClusterInput()
move_3 = Move(Geometry=d4end_2, Motion=vec_2.Vector)  # -> Geometry, Transform
e1tp = ClusterInput()
move_4 = Move(Geometry=move_3.Geometry, Motion=T_2)  # -> Geometry, Transform
e2tp_2 = Point([move_2.Geometry, e2tp])
e2sp = Point([move.Geometry, d41end_2])
e1sp = Point([move_3.Geometry, d4end_2])
e1tp_2 = Point([move_4.Geometry, e1tp])
e2tp_3 = ClusterOutput(e2tp_2)
e2sp_2 = ClusterOutput(e2sp)
e1sp_2 = ClusterOutput(e1sp)
e1tp_3 = ClusterOutput(e1tp_2)

# ==== cluster Cluster_4
L = ClusterInput()
A = ClusterInput()
B = ClusterInput()
split = SplitList(List=L, Index="2")  # -> ListA, ListB
subtraction = Subtraction(A=A, B=B)
T = ClusterInput()
Y = UnitY(Factor=subtraction)
move1 = Move(Geometry=split.ListA, Motion=T)  # -> Geometry, Transform
move = Move(Geometry=split.ListB, Motion=Y)  # -> Geometry, Transform
te2tp = Point([move.Geometry, move1.Geometry])
G = ClusterOutput(move.Geometry)
te2tp_2 = ClusterOutput(te2tp)

# ==== cluster Cluster_5
L = ClusterInput()
A = ClusterInput()
B = ClusterInput()
split = SplitList(List=L, Index="2")  # -> ListA, ListB
subtraction = Subtraction(A=A, B=B)
Y = UnitY(Factor=subtraction)
T = ClusterInput()
move1 = Move(Geometry=split.ListB, Motion=T)  # -> Geometry, Transform
move = Move(Geometry=split.ListA, Motion=Y)  # -> Geometry, Transform
pt = ClusterInput()
G = ClusterOutput(move1.Geometry)
G_2 = ClusterOutput(move.Geometry)
T_2 = ClusterInput()
pt_2 = Point([move.Geometry, pt])
move_2 = Move(Geometry=pt_2, Motion=T_2)  # -> Geometry, Transform
G_3 = ClusterOutput(move_2.Geometry)

# ==== cluster Cluster_6
pts = ClusterInput()
sortxz = CSharpScript(Pts=pts, TooltipDescriptionOverride="Sort 4 points counter clockwise ", TooltipTextOverride="Sort")  # -> SPts; inputs Pts: list of Point3d
# ---------- sortxz: C# ----------
    Point3d[] pointarray = Pts.ToArray();
    Point3d cnt = new Point3d((Pts[0].X + Pts[1].X + Pts[2].X + Pts[3].X) / 4, (Pts[0].Y + Pts[1].Y + Pts[2].Y + Pts[3].Y) / 4, (Pts[0].Z + Pts[1].Z + Pts[2].Z + Pts[3].Z) / 4); //central point

    double[] angles = new double[pointarray.Length];

    for (int i = 0; i < pointarray.Length; i++)
    {
      angles[i] = Math.Atan2((pointarray[i].Z - cnt.Z), (pointarray[i].X - cnt.X));
    }
    Array.Sort(angles, pointarray);

    List < Point3d > sorted = new List <Point3d>();
    sorted.Add(pointarray[1]); //to get correct listing
    sorted.Add(pointarray[2]);
    sorted.Add(pointarray[3]);
    sorted.Add(pointarray[0]);


    SPts = sorted;
# ---------- end sortxz ----------
L = ClusterInput()
L_2 = ClusterInput()
L_3 = ClusterInput()
L_4 = ClusterInput()
spts = ClusterOutput(sortxz)
split = SplitList(List=L, Index="2")  # -> ListA, ListB
split_2 = SplitList(List=L_2, Index="2")  # -> ListA, ListB
split_3 = SplitList(List=L_3, Index="2")  # -> ListA, ListB
split_4 = SplitList(List=L_4, Index="2")  # -> ListA, ListB
ptie7 = Point(flatten([split_4.ListA, split_2.ListA]))
ptie9 = Point(flatten([split_2.ListB, split_4.ListB]))
ptie3 = Point(flatten([split.ListA, split_3.ListA]))
ptie5 = Point(flatten([split_3.ListB, split.ListB]))
ptie6 = Point(flatten([split_3.ListB, split_4.ListA]))
sortyz = CSharpScript(Pts=ptie5, TooltipDescriptionOverride="Sort 4 points counter clockwise ", TooltipTextOverride="Sort")  # -> SPts; inputs Pts: list of Point3d
# ---------- sortyz: C# ----------
    Point3d[] pointarray = Pts.ToArray();
    Point3d cnt = new Point3d((Pts[0].X + Pts[1].X + Pts[2].X + Pts[3].X) / 4, (Pts[0].Y + Pts[1].Y + Pts[2].Y + Pts[3].Y) / 4, (Pts[0].Z + Pts[1].Z + Pts[2].Z + Pts[3].Z) / 4); //central point

    double[] angles = new double[pointarray.Length];

    for (int i = 0; i < pointarray.Length; i++)
    {
      angles[i] = Math.Atan2((pointarray[i].Z - cnt.Z), (pointarray[i].Y - cnt.Y));
    }
    Array.Sort(angles, pointarray);

    List < Point3d > sorted = new List <Point3d>();
    sorted.Add(pointarray[1]); //to get correct listing
    sorted.Add(pointarray[2]);
    sorted.Add(pointarray[3]);
    sorted.Add(pointarray[0]);
    sorted.Reverse();



    SPts = sorted;
# ---------- end sortyz ----------
sortyz_2 = CSharpScript(Pts=ptie3, TooltipDescriptionOverride="Sort 4 points counter clockwise ", TooltipTextOverride="Sort")  # -> SPts; inputs Pts: list of Point3d; same code as sortyz
sortyz_3 = CSharpScript(Pts=ptie7, TooltipDescriptionOverride="Sort 4 points counter clockwise ", TooltipTextOverride="Sort")  # -> SPts; inputs Pts: list of Point3d; same code as sortyz
sortxz_2 = CSharpScript(Pts=ptie6, TooltipDescriptionOverride="Sort 4 points counter clockwise ", TooltipTextOverride="Sort")  # -> SPts; inputs Pts: list of Point3d; same code as sortxz
sortyz_4 = CSharpScript(Pts=ptie9, TooltipDescriptionOverride="Sort 4 points counter clockwise ", TooltipTextOverride="Sort")  # -> SPts; inputs Pts: list of Point3d; same code as sortyz
cpts = ClusterInput()
tie4 = ClusterInput()
tie2 = ClusterInput()
tie8 = ClusterInput()
tie10 = ClusterInput()
tie11 = ClusterInput()
tie1 = CSharpScript(cpts=cpts)  # -> srf; inputs cpts: list of Point3d
# ---------- tie1: C# ----------
    Brep b = Brep.CreateFromCornerPoints(cpts[0], cpts[1], cpts[2], cpts[3], 0);
    srf = b;
# ---------- end tie1 ----------
tie3_5_6_7_9 = CSharpScript(cpts=[sortyz_2, sortyz, sortxz_2, sortyz_3, sortyz_4])  # -> srf; inputs cpts: list of Point3d
# ---------- tie3_5_6_7_9: C# ----------
    List<Brep> breps = new List<Brep>();
    for (int i = 0; i < cpts.Count(); i += 4)
    {
      Brep b = Brep.CreateFromCornerPoints(cpts[i], cpts[i + 1], cpts[i + 2], cpts[i + 3], 0);
      breps.Add(b);
    }
    srf = breps;
# ---------- end tie3_5_6_7_9 ----------
tie4_2 = Brep(tie4)
tie2_2 = Brep(tie2)
tie8_2 = Brep(tie8)
tie10_2 = Brep(tie10)
tie11_2 = Brep(tie11)
srf = ClusterOutput(tie1)
tie4_3 = ClusterOutput(tie4_2)
tie2_3 = ClusterOutput(tie2_2)
srf_2 = ClusterOutput(tie3_5_6_7_9)
tie8_3 = ClusterOutput(tie8_2)
tie10_3 = ClusterOutput(tie10_2)
tie11_3 = ClusterOutput(tie11_2)

# ==== cluster AluPart1
pointssource = ClusterInput()
pointstarget = ClusterInput()
divisions = ClusterInput()
U = ClusterInput()
V = ClusterInput()
pointssource_2 = ClusterInput()
pointstarget_2 = ClusterInput()
divisions_2 = ClusterInput()
U_2 = ClusterInput()
V_2 = ClusterInput()
pointssource_3 = ClusterInput()
pointstarget_3 = ClusterInput()
divisions_3 = ClusterInput()
U_3 = ClusterInput()
V_3 = ClusterInput()
pointssource_4 = ClusterInput()
pointstarget_4 = ClusterInput()
divisions_4 = ClusterInput()
U_4 = ClusterInput()
V_4 = ClusterInput()
pointssource_5 = ClusterInput()
pointstarget_5 = ClusterInput()
divisions_5 = ClusterInput()
U_5 = ClusterInput()
V_5 = ClusterInput()
pointssource_6 = ClusterInput()
pointstarget_6 = ClusterInput()
divisions_6 = ClusterInput()
U_6 = ClusterInput()
V_6 = ClusterInput()
pointssource_7 = ClusterInput()
pointstarget_7 = ClusterInput()
divisions_7 = ClusterInput()
U_7 = ClusterInput()
V_7 = ClusterInput()
pointssource_8 = ClusterInput()
pointstarget_8 = ClusterInput()
divisions_8 = ClusterInput()
U_8 = ClusterInput()
V_8 = ClusterInput()
pointssource_9 = ClusterInput()
pointstarget_9 = ClusterInput()
divisions_9 = ClusterInput()
U_9 = ClusterInput()
V_9 = ClusterInput()
pointssource_10 = ClusterInput()
pointstarget_10 = ClusterInput()
divisions_10 = ClusterInput()
U_10 = ClusterInput()
V_10 = ClusterInput()
pointssource_11 = ClusterInput()
pointstarget_11 = ClusterInput()
divisions_11 = ClusterInput()
U_11 = ClusterInput()
V_11 = ClusterInput()
pointssource_12 = ClusterInput()
pointstarget_12 = ClusterInput()
divisions_12 = ClusterInput()
U_12 = ClusterInput()
V_12 = ClusterInput()
pointssource_13 = ClusterInput()
pointstarget_13 = ClusterInput()
divisions_13 = ClusterInput()
U_13 = ClusterInput()
V_13 = ClusterInput()
B = CSharpScript(
    PointsSource=pointssource,
    PointsTarget=pointstarget,
    Divisions=divisions,
    U=U,
    V=V,
    TooltipDescriptionOverride="Divisions longitudinally")  # -> Mesh, Srf, SourceSrf, TargetSrf, Orientation; inputs PointsSource: list of Point3d, PointsTarget: list of Point3d, Divisions: Int32, U: Int32, V: Int32
# ---------- B: C# ----------
    List<double> length = new List<double>();
    List <Curve> edgecrv = new List<Curve>();
    DataTree<Curve> edgecrvtree = new DataTree<Curve>();
    DataTree <Point3d> vrttree = new DataTree<Point3d>();
    DataTree <Point3d> vrtsectiontree = new DataTree<Point3d>();
    List <NurbsSurface> s = new List<NurbsSurface>();
    DataTree <System.Object> meshtree = new DataTree<System.Object>();


    //Default values if not specified, added 27.04
    if(Divisions == 0){Divisions = 1;};
    if(U == 0){U = 1;};
    if(V == 0){V = 1;};

    //Make edgecurves, get their length and make new corner points
    for ( int i = 0; i < 4; i++)
    {
      edgecrv.Add(new Line(PointsSource[i], PointsTarget[i]).ToNurbsCurve()); //Add for only one item
      length.Add(edgecrv[i].GetLength());
      edgecrvtree.Add(new Line(PointsSource[i], PointsTarget[i]).ToNurbsCurve(), new GH_Path(i));
      vrttree.AddRange(edgecrvtree.Branch(i)[0].DivideEquidistant(length[i] / Divisions), new GH_Path(i));

      int listitem = 0;
      for (int j = 0; j < (Divisions + 1); j++)
      {
        vrtsectiontree.Add(vrttree.Branch(i)[listitem], new GH_Path(j));
        listitem++;
      }
    }
    //make surfaces
    //get beginning and end surface if needed for tie/boundary conditions or etc.
    Brep ss = Brep.CreateFromCornerPoints(PointsSource[0], PointsSource[1], PointsSource[2], PointsSource[3], 0);
    Brep ts = Brep.CreateFromCornerPoints(PointsTarget[0], PointsTarget[1], PointsTarget[2], PointsTarget[3], 0);

    //get cross-sectional surfaces
    for (int j = 0; j < (Divisions + 1); j++)
    {
      s.Add(NurbsSurface.CreateFromCorners(vrtsectiontree.Branch(j)[0], vrtsectiontree.Branch(j)[1], vrtsectiontree.Branch(j)[2], vrtsectiontree.Branch(j)[3], 0));
    } // (branch number) [list number]


    DataTree<Brep> btree = new DataTree<Brep>();
    DataTree <Curve> loftcrv = new DataTree<Curve>(); //loft to get solid
    DataTree <Point3d> nodetree = new DataTree<Point3d>();


    for (int a = 0; a < (Divisions + 1); a++)
    {
      for (int i = 0; i < (V + 1); i++)
      {
        for (int j = 0; j < (U + 1); j++)
        {
          Point3d p = new Point3d(s[a].PointAt(s[a].Domain(0).Length / V * i, s[a].Domain(1).Length / U * j)); // v-value first, then u value, because domain(0) is v
          meshtree.Add(p, new GH_Path(0, 0)); //added 1704
          //meshtree.Add(p, new GH_Path(1, a)); //added1704 to get nodetree2 in same list
          nodetree.Add(p, new GH_Path(a, i));
        }
      }
    }

    for (int a = 0; a < (Divisions + 1); a++)
    {
      for (int i = 0; i < V; i++)
      {
        for (int j = 0; j < U; j++)
        {
          Brep b = Brep.CreateFromCornerPoints(nodetree.Branch(a, i)[j], nodetree.Branch(a, i + 1)[j], nodetree.Branch(a, i + 1)[j + 1], nodetree.Branch(a, i)[j + 1], 0);
          btree.Add(b, new GH_Path(a, i));
          //meshtree.Add(b, new GH_Path(2, a));
          meshtree.Add(b, new GH_Path(1, 0));
          loftcrv.AddRange(btree.Branch(a, i)[j].DuplicateEdgeCurves(), new GH_Path(a));
        }
      }
    }


    List <Brep> srf = new List<Brep>();
    for ( int i = 0; i < loftcrv.Branch(0).Count; i++)
    {
      for (int j = 0; j < Divisions; j++)
      {
        srf.AddRange(Brep.CreateFromLoft(new List<Curve>{loftcrv.Branch(0 + j)[i], loftcrv.Branch(1 + j)[i]}, Point3d.Unset, Point3d.Unset, LoftType.Normal, false));
      }
    } // Surfaces in the middle are doubled


    //orientation

    Point3d p1 = new Point3d((PointsSource[0].X + PointsSource[1].X + PointsSource[2].X + PointsSource[3].X) / 4, (PointsSource[0].Y + PointsSource[1].Y + PointsSource[2].Y + PointsSource[3].Y) / 4, (PointsSource[0].Z + PointsSource[1].Z + PointsSource[2].Z + PointsSource[3].Z) / 4);
    Point3d p2 = new Point3d((PointsTarget[0].X + PointsTarget[1].X + PointsTarget[2].X + PointsTarget[3].X) / 4, (PointsTarget[0].Y + PointsTarget[1].Y + PointsTarget[2].Y + PointsTarget[3].Y) / 4, (PointsTarget[0].Z + PointsTarget[1].Z + PointsTarget[2].Z + PointsTarget[3].Z) / 4);

    List <string> orilist = new List<string>();

    Vector3d vec1 = p2 - p1; //longitudinal direction of timber cross-section central points = Direction 1
    vec1.Unitize();
    Plane nplan = new Plane(p1, vec1); //normal plane
    Vector3d vec2 = nplan.XAxis; // Second axis (unitized)

    double x1 = vec1.X;
    double y1 = vec1.Y;
    double z1 = vec1.Z;

    double x2 = vec2.X;
    double y2 = vec2.Y;
    double z2 = vec2.Z;

    double cx = p1.X;
    double cy = p1.Y;
    double cz = p1.Z;

    //Add orientation (for orthotropic material)
    orilist.Add("Ori-1");
    orilist.Add("*Orientation, name=Ori-1");
    orilist.Add(string.Format("{0}, {1}, {2}, {3}, {4}, {5}, {6}, {7}, {8}", x1, z1, y1, x2, z2, y2, cx, cz, cy)); //changed y z due to abaqus/rhino different axis systems
    orilist.Add("1, 0"); // 1,0. 1 means primary axis (x), 0 means no rotation


    //add divisions, u and v to be used further to end of mesh tree
    GH_Path pth = new GH_Path(2, 0);
    meshtree.Add(Divisions, pth); //number of divisions
    meshtree.Add((U + 1) * (V + 1), pth); // number of nodes per branch
    meshtree.Add(U * V, pth); //number of surfaces per branch


    Srf = srf;
    Mesh = meshtree;
    SourceSrf = ss;
    TargetSrf = ts;
    Orientation = orilist;
# ---------- end B ----------
C = CSharpScript(
    PointsSource=pointssource_2,
    PointsTarget=pointstarget_2,
    Divisions=divisions_2,
    U=U_2,
    V=V_2,
    TooltipDescriptionOverride="Divisions longitudinally")  # -> Mesh, Srf, SourceSrf, TargetSrf, Orientation; inputs PointsSource: list of Point3d, PointsTarget: list of Point3d, Divisions: Int32, U: Int32, V: Int32; same code as B
e1 = CSharpScript(
    PointsSource=pointssource_3,
    PointsTarget=pointstarget_3,
    Divisions=divisions_3,
    U=U_3,
    V=V_3,
    TooltipDescriptionOverride="Divisions longitudinally")  # -> Mesh, Srf, SourceSrf, TargetSrf, Orientation; inputs PointsSource: list of Point3d, PointsTarget: list of Point3d, Divisions: Int32, U: Int32, V: Int32; same code as B
d3 = CSharpScript(
    PointsSource=pointssource_4,
    PointsTarget=pointstarget_4,
    Divisions=divisions_4,
    U=U_4,
    V=V_4,
    TooltipDescriptionOverride="Divisions longitudinally")  # -> Mesh, Srf, SourceSrf, TargetSrf, Orientation; inputs PointsSource: list of Point3d, PointsTarget: list of Point3d, Divisions: Int32, U: Int32, V: Int32; same code as B
d2 = CSharpScript(
    PointsSource=pointssource_5,
    PointsTarget=pointstarget_5,
    Divisions=divisions_5,
    U=U_5,
    V=V_5,
    TooltipDescriptionOverride="Divisions longitudinally")  # -> Mesh, Srf, SourceSrf, TargetSrf, Orientation; inputs PointsSource: list of Point3d, PointsTarget: list of Point3d, Divisions: Int32, U: Int32, V: Int32; same code as B
d4 = CSharpScript(
    PointsSource=pointssource_6,
    PointsTarget=pointstarget_6,
    Divisions=divisions_6,
    U=U_6,
    V=V_6,
    TooltipDescriptionOverride="Divisions longitudinally")  # -> Mesh, Srf, SourceSrf, TargetSrf, Orientation; inputs PointsSource: list of Point3d, PointsTarget: list of Point3d, Divisions: Int32, U: Int32, V: Int32; same code as B
d1 = CSharpScript(
    PointsSource=pointssource_7,
    PointsTarget=pointstarget_7,
    Divisions=divisions_7,
    U=U_7,
    V=V_7,
    TooltipDescriptionOverride="Divisions longitudinally")  # -> Mesh, Srf, SourceSrf, TargetSrf, Orientation; inputs PointsSource: list of Point3d, PointsTarget: list of Point3d, Divisions: Int32, U: Int32, V: Int32; same code as B
d21 = CSharpScript(
    PointsSource=pointssource_8,
    PointsTarget=pointstarget_8,
    Divisions=divisions_8,
    U=U_8,
    V=V_8,
    TooltipDescriptionOverride="Divisions longitudinally")  # -> Mesh, Srf, SourceSrf, TargetSrf, Orientation; inputs PointsSource: list of Point3d, PointsTarget: list of Point3d, Divisions: Int32, U: Int32, V: Int32; same code as B
d31 = CSharpScript(
    PointsSource=pointssource_9,
    PointsTarget=pointstarget_9,
    Divisions=divisions_9,
    U=U_9,
    V=V_9,
    TooltipDescriptionOverride="Divisions longitudinally")  # -> Mesh, Srf, SourceSrf, TargetSrf, Orientation; inputs PointsSource: list of Point3d, PointsTarget: list of Point3d, Divisions: Int32, U: Int32, V: Int32; same code as B
d41 = CSharpScript(
    PointsSource=pointssource_10,
    PointsTarget=pointstarget_10,
    Divisions=divisions_10,
    U=U_10,
    V=V_10,
    TooltipDescriptionOverride="Divisions longitudinally")  # -> Mesh, Srf, SourceSrf, TargetSrf, Orientation; inputs PointsSource: list of Point3d, PointsTarget: list of Point3d, Divisions: Int32, U: Int32, V: Int32; same code as B
e2 = CSharpScript(
    PointsSource=pointssource_11,
    PointsTarget=pointstarget_11,
    Divisions=divisions_11,
    U=U_11,
    V=V_11,
    TooltipDescriptionOverride="Divisions longitudinally")  # -> Mesh, Srf, SourceSrf, TargetSrf, Orientation; inputs PointsSource: list of Point3d, PointsTarget: list of Point3d, Divisions: Int32, U: Int32, V: Int32; same code as B
f31 = CSharpScript(
    PointsSource=pointssource_12,
    PointsTarget=pointstarget_12,
    Divisions=divisions_12,
    U=U_12,
    V=V_12,
    TooltipDescriptionOverride="Divisions longitudinally")  # -> Mesh, Srf, SourceSrf, TargetSrf, Orientation; inputs PointsSource: list of Point3d, PointsTarget: list of Point3d, Divisions: Int32, U: Int32, V: Int32; same code as B
f3 = CSharpScript(
    PointsSource=pointssource_13,
    PointsTarget=pointstarget_13,
    Divisions=divisions_13,
    U=U_13,
    V=V_13,
    TooltipDescriptionOverride="Divisions longitudinally")  # -> Mesh, Srf, SourceSrf, TargetSrf, Orientation; inputs PointsSource: list of Point3d, PointsTarget: list of Point3d, Divisions: Int32, U: Int32, V: Int32; same code as B
mesh = ClusterOutput(B.Mesh)
srf = ClusterOutput(B.Srf)
sourcesrf = ClusterOutput(B.SourceSrf)
targetsrf = ClusterOutput(B.TargetSrf)
mesh_2 = ClusterOutput(C.Mesh)
srf_2 = ClusterOutput(C.Srf)
sourcesrf_2 = ClusterOutput(C.SourceSrf)
targetsrf_2 = ClusterOutput(C.TargetSrf)
mesh_3 = ClusterOutput(e1.Mesh)
srf_3 = ClusterOutput(e1.Srf)
sourcesrf_3 = ClusterOutput(e1.SourceSrf)
targetsrf_3 = ClusterOutput(e1.TargetSrf)
mesh_4 = ClusterOutput(d3.Mesh)
srf_4 = ClusterOutput(d3.Srf)
sourcesrf_4 = ClusterOutput(d3.SourceSrf)
targetsrf_4 = ClusterOutput(d3.TargetSrf)
mesh_5 = ClusterOutput(d2.Mesh)
srf_5 = ClusterOutput(d2.Srf)
sourcesrf_5 = ClusterOutput(d2.SourceSrf)
targetsrf_5 = ClusterOutput(d2.TargetSrf)
mesh_6 = ClusterOutput(d4.Mesh)
srf_6 = ClusterOutput(d4.Srf)
sourcesrf_6 = ClusterOutput(d4.SourceSrf)
targetsrf_6 = ClusterOutput(d4.TargetSrf)
mesh_7 = ClusterOutput(d1.Mesh)
srf_7 = ClusterOutput(d1.Srf)
sourcesrf_7 = ClusterOutput(d1.SourceSrf)
targetsrf_7 = ClusterOutput(d1.TargetSrf)
mesh_8 = ClusterOutput(d21.Mesh)
srf_8 = ClusterOutput(d21.Srf)
sourcesrf_8 = ClusterOutput(d21.SourceSrf)
targetsrf_8 = ClusterOutput(d21.TargetSrf)
mesh_9 = ClusterOutput(d31.Mesh)
srf_9 = ClusterOutput(d31.Srf)
sourcesrf_9 = ClusterOutput(d31.SourceSrf)
targetsrf_9 = ClusterOutput(d31.TargetSrf)
mesh_10 = ClusterOutput(d41.Mesh)
srf_10 = ClusterOutput(d41.Srf)
sourcesrf_10 = ClusterOutput(d41.SourceSrf)
targetsrf_10 = ClusterOutput(d41.TargetSrf)
mesh_11 = ClusterOutput(e2.Mesh)
srf_11 = ClusterOutput(e2.Srf)
sourcesrf_11 = ClusterOutput(e2.SourceSrf)
targetsrf_11 = ClusterOutput(e2.TargetSrf)
mesh_12 = ClusterOutput(f31.Mesh)
srf_12 = ClusterOutput(f31.Srf)
sourcesrf_12 = ClusterOutput(f31.SourceSrf)
targetsrf_12 = ClusterOutput(f31.TargetSrf)
mesh_13 = ClusterOutput(f3.Mesh)
srf_13 = ClusterOutput(f3.Srf)
sourcesrf_13 = ClusterOutput(f3.SourceSrf)
targetsrf_13 = ClusterOutput(f3.TargetSrf)

# ==== cluster TimberPart2
pointssource = ClusterInput()
pointstarget = ClusterInput()
divisions = ClusterInput()
U = ClusterInput()
V = ClusterInput()
pointssource_2 = ClusterInput()
pointstarget_2 = ClusterInput()
divisions_2 = ClusterInput()
U_2 = ClusterInput()
V_2 = ClusterInput()
pointssource_3 = ClusterInput()
pointstarget_3 = ClusterInput()
divisions_3 = ClusterInput()
U_3 = ClusterInput()
V_3 = ClusterInput()
pointssource_4 = ClusterInput()
pointstarget_4 = ClusterInput()
divisions_4 = ClusterInput()
U_4 = ClusterInput()
V_4 = ClusterInput()
pointssource_5 = ClusterInput()
pointstarget_5 = ClusterInput()
divisions_5 = ClusterInput()
U_5 = ClusterInput()
V_5 = ClusterInput()
pointssource_6 = ClusterInput()
pointstarget_6 = ClusterInput()
divisions_6 = ClusterInput()
U_6 = ClusterInput()
V_6 = ClusterInput()
pointssource_7 = ClusterInput()
pointstarget_7 = ClusterInput()
divisions_7 = ClusterInput()
U_7 = ClusterInput()
V_7 = ClusterInput()
pointssource_8 = ClusterInput()
pointstarget_8 = ClusterInput()
divisions_8 = ClusterInput()
U_8 = ClusterInput()
V_8 = ClusterInput()
pointssource_9 = ClusterInput()
pointstarget_9 = ClusterInput()
divisions_9 = ClusterInput()
U_9 = ClusterInput()
V_9 = ClusterInput()
pointssource_10 = ClusterInput()
pointstarget_10 = ClusterInput()
divisions_10 = ClusterInput()
U_10 = ClusterInput()
V_10 = ClusterInput()
pointssource_11 = ClusterInput()
pointstarget_11 = ClusterInput()
divisions_11 = ClusterInput()
U_11 = ClusterInput()
V_11 = ClusterInput()
pointssource_12 = ClusterInput()
pointstarget_12 = ClusterInput()
divisions_12 = ClusterInput()
U_12 = ClusterInput()
V_12 = ClusterInput()
pointssource_13 = ClusterInput()
pointstarget_13 = ClusterInput()
divisions_13 = ClusterInput()
U_13 = ClusterInput()
V_13 = ClusterInput()
pointssource_14 = ClusterInput()
pointstarget_14 = ClusterInput()
divisions_14 = ClusterInput()
U_14 = ClusterInput()
V_14 = ClusterInput()
pointssource_15 = ClusterInput()
pointstarget_15 = ClusterInput()
divisions_15 = ClusterInput()
U_15 = ClusterInput()
V_15 = ClusterInput()
pointssource_16 = ClusterInput()
pointstarget_16 = ClusterInput()
divisions_16 = ClusterInput()
U_16 = ClusterInput()
V_16 = ClusterInput()
td41 = CSharpScript(
    PointsSource=pointssource,
    PointsTarget=pointstarget,
    Divisions=divisions,
    U=U,
    V=V,
    TooltipDescriptionOverride="Divisions longitudinally")  # -> Mesh, Srf, SourceSrf, TargetSrf, Orientation; inputs PointsSource: list of Point3d, PointsTarget: list of Point3d, Divisions: Int32, U: Int32, V: Int32; same code as B
t2d21 = CSharpScript(
    PointsSource=pointssource_2,
    PointsTarget=pointstarget_2,
    Divisions=divisions_2,
    U=U_2,
    V=V_2,
    TooltipDescriptionOverride="Divisions longitudinally")  # -> Mesh, Srf, SourceSrf, TargetSrf, Orientation; inputs PointsSource: list of Point3d, PointsTarget: list of Point3d, Divisions: Int32, U: Int32, V: Int32; same code as B
t2d41 = CSharpScript(
    PointsSource=pointssource_3,
    PointsTarget=pointstarget_3,
    Divisions=divisions_3,
    U=U_3,
    V=V_3,
    TooltipDescriptionOverride="Divisions longitudinally")  # -> Mesh, Srf, SourceSrf, TargetSrf, Orientation; inputs PointsSource: list of Point3d, PointsTarget: list of Point3d, Divisions: Int32, U: Int32, V: Int32; same code as B
t2e2 = CSharpScript(
    PointsSource=pointssource_4,
    PointsTarget=pointstarget_4,
    Divisions=divisions_4,
    U=U_4,
    V=V_4,
    TooltipDescriptionOverride="Divisions longitudinally")  # -> Mesh, Srf, SourceSrf, TargetSrf, Orientation; inputs PointsSource: list of Point3d, PointsTarget: list of Point3d, Divisions: Int32, U: Int32, V: Int32; same code as B
td21 = CSharpScript(
    PointsSource=pointssource_5,
    PointsTarget=pointstarget_5,
    Divisions=divisions_5,
    U=U_5,
    V=V_5,
    TooltipDescriptionOverride="Divisions longitudinally")  # -> Mesh, Srf, SourceSrf, TargetSrf, Orientation; inputs PointsSource: list of Point3d, PointsTarget: list of Point3d, Divisions: Int32, U: Int32, V: Int32; same code as B
t2f31 = CSharpScript(
    PointsSource=pointssource_6,
    PointsTarget=pointstarget_6,
    Divisions=divisions_6,
    U=U_6,
    V=V_6,
    TooltipDescriptionOverride="Divisions longitudinally")  # -> Mesh, Srf, SourceSrf, TargetSrf, Orientation; inputs PointsSource: list of Point3d, PointsTarget: list of Point3d, Divisions: Int32, U: Int32, V: Int32; same code as B
td1 = CSharpScript(
    PointsSource=pointssource_7,
    PointsTarget=pointstarget_7,
    Divisions=divisions_7,
    U=U_7,
    V=V_7,
    TooltipDescriptionOverride="Divisions longitudinally")  # -> Mesh, Srf, SourceSrf, TargetSrf, Orientation; inputs PointsSource: list of Point3d, PointsTarget: list of Point3d, Divisions: Int32, U: Int32, V: Int32; same code as B
t2d4 = CSharpScript(
    PointsSource=pointssource_8,
    PointsTarget=pointstarget_8,
    Divisions=divisions_8,
    U=U_8,
    V=V_8,
    TooltipDescriptionOverride="Divisions longitudinally")  # -> Mesh, Srf, SourceSrf, TargetSrf, Orientation; inputs PointsSource: list of Point3d, PointsTarget: list of Point3d, Divisions: Int32, U: Int32, V: Int32; same code as B
td2 = CSharpScript(
    PointsSource=pointssource_9,
    PointsTarget=pointstarget_9,
    Divisions=divisions_9,
    U=U_9,
    V=V_9,
    TooltipDescriptionOverride="Divisions longitudinally")  # -> Mesh, Srf, SourceSrf, TargetSrf, Orientation; inputs PointsSource: list of Point3d, PointsTarget: list of Point3d, Divisions: Int32, U: Int32, V: Int32; same code as B
te2 = CSharpScript(
    PointsSource=pointssource_10,
    PointsTarget=pointstarget_10,
    Divisions=divisions_10,
    U=U_10,
    V=V_10,
    TooltipDescriptionOverride="Divisions longitudinally")  # -> Mesh, Srf, SourceSrf, TargetSrf, Orientation; inputs PointsSource: list of Point3d, PointsTarget: list of Point3d, Divisions: Int32, U: Int32, V: Int32; same code as B
t2e1 = CSharpScript(
    PointsSource=pointssource_11,
    PointsTarget=pointstarget_11,
    Divisions=divisions_11,
    U=U_11,
    V=V_11,
    TooltipDescriptionOverride="Divisions longitudinally")  # -> Mesh, Srf, SourceSrf, TargetSrf, Orientation; inputs PointsSource: list of Point3d, PointsTarget: list of Point3d, Divisions: Int32, U: Int32, V: Int32; same code as B
t2f3 = CSharpScript(
    PointsSource=pointssource_12,
    PointsTarget=pointstarget_12,
    Divisions=divisions_12,
    U=U_12,
    V=V_12,
    TooltipDescriptionOverride="Divisions longitudinally")  # -> Mesh, Srf, SourceSrf, TargetSrf, Orientation; inputs PointsSource: list of Point3d, PointsTarget: list of Point3d, Divisions: Int32, U: Int32, V: Int32; same code as B
t2d1 = CSharpScript(
    PointsSource=pointssource_13,
    PointsTarget=pointstarget_13,
    Divisions=divisions_13,
    U=U_13,
    V=V_13,
    TooltipDescriptionOverride="Divisions longitudinally")  # -> Mesh, Srf, SourceSrf, TargetSrf, Orientation; inputs PointsSource: list of Point3d, PointsTarget: list of Point3d, Divisions: Int32, U: Int32, V: Int32; same code as B
td4 = CSharpScript(
    PointsSource=pointssource_14,
    PointsTarget=pointstarget_14,
    Divisions=divisions_14,
    U=U_14,
    V=V_14,
    TooltipDescriptionOverride="Divisions longitudinally")  # -> Mesh, Srf, SourceSrf, TargetSrf, Orientation; inputs PointsSource: list of Point3d, PointsTarget: list of Point3d, Divisions: Int32, U: Int32, V: Int32; same code as B
te1 = CSharpScript(
    PointsSource=pointssource_15,
    PointsTarget=pointstarget_15,
    Divisions=divisions_15,
    U=U_15,
    V=V_15,
    TooltipDescriptionOverride="Divisions longitudinally")  # -> Mesh, Srf, SourceSrf, TargetSrf, Orientation; inputs PointsSource: list of Point3d, PointsTarget: list of Point3d, Divisions: Int32, U: Int32, V: Int32; same code as B
t2d2 = CSharpScript(
    PointsSource=pointssource_16,
    PointsTarget=pointstarget_16,
    Divisions=divisions_16,
    U=U_16,
    V=V_16,
    TooltipDescriptionOverride="Divisions longitudinally")  # -> Mesh, Srf, SourceSrf, TargetSrf, Orientation; inputs PointsSource: list of Point3d, PointsTarget: list of Point3d, Divisions: Int32, U: Int32, V: Int32; same code as B
mesh = ClusterOutput(td41.Mesh)
srf = ClusterOutput(td41.Srf)
sourcesrf = ClusterOutput(td41.SourceSrf)
mesh_2 = ClusterOutput(t2d21.Mesh)
srf_2 = ClusterOutput(t2d21.Srf)
mesh_3 = ClusterOutput(t2d41.Mesh)
srf_3 = ClusterOutput(t2d41.Srf)
mesh_4 = ClusterOutput(t2e2.Mesh)
srf_4 = ClusterOutput(t2e2.Srf)
mesh_5 = ClusterOutput(td21.Mesh)
srf_5 = ClusterOutput(td21.Srf)
mesh_6 = ClusterOutput(t2f31.Mesh)
srf_6 = ClusterOutput(t2f31.Srf)
sourcesrf_2 = ClusterOutput(t2f31.SourceSrf)
mesh_7 = ClusterOutput(td1.Mesh)
srf_7 = ClusterOutput(td1.Srf)
orientation = ClusterOutput(td1.Orientation)
mesh_8 = ClusterOutput(t2d4.Mesh)
srf_8 = ClusterOutput(t2d4.Srf)
mesh_9 = ClusterOutput(td2.Mesh)
srf_9 = ClusterOutput(td2.Srf)
mesh_10 = ClusterOutput(te2.Mesh)
srf_10 = ClusterOutput(te2.Srf)
mesh_11 = ClusterOutput(t2e1.Mesh)
srf_11 = ClusterOutput(t2e1.Srf)
mesh_12 = ClusterOutput(t2f3.Mesh)
srf_12 = ClusterOutput(t2f3.Srf)
sourcesrf_3 = ClusterOutput(t2f3.SourceSrf)
mesh_13 = ClusterOutput(t2d1.Mesh)
srf_13 = ClusterOutput(t2d1.Srf)
mesh_14 = ClusterOutput(td4.Mesh)
srf_14 = ClusterOutput(td4.Srf)
sourcesrf_4 = ClusterOutput(td4.SourceSrf)
mesh_15 = ClusterOutput(te1.Mesh)
srf_15 = ClusterOutput(te1.Srf)
mesh_16 = ClusterOutput(t2d2.Mesh)
srf_16 = ClusterOutput(t2d2.Srf)
