# Grasshopper definition E.4_SRConnector.gh (Grasshopper 1.0.7)

# ----
# Hide/Shows Faint Wires
toggle = BooleanToggle(False)
wdt = CSharpScript(showFaintWires=toggle)  # inputs showFaintWires: Boolean
# ---------- wdt: C# usings ----------
using System.IO;
using System.Linq;
using System.Data;
using System.Drawing;
using System.Reflection;
using System.Windows.Forms;
using System.Xml;
using System.Xml.Linq;
using System.Runtime.InteropServices;

using Rhino.DocObjects;
using Rhino.Collections;
using GH_IO;
using GH_IO.Serialization;
# ---------- wdt: C# ----------
    foreach(IGH_ActiveObject ao in GrasshopperDocument.ActiveObjects()){
      if(ao is IGH_Param){
        IGH_Param param = ao as IGH_Param;
        fixWires(param, showFaintWires);
      } else if(ao is IGH_Component){
        IGH_Component comp = ao as IGH_Component;
        foreach(IGH_Param param in comp.Params){
          fixWires(param, showFaintWires);
        }
      }
    }
# ---------- wdt: C# additional code ----------
  void fixWires(IGH_Param param, bool showFaint){
    if(showFaint && param.WireDisplay == GH_ParamWireDisplay.hidden){
      param.WireDisplay = GH_ParamWireDisplay.faint;
    } else if((!showFaint) && param.WireDisplay == GH_ParamWireDisplay.faint){
      param.WireDisplay = GH_ParamWireDisplay.hidden;
    }
  }
# ---------- end wdt ----------

sin = Sine(Value=degrees("60"))
height_cross_section = Slider(350, range=0..1000)
width_timber = Slider(200, range=0..400)
divisions_timberlongitudinal = Slider(4, range=0..20)

divisionswholehexagon = Slider(6, range=1..50, expression="x*6")
divwidth_hex = Slider(3, range=0..10)
divheight_hex = Slider(2, range=0..10)

length_timber = Slider(250, range=0..1000)
middletimberheightdivisions = Slider(4, range=0..10)

wnode = Slider(55, range=0..100)
hnode = Slider(65, range=0..175)

division = Division(A=wnode, B=sin)
Z = UnitZ(Factor=height_cross_section)
panel = Panel("""3
7
11
15""")
number_slider = Slider(6, range=0..100)
division_2 = Division(A=divisionswholehexagon, B=number_slider)
cir = Circle(Plane=PlaneXY(0, 0, 0), Radius=width_timber)
move = Move(Geometry=cir, Motion=Z)  # -> Geometry, Transform
number_slider_2 = Slider(6, range=0..100)
cir_2 = Circle(Plane=PlaneXY(0, 0, 0), Radius=width_timber)
crv = Curve(move.Geometry)
crv_2 = Curve(cir_2)
pframes = PerpFrames(Curve=crv, Count=number_slider_2, Align=True)  # -> Frames, Parameters
pframes_2 = PerpFrames(Curve=crv_2, Count=number_slider, Align=True)  # -> Frames, Parameters
multiplication = Multiplication(A=hnode, B="-1")
panel_2 = Panel("""3
7
11
15""")
division_3 = Division(A=divisionswholehexagon, B=number_slider_2)
rectangle = Rectangle(Plane=pframes_2.Frames, XSize=division, YSize=hnode, Radius=0)  # -> flatten(Rectangle), Length
getvertices = CSharpScript(Breps=rectangle.Rectangle, Closed=Toggle(True))  # -> Vrt; inputs Breps: list of Brep, Closed: Boolean
# ---------- getvertices: C# ----------
    List<Point3d> vertices = new List<Point3d>();

    for (int i = 0; i < Breps.Count; i++)
    {
      List<Point3d> vrev = new List<Point3d>();
      vrev.AddRange(Breps[i].DuplicateVertices());
      vrev.Reverse();
      vertices.AddRange(vrev);
    }
    if (Closed)
    {
      List<Point3d> vend = new List<Point3d>();
      vend.AddRange(Breps[0].DuplicateVertices()); //to make closed shape
      vend.Reverse();
      vertices.AddRange(vend);
    }

    Vrt = vertices;
# ---------- end getvertices ----------
item = ListItem(List=getvertices, Index="1", Wrap=True)
item_2 = ListItem(List=getvertices, Index="5", Wrap=True)
sideinner = Distance(PointA=item, PointB=item_2)
panel_3 = Panel(sideinner)
rectangle_2 = Rectangle(Plane=pframes.Frames, XSize=division, YSize=multiplication, Radius=0)  # -> flatten(Rectangle), Length
getvertices_2 = CSharpScript(Breps=rectangle_2.Rectangle, Closed=Toggle(True))  # -> Vrt; inputs Breps: list of Brep, Closed: Boolean; same code as getvertices
item_3 = ListItem(List=getvertices_2, Index="0", Wrap=True)
item_4 = ListItem(List=getvertices_2, Index="4", Wrap=True)
dist = Distance(PointA=item_3, PointB=item_4)
topalu = CSharpScript(
    Points=getvertices_2,
    Degree=Slider(1, range=1..19),
    Divisions=divisionswholehexagon,
    U=divheight_hex,
    V=divwidth_hex,
    TooltipDescriptionOverride="Divisions longitudinally")  # -> Mesh, Srf, SourceSrf, TargetSrf, Orientation; inputs Points: list of Point3d, Degree: Int32, Divisions: Int32, U: Int32, V: Int32
# ---------- topalu: C# ----------
    List<double> length = new List<double>();
    List <NurbsCurve> edgecrv = new List<NurbsCurve>();
    DataTree<NurbsCurve> edgecrvtree = new DataTree<NurbsCurve>();
    DataTree <Point3d> vrttree = new DataTree<Point3d>();
    DataTree <Point3d> vrtsectiontree = new DataTree<Point3d>();
    List <NurbsSurface> s = new List<NurbsSurface>();
    DataTree <System.Object> meshtree = new DataTree<System.Object>();


    //Default values if not specified, added 27.04
    if(Divisions == 0){Divisions = 1;};
    if(U == 0){U = 1;};
    if(V == 0){V = 1;};
    if(Degree == 0){Degree = 1;}

    // NurbsCurve crv = NurbsCurve.Create(false, Degree, PointsSource[1] PointsMid[1] PointsTarget[1]);
    DataTree<Point3d> clst = new DataTree<Point3d>(); //make ordered list to make curve
    //List <NurbsCurve> nrbs = new List<NurbsCurve>();
    Point3d ps;
    for (int i = 0;i < 4;i++)
    {
      GH_Path pthnr = new GH_Path(i);
      for (int j = i;j < Points.Count();j += 4) //if more midpoints
      {
        ps = Points[j];
        clst.Add(ps, pthnr);
      }
      edgecrv.Add(NurbsCurve.Create(false, Degree, clst.Branch(i)));
      length.Add(edgecrv[i].GetLength());
      //edgecrvtree.Add(NurbsCurve.Create(false, Degree, clst.Branch(i)), new GH_Path(i));
      vrttree.AddRange(edgecrv[i].DivideEquidistant(length[i] / Divisions), new GH_Path(i));
      vrttree.Add(Points[Points.Count() - 4 + i], new GH_Path(i));
      int listitem = 0;

      for (int j = 0; j < (Divisions + 1); j++)
      {
        vrtsectiontree.Add(vrttree.Branch(i)[listitem], new GH_Path(j));
        listitem++;
      }

    }
    //make surfaces
    //get beginning and end surface if needed for tie/boundary conditions or etc.
    int pnum = Points.Count();
    Brep ss = Brep.CreateFromCornerPoints(Points[0], Points[1], Points[2], Points[3], 0);
    Brep ts = Brep.CreateFromCornerPoints(Points[pnum - 4], Points[pnum - 3], Points[pnum - 2], Points[pnum - 1], 0);

    //get cross-sectional surfaces
    for (int j = 0; j < (Divisions + 1); j++)
    {
      s.Add(NurbsSurface.CreateFromCorners(vrtsectiontree.Branch(j)[0], vrtsectiontree.Branch(j)[1], vrtsectiontree.Branch(j)[2], vrtsectiontree.Branch(j)[3], 0));
    } // (branch number) [list number]


    DataTree<Brep> btree = new DataTree<Brep>();
    DataTree <Curve> loftcrv = new DataTree<Curve>(); //loft to get solid
    DataTree <Point3d> nodetree = new DataTree<Point3d>();


    for (int a = 0; a < (Divisions + 1); a++)
    {
      for (int i = 0; i < (V + 1); i++)
      {
        for (int j = 0; j < (U + 1); j++)
        {
          Point3d p = new Point3d(s[a].PointAt(s[a].Domain(0).Length / V * i, s[a].Domain(1).Length / U * j)); // v-value first, then u value, because domain(0) is v
          meshtree.Add(p, new GH_Path(0, 0)); //added 1704
          //meshtree.Add(p, new GH_Path(1, a)); //added1704 to get nodetree2 in same list
          nodetree.Add(p, new GH_Path(a, i));
        }
      }
    }

    for (int a = 0; a < (Divisions + 1); a++)
    {
      for (int i = 0; i < V; i++)
      {
        for (int j = 0; j < U; j++)
        {
          Brep b = Brep.CreateFromCornerPoints(nodetree.Branch(a, i)[j], nodetree.Branch(a, i + 1)[j], nodetree.Branch(a, i + 1)[j + 1], nodetree.Branch(a, i)[j + 1], 0);
          btree.Add(b, new GH_Path(a, i));
          //meshtree.Add(b, new GH_Path(2, a));
          meshtree.Add(b, new GH_Path(1, 0));
          loftcrv.AddRange(btree.Branch(a, i)[j].DuplicateEdgeCurves(), new GH_Path(a));
        }
      }
    }


    DataTree <Brep> srf = new DataTree<Brep>();
    for ( int i = 0; i < loftcrv.Branch(0).Count; i++)
    {
      for (int j = 0; j < Divisions; j++)
      {
        //srf.AddRange(Brep.CreateFromLoft(new List<Curve>{loftcrv.Branch(0 + j)[i], loftcrv.Branch(1 + j)[i]}, Point3d.Unset, Point3d.Unset, LoftType.Normal, false), new GH_Path(i, j));
        srf.AddRange(Brep.CreateFromLoft(new List<Curve>{loftcrv.Branch(0 + j)[i], loftcrv.Branch(1 + j)[i]}, Point3d.Unset, Point3d.Unset, LoftType.Normal, false), new GH_Path(i));
      }
    } // Surfaces in the middle are doubled


    //orientation


    Point3d p1 = new Point3d((Points[0].X + Points[1].X + Points[2].X + Points[3].X) / 4, (Points[0].Y + Points[1].Y + Points[2].Y + Points[3].Y) / 4, (Points[0].Z + Points[1].Z + Points[2].Z + Points[3].Z) / 4);
    Point3d p2 = new Point3d((Points[pnum - 4].X + Points[pnum - 3].X + Points[pnum - 2].X + Points[pnum - 1].X) / 4, (Points[pnum - 4].Y + Points[pnum - 3].Y + Points[pnum - 2].Y + Points[pnum - 3].Y) / 4, (Points[pnum - 4].Z + Points[pnum - 3].Z + Points[pnum - 2].Z + Points[pnum - 1].Z) / 4);

    List <string> orilist = new List<string>();

    Vector3d vec1 = p2 - p1; //longitudinal direction of timber cross-section central points = Direction 1
    vec1.Unitize();
    Plane nplan = new Plane(p1, vec1); //normal plane
    Vector3d vec2 = nplan.XAxis; // Second axis (unitized)

    double x1 = vec1.X;
    double y1 = vec1.Y;
    double z1 = vec1.Z;

    double x2 = vec2.X;
    double y2 = vec2.Y;
    double z2 = vec2.Z;

    double cx = p1.X;
    double cy = p1.Y;
    double cz = p1.Z;

    //Add orientation (for orthotropic material)
    orilist.Add("Ori-1");
    orilist.Add("*Orientation, name=Ori-1");
    orilist.Add(string.Format("{0}, {1}, {2}, {3}, {4}, {5}, {6}, {7}, {8}", x1, z1, y1, x2, z2, y2, cx, cz, cy)); //changed y z due to abaqus/rhino different axis systems
    orilist.Add("1, 0"); // 1,0. 1 means primary axis (x), 0 means no rotation

    //add divisions, u and v to be used further to end of mesh tree
    GH_Path pth = new GH_Path(2, 0);
    meshtree.Add(Divisions, pth); //number of divisions
    meshtree.Add((U + 1) * (V + 1), pth); // number of nodes per branch
    meshtree.Add(U * V, pth); //number of surfaces per branch


    //    Srf = srf;
    Mesh = meshtree;
    Srf = srf;
    SourceSrf = ss;
    TargetSrf = ts;
    Orientation = orilist;
# ---------- end topalu ----------
branch = TreeBranch(Tree=topalu.Srf, Path=panel_2, MaintainPaths=True)  # -> flatten(Branch)
partition = PartitionList(List=branch, Size=division_3)  # -> simplify(Chunks)
c_script = CSharpScript(breps=partition, sides=number_slider_2)  # -> BrepTree, one, two, three, four, five, six; inputs breps: tree of Brep, sides: Int32
# ---------- c_script: C# ----------
    DataTree<Brep> breptree = new DataTree<Brep>();
    for (int i = 0; i < sides; i++)
    {
      GH_Path pth = new GH_Path(i);
      breptree.AddRange(breps.Branch(i), pth);
      breptree.AddRange(breps.Branch(i + 6), pth);
      breptree.AddRange(breps.Branch(i + 12), pth);
      breptree.AddRange(breps.Branch(i + 18), pth);
    }
    BrepTree = breptree;
    one = breptree.Branch(0);
    two = breptree.Branch(1);
    three = breptree.Branch(2);
    four = breptree.Branch(3);
    five = breptree.Branch(4);
    six = breptree.Branch(5);
# ---------- end c_script ----------
join = BrepJoin(Breps=c_script.five)  # -> Breps, Closed
join_2 = BrepJoin(Breps=c_script.six)  # -> Breps, Closed
join_3 = BrepJoin(Breps=c_script.four)  # -> Breps, Closed
join_4 = BrepJoin(Breps=c_script.three)  # -> Breps, Closed
join_5 = BrepJoin(Breps=c_script.two)  # -> Breps, Closed
panel_4 = Panel(dist)
join_6 = BrepJoin(Breps=c_script.one)  # -> Breps, Closed

panel_5 = Panel("""4
7
8
11""")
item_5 = ListItem(List=getvertices, Index=panel_5, Wrap=True)
sortptsxzplane = CSharpScript(Pts=item_5, TooltipDescriptionOverride="Sort 4 points counter clockwise ", TooltipTextOverride="Sort")  # -> SPts; inputs Pts: list of Point3d; same code as sortptsxzplane
ptstosrf = CSharpScript(
    Pts=sortptsxzplane,
    TooltipDescriptionOverride="Points must be sorted correctly",
    TooltipTextOverride="From 4 corner points to surface. Or list of corner points to list of surfaces")  # -> Srf; inputs Pts: list of Point3d
# ---------- ptstosrf: C# ----------
    List<Brep> breps = new List<Brep>();
    for (int i = 0; i < Pts.Count(); i += 4)
    {
      Brep b = Brep.CreateFromCornerPoints(Pts[i], Pts[i + 1], Pts[i + 2], Pts[i + 3], 0);
      breps.Add(b);
    }
    Srf = breps;
# ---------- end ptstosrf ----------

panel_6 = Panel("""4
7
8
11""")
item_6 = ListItem(List=getvertices_2, Index=panel_6, Wrap=True)
sortptsxzplane_2 = CSharpScript(Pts=item_6, TooltipDescriptionOverride="Sort 4 points counter clockwise ", TooltipTextOverride="Sort")  # -> SPts; inputs Pts: list of Point3d; same code as sortptsxzplane
ptstosrf_2 = CSharpScript(
    Pts=sortptsxzplane_2,
    TooltipDescriptionOverride="Points must be sorted correctly",
    TooltipTextOverride="From 4 corner points to surface. Or list of corner points to list of surfaces")  # -> Srf; inputs Pts: list of Point3d; same code as ptstosrf

meshpointsnurbs0705riktig = CSharpScript(
    Points=getvertices,
    Degree=Slider(1, range=1..19),
    Divisions=divisionswholehexagon,
    U=divheight_hex,
    V=divwidth_hex,
    TooltipDescriptionOverride="Divisions longitudinally")  # -> Mesh, Srf, SourceSrf, TargetSrf, Orientation; inputs Points: list of Point3d, Degree: Int32, Divisions: Int32, U: Int32, V: Int32; same code as topalu
branch_2 = TreeBranch(Tree=meshpointsnurbs0705riktig.Srf, Path=panel, MaintainPaths=True)  # -> flatten(Branch)
partition_2 = PartitionList(List=branch_2, Size=division_2)  # -> simplify(Chunks)
c_script_2 = CSharpScript(breps=partition_2, sides=number_slider)  # -> BrepTree, one, two, three, four, five, six; inputs breps: tree of Brep, sides: Int32; same code as c_script
join_7 = BrepJoin(Breps=c_script_2.five)  # -> Breps, Closed
join_8 = BrepJoin(Breps=c_script_2.six)  # -> Breps, Closed
join_9 = BrepJoin(Breps=c_script_2.four)  # -> Breps, Closed
join_10 = BrepJoin(Breps=c_script_2.three)  # -> Breps, Closed
join_11 = BrepJoin(Breps=c_script_2.two)  # -> Breps, Closed
join_12 = BrepJoin(Breps=c_script_2.one)  # -> Breps, Closed
cluster = Cluster(S=ptstosrf, F=length_timber, F_3=length_timber, S_2=ptstosrf_2, F_2=length_timber)  # -> spts, G, spts_3, G_2, spts_2, G_3
cluster_2 = Cluster_2(
    G=cluster.spts,
    A="60",
    G_3=cluster.G,
    A_3="60",
    G_2=cluster.spts_3,
    A_2="60",
    G_4=cluster.G_2,
    A_4="60",
    G_5=cluster.spts_2,
    A_5="60",
    G_6=cluster.G_3,
    A_6="60")  # -> G_7, G_9, G_8, G_10, G_11, G_12
isotropicalumaterial = CSharpScript(
    TooltipDescriptionOverride="Default material: Aluminium, E=70000, PR=0.3",
    TooltipTextOverride="Isotropic Material. Alu default")  # -> Properties; inputs Material: String, E: Int32, PR: Double
# ---------- isotropicalumaterial: C# ----------
    //Create Lists
    List< System.Object > B = new List<System.Object>();
    ///////////////////////////////////////////////////////////////////////////////////////
    ///////////////////////////////////////////////////////////////////////////////////////
    if (string.IsNullOrEmpty(Material)){Material = "Aluminium";}
    B.Add(Material);
    B.Add("Elastic");
    if(E == 0){E = 70000;}
    if(PR == 0){PR = 0.3;}
    B.Add(string.Format("{0}, {1}", E, PR));
    B.Add("**");

    Properties = B;
# ---------- end isotropicalumaterial ----------
cluster_3 = Cluster_2(
    G=cluster.spts,
    A="120",
    G_3=cluster.G,
    A_3="120",
    G_2=cluster.spts_3,
    A_2="120",
    G_4=cluster.G_2,
    A_4="120",
    G_5=cluster.spts_2,
    A_5="120",
    G_6=cluster.G_3,
    A_6="120")  # -> G_7, G_9, G_8, G_10, G_11, G_12
cluster_4 = Cluster_2(
    G=cluster.spts,
    A="180",
    G_3=cluster.G,
    A_3="180",
    G_2=cluster.spts_3,
    A_2="180",
    G_4=cluster.G_2,
    A_4="180",
    G_5=cluster.spts_2,
    A_5="180",
    G_6=cluster.G_3,
    A_6="180")  # -> G_7, G_9, G_8, G_10, G_11, G_12
aluminium = Panel("AluPart")
cluster_5 = Cluster_2(
    G=cluster.spts,
    A="240",
    G_3=cluster.G,
    A_3="240",
    G_2=cluster.spts_3,
    A_2="240",
    G_4=cluster.G_2,
    A_4="240",
    G_5=cluster.spts_2,
    A_5="240",
    G_6=cluster.G_3,
    A_6="240")  # -> G_7, G_9, G_8, G_10, G_11, G_12
t1bottom = CSharpScript(
    PointsSource=cluster.spts,
    PointsTarget=cluster.G,
    Divisions=divisions_timberlongitudinal,
    U=division_2,
    V=divheight_hex,
    TooltipDescriptionOverride="Divisions longitudinally")  # -> Mesh, Srf, SourceSrf, TargetSrf, Orientation; inputs PointsSource: list of Point3d, PointsTarget: list of Point3d, Divisions: Int32, U: Int32, V: Int32
# ---------- t1bottom: C# ----------
    List<double> length = new List<double>();
    List <Curve> edgecrv = new List<Curve>();
    DataTree<Curve> edgecrvtree = new DataTree<Curve>();
    DataTree <Point3d> vrttree = new DataTree<Point3d>();
    DataTree <Point3d> vrtsectiontree = new DataTree<Point3d>();
    List <NurbsSurface> s = new List<NurbsSurface>();
    DataTree <System.Object> meshtree = new DataTree<System.Object>();


    //Default values if not specified, added 27.04
    if(Divisions == 0){Divisions = 1;};
    if(U == 0){U = 1;};
    if(V == 0){V = 1;};

    //Make edgecurves, get their length and make new corner points
    for ( int i = 0; i < 4; i++)
    {
      edgecrv.Add(new Line(PointsSource[i], PointsTarget[i]).ToNurbsCurve()); //Add for only one item
      length.Add(edgecrv[i].GetLength());
      edgecrvtree.Add(new Line(PointsSource[i], PointsTarget[i]).ToNurbsCurve(), new GH_Path(i));
      vrttree.AddRange(edgecrvtree.Branch(i)[0].DivideEquidistant(length[i] / Divisions), new GH_Path(i));

      int listitem = 0;
      for (int j = 0; j < (Divisions + 1); j++)
      {
        vrtsectiontree.Add(vrttree.Branch(i)[listitem], new GH_Path(j));
        listitem++;
      }
    }
    //make surfaces
    //get beginning and end surface if needed for tie/boundary conditions or etc.
    Brep ss = Brep.CreateFromCornerPoints(PointsSource[0], PointsSource[1], PointsSource[2], PointsSource[3], 0);
    Brep ts = Brep.CreateFromCornerPoints(PointsTarget[0], PointsTarget[1], PointsTarget[2], PointsTarget[3], 0);

    //get cross-sectional surfaces
    for (int j = 0; j < (Divisions + 1); j++)
    {
      s.Add(NurbsSurface.CreateFromCorners(vrtsectiontree.Branch(j)[0], vrtsectiontree.Branch(j)[1], vrtsectiontree.Branch(j)[2], vrtsectiontree.Branch(j)[3], 0));
    } // (branch number) [list number]


    DataTree<Brep> btree = new DataTree<Brep>();
    DataTree <Curve> loftcrv = new DataTree<Curve>(); //loft to get solid
    DataTree <Point3d> nodetree = new DataTree<Point3d>();


    for (int a = 0; a < (Divisions + 1); a++)
    {
      for (int i = 0; i < (V + 1); i++)
      {
        for (int j = 0; j < (U + 1); j++)
        {
          Point3d p = new Point3d(s[a].PointAt(s[a].Domain(0).Length / V * i, s[a].Domain(1).Length / U * j)); // v-value first, then u value, because domain(0) is v
          meshtree.Add(p, new GH_Path(0, 0)); //added 1704
          //meshtree.Add(p, new GH_Path(1, a)); //added1704 to get nodetree2 in same list
          nodetree.Add(p, new GH_Path(a, i));
        }
      }
    }

    for (int a = 0; a < (Divisions + 1); a++)
    {
      for (int i = 0; i < V; i++)
      {
        for (int j = 0; j < U; j++)
        {
          Brep b = Brep.CreateFromCornerPoints(nodetree.Branch(a, i)[j], nodetree.Branch(a, i + 1)[j], nodetree.Branch(a, i + 1)[j + 1], nodetree.Branch(a, i)[j + 1], 0);
          btree.Add(b, new GH_Path(a, i));
          //meshtree.Add(b, new GH_Path(2, a));
          meshtree.Add(b, new GH_Path(1, 0));
          loftcrv.AddRange(btree.Branch(a, i)[j].DuplicateEdgeCurves(), new GH_Path(a));
        }
      }
    }


    DataTree <Brep> srf = new DataTree<Brep>();
    for ( int i = 0; i < loftcrv.Branch(0).Count; i++)
    {
      for (int j = 0; j < Divisions; j++)
      {
        srf.AddRange(Brep.CreateFromLoft(new List<Curve>{loftcrv.Branch(0 + j)[i], loftcrv.Branch(1 + j)[i]}, Point3d.Unset, Point3d.Unset, LoftType.Normal, false), new GH_Path(i));
      }
    } // Surfaces in the middle are doubled


    //orientation

    Point3d p1 = new Point3d((PointsSource[0].X + PointsSource[1].X + PointsSource[2].X + PointsSource[3].X) / 4, (PointsSource[0].Y + PointsSource[1].Y + PointsSource[2].Y + PointsSource[3].Y) / 4, (PointsSource[0].Z + PointsSource[1].Z + PointsSource[2].Z + PointsSource[3].Z) / 4);
    Point3d p2 = new Point3d((PointsTarget[0].X + PointsTarget[1].X + PointsTarget[2].X + PointsTarget[3].X) / 4, (PointsTarget[0].Y + PointsTarget[1].Y + PointsTarget[2].Y + PointsTarget[3].Y) / 4, (PointsTarget[0].Z + PointsTarget[1].Z + PointsTarget[2].Z + PointsTarget[3].Z) / 4);

    List <string> orilist = new List<string>();

    Vector3d vec1 = p2 - p1; //longitudinal direction of timber cross-section central points = Direction 1
    vec1.Unitize();
    Plane nplan = new Plane(p1, vec1); //normal plane
    Vector3d vec2 = nplan.XAxis; // Second axis (unitized)

    double cx = p1.X;
    double cy = p1.Y;
    double cz = p1.Z;

    double x1 = vec1.X + cx;
    double y1 = vec1.Y + cy;
    double z1 = vec1.Z + cz;

    double x2 = vec2.X + cx;
    double y2 = vec2.Y + cy;
    double z2 = vec2.Z + cz;

    //Add orientation (for orthotropic material)
    orilist.Add("Ori-1");
    orilist.Add("*Orientation, name=Ori-1");
    orilist.Add(string.Format("{0}, {1}, {2}, {3}, {4}, {5}, {6}, {7}, {8}", x1, z1, y1, x2, z2, y2, cx, cz, cy)); //changed y z due to abaqus/rhino different axis systems
    orilist.Add("1, 0"); // 1,0. 1 means primary axis (x), 0 means no rotation


    //add divisions, u and v to be used further to end of mesh tree
    GH_Path pth = new GH_Path(2, 0);
    meshtree.Add(Divisions, pth); //number of divisions
    meshtree.Add((U + 1) * (V + 1), pth); // number of nodes per branch
    meshtree.Add(U * V, pth); //number of surfaces per branch


    Srf = srf;
    Mesh = meshtree;
    SourceSrf = ss;
    TargetSrf = ts;
    Orientation = orilist;
# ---------- end t1bottom ----------
cluster_6 = Cluster_2(
    G=cluster.spts,
    A="300",
    G_3=cluster.G,
    A_3="300",
    G_2=cluster.spts_3,
    A_2="300",
    G_4=cluster.G_2,
    A_4="300",
    G_5=cluster.spts_2,
    A_5="300",
    G_6=cluster.G_3,
    A_6="300")  # -> G_7, G_9, G_8, G_10, G_11, G_12
t1middle = CSharpScript(
    PointsSource=cluster.spts_3,
    PointsTarget=cluster.G_2,
    Divisions=divisions_timberlongitudinal,
    U=division_2,
    V=middletimberheightdivisions,
    TooltipDescriptionOverride="Divisions longitudinally")  # -> Mesh, Srf, SourceSrf, TargetSrf, Orientation; inputs PointsSource: list of Point3d, PointsTarget: list of Point3d, Divisions: Int32, U: Int32, V: Int32
# ---------- t1middle: C# ----------
    List<double> length = new List<double>();
    List <Curve> edgecrv = new List<Curve>();
    DataTree<Curve> edgecrvtree = new DataTree<Curve>();
    DataTree <Point3d> vrttree = new DataTree<Point3d>();
    DataTree <Point3d> vrtsectiontree = new DataTree<Point3d>();
    List <NurbsSurface> s = new List<NurbsSurface>();
    DataTree <System.Object> meshtree = new DataTree<System.Object>();


    //Default values if not specified, added 27.04
    if(Divisions == 0){Divisions = 1;};
    if(U == 0){U = 1;};
    if(V == 0){V = 1;};

    //Make edgecurves, get their length and make new corner points
    for ( int i = 0; i < 4; i++)
    {
      edgecrv.Add(new Line(PointsSource[i], PointsTarget[i]).ToNurbsCurve()); //Add for only one item
      length.Add(edgecrv[i].GetLength());
      edgecrvtree.Add(new Line(PointsSource[i], PointsTarget[i]).ToNurbsCurve(), new GH_Path(i));
      vrttree.AddRange(edgecrvtree.Branch(i)[0].DivideEquidistant(length[i] / Divisions), new GH_Path(i));

      int listitem = 0;
      for (int j = 0; j < (Divisions + 1); j++)
      {
        vrtsectiontree.Add(vrttree.Branch(i)[listitem], new GH_Path(j));
        listitem++;
      }
    }
    //make surfaces
    //get beginning and end surface if needed for tie/boundary conditions or etc.
    Brep ss = Brep.CreateFromCornerPoints(PointsSource[0], PointsSource[1], PointsSource[2], PointsSource[3], 0);
    Brep ts = Brep.CreateFromCornerPoints(PointsTarget[0], PointsTarget[1], PointsTarget[2], PointsTarget[3], 0);

    //get cross-sectional surfaces
    for (int j = 0; j < (Divisions + 1); j++)
    {
      s.Add(NurbsSurface.CreateFromCorners(vrtsectiontree.Branch(j)[0], vrtsectiontree.Branch(j)[1], vrtsectiontree.Branch(j)[2], vrtsectiontree.Branch(j)[3], 0));
    } // (branch number) [list number]


    DataTree<Brep> btree = new DataTree<Brep>();
    DataTree <Curve> loftcrv = new DataTree<Curve>(); //loft to get solid
    DataTree <Point3d> nodetree = new DataTree<Point3d>();


    for (int a = 0; a < (Divisions + 1); a++)
    {
      for (int i = 0; i < (V + 1); i++)
      {
        for (int j = 0; j < (U + 1); j++)
        {
          Point3d p = new Point3d(s[a].PointAt(s[a].Domain(0).Length / V * i, s[a].Domain(1).Length / U * j)); // v-value first, then u value, because domain(0) is v
          meshtree.Add(p, new GH_Path(0, 0)); //added 1704
          //meshtree.Add(p, new GH_Path(1, a)); //added1704 to get nodetree2 in same list
          nodetree.Add(p, new GH_Path(a, i));
        }
      }
    }

    for (int a = 0; a < (Divisions + 1); a++)
    {
      for (int i = 0; i < V; i++)
      {
        for (int j = 0; j < U; j++)
        {
          Brep b = Brep.CreateFromCornerPoints(nodetree.Branch(a, i)[j], nodetree.Branch(a, i + 1)[j], nodetree.Branch(a, i + 1)[j + 1], nodetree.Branch(a, i)[j + 1], 0);
          btree.Add(b, new GH_Path(a, i));
          //meshtree.Add(b, new GH_Path(2, a));
          meshtree.Add(b, new GH_Path(1, 0));
          loftcrv.AddRange(btree.Branch(a, i)[j].DuplicateEdgeCurves(), new GH_Path(a));
        }
      }
    }


    DataTree <Brep> srf = new DataTree<Brep>();
    for ( int i = 0; i < loftcrv.Branch(0).Count; i++)
    {
      for (int j = 0; j < Divisions; j++)
      {
        srf.AddRange(Brep.CreateFromLoft(new List<Curve>{loftcrv.Branch(0 + j)[i], loftcrv.Branch(1 + j)[i]}, Point3d.Unset, Point3d.Unset, LoftType.Normal, false), new GH_Path(i));
      }
    } // Surfaces in the middle are doubled


    //orientation

    Point3d p1 = new Point3d((PointsSource[0].X + PointsSource[1].X + PointsSource[2].X + PointsSource[3].X) / 4, (PointsSource[0].Y + PointsSource[1].Y + PointsSource[2].Y + PointsSource[3].Y) / 4, (PointsSource[0].Z + PointsSource[1].Z + PointsSource[2].Z + PointsSource[3].Z) / 4);
    Point3d p2 = new Point3d((PointsTarget[0].X + PointsTarget[1].X + PointsTarget[2].X + PointsTarget[3].X) / 4, (PointsTarget[0].Y + PointsTarget[1].Y + PointsTarget[2].Y + PointsTarget[3].Y) / 4, (PointsTarget[0].Z + PointsTarget[1].Z + PointsTarget[2].Z + PointsTarget[3].Z) / 4);

    List <string> orilist = new List<string>();

    Vector3d vec1 = p2 - p1; //longitudinal direction of timber cross-section central points = Direction 1
    vec1.Unitize();
    Plane nplan = new Plane(p1, vec1); //normal plane
    Vector3d vec2 = nplan.XAxis; // Second axis (unitized)

    double cx = p1.X;
    double cy = p1.Y;
    double cz = p1.Z;

    double x1 = vec1.X + cx;
    double y1 = vec1.Y + cy;
    double z1 = vec1.Z + cz;

    double x2 = vec2.X + cx;
    double y2 = vec2.Y + cy;
    double z2 = vec2.Z + cz;



    //Add orientation (for orthotropic material)
    orilist.Add("Ori-1");
    orilist.Add("*Orientation, name=Ori-1");
    orilist.Add(string.Format("{0}, {1}, {2}, {3}, {4}, {5}, {6}, {7}, {8}", x1, z1, y1, x2, z2, y2, cx, cz, cy)); //changed y z due to abaqus/rhino different axis systems
    orilist.Add("1, 0"); // 1,0. 1 means primary axis (x), 0 means no rotation


    //add divisions, u and v to be used further to end of mesh tree
    GH_Path pth = new GH_Path(2, 0);
    meshtree.Add(Divisions, pth); //number of divisions
    meshtree.Add((U + 1) * (V + 1), pth); // number of nodes per branch
    meshtree.Add(U * V, pth); //number of surfaces per branch


    Srf = srf;
    Mesh = meshtree;
    SourceSrf = ss;
    TargetSrf = ts;
    Orientation = orilist;
# ---------- end t1middle ----------
t1bottom_2 = CSharpScript(
    PointsSource=cluster.spts_2,
    PointsTarget=cluster.G_3,
    Divisions=divisions_timberlongitudinal,
    U=division_2,
    V=divheight_hex,
    TooltipDescriptionOverride="Divisions longitudinally")  # -> Mesh, Srf, SourceSrf, TargetSrf, Orientation; inputs PointsSource: list of Point3d, PointsTarget: list of Point3d, Divisions: Int32, U: Int32, V: Int32
# ---------- t1bottom_2: C# ----------
    List<double> length = new List<double>();
    List <Curve> edgecrv = new List<Curve>();
    DataTree<Curve> edgecrvtree = new DataTree<Curve>();
    DataTree <Point3d> vrttree = new DataTree<Point3d>();
    DataTree <Point3d> vrtsectiontree = new DataTree<Point3d>();
    List <NurbsSurface> s = new List<NurbsSurface>();
    DataTree <System.Object> meshtree = new DataTree<System.Object>();


    //Default values if not specified, added 27.04
    if(Divisions == 0){Divisions = 1;};
    if(U == 0){U = 1;};
    if(V == 0){V = 1;};

    //Make edgecurves, get their length and make new corner points
    for ( int i = 0; i < 4; i++)
    {
      edgecrv.Add(new Line(PointsSource[i], PointsTarget[i]).ToNurbsCurve()); //Add for only one item
      length.Add(edgecrv[i].GetLength());
      edgecrvtree.Add(new Line(PointsSource[i], PointsTarget[i]).ToNurbsCurve(), new GH_Path(i));
      vrttree.AddRange(edgecrvtree.Branch(i)[0].DivideEquidistant(length[i] / Divisions), new GH_Path(i));

      int listitem = 0;
      for (int j = 0; j < (Divisions + 1); j++)
      {
        vrtsectiontree.Add(vrttree.Branch(i)[listitem], new GH_Path(j));
        listitem++;
      }
    }
    //make surfaces
    //get beginning and end surface if needed for tie/boundary conditions or etc.
    Brep ss = Brep.CreateFromCornerPoints(PointsSource[0], PointsSource[1], PointsSource[2], PointsSource[3], 0);
    Brep ts = Brep.CreateFromCornerPoints(PointsTarget[0], PointsTarget[1], PointsTarget[2], PointsTarget[3], 0);

    //get cross-sectional surfaces
    for (int j = 0; j < (Divisions + 1); j++)
    {
      s.Add(NurbsSurface.CreateFromCorners(vrtsectiontree.Branch(j)[0], vrtsectiontree.Branch(j)[1], vrtsectiontree.Branch(j)[2], vrtsectiontree.Branch(j)[3], 0));
    } // (branch number) [list number]


    DataTree<Brep> btree = new DataTree<Brep>();
    DataTree <Curve> loftcrv = new DataTree<Curve>(); //loft to get solid
    DataTree <Point3d> nodetree = new DataTree<Point3d>();


    for (int a = 0; a < (Divisions + 1); a++)
    {
      for (int i = 0; i < (V + 1); i++)
      {
        for (int j = 0; j < (U + 1); j++)
        {
          Point3d p = new Point3d(s[a].PointAt(s[a].Domain(0).Length / V * i, s[a].Domain(1).Length / U * j)); // v-value first, then u value, because domain(0) is v
          meshtree.Add(p, new GH_Path(0, 0)); //added 1704
          //meshtree.Add(p, new GH_Path(1, a)); //added1704 to get nodetree2 in same list
          nodetree.Add(p, new GH_Path(a, i));
        }
      }
    }

    for (int a = 0; a < (Divisions + 1); a++)
    {
      for (int i = 0; i < V; i++)
      {
        for (int j = 0; j < U; j++)
        {
          Brep b = Brep.CreateFromCornerPoints(nodetree.Branch(a, i)[j], nodetree.Branch(a, i + 1)[j], nodetree.Branch(a, i + 1)[j + 1], nodetree.Branch(a, i)[j + 1], 0);
          btree.Add(b, new GH_Path(a, i));
          //meshtree.Add(b, new GH_Path(2, a));
          meshtree.Add(b, new GH_Path(1, 0));
          loftcrv.AddRange(btree.Branch(a, i)[j].DuplicateEdgeCurves(), new GH_Path(a));
        }
      }
    }


    DataTree <Brep> srf = new DataTree<Brep>();
    for ( int i = 0; i < loftcrv.Branch(0).Count; i++)
    {
      for (int j = 0; j < Divisions; j++)
      {
        srf.AddRange(Brep.CreateFromLoft(new List<Curve>{loftcrv.Branch(0 + j)[i], loftcrv.Branch(1 + j)[i]}, Point3d.Unset, Point3d.Unset, LoftType.Normal, false), new GH_Path(i));
      }
    } // Surfaces in the middle are doubled


    //orientation

    Point3d p1 = new Point3d((PointsSource[0].X + PointsSource[1].X + PointsSource[2].X + PointsSource[3].X) / 4, (PointsSource[0].Y + PointsSource[1].Y + PointsSource[2].Y + PointsSource[3].Y) / 4, (PointsSource[0].Z + PointsSource[1].Z + PointsSource[2].Z + PointsSource[3].Z) / 4);
    Point3d p2 = new Point3d((PointsTarget[0].X + PointsTarget[1].X + PointsTarget[2].X + PointsTarget[3].X) / 4, (PointsTarget[0].Y + PointsTarget[1].Y + PointsTarget[2].Y + PointsTarget[3].Y) / 4, (PointsTarget[0].Z + PointsTarget[1].Z + PointsTarget[2].Z + PointsTarget[3].Z) / 4);

    List <string> orilist = new List<string>();

    Vector3d vec1 = p2 - p1; //longitudinal direction of timber cross-section central points = Direction 1
    vec1.Unitize();
    Plane nplan = new Plane(p1, vec1); //normal plane
    Vector3d vec2 = nplan.XAxis; // Second axis (unitized)

    double cx = p1.X;
    double cy = p1.Y;
    double cz = p1.Z;

    double x1 = vec1.X + cx;
    double y1 = vec1.Y + cy;
    double z1 = vec1.Z + cz;

    double x2 = vec2.X + cx;
    double y2 = vec2.Y + cy;
    double z2 = vec2.Z + cz;


    //Add orientation (for orthotropic material)
    orilist.Add("Ori-1");
    orilist.Add("*Orientation, name=Ori-1");
    orilist.Add(string.Format("{0}, {1}, {2}, {3}, {4}, {5}, {6}, {7}, {8}", x1, z1, y1, x2, z2, y2, cx, cz, cy)); //changed y z due to abaqus/rhino different axis systems
    orilist.Add("1, 0"); // 1,0. 1 means primary axis (x), 0 means no rotation


    //add divisions, u and v to be used further to end of mesh tree
    GH_Path pth = new GH_Path(2, 0);
    meshtree.Add(Divisions, pth); //number of divisions
    meshtree.Add((U + 1) * (V + 1), pth); // number of nodes per branch
    meshtree.Add(U * V, pth); //number of surfaces per branch


    Srf = srf;
    Mesh = meshtree;
    SourceSrf = ss;
    TargetSrf = ts;
    Orientation = orilist;
# ---------- end t1bottom_2 ----------
t2bottom = CSharpScript(
    PointsSource=cluster_2.G_7,
    PointsTarget=cluster_2.G_9,
    Divisions=divisions_timberlongitudinal,
    U=division_2,
    V=divheight_hex,
    TooltipDescriptionOverride="Divisions longitudinally")  # -> Mesh, Srf, SourceSrf, TargetSrf, Orientation; inputs PointsSource: list of Point3d, PointsTarget: list of Point3d, Divisions: Int32, U: Int32, V: Int32; same code as t1bottom
t2middle = CSharpScript(
    PointsSource=cluster_2.G_8,
    PointsTarget=cluster_2.G_10,
    Divisions=divisions_timberlongitudinal,
    U=division_2,
    V=middletimberheightdivisions,
    TooltipDescriptionOverride="Divisions longitudinally")  # -> Mesh, Srf, SourceSrf, TargetSrf, Orientation; inputs PointsSource: list of Point3d, PointsTarget: list of Point3d, Divisions: Int32, U: Int32, V: Int32
# ---------- t2middle: C# ----------
    List<double> length = new List<double>();
    List <Curve> edgecrv = new List<Curve>();
    DataTree<Curve> edgecrvtree = new DataTree<Curve>();
    DataTree <Point3d> vrttree = new DataTree<Point3d>();
    DataTree <Point3d> vrtsectiontree = new DataTree<Point3d>();
    List <NurbsSurface> s = new List<NurbsSurface>();
    DataTree <System.Object> meshtree = new DataTree<System.Object>();


    //Default values if not specified, added 27.04
    if(Divisions == 0){Divisions = 1;};
    if(U == 0){U = 1;};
    if(V == 0){V = 1;};

    //Make edgecurves, get their length and make new corner points
    for ( int i = 0; i < 4; i++)
    {
      edgecrv.Add(new Line(PointsSource[i], PointsTarget[i]).ToNurbsCurve()); //Add for only one item
      length.Add(edgecrv[i].GetLength());
      edgecrvtree.Add(new Line(PointsSource[i], PointsTarget[i]).ToNurbsCurve(), new GH_Path(i));
      vrttree.AddRange(edgecrvtree.Branch(i)[0].DivideEquidistant(length[i] / Divisions), new GH_Path(i));

      int listitem = 0;
      for (int j = 0; j < (Divisions + 1); j++)
      {
        vrtsectiontree.Add(vrttree.Branch(i)[listitem], new GH_Path(j));
        listitem++;
      }
    }
    //make surfaces
    //get beginning and end surface if needed for tie/boundary conditions or etc.
    Brep ss = Brep.CreateFromCornerPoints(PointsSource[0], PointsSource[1], PointsSource[2], PointsSource[3], 0);
    Brep ts = Brep.CreateFromCornerPoints(PointsTarget[0], PointsTarget[1], PointsTarget[2], PointsTarget[3], 0);

    //get cross-sectional surfaces
    for (int j = 0; j < (Divisions + 1); j++)
    {
      s.Add(NurbsSurface.CreateFromCorners(vrtsectiontree.Branch(j)[0], vrtsectiontree.Branch(j)[1], vrtsectiontree.Branch(j)[2], vrtsectiontree.Branch(j)[3], 0));
    } // (branch number) [list number]


    DataTree<Brep> btree = new DataTree<Brep>();
    DataTree <Curve> loftcrv = new DataTree<Curve>(); //loft to get solid
    DataTree <Point3d> nodetree = new DataTree<Point3d>();


    for (int a = 0; a < (Divisions + 1); a++)
    {
      for (int i = 0; i < (V + 1); i++)
      {
        for (int j = 0; j < (U + 1); j++)
        {
          Point3d p = new Point3d(s[a].PointAt(s[a].Domain(0).Length / V * i, s[a].Domain(1).Length / U * j)); // v-value first, then u value, because domain(0) is v
          meshtree.Add(p, new GH_Path(0, 0)); //added 1704
          //meshtree.Add(p, new GH_Path(1, a)); //added1704 to get nodetree2 in same list
          nodetree.Add(p, new GH_Path(a, i));
        }
      }
    }

    for (int a = 0; a < (Divisions + 1); a++)
    {
      for (int i = 0; i < V; i++)
      {
        for (int j = 0; j < U; j++)
        {
          Brep b = Brep.CreateFromCornerPoints(nodetree.Branch(a, i)[j], nodetree.Branch(a, i + 1)[j], nodetree.Branch(a, i + 1)[j + 1], nodetree.Branch(a, i)[j + 1], 0);
          btree.Add(b, new GH_Path(a, i));
          //meshtree.Add(b, new GH_Path(2, a));
          meshtree.Add(b, new GH_Path(1, 0));
          loftcrv.AddRange(btree.Branch(a, i)[j].DuplicateEdgeCurves(), new GH_Path(a));
        }
      }
    }


    DataTree <Brep> srf = new DataTree<Brep>();
    for ( int i = 0; i < loftcrv.Branch(0).Count; i++)
    {
      for (int j = 0; j < Divisions; j++)
      {
        srf.AddRange(Brep.CreateFromLoft(new List<Curve>{loftcrv.Branch(0 + j)[i], loftcrv.Branch(1 + j)[i]}, Point3d.Unset, Point3d.Unset, LoftType.Normal, false), new GH_Path(i));
      }
    } // Surfaces in the middle are doubled


    //orientation

    Point3d p1 = new Point3d((PointsSource[0].X + PointsSource[1].X + PointsSource[2].X + PointsSource[3].X) / 4, (PointsSource[0].Y + PointsSource[1].Y + PointsSource[2].Y + PointsSource[3].Y) / 4, (PointsSource[0].Z + PointsSource[1].Z + PointsSource[2].Z + PointsSource[3].Z) / 4);
    Point3d p2 = new Point3d((PointsTarget[0].X + PointsTarget[1].X + PointsTarget[2].X + PointsTarget[3].X) / 4, (PointsTarget[0].Y + PointsTarget[1].Y + PointsTarget[2].Y + PointsTarget[3].Y) / 4, (PointsTarget[0].Z + PointsTarget[1].Z + PointsTarget[2].Z + PointsTarget[3].Z) / 4);

    List <string> orilist = new List<string>();

    Vector3d vec1 = p2 - p1; //longitudinal direction of timber cross-section central points = Direction 1
    vec1.Unitize();
    Plane nplan = new Plane(p1, vec1); //normal plane
    Vector3d vec2 = nplan.XAxis; // Second axis (unitized)

    double cx = p1.X;
    double cy = p1.Y;
    double cz = p1.Z;

    double x1 = vec1.X + cx;
    double y1 = vec1.Y + cy;
    double z1 = vec1.Z + cz;

    double x2 = vec2.X + cx;
    double y2 = vec2.Y + cy;
    double z2 = vec2.Z + cz;



    //Add orientation (for orthotropic material)
    orilist.Add("Ori-1");
    orilist.Add("*Orientation, name=Ori-1");
    orilist.Add(string.Format("{0}, {1}, {2}, {3}, {4}, {5}, {6}, {7}, {8}", x1, z1, y1, x2, z2, y2, cx, cz, cy)); //changed y z due to abaqus/rhino different axis systems
    orilist.Add("1, 270"); // 1,0. 1 means primary axis (x), 0 means no rotation


    //add divisions, u and v to be used further to end of mesh tree
    GH_Path pth = new GH_Path(2, 0);
    meshtree.Add(Divisions, pth); //number of divisions
    meshtree.Add((U + 1) * (V + 1), pth); // number of nodes per branch
    meshtree.Add(U * V, pth); //number of surfaces per branch


    Srf = srf;
    Mesh = meshtree;
    SourceSrf = ss;
    TargetSrf = ts;
    Orientation = orilist;
# ---------- end t2middle ----------
t2bottom_2 = CSharpScript(
    PointsSource=cluster_2.G_11,
    PointsTarget=cluster_2.G_12,
    Divisions=divisions_timberlongitudinal,
    U=division_2,
    V=divheight_hex,
    TooltipDescriptionOverride="Divisions longitudinally")  # -> Mesh, Srf, SourceSrf, TargetSrf, Orientation; inputs PointsSource: list of Point3d, PointsTarget: list of Point3d, Divisions: Int32, U: Int32, V: Int32; same code as t1bottom_2
t3bottom = CSharpScript(
    PointsSource=cluster_3.G_7,
    PointsTarget=cluster_3.G_9,
    Divisions=divisions_timberlongitudinal,
    U=division_2,
    V=divheight_hex,
    TooltipDescriptionOverride="Divisions longitudinally")  # -> Mesh, Srf, SourceSrf, TargetSrf, Orientation; inputs PointsSource: list of Point3d, PointsTarget: list of Point3d, Divisions: Int32, U: Int32, V: Int32; same code as t1bottom
t3middle = CSharpScript(
    PointsSource=cluster_3.G_8,
    PointsTarget=cluster_3.G_10,
    Divisions=divisions_timberlongitudinal,
    U=division_2,
    V=middletimberheightdivisions,
    TooltipDescriptionOverride="Divisions longitudinally")  # -> Mesh, Srf, SourceSrf, TargetSrf, Orientation; inputs PointsSource: list of Point3d, PointsTarget: list of Point3d, Divisions: Int32, U: Int32, V: Int32; same code as t2middle
t3bottom_2 = CSharpScript(
    PointsSource=cluster_3.G_11,
    PointsTarget=cluster_3.G_12,
    Divisions=divisions_timberlongitudinal,
    U=division_2,
    V=divheight_hex,
    TooltipDescriptionOverride="Divisions longitudinally")  # -> Mesh, Srf, SourceSrf, TargetSrf, Orientation; inputs PointsSource: list of Point3d, PointsTarget: list of Point3d, Divisions: Int32, U: Int32, V: Int32; same code as t1bottom_2
t4bottom = CSharpScript(
    PointsSource=cluster_4.G_7,
    PointsTarget=cluster_4.G_9,
    Divisions=divisions_timberlongitudinal,
    U=division_2,
    V=divheight_hex,
    TooltipDescriptionOverride="Divisions longitudinally")  # -> Mesh, Srf, SourceSrf, TargetSrf, Orientation; inputs PointsSource: list of Point3d, PointsTarget: list of Point3d, Divisions: Int32, U: Int32, V: Int32; same code as t1bottom
t4middle = CSharpScript(
    PointsSource=cluster_4.G_8,
    PointsTarget=cluster_4.G_10,
    Divisions=divisions_timberlongitudinal,
    U=division_2,
    V=middletimberheightdivisions,
    TooltipDescriptionOverride="Divisions longitudinally")  # -> Mesh, Srf, SourceSrf, TargetSrf, Orientation; inputs PointsSource: list of Point3d, PointsTarget: list of Point3d, Divisions: Int32, U: Int32, V: Int32
# ---------- t4middle: C# ----------
    List<double> length = new List<double>();
    List <Curve> edgecrv = new List<Curve>();
    DataTree<Curve> edgecrvtree = new DataTree<Curve>();
    DataTree <Point3d> vrttree = new DataTree<Point3d>();
    DataTree <Point3d> vrtsectiontree = new DataTree<Point3d>();
    List <NurbsSurface> s = new List<NurbsSurface>();
    DataTree <System.Object> meshtree = new DataTree<System.Object>();


    //Default values if not specified, added 27.04
    if(Divisions == 0){Divisions = 1;};
    if(U == 0){U = 1;};
    if(V == 0){V = 1;};

    //Make edgecurves, get their length and make new corner points
    for ( int i = 0; i < 4; i++)
    {
      edgecrv.Add(new Line(PointsSource[i], PointsTarget[i]).ToNurbsCurve()); //Add for only one item
      length.Add(edgecrv[i].GetLength());
      edgecrvtree.Add(new Line(PointsSource[i], PointsTarget[i]).ToNurbsCurve(), new GH_Path(i));
      vrttree.AddRange(edgecrvtree.Branch(i)[0].DivideEquidistant(length[i] / Divisions), new GH_Path(i));

      int listitem = 0;
      for (int j = 0; j < (Divisions + 1); j++)
      {
        vrtsectiontree.Add(vrttree.Branch(i)[listitem], new GH_Path(j));
        listitem++;
      }
    }
    //make surfaces
    //get beginning and end surface if needed for tie/boundary conditions or etc.
    Brep ss = Brep.CreateFromCornerPoints(PointsSource[0], PointsSource[1], PointsSource[2], PointsSource[3], 0);
    Brep ts = Brep.CreateFromCornerPoints(PointsTarget[0], PointsTarget[1], PointsTarget[2], PointsTarget[3], 0);

    //get cross-sectional surfaces
    for (int j = 0; j < (Divisions + 1); j++)
    {
      s.Add(NurbsSurface.CreateFromCorners(vrtsectiontree.Branch(j)[0], vrtsectiontree.Branch(j)[1], vrtsectiontree.Branch(j)[2], vrtsectiontree.Branch(j)[3], 0));
    } // (branch number) [list number]


    DataTree<Brep> btree = new DataTree<Brep>();
    DataTree <Curve> loftcrv = new DataTree<Curve>(); //loft to get solid
    DataTree <Point3d> nodetree = new DataTree<Point3d>();


    for (int a = 0; a < (Divisions + 1); a++)
    {
      for (int i = 0; i < (V + 1); i++)
      {
        for (int j = 0; j < (U + 1); j++)
        {
          Point3d p = new Point3d(s[a].PointAt(s[a].Domain(0).Length / V * i, s[a].Domain(1).Length / U * j)); // v-value first, then u value, because domain(0) is v
          meshtree.Add(p, new GH_Path(0, 0)); //added 1704
          //meshtree.Add(p, new GH_Path(1, a)); //added1704 to get nodetree2 in same list
          nodetree.Add(p, new GH_Path(a, i));
        }
      }
    }

    for (int a = 0; a < (Divisions + 1); a++)
    {
      for (int i = 0; i < V; i++)
      {
        for (int j = 0; j < U; j++)
        {
          Brep b = Brep.CreateFromCornerPoints(nodetree.Branch(a, i)[j], nodetree.Branch(a, i + 1)[j], nodetree.Branch(a, i + 1)[j + 1], nodetree.Branch(a, i)[j + 1], 0);
          btree.Add(b, new GH_Path(a, i));
          //meshtree.Add(b, new GH_Path(2, a));
          meshtree.Add(b, new GH_Path(1, 0));
          loftcrv.AddRange(btree.Branch(a, i)[j].DuplicateEdgeCurves(), new GH_Path(a));
        }
      }
    }


    DataTree <Brep> srf = new DataTree<Brep>();
    for ( int i = 0; i < loftcrv.Branch(0).Count; i++)
    {
      for (int j = 0; j < Divisions; j++)
      {
        srf.AddRange(Brep.CreateFromLoft(new List<Curve>{loftcrv.Branch(0 + j)[i], loftcrv.Branch(1 + j)[i]}, Point3d.Unset, Point3d.Unset, LoftType.Normal, false), new GH_Path(i));
      }
    } // Surfaces in the middle are doubled


    //orientation

    Point3d p1 = new Point3d((PointsSource[0].X + PointsSource[1].X + PointsSource[2].X + PointsSource[3].X) / 4, (PointsSource[0].Y + PointsSource[1].Y + PointsSource[2].Y + PointsSource[3].Y) / 4, (PointsSource[0].Z + PointsSource[1].Z + PointsSource[2].Z + PointsSource[3].Z) / 4);
    Point3d p2 = new Point3d((PointsTarget[0].X + PointsTarget[1].X + PointsTarget[2].X + PointsTarget[3].X) / 4, (PointsTarget[0].Y + PointsTarget[1].Y + PointsTarget[2].Y + PointsTarget[3].Y) / 4, (PointsTarget[0].Z + PointsTarget[1].Z + PointsTarget[2].Z + PointsTarget[3].Z) / 4);

    List <string> orilist = new List<string>();

    Vector3d vec1 = p2 - p1; //longitudinal direction of timber cross-section central points = Direction 1
    vec1.Unitize();
    Plane nplan = new Plane(p1, vec1); //normal plane
    Vector3d vec2 = nplan.XAxis; // Second axis (unitized)

    double cx = p1.X;
    double cy = p1.Y;
    double cz = p1.Z;

    double x1 = vec1.X + cx;
    double y1 = vec1.Y + cy;
    double z1 = vec1.Z + cz;

    double x2 = vec2.X + cx;
    double y2 = vec2.Y + cy;
    double z2 = vec2.Z + cz;



    //Add orientation (for orthotropic material)
    orilist.Add("Ori-1");
    orilist.Add("*Orientation, name=Ori-1");
    orilist.Add(string.Format("{0}, {1}, {2}, {3}, {4}, {5}, {6}, {7}, {8}", x1, z1, y1, x2, z2, y2, cx, cz, cy)); //changed y z due to abaqus/rhino different axis systems
    orilist.Add("1, 180"); // 1,0. 1 means primary axis (x), 0 means no rotation


    //add divisions, u and v to be used further to end of mesh tree
    GH_Path pth = new GH_Path(2, 0);
    meshtree.Add(Divisions, pth); //number of divisions
    meshtree.Add((U + 1) * (V + 1), pth); // number of nodes per branch
    meshtree.Add(U * V, pth); //number of surfaces per branch


    Srf = srf;
    Mesh = meshtree;
    SourceSrf = ss;
    TargetSrf = ts;
    Orientation = orilist;
# ---------- end t4middle ----------
t4bottom_2 = CSharpScript(
    PointsSource=cluster_4.G_11,
    PointsTarget=cluster_4.G_12,
    Divisions=divisions_timberlongitudinal,
    U=division_2,
    V=divheight_hex,
    TooltipDescriptionOverride="Divisions longitudinally")  # -> Mesh, Srf, SourceSrf, TargetSrf, Orientation; inputs PointsSource: list of Point3d, PointsTarget: list of Point3d, Divisions: Int32, U: Int32, V: Int32; same code as t1bottom_2
t5bottom = CSharpScript(
    PointsSource=cluster_5.G_7,
    PointsTarget=cluster_5.G_9,
    Divisions=divisions_timberlongitudinal,
    U=division_2,
    V=divheight_hex,
    TooltipDescriptionOverride="Divisions longitudinally")  # -> Mesh, Srf, SourceSrf, TargetSrf, Orientation; inputs PointsSource: list of Point3d, PointsTarget: list of Point3d, Divisions: Int32, U: Int32, V: Int32; same code as t1bottom
t5middle = CSharpScript(
    PointsSource=cluster_5.G_8,
    PointsTarget=cluster_5.G_10,
    Divisions=divisions_timberlongitudinal,
    U=division_2,
    V=middletimberheightdivisions,
    TooltipDescriptionOverride="Divisions longitudinally")  # -> Mesh, Srf, SourceSrf, TargetSrf, Orientation; inputs PointsSource: list of Point3d, PointsTarget: list of Point3d, Divisions: Int32, U: Int32, V: Int32; same code as t2middle
t5bottom_2 = CSharpScript(
    PointsSource=cluster_5.G_11,
    PointsTarget=cluster_5.G_12,
    Divisions=divisions_timberlongitudinal,
    U=division_2,
    V=divheight_hex,
    TooltipDescriptionOverride="Divisions longitudinally")  # -> Mesh, Srf, SourceSrf, TargetSrf, Orientation; inputs PointsSource: list of Point3d, PointsTarget: list of Point3d, Divisions: Int32, U: Int32, V: Int32; same code as t1bottom_2
t6bottom = CSharpScript(
    PointsSource=cluster_6.G_7,
    PointsTarget=cluster_6.G_9,
    Divisions=divisions_timberlongitudinal,
    U=division_2,
    V=divheight_hex,
    TooltipDescriptionOverride="Divisions longitudinally")  # -> Mesh, Srf, SourceSrf, TargetSrf, Orientation; inputs PointsSource: list of Point3d, PointsTarget: list of Point3d, Divisions: Int32, U: Int32, V: Int32; same code as t1bottom
orthotropicmaterial = CSharpScript(TooltipDescriptionOverride="Norwegian Spruce default material. E1=10000, E2 = 800, E3 = 400. Nu12=0.5, Nu13=0.6, Nu23=0.6. G12=600, G13=600, G23=30.")  # -> Properties; inputs Material: String, E1: Int32, E2: Int32, E3: Int32, Nu12: Double, Nu13: Double, Nu23: Double, G12: Int32, G13: Int32, G23: Int32
# ---------- orthotropicmaterial: C# ----------
    List< System.Object > B = new List<System.Object>();
    ///////////////////////////////////////////////////////////////////////////////////////
    ///////////////////////////////////////////////////////////////////////////////////////
    if (string.IsNullOrEmpty(Material)){Material = "Timber";}
    B.Add(Material);
    B.Add("Elastic, type=ENGINEERING CONSTANTS");
    //Elastic moduli
    if(E1 == 0){E1 = 10000;}
    if(E2 == 0){E2 = 800;}
    if(E3 == 0){E3 = 400;}

    //Poisson's ratios
    if(Nu12 == 0){Nu12 = 0.5;}
    if(Nu13 == 0){Nu13 = 0.6;}
    if(Nu23 == 0){Nu23 = 0.6;}

    //Shear moduli
    if(G12 == 0){G12 = 600;}
    if(G13 == 0){G13 = 600;}
    if(G23 == 0){G23 = 30;}


    B.Add(string.Format("{0}, {1}, {2}, {3}, {4}, {5}, {6}, {7}", E1, E2, E3, Nu12, Nu13, Nu23, G12, G13));
    B.Add(string.Format("{0}", G23)); //Apparently the ABAQUS demands that G23 is on the second line.

    Properties = B;
# ---------- end orthotropicmaterial ----------
t6middle = CSharpScript(
    PointsSource=cluster_6.G_8,
    PointsTarget=cluster_6.G_10,
    Divisions=divisions_timberlongitudinal,
    U=division_2,
    V=middletimberheightdivisions,
    TooltipDescriptionOverride="Divisions longitudinally")  # -> Mesh, Srf, SourceSrf, TargetSrf, Orientation; inputs PointsSource: list of Point3d, PointsTarget: list of Point3d, Divisions: Int32, U: Int32, V: Int32; same code as t2middle
t6bottom_2 = CSharpScript(
    PointsSource=cluster_6.G_11,
    PointsTarget=cluster_6.G_12,
    Divisions=divisions_timberlongitudinal,
    U=division_2,
    V=divheight_hex,
    TooltipDescriptionOverride="Divisions longitudinally")  # -> Mesh, Srf, SourceSrf, TargetSrf, Orientation; inputs PointsSource: list of Point3d, PointsTarget: list of Point3d, Divisions: Int32, U: Int32, V: Int32; same code as t1bottom_2
swatch = ColourSwatch(SwatchColor=RGB(225, 255, 77))
brep = Brep([t1bottom.SourceSrf, t1bottom_2.SourceSrf])
brep_2 = Brep([t2bottom.SourceSrf, t2bottom_2.SourceSrf])
ids = CSharpScript(Breps=brep)  # -> IDList; inputs Breps: list of Brep
# ---------- ids: C# ----------
    List < string > idlist = new List < string >();
    for (int i = 0; i < Breps.Count; i++)
    {
      idlist.Add("tie1" + i);
    }
    IDList = idlist;
# ---------- end ids ----------
preview = CustomPreview(
    Geometry=[t1bottom.Srf, t1bottom.SourceSrf, t1bottom.TargetSrf, t1bottom_2.Srf, t1bottom_2.SourceSrf, t1bottom_2.TargetSrf, t1middle.Srf, t1middle.SourceSrf, t1middle.TargetSrf],
    Material=swatch)
brep_3 = Brep([t1bottom.TargetSrf, t1middle.TargetSrf, t1bottom_2.TargetSrf])
brep_4 = Brep([t3bottom.SourceSrf, t3bottom_2.SourceSrf])
ids_2 = CSharpScript(Breps=brep_2)  # -> IDList; inputs Breps: list of Brep
# ---------- ids_2: C# ----------
    List < string > idlist = new List < string >();
    for (int i = 0; i < Breps.Count; i++)
    {
      idlist.Add("tie2" + i);
    }
    IDList = idlist;
# ---------- end ids_2 ----------
# Toggle to Run
toggle_2 = BooleanToggle(False)
ids_3 = CSharpScript(Breps=brep_4)  # -> IDList; inputs Breps: list of Brep
# ---------- ids_3: C# ----------
    List < string > idlist = new List < string >();
    for (int i = 0; i < Breps.Count; i++)
    {
      idlist.Add("tie3" + i);
    }
    IDList = idlist;
# ---------- end ids_3 ----------
load_support_surface = BrepJoin(Breps=brep_3)  # -> Breps, Closed
brep_5 = Brep([t2bottom.TargetSrf, t2middle.TargetSrf, t2bottom_2.TargetSrf])
brep_6 = Brep([t4bottom.SourceSrf, t4bottom_2.SourceSrf])
load_type = ValueList({"Uniform Pressure": "Pressure,P", "Surface Traction Shear": "Surface traction,TRSHR", "Surface Traction General": "Surface traction,TRVEC"}, selected="Uniform Pressure")
preview_2 = CustomPreview(
    Geometry=[t2bottom.Srf, t2bottom.SourceSrf, t2bottom.TargetSrf, t2bottom_2.Srf, t2bottom_2.SourceSrf, t2bottom_2.TargetSrf, t2middle.Srf, t2middle.SourceSrf, t2middle.TargetSrf],
    Material=swatch)
brep_7 = Brep([t3bottom.TargetSrf, t3middle.TargetSrf, t3bottom_2.TargetSrf])
load_support_surface_2 = BrepJoin(Breps=brep_5)  # -> Breps, Closed
ids_4 = CSharpScript(Breps=brep_6)  # -> IDList; inputs Breps: list of Brep
# ---------- ids_4: C# ----------
    List < string > idlist = new List < string >();
    for (int i = 0; i < Breps.Count; i++)
    {
      idlist.Add("tie4" + i);
    }
    IDList = idlist;
# ---------- end ids_4 ----------
bcs = ValueList({"U1": 1, "U2": 2, "U3": 3, "UR1": 4, "UR2": 5, "UR3": 6}, selected=["U1", "U2", "U3", "UR1", "UR2", "UR3"])
preview_3 = CustomPreview(
    Geometry=[t3bottom.Srf, t3bottom.SourceSrf, t3bottom.TargetSrf, t3bottom_2.Srf, t3bottom_2.SourceSrf, t3bottom_2.TargetSrf, t3middle.Srf, t3middle.SourceSrf, t3middle.TargetSrf],
    Material=swatch)
brep_8 = Brep([t5bottom.SourceSrf, t5bottom_2.SourceSrf])
brep_9 = Brep([t6bottom.SourceSrf, t6bottom_2.SourceSrf])
load_support_surface_3 = BrepJoin(Breps=brep_7)  # -> Breps, Closed
brep_10 = Brep([t4bottom.TargetSrf, t4middle.TargetSrf, t4bottom_2.TargetSrf])
ids_5 = CSharpScript(Breps=brep_8)  # -> IDList; inputs Breps: list of Brep
# ---------- ids_5: C# ----------
    List < string > idlist = new List < string >();
    for (int i = 0; i < Breps.Count; i++)
    {
      idlist.Add("tie5" + i);
    }
    IDList = idlist;
# ---------- end ids_5 ----------
ids_6 = CSharpScript(Breps=brep_9)  # -> IDList; inputs Breps: list of Brep
# ---------- ids_6: C# ----------
    List < string > idlist = new List < string >();
    for (int i = 0; i < Breps.Count; i++)
    {
      idlist.Add("tie6" + i);
    }
    IDList = idlist;
# ---------- end ids_6 ----------
preview_4 = CustomPreview(
    Geometry=[t4bottom.Srf, t4bottom.SourceSrf, t4bottom.TargetSrf, t4bottom_2.Srf, t4bottom_2.SourceSrf, t4bottom_2.TargetSrf, t4middle.Srf, t4middle.SourceSrf, t4middle.TargetSrf],
    Material=swatch)
load_support_surface_4 = BrepJoin(Breps=brep_10)  # -> Breps, Closed
brep_11 = Brep([t5bottom.TargetSrf, t5middle.TargetSrf, t5bottom_2.TargetSrf])
brep_12 = Brep([t6bottom.TargetSrf, t6middle.TargetSrf, t6bottom_2.TargetSrf])
support = CSharpScript(ID="fixedsupport", Face=load_support_surface.Breps, Conditions=bcs)  # -> Support; inputs ID: String, Tol: Double, Face: Brep, Conditions: list of String
# ---------- support: C# ----------
    //Create output tree
    DataTree <System.Object> tree = new DataTree<System.Object>();
    ///////////////////////////////////////////////////////////////////////////////////////
    ///////////////////////////////////////////////////////////////////////////////////////
    //Add surface and ID to be used in Part component
    tree.Add(Face, new GH_Path(0));
    tree.Add(ID, new GH_Path(2));
    ///////////////////////////////////////////////////////////////////////////////////////
    ///////////////////////////////////////////////////////////////////////////////////////
    //Add conditions to be exported in INP
    for( int i = 0; i < Conditions.Count(); i++)
    {
      if(Conditions[i] == "U1" || Conditions[i] == "1")
      {
        tree.Add(string.Format("{0}, 1, 1", ID), new GH_Path(1));
      }
      if(Conditions[i] == "U2" || Conditions[i] == "2")
      {
        tree.Add(string.Format("{0}, 2, 2", ID), new GH_Path(1));
      }
      if(Conditions[i] == "U3" || Conditions[i] == "3")
      {
        tree.Add(string.Format("{0}, 3, 3", ID), new GH_Path(1));
      }
      if(Conditions[i] == "UR1" || Conditions[i] == "4")
      {
        tree.Add(string.Format("{0}, 4, 4", ID), new GH_Path(1));
      }
      if(Conditions[i] == "UR2" || Conditions[i] == "5")
      {
        tree.Add(string.Format("{0}, 5, 5", ID), new GH_Path(1));
      }
      if(Conditions[i] == "UR3" || Conditions[i] == "6")
      {
        tree.Add(string.Format("{0}, 6, 6", ID), new GH_Path(1));
      }

    }
    ///////////////////////////////////////////////////////////////////////////////////////
    ///////////////////////////////////////////////////////////////////////////////////////
    //Add tolerance for pointcompare
    if(Tol == 0)
    {
      tree.Add(0.001, new GH_Path(3));
    }
    else
    {
      tree.Add(Tol, new GH_Path(3));
    }

    Support = tree;
# ---------- end support ----------
preview_5 = CustomPreview(
    Geometry=[t5bottom.Srf, t5bottom.SourceSrf, t5bottom.TargetSrf, t5bottom_2.Srf, t5bottom_2.SourceSrf, t5bottom_2.TargetSrf, t5middle.Srf, t5middle.SourceSrf, t5middle.TargetSrf],
    Material=swatch)
preview_6 = CustomPreview(
    Geometry=[t6bottom.Srf, t6bottom.SourceSrf, t6bottom.TargetSrf, t6bottom_2.Srf, t6bottom_2.SourceSrf, t6bottom_2.TargetSrf, t6middle.Srf, t6middle.SourceSrf, t6middle.TargetSrf],
    Material=swatch)
load_support_surface_5 = BrepJoin(Breps=brep_11)  # -> Breps, Closed
load_support_surface_6 = BrepJoin(Breps=brep_12)  # -> Breps, Closed
tie1 = CSharpScript(ID=ids, Master=aluminium, Slave="TimberPart1", Face=brep)  # -> Part, INP; inputs ID: String, Master: String, Slave: String, Tol: Double, Face: Brep
# ---------- tie1: C# ----------
    //Create output tree
    DataTree <System.Object> tree = new DataTree<System.Object>();
    List< string > INPLst = new List<string>();
    //Add surface and ID to be used in Part component
    tree.Add(Face, new GH_Path(0));
    tree.Add(ID, new GH_Path(1));
    //Add tolerance for pointcompare
    if(Tol == 0)
    {
      tree.Add(0.001, new GH_Path(2));
    }
    else
    {
      tree.Add(Tol, new GH_Path(2));
    }
    //Add conditions to be exported in INP
    INPLst.Add(string.Format("** Constraint: {0}", ID));
    INPLst.Add(string.Format("*Tie, name={0}, adjust=yes, type=SURFACE TO SURFACE", ID));
    INPLst.Add(string.Format("{0}-{1}-TieSrf, {0}-{2}-TieSrf", ID, Slave, Master));
    ///////////////////////////////////////////////////////////////////////////////////////
    ///////////////////////////////////////////////////////////////////////////////////////
    Part = tree;
    INP = INPLst;
# ---------- end tie1 ----------
load = CSharpScript(ID="load5", LoadType=load_type, Face=load_support_surface_5.Breps, kNMagnitude=Slider(39.99, range=0..100))  # -> Load; inputs ID: String, LoadType: String, Tol: Double, Face: Brep, DirVector: Vector3d, kNMagnitude: Double, MPaMagnitude: Double
# ---------- load: C# ----------
    //Create output tree
    DataTree <System.Object> tree = new DataTree<System.Object>();
    ///////////////////////////////////////////////////////////////////////////////////////
    ///////////////////////////////////////////////////////////////////////////////////////
    if (string.IsNullOrEmpty(ID)) //if ID is not assigned
    {
      ID = "Load1"; //Make default ID
    }
    //Add surface and ID to be used in Part component
    tree.Add(Face, new GH_Path(0));
    tree.Add(ID, new GH_Path(2));
    ///////////////////////////////////////////////////////////////////////////////////////
    //Makes string LoadType into list of two values with LoadType and abbreviation (P,TRSHR,TRVEC)
    string[] loadtypelist;
    loadtypelist = LoadType.Split(new char[] {','}, StringSplitOptions.None);
    ///////////////////////////////////////////////////////////////////////////////////////
    //Get info from the Direction vector, assign Default value
    if (DirVector.IsZero) //it the vector is the default value {0,0,0}
    {
      DirVector = new Vector3d(0, 0, -1); //default value downwards in z-direction, otherwise DirVec=DirVec
    }
    DirVector.Unitize(); //make the direction vector have unit length
    //Calculate the magnitude Stress [MPa] that works over the Face Area, so that the magnitude adds itself up to assigned kNMagnitude
    double Magnitude;
    if (kNMagnitude == 0)//if kNMagnitude is empty (==0)
    {
      Magnitude = MPaMagnitude; //then Magnitude is given in MPa
    }
    else
    {
      Magnitude = kNMagnitude * 1000 / Face.GetArea(); //Convert kN to a stress working over the face area
    }

    //Add conditions to be exported in INP
    tree.Add("**", new GH_Path(1));
    tree.Add(string.Format("** STEP: {0}", ID), new GH_Path(1));
    tree.Add("**", new GH_Path(1));
    tree.Add(string.Format("*Step, name={0}, nlgeom=NO", ID), new GH_Path(1));
    tree.Add("Uniform Load", new GH_Path(1));
    tree.Add("*Static", new GH_Path(1));
    tree.Add("0.1, 1., 1e-05, 1.", new GH_Path(1));
    tree.Add("**", new GH_Path(1));
    tree.Add("** LOADS", new GH_Path(1));
    tree.Add("**", new GH_Path(1));
    tree.Add(string.Format("** Name: {0}-Load   Type: {1}", ID, loadtypelist[0]), new GH_Path(1));
    tree.Add("*Dsload", new GH_Path(1));
    tree.Add(string.Format("{0},{1}, {2}, {3}, {4},{5}", ID, loadtypelist[1], Magnitude, DirVector.X, DirVector.Z, DirVector.Y), new GH_Path(1));
    tree.Add("**", new GH_Path(1));
    tree.Add("** OUTPUT REQUESTS", new GH_Path(1));
    tree.Add("**", new GH_Path(1));
    tree.Add("*Restart, write, frequency=0", new GH_Path(1));
    tree.Add("**", new GH_Path(1));
    tree.Add("** FIELD OUTPUT: F-Output-1", new GH_Path(1));
    tree.Add("**", new GH_Path(1));
    tree.Add("*Output, field, variable=PRESELECT", new GH_Path(1));
    tree.Add("**", new GH_Path(1));
    tree.Add("** HISTORY OUTPUT: H-Output-1", new GH_Path(1));
    tree.Add("**", new GH_Path(1));
    tree.Add("*Output, history, variable=PRESELECT", new GH_Path(1));
    tree.Add("*End Step", new GH_Path(1));
    ///////////////////////////////////////////////////////////////////////////////////////
    ///////////////////////////////////////////////////////////////////////////////////////
    //Add tolerance for pointcompare
    if(Tol == 0)
    {
      tree.Add(0.001, new GH_Path(3));
    }
    else
    {
      tree.Add(Tol, new GH_Path(3));
    }
    ///////////////////////////////////////////////////////////////////////////////////////
    ///////////////////////////////////////////////////////////////////////////////////////
    Load = tree;
# ---------- end load ----------
load_2 = CSharpScript(ID="load3", LoadType=load_type, Face=load_support_surface_3.Breps, kNMagnitude=Slider(109.66, range=0..1000))  # -> Load; inputs ID: String, LoadType: String, Tol: Double, Face: Brep, DirVector: Vector3d, kNMagnitude: Double, MPaMagnitude: Double; same code as load
load_3 = CSharpScript(ID="load4", LoadType=load_type, Face=load_support_surface_4.Breps, kNMagnitude=Slider(32.7, range=0..100))  # -> Load; inputs ID: String, LoadType: String, Tol: Double, Face: Brep, DirVector: Vector3d, kNMagnitude: Double, MPaMagnitude: Double; same code as load
tie3 = CSharpScript(ID=ids_3, Master=aluminium, Slave="TimberPart3", Face=brep_4)  # -> Part, INP; inputs ID: String, Master: String, Slave: String, Tol: Double, Face: Brep; same code as tie1
tie4 = CSharpScript(ID=ids_4, Master=aluminium, Slave="TimberPart4", Face=brep_6)  # -> Part, INP; inputs ID: String, Master: String, Slave: String, Tol: Double, Face: Brep; same code as tie1
timber1 = CSharpScript(
    ID="TimberPart1",
    Mesh=[t1bottom.Mesh, t1middle.Mesh, t1bottom_2.Mesh],
    ElmntType="C3D8R",
    Material=orthotropicmaterial,
    Orientation=t1middle.Orientation,
    Support=support,
    Tie=tie1.Part,
    Run=toggle_2)  # -> Geometry, Part, Instance, Sets, BC, Steps; inputs ID: String, Mesh: tree, ElmntType: list of String, Material: list, Orientation: list of String, Support: tree, Load: tree, Displ: tree, Tie: tree, Run: Boolean
# ---------- timber1: C# ----------
    //Declare variables;
    Point3d Crd;
    string Nr, X, Y, Z;

    //Create output tree;
    DataTree <Curve> Crvs = new DataTree<Curve>();
    DataTree <Point3d> Elements = new DataTree<Point3d>();
    DataTree <System.Object> GeoTree = new DataTree<System.Object>();
    DataTree <string> Inf = new DataTree<string>();
    DataTree <int> Tick = new DataTree<int>();
    DataTree <int> Tock = new DataTree<int>();

    //Create Lists;
    List< Point3d > Vertices = new List<Point3d>();
    List< Point3d > Nds = new List<Point3d>();
    List< Brep > Srf = new List<Brep>();
    List< Brep > ObjList = new List<Brep>();
    List< string > PrtLst = new List<string>();
    List< string > SetLst = new List<string>();
    List< string > InsLst = new List<string>();
    List< string > BCLst = new List<string>();
    List< string > StpLst = new List<string>();
    List< string > ElNr = new List<string>();
    List<Brep> SupLst = new List<Brep>();
    List<double> TolSupLst = new List<double>();
    List<Brep> DisLst = new List<Brep>();
    List<double> TolDisLst = new List<double>();
    List<Brep> LdLst = new List<Brep>();
    List<double> TolLdLst = new List<double>();
    List<Brep> TieLst = new List<Brep>();
    List<double> TolTieLst = new List<double>();

    ////////////////////////////////////////////////////////////////////////////////////
    //Sorts number of meshes into correct lists so that it is possible to assign different values of v,u and div to each mesh and merge meshes into same part
    List<Point3d> nodelist = new List<Point3d>();
    DataTree<Point3d> nodetree = new DataTree<Point3d>();
    DataTree<Brep> breps = new DataTree<Brep>();

    for (int i = 0; i < Mesh.Branch(0, 0).Count(); i++)
    {
      Point3d n = (Point3d) Mesh.Branch(0, 0)[i];
      nodelist.Add(n);
    }

    int div, numnb, numbr;
    int startlocn = 0; //startindex of node
    int startlocb = 0; //startindex of brep
    int count = 0; //count to get correct assignment of div,numnb,numbr;
    for (int j = 0; j < (Mesh.Branch(2, 0).Count() / 3) ; j++) //number of meshes
    {
      div = (int) Mesh.Branch(2, 0)[count]; //divisions j mesh
      numnb = (int) Mesh.Branch(2, 0)[count + 1]; //number of nodes in each division
      numbr = (int) Mesh.Branch(2, 0)[count + 2]; //number of surfaces in each division
      for (int k = 0; k < (div + 1); k++)
      {
        for (int m = startlocn; m < (startlocn + numnb); m++)
        {
          Point3d nb = nodelist[m];
          nodetree.Add(nb, new GH_Path(j, k));
        }

        for (int p = startlocb; p < (startlocb + numbr); p++)
        {
          Brep bb = (Brep) Mesh.Branch(1, 0)[p];
          breps.Add(bb, new GH_Path(j, k));
        }
        for (int q = 0; q < numbr; q++)
        {
          Elements.AddRange(breps.Branch(j, k)[q].DuplicateVertices(), new GH_Path(j, k, q));
        }

        startlocn = startlocn + numnb; //make next location
        startlocb = startlocb + numbr; //make next location
      }
      count = count + 3;
    }



    ///////////////////////////////////////////////////////////////////////////////////////
    ///////////////////////////////////////////////////////////////////////////////////////

    if (Run)
    {
      //Discretize the data of the Part;
      PrtLst.Add(string.Format("*Part, name={0}", ID));
      //Nodes of the Part;
      PrtLst.Add("*Node");

      Nds.AddRange(Point3d.CullDuplicates(nodelist, doc.ModelAbsoluteTolerance)); //remove duplicate node points
      for ( int i = 0; i < Nds.Count; i++)
      {
        Nr = (i + 1).ToString();
        Crd = Nds[i];
        X = Crd.X.ToString();
        Y = Crd.Y.ToString();
        Z = Crd.Z.ToString();
        PrtLst.Add(Nr + ", " + X + ", " + Z + ", " + Y);
      }
      //Sort element Nodes and identify faces which is supported or loaded;
      PrtLst.Add(string.Format("*Element, type={0}", ElmntType[0]));

      //If Load, import input for load;
      if ( Load.PathExists(0) )
      {
        double TolLd;
        Brep LdSrf = new Brep();
        for (int i = 0; i < Load.Branch(0).Count(); i++)
        {
          GH_Convert.ToBrep(Load.Branch(0)[i], ref LdSrf, Grasshopper.Kernel.GH_Conversion.Both);
          GH_Convert.ToDouble(Load.Branch(3)[i], out TolLd, GH_Conversion.Both);
          TolLdLst.Add(TolLd);
          LdLst.Add(LdSrf);
        }
      }
      //If Tie, import input for tie;
      if ( Tie.PathExists(0) )
      {
        double TolTie;
        Brep TieSrf = new Brep();
        for (int i = 0; i < Tie.Branch(0).Count(); i++)
        {
          GH_Convert.ToBrep(Tie.Branch(0)[i], ref TieSrf, Grasshopper.Kernel.GH_Conversion.Both);
          GH_Convert.ToDouble(Tie.Branch(2)[i], out TolTie, GH_Conversion.Both);
          TolTieLst.Add(TolTie);
          TieLst.Add(TieSrf);
        }
      }

      //Make list of elements, identify load and tie
      int count2 = 0; //To get the correct assignment of divisions, number of breps for each mesh
      int count3 = 1; //Begin at element 1 in Abaqus

      for (int f = 0; f < (Mesh.Branch(2, 0).Count() / 3) ; f++) //number of meshes
      {
        int div2 = (int) Mesh.Branch(2, 0)[count2]; //divisions of f mesh
        int numbr2 = (int) Mesh.Branch(2, 0)[count2 + 2]; //numbers of breps in each division

        for (int g = 0; g < div2; g++)
        {
          for (int h = 0; h < numbr2; h++)
          {
            ElNr.Add(count3.ToString());
            for ( int k = 0; k < Elements.Branch(f, g, h).Count; k++)
            {
              for ( int l = 0; l < Nds.Count; l++)
              {
                if ( PtCmp(Elements.Branch(f, g, h)[k], Nds[l]))
                {
                  ElNr.Add((l + 1).ToString());
                }
              } //4 first corners
            }
            for ( int k = 0; k < Elements.Branch(f, g, h).Count; k++)
            {
              for ( int l = 0; l < Nds.Count; l++)
              {
                if ( PtCmp(Elements.Branch(f, g + 1, h)[k], Nds[l]))
                {
                  ElNr.Add((l + 1).ToString());
                }
              } //4 second corners

              //identify if srf is loaded
              if ( Load.PathExists(0) )
              {
                for (int m = 0; m < Load.Branch(0).Count; m++)
                {
                  Tick.EnsurePath(m);
                  if ( IdenSet(LdLst[m], Elements.Branch(f, g, h)[k], TolLdLst[m]))
                  {
                    Tick.Add(k + 1, new GH_Path(m));
                    if (Tick.Branch(m).Count == 4)
                    {
                      Inf.Add((count3).ToString() + ",", new GH_Path(1, m, 2));
                      Inf.Add(SrfInd(Tick.Branch(m)).ToString(), new GH_Path(1, m, 3));
                    }
                  }
                  if ( IdenSet(LdLst[m], Elements.Branch(f, g + 1, h)[k], TolLdLst[m]))
                  {
                    Tick.Add(k + 5, new GH_Path(m));
                    if (Tick.Branch(m).Count == 4)
                    {
                      Inf.Add((count3).ToString() + ",", new GH_Path(1, m, 2));
                      Inf.Add(SrfInd(Tick.Branch(m)).ToString(), new GH_Path(1, m, 3));
                    }
                  }
                }
              } //end load Path

              //identify if nodes are tied
              if ( Tie.PathExists(0) )
              {
                for (int m = 0; m < Tie.Branch(0).Count; m++)
                {
                  Tock.EnsurePath(m);
                  if ( IdenSet(TieLst[m], Elements.Branch(f, g, h)[k], TolTieLst[m]))
                  {
                    Tock.Add(k + 1, new GH_Path(m));
                    if (Tock.Branch(m).Count == 4)
                    {
                      Inf.Add((count3).ToString() + ",", new GH_Path(1, m, 4));
                      Inf.Add(SrfInd(Tock.Branch(m)).ToString(), new GH_Path(1, m, 5));
                    }
                  }
                  if ( IdenSet(TieLst[m], Elements.Branch(f, g + 1, h)[k], TolTieLst[m]))
                  {
                    Tock.Add(k + 5, new GH_Path(m));
                    if (Tock.Branch(m).Count == 4)
                    {
                      Inf.Add((count3).ToString() + ",", new GH_Path(1, m, 4));
                      Inf.Add(SrfInd(Tock.Branch(m)).ToString(), new GH_Path(1, m, 5));
                    }
                  }
                }
              } //end tie
            }

            PrtLst.Add(String.Join(",  ", ElNr.ToArray()));
            count3 = count3 + 1;
            ElNr.Clear();
            Tick.ClearData();
            Tock.ClearData();
          }
        }
        count2 = count2 + 3;
      }


      //Identify nodes on supported face;
      if ( Support.PathExists(0) )
      {
        double TolSup;
        Brep SupSrf = new Brep();
        for (int i = 0; i < Support.Branch(0).Count(); i++)
        {
          GH_Convert.ToBrep(Support.Branch(0)[i], ref SupSrf, Grasshopper.Kernel.GH_Conversion.Both);
          GH_Convert.ToDouble(Support.Branch(3)[i], out TolSup, GH_Conversion.Both);
          TolSupLst.Add(TolSup);
          SupLst.Add(SupSrf);
        }
        for (int i = 0; i < Nds.Count; i++)
        {
          for (int j = 0; j < Support.Branch(0).Count; j++)
          {
            if ( IdenSet(SupLst[j], Nds[i], TolSupLst[j]) )
            {
              Inf.Add((i + 1).ToString() + ",", new GH_Path(0, j, 1));
              GeoTree.Add(Nds[i].X.ToString(), new GH_Path(2, j, 0));
              GeoTree.Add(Nds[i].Y.ToString(), new GH_Path(2, j, 1));
              GeoTree.Add(Nds[i].Z.ToString(), new GH_Path(2, j, 2));
            }
          }
        }
      }
      //Identify displaced nodes;
      if ( Displ.PathExists(0) )
      {
        double TolDis;
        Brep DisSrf = new Brep();
        for (int i = 0; i < Displ.Branch(0).Count(); i++)
        {
          GH_Convert.ToBrep(Displ.Branch(0)[i], ref DisSrf, Grasshopper.Kernel.GH_Conversion.Both);
          GH_Convert.ToDouble(Displ.Branch(3)[i], out TolDis, GH_Conversion.Both);
          TolDisLst.Add(TolDis);
          DisLst.Add(DisSrf);
        }
        for (int i = 0; i < Nds.Count; i++)
        {
          for (int j = 0; j < Displ.Branch(0).Count; j++)
          {
            if ( IdenSet(DisLst[j], Nds[i], TolDisLst[j]) )
            {
              Inf.Add((i + 1).ToString() + ",", new GH_Path(0, j, 2));
              GeoTree.Add(Nds[i].X.ToString(), new GH_Path(3, j, 0));
              GeoTree.Add(Nds[i].Y.ToString(), new GH_Path(3, j, 1));
              GeoTree.Add(Nds[i].Z.ToString(), new GH_Path(3, j, 2));
            }
          }
        }
      }
      ///////////////////////////////////////////////////////////////////////////////////////
      ///////////////////////////////////////////////////////////////////////////////////////
      //Create sets of nodes;
      PrtLst.Add("*Nset, nset=Set-1, generate");
      PrtLst.Add(string.Format("   1,    {0},    1", Nds.Count));
      //Create sets of elements;
      PrtLst.Add("*Elset, elset=Set-1, generate");
      PrtLst.Add(string.Format("   1,    {0},    1", count3 - 1));

      //Add orientation (for orthotropic material) 30.04

      if ( (Orientation != null) && (!Orientation.Any()) ) //if the list is empty
      {
        PrtLst.Add(string.Format("**Section: {0}_section", ID));
        PrtLst.Add(string.Format("*Solid Section, elset=Set-1, material={0}", Material[0]));
      }
      else
      {
        PrtLst.Add(Orientation[1]);
        PrtLst.Add(Orientation[2]);
        PrtLst.Add(Orientation[3]);
        PrtLst.Add(string.Format("**Section: {0}_section", ID));
        PrtLst.Add(string.Format("*Solid Section, elset=Set-1, orientation=Ori-1, material={0}", Material[0]));
      }

      PrtLst.Add(",");
      //Finish defining Part;
      PrtLst.Add("*End Part");
      PrtLst.Add("**");
      //Create instance of the part;
      InsLst.Add(string.Format("*Instance, name={0}, part={0}", ID));
      InsLst.Add("*End Instance");
      InsLst.Add("**");
      //BC; Add nodes on supported Face;
      if ( Inf.PathExists(0, 0, 1) )
      {
        for (int i = 0; i < Support.Branch(0).Count; i++)
        {
          SetLst.Add(string.Format("*Nset, nset={0}, instance={1}", Support.Branch(2)[i], ID));
          for (int j = 0; j < Inf.Branch(0, i, 1).Count; j++)
          {
            SetLst.Add(Inf.Branch(0, i, 1)[j]);
          }
        }
      }
      //Displ/Rot; Add displaced nodes;
      if ( Inf.PathExists(0, 0, 2) )
      {
        for (int i = 0; i < Displ.Branch(0).Count; i++)
        {
          SetLst.Add(string.Format("*Nset, nset={0}, instance={1}", Displ.Branch(2)[i], ID));
          for (int j = 0; j < Inf.Branch(0, i, 2).Count; j++)
          {
            SetLst.Add(Inf.Branch(0, i, 2)[j]);
          }
        }
      }
      //Add elements on tied face;
      if ( Inf.PathExists(1, 0, 4) )
      {
        for (int i = 0; i < Tie.Branch(0).Count; i++)
        {
          SetLst.Add(string.Format("*Elset, elset={0}-{1}-TieSrf, internal, instance={1}", Tie.Branch(1)[i], ID));
          for (int j = 0; j < Inf.Branch(1, i, 4).Count; j++)
          {
            SetLst.Add(Inf.Branch(1, i, 4)[j]);
          }
        }
      }
      //Define tie surface;
      if ( Inf.PathExists(1, 0, 5) )
      {
        for (int i = 0; i < Tie.Branch(0).Count; i++)
        {
          SetLst.Add(string.Format("*Surface, type=ELEMENT, name={0}-{1}-TieSrf", Tie.Branch(1)[i], ID));
          SetLst.Add(string.Format("{0}-{1}-TieSrf, S{2}", Tie.Branch(1)[i], ID, Inf.Branch(1, i, 5)[0]));
        }
      }
      //Add elements on loaded face;
      if ( Inf.PathExists(1, 0, 2) )
      {
        for (int i = 0; i < Load.Branch(0).Count; i++)
        {
          SetLst.Add(string.Format("*Elset, elset={0}-Surf, internal, instance={1}", Load.Branch(2)[i], ID));
          for (int j = 0; j < Inf.Branch(1, i, 2).Count; j++)
          {
            SetLst.Add(Inf.Branch(1, i, 2)[j]);
          }
        }
      }
      //Define load surface;
      if ( Inf.PathExists(1, 0, 2) )
      {
        for (int i = 0; i < Load.Branch(0).Count; i++)
        {
          SetLst.Add(string.Format("*Surface, type=ELEMENT, name={0}", Load.Branch(2)[i]));
          SetLst.Add(string.Format("{0}-Surf, S{1}", Load.Branch(2)[i], Inf.Branch(1, i, 3)[0]));
        }
      }
      //Boundary conditions;
      if ( Support.PathExists(0) )
      {
        for (int i = 0; i < Support.Branch(1).Count; i++)
        {
          BCLst.Add(string.Format("{0}", Support.Branch(1)[i]));
        }
      }
      //Steps;
      if ( Load.PathExists(0) )
      {
        for (int i = 0; i < Load.Branch(1).Count; i++)
        {
          StpLst.Add(string.Format("{0}", Load.Branch(1)[i]));;
        }
      }
      if ( Displ.PathExists(0) )
      {
        for (int i = 0; i < Displ.Branch(1).Count; i++)
        {
          StpLst.Add(string.Format("{0}", Displ.Branch(1)[i]));
        }
      }

    }
    Geometry = GeoTree;
    Part = PrtLst;
    Instance = InsLst;
    Sets = SetLst;
    BC = BCLst;
    Steps = StpLst;
# ---------- timber1: C# additional code ----------
  public int SrfInd(List < int > N)
  {
    int Indx;

    if (!N.Except(new List<int>{ 1, 2, 3, 4 }).Any() && N.Count == 4)
    {
      Indx = 1;
    }
    else if(!N.Except(new List<int>{ 5, 6, 7, 8 }).Any() && N.Count == 4)
    {
      Indx = 2;
    }
    else if(!N.Except(new List<int>{ 1, 2, 5, 6 }).Any() && N.Count == 4)
    {
      Indx = 3;
    }
    else if(!N.Except(new List<int>{ 2, 3, 6, 7 }).Any() && N.Count == 4)
    {
      Indx = 4;
    }
    else if(!N.Except(new List<int>{ 3, 4, 7, 8 }).Any() && N.Count == 4)
    {
      Indx = 5;
    }
    else
    {
      Indx = 6;
    }
    return Indx;
  }

  public bool IdenSet(Brep Srf, Point3d Nd, double Tol)
  {
    bool Truth;
    Point3d Pt = Srf.ClosestPoint(Nd);
    Vector3d Vct = Pt - Nd;

    if (Vct.Length < Tol)
    {
      Truth = true;
    }
    else
    {
      Truth = false;
    }
    return Truth;
  }

  public bool PtCmp(Point3d ElNd, Point3d Nd)
  {
    bool Truth;
    Vector3d Vct = ElNd - Nd;

    if (Vct.Length < doc.ModelAbsoluteTolerance)
    {
      Truth = true;
    }
    else
    {
      Truth = false;
    }
    return Truth;
  }
# ---------- end timber1 ----------
load_4 = CSharpScript(ID="load6", LoadType=load_type, Face=load_support_surface_6.Breps, kNMagnitude=Slider(108.82, range=0..1000))  # -> Load; inputs ID: String, LoadType: String, Tol: Double, Face: Brep, DirVector: Vector3d, kNMagnitude: Double, MPaMagnitude: Double; same code as load
tie5 = CSharpScript(ID=ids_5, Master=aluminium, Slave="TimberPart5", Face=brep_8)  # -> Part, INP; inputs ID: String, Master: String, Slave: String, Tol: Double, Face: Brep; same code as tie1
tie6 = CSharpScript(ID=ids_6, Master=aluminium, Slave="TimberPart6", Face=brep_9)  # -> Part, INP; inputs ID: String, Master: String, Slave: String, Tol: Double, Face: Brep; same code as tie1
load_5 = CSharpScript(ID="load2", LoadType=load_type, Face=load_support_surface_2.Breps, kNMagnitude=Slider(34.59, range=0..100))  # -> Load; inputs ID: String, LoadType: String, Tol: Double, Face: Brep, DirVector: Vector3d, kNMagnitude: Double, MPaMagnitude: Double; same code as load
tie2 = CSharpScript(ID=ids_2, Master=aluminium, Slave="TimberPart2", Face=brep_2)  # -> Part, INP; inputs ID: String, Master: String, Slave: String, Tol: Double, Face: Brep; same code as tie1
ties = Relay([tie2.Part, tie3.Part, tie4.Part, tie5.Part, tie6.Part])
alupart = CSharpScript(
    ID=aluminium,
    Mesh=[meshpointsnurbs0705riktig.Mesh, topalu.Mesh],
    ElmntType="C3D8R",
    Material=isotropicalumaterial,
    Tie=[tie1.Part, ties],
    Run=toggle_2)  # -> Geometry, Part, Instance, Sets, BC, Steps; inputs ID: String, Mesh: tree, ElmntType: list of String, Material: list, Orientation: list of String, Support: tree, Load: tree, Displ: tree, Tie: tree, Run: Boolean; same code as timber1
timber3 = CSharpScript(
    ID="TimberPart3",
    Mesh=[t3bottom.Mesh, t3middle.Mesh, t3bottom_2.Mesh],
    ElmntType="C3D8R",
    Material=orthotropicmaterial,
    Orientation=t3middle.Orientation,
    Load=load_2,
    Tie=tie3.Part,
    Run=toggle_2)  # -> Geometry, Part, Instance, Sets, BC, Steps; inputs ID: String, Mesh: tree, ElmntType: list of String, Material: list, Orientation: list of String, Support: tree, Load: tree, Displ: tree, Tie: tree, Run: Boolean; same code as timber1
timber4 = CSharpScript(
    ID="TimberPart4",
    Mesh=[t4bottom.Mesh, t4middle.Mesh, t4bottom_2.Mesh],
    ElmntType="C3D8R",
    Material=orthotropicmaterial,
    Orientation=t4middle.Orientation,
    Load=load_3,
    Tie=tie4.Part,
    Run=toggle_2)  # -> Geometry, Part, Instance, Sets, BC, Steps; inputs ID: String, Mesh: tree, ElmntType: list of String, Material: list, Orientation: list of String, Support: tree, Load: tree, Displ: tree, Tie: tree, Run: Boolean; same code as timber1
timber5 = CSharpScript(
    ID="TimberPart5",
    Mesh=[t5bottom.Mesh, t5middle.Mesh, t5bottom_2.Mesh],
    ElmntType="C3D8R",
    Material=orthotropicmaterial,
    Orientation=t5middle.Orientation,
    Load=load,
    Tie=tie5.Part,
    Run=toggle_2)  # -> Geometry, Part, Instance, Sets, BC, Steps; inputs ID: String, Mesh: tree, ElmntType: list of String, Material: list, Orientation: list of String, Support: tree, Load: tree, Displ: tree, Tie: tree, Run: Boolean; same code as timber1
timber6 = CSharpScript(
    ID="TimberPart6",
    Mesh=[t6bottom.Mesh, t6middle.Mesh, t6bottom_2.Mesh],
    ElmntType="C3D8R",
    Material=orthotropicmaterial,
    Orientation=t6middle.Orientation,
    Load=load_4,
    Tie=tie6.Part,
    Run=toggle_2)  # -> Geometry, Part, Instance, Sets, BC, Steps; inputs ID: String, Mesh: tree, ElmntType: list of String, Material: list, Orientation: list of String, Support: tree, Load: tree, Displ: tree, Tie: tree, Run: Boolean; same code as timber1
# Make Geometry/Mesh
# Making the INP file for importing the model to ABAQUS, deciding boundary conditions, load etc.
# Make Geometry/Mesh
# Making the INP file for importing the model to ABAQUS, deciding boundary conditions, load etc.
timber2 = CSharpScript(
    ID="TimberPart2",
    Mesh=[t2bottom.Mesh, t2middle.Mesh, t2bottom_2.Mesh],
    ElmntType="C3D8R",
    Material=orthotropicmaterial,
    Orientation=t2middle.Orientation,
    Load=load_5,
    Tie=tie2.Part,
    Run=toggle_2)  # -> Geometry, Part, Instance, Sets, BC, Steps; inputs ID: String, Mesh: tree, ElmntType: list of String, Material: list, Orientation: list of String, Support: tree, Load: tree, Displ: tree, Tie: tree, Run: Boolean; same code as timber1
inpassembly = CSharpScript(
    Part=flatten([alupart.Part, timber1.Part, timber2.Part, timber3.Part, timber4.Part, timber5.Part, timber6.Part]),
    Instance=flatten([alupart.Instance, timber1.Instance, timber2.Instance, timber3.Instance, timber4.Instance, timber5.Instance, timber6.Instance]),
    Sets=flatten([alupart.Sets, timber1.Sets, timber2.Sets, timber3.Sets, timber4.Sets, timber5.Sets, timber6.Sets]),
    BC=flatten([alupart.BC, timber1.BC, timber2.BC, timber3.BC, timber4.BC, timber5.BC, timber6.BC]),
    Material=[isotropicalumaterial, orthotropicmaterial],
    Tie=flatten([tie1.INP, tie2.INP, tie3.INP, tie4.INP, tie5.INP, tie6.INP]),
    Steps=flatten([alupart.Steps, timber1.Steps, timber2.Steps, timber3.Steps, timber4.Steps, timber5.Steps, timber6.Steps]))  # -> INP; inputs ID: list of String, Job: list of String, Model: list of String, Part: list of String, Instance: list of String, Sets: list of String, BC: list of String, Material: list of String, Tie: list of String, Steps: list of String
# ---------- inpassembly: C# ----------
    //Create output;
    List < string > INPLst = new List<string>{ "*Heading" };
    //Create variables;
    string job, model;
    //Include the header, job- and model name;Model
    if (ID.Count == 0)
    {
      INPLst.Add("GH_File");
    }
    else
    {
      INPLst.Add(ID[0]);
    }
    if (Job.Count == 0)
    {
      job = "GH_Job";
    }
    else
    {
      job = Job[0];
    }
    if (Model.Count == 0)
    {
      model = "GH_Model";
    }
    else
    {
      model = Model[0];
    }
    INPLst.Add(string.Format("** Job name: {0} Model name: {1}", job, model));
    ///////////////////////////////////////////////////////////////////////////////////////
    ///////////////////////////////////////////////////////////////////////////////////////
    //Setting the data file printing options;
    INPLst.Add("*Preprint, echo=NO, model=NO, history=NO, contact=NO");
    //Parts;
    INPLst.Add("**");
    INPLst.Add("** PARTS");
    INPLst.Add("**");
    INPLst.AddRange(Part);
    //Start assemble the model;
    INPLst.Add("**");
    INPLst.Add("** ASSEMBLY");
    INPLst.Add("**");
    INPLst.Add("*Assembly, name=Assembly");
    INPLst.Add("**");
    //Instances;
    INPLst.AddRange(Instance);
    //Sets;
    INPLst.AddRange(Sets);
    //Tie;
    INPLst.AddRange(Tie);
    //End assembly;
    INPLst.Add("*End Assembly");
    //Defining the material properties;
    INPLst.Add("**");
    INPLst.Add("** MATERIALS");
    INPLst.Add("**");

    /*if ( Material.Count > 3)
    {
      INPLst.Add(string.Format("*Material, name={0}", Material[0]));
      INPLst.Add(string.Format("* {0}", Material[1]));
      INPLst.Add(string.Format("{0}, {1}", Material[2], Material[3]));
    }
 */

    for (int i = 0; i < Material.Count; i += 4) //fixed 2904
    {
      INPLst.Add(string.Format("*Material, name={0}", Material[i]));
      INPLst.Add(string.Format("*{0}", Material[i + 1]));
      INPLst.Add(string.Format("{0}", Material[i + 2]));
      INPLst.Add(string.Format("{0}", Material[i + 3]));
    }


    //Defining the boundary conditions;
    INPLst.Add("**");
    INPLst.Add("** BOUNDARY CONDITIONS");
    INPLst.Add("**");
    INPLst.Add("** Name: BC-1 Type: Displacement/Rotation");
    INPLst.Add("*Boundary");
    INPLst.AddRange(BC);
    //End defining BC;
    INPLst.Add("** ----------------------------------------------------------------");
    //Add the steps;
    INPLst.AddRange(Steps);
    ///////////////////////////////////////////////////////////////////////////////////////
    ///////////////////////////////////////////////////////////////////////////////////////
    INP = INPLst;
# ---------- end inpassembly ----------
panel_7 = Panel(inpassembly)

# ==== cluster Cluster
number_slider = Slider(1, range=0..10)
number_slider_2 = Slider(1, range=0..10)
S = ClusterInput()
S_2 = ClusterInput()
sdivide = DivideSurface(Surface=S, UCount=number_slider, VCount=number_slider)  # -> flatten(Points), Normals, Parameters
panel = Panel("""3
4""")
sdivide_2 = DivideSurface(Surface=S_2, UCount=number_slider_2, VCount=number_slider_2)  # -> flatten(Points), Normals, Parameters
panel_2 = Panel("""1
2""")
F = ClusterInput()
F_2 = ClusterInput()
F_3 = ClusterInput()
sortptsxzplane = CSharpScript(Pts=sdivide.Points, TooltipDescriptionOverride="Sort 4 points counter clockwise ", TooltipTextOverride="Sort")  # -> SPts; inputs Pts: list of Point3d
# ---------- sortptsxzplane: C# ----------
    Point3d[] pointarray = Pts.ToArray();
    Point3d cnt = new Point3d((Pts[0].X + Pts[1].X + Pts[2].X + Pts[3].X) / 4, (Pts[0].Y + Pts[1].Y + Pts[2].Y + Pts[3].Y) / 4, (Pts[0].Z + Pts[1].Z + Pts[2].Z + Pts[3].Z) / 4); //central point

    double[] angles = new double[pointarray.Length];

    for (int i = 0; i < pointarray.Length; i++)
    {
      angles[i] = Math.Atan2((pointarray[i].Z - cnt.Z), (pointarray[i].X - cnt.X));
    }
    Array.Sort(angles, pointarray);

    List < Point3d > sorted = new List <Point3d>();
    sorted.Add(pointarray[1]); //to get correct listing
    sorted.Add(pointarray[2]);
    sorted.Add(pointarray[3]);
    sorted.Add(pointarray[0]);


    SPts = sorted;
# ---------- end sortptsxzplane ----------
item = ListItem(List=sortptsxzplane, Index=panel_2, Wrap=True)
Y = UnitY(Factor=F)
Y_2 = UnitY(Factor=F_2)
sortptsxzplane_2 = CSharpScript(Pts=sdivide_2.Points, TooltipDescriptionOverride="Sort 4 points counter clockwise ", TooltipTextOverride="Sort")  # -> SPts; inputs Pts: list of Point3d; same code as sortptsxzplane
item_2 = ListItem(List=sortptsxzplane_2, Index=panel, Wrap=True)
Y_3 = UnitY(Factor=F_3)
sortptsxzplane_3 = CSharpScript(Pts=[item_2, item], TooltipDescriptionOverride="Sort 4 points counter clockwise ", TooltipTextOverride="Sort")  # -> SPts; inputs Pts: list of Point3d; same code as sortptsxzplane
move = Move(Geometry=sortptsxzplane, Motion=Y)  # -> Geometry, Transform
spts = ClusterOutput(sortptsxzplane)
move_2 = Move(Geometry=sortptsxzplane_3, Motion=Y_3)  # -> Geometry, Transform
spts_2 = ClusterOutput(sortptsxzplane_2)
move_3 = Move(Geometry=sortptsxzplane_2, Motion=Y_2)  # -> Geometry, Transform
G = ClusterOutput(move.Geometry)
spts_3 = ClusterOutput(sortptsxzplane_3)
G_2 = ClusterOutput(move_2.Geometry)
G_3 = ClusterOutput(move_3.Geometry)

# ==== cluster Cluster_2
G = ClusterInput()
A = ClusterInput()
G_2 = ClusterInput()
A_2 = ClusterInput()
G_3 = ClusterInput()
A_3 = ClusterInput()
G_4 = ClusterInput()
A_4 = ClusterInput()
G_5 = ClusterInput()
A_5 = ClusterInput()
G_6 = ClusterInput()
A_6 = ClusterInput()
rotate = Rotate3D(Geometry=G, Angle=degrees(A), Center=Point(0, 0, 0), Axis=Vector(0, 0, 1))  # -> Geometry, Transform
rotate_2 = Rotate3D(Geometry=G_2, Angle=degrees(A_2), Center=Point(0, 0, 0), Axis=Vector(0, 0, 1))  # -> Geometry, Transform
rotate_3 = Rotate3D(Geometry=G_3, Angle=degrees(A_3), Center=Point(0, 0, 0), Axis=Vector(0, 0, 1))  # -> Geometry, Transform
rotate_4 = Rotate3D(Geometry=G_4, Angle=degrees(A_4), Center=Point(0, 0, 0), Axis=Vector(0, 0, 1))  # -> Geometry, Transform
rotate_5 = Rotate3D(Geometry=G_5, Angle=degrees(A_5), Center=Point(0, 0, 0), Axis=Vector(0, 0, 1))  # -> Geometry, Transform
rotate_6 = Rotate3D(Geometry=G_6, Angle=degrees(A_6), Center=Point(0, 0, 0), Axis=Vector(0, 0, 1))  # -> Geometry, Transform
G_7 = ClusterOutput(rotate.Geometry)
G_8 = ClusterOutput(rotate_2.Geometry)
G_9 = ClusterOutput(rotate_3.Geometry)
G_10 = ClusterOutput(rotate_4.Geometry)
G_11 = ClusterOutput(rotate_5.Geometry)
G_12 = ClusterOutput(rotate_6.Geometry)
